# Grasshopper definition 35 w east bid doc.gh (Grasshopper 1.0.7)
# plug-ins: EleFront, GH_CPython

id = Guid([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])
python = GhPythonScript(texts=id, run=Button())  # -> out, points, text1, text2; inputs texts: list of Guid
# ---------- python: Python ----------
import rhinoscriptsyntax as rs
import scriptcontext as sc
import Rhino
sc.doc = Rhino.RhinoDoc.ActiveDoc

points = []
text = []



for t in texts:
    point = rs.TextObjectPoint(t)
    points.append(point)
    t = rs.TextObjectText(t)
    print t
    text.append(t)

text1 = str(text)
text2 = text

sc.doc = ghdoc
# ---------- end python ----------
number_slider = Slider(7.52, range=1..15)
gh_cpython = GH_CPython(points=python.points, texts=python.text1, radius=number_slider)  # -> groups, r, g, b, text_out; inputs points: list, texts: list, radius: list
#   port points: [required] - [type = int] - [default = None] Descripe your input here * bullet point. * bullet point
# ---------- gh_cpython: Python ----------
import pandas as pd
import re
import datetime
import os
from reportlab.pdfgen import canvas
import qrcode
import uuid
from natsort import natsorted, ns
from sklearn.cluster import DBSCAN
import numpy as np
import matplotlib.pyplot as plt
from matplotlib.backends.backend_pdf import PdfPages
import seaborn as sns
import random



class Block:
    def __init__(self):
        self.point = None
        self.text = None
        self.x = None
        self.y = None
        self.z = None
        

def rand_color(x):
    """Takes some number and returns a random color"""
    random.seed(x)
    color = random.randint(0, 255), random.randint(0, 255), random.randint(0, 255)
    #color = '#%02x%02x%02x' % color
    return color


def rgb_r(x):
    return x[0]

def rgb_g(x):
    return x[1]

def rgb_b(x):
    return x[2]

def make_groups(df, radius=34):
    """Use DBSCAN to find point clusters, add them to df"""
    # df = pd.read_excel(path, sheet_name="Main")
    coords = df[["x", "y"]]
    coords = np.array(coords)
    X = coords

    # perform DBSCAN grouping
    clustering = DBSCAN(eps=radius, min_samples=1).fit(X)

    # add column db to df
    df["db"] = clustering.labels_
    df.db = df.db + 1

    # get the number of groups in df
    size = len(df.groupby("db"))

    # Adjacency groups will be the same color, make new column
    df["color"] = df.db.apply(rand_color)

    df["R"] = df.color.apply(rgb_r)
    df["G"] = df.color.apply(rgb_g)
    df["B"] = df.color.apply(rgb_b)

    return df





blocks = []

for i,t in enumerate(texts):
    b = Block()
    b.point = points[i]
    b.text = t
    b.x = b.point[0]
    b.y = b.point[1]
    b.z = b.point[2]
   

    blocks.append(b)


# turn the above list to a pandas dataframe
df = pd.DataFrame([vars(f) for f in blocks])

df = make_groups(df, radius)

r = df.R.tolist()
g = df.G.tolist()
b = df.B.tolist()
groups = df.db.tolist()

text_out = df.text.tolist()
# ---------- end gh_cpython ----------
textdot = DefineTextDot(Text=python.text2, Location=python.points, Font="Arial", Size=14)
rgb = ColourRGB(Alpha=Slider(142, range=0..255), Red=gh_cpython.r, Green=gh_cpython.g, Blue=gh_cpython.b)
sph = Sphere(Base=python.points, Radius=number_slider)
preview = CustomPreview(Geometry=sph, Material=rgb)
