# Grasshopper definition 35Ewhacker_block.gh (Grasshopper 0.9.76)

pt = Point(<point referenced from the Rhino model>)
crv = Curve([<curve referenced from the Rhino model> x4])
vec = VectorXYZ(XComponent=0, YComponent=Slider(8.4375, range=0..10), ZComponent=0)  # -> Vector, Length
pt_curvedface = Point([<point referenced from the Rhino model> x13])
plfit = PlaneFit(Points=pt_curvedface)  # -> Plane, Deviation
mesh_curveonly = Mesh(<mesh referenced from the Rhino model>)
deplane = DeconstructPlane(Plane=plfit.Plane)  # -> Origin, XAxis, YAxis, ZAxis
pt_2 = Point(<point referenced from the Rhino model>)
mesh_agiscan = Mesh(<mesh referenced from the Rhino model>)
neg = Negative(Value=deplane.XAxis)
pl = PlaneNormal(Origin=pt_2, ZAxis=deplane.XAxis)
sec = MeshPlane(Mesh=mesh_curveonly, Plane=pl)
explode = Explode(Curve=sec, Recursive=True)  # -> Segments, Vertices
multiplication = Multiplication(A=[deplane.XAxis, neg], B=Slider(31, range=0..100))
item = ListItem(List=explode.Vertices, Index=130, Wrap=True)
item_2 = ListItem(List=explode.Vertices, Index=70, Wrap=True)
item_3 = ListItem(List=explode.Vertices, Index=0, Wrap=True)
circle = Circle3Pt(PointA=item_3, PointB=item_2, PointC=item)  # -> Circle, Plane, Radius
extr = Extrude(Base=circle.Circle, Direction=multiplication)
extr_2 = Extrude(Base=crv, Direction=vec.Vector)
join = BrepJoin(Breps=extr)  # -> Breps, Closed
brep = Brep([extr_2, join.Breps])
