# Grasshopper definition 9_InflectionPoints.gh (Grasshopper 0.9.14)

# ---- group: Adjust for approximate obvious local minima/maxima
number_slider = Slider(5, range=0..20)

# ---- group: Referenced Planar Curve
crv = Curve(<curve referenced from the Rhino model>)

# ---- group: Local Minima/Maxima
series = Series(Start=0, Step=0.0001, Count=10001)
Y = UnitY(Factor=1)
cdiv = Derivatives(Curve=reparameterize(crv), Parameter=series)  # -> Point, FirstDerivative
series_2 = Series(Start=0, Step=1, Count=number_slider)
dprod = DotProduct(VectorA=cdiv.FirstDerivative, VectorB=Y, Unitize=True)
abs = Absolute(Value=dprod)
sort = SortList(Keys=abs, ValuesA=cdiv.Point)  # -> Keys, ValuesA
item = ListItem(List=sort.ValuesA, Index=series_2, Wrap=False)

# ---- group: Reduction of Multiple Minima/Maxima Points
crv_cp = CurveCP(Point=item, Curve=crv)  # -> Point, Parameter, Distance
dist = Distance(PointA=graft(crv_cp.Point), PointB=crv_cp.Point)
sort_2 = SortList(Keys=dist, ValuesA=crv_cp.Point)  # -> Keys, ValuesA
item_2 = ListItem(List=sort_2.Keys, Index=1, Wrap=False)
item_3 = ListItem(List=sort_2.Keys, Index=0, Wrap=False)
eval = Evaluate(F="If(x+y<0.01, 2,1)", x=item_3, y=item_2)
series_3 = Series(Start=0, Step=1, Count=eval)
item_4 = ListItem(List=sort_2.ValuesA, Index=series_3, Wrap=False)
avr = Average(Input=item_4)

# ---- group: Local Minima/Maxima Output
crv_cp_2 = CurveCP(Point=avr, Curve=crv)  # -> Point, flatten(Parameter), Distance

# ---- group: Inflection Points / Inflection point resolution adjustment
slider = Slider(0.25, range=0..1)

# ---- group: Inflection Points
shatter = Shatter(Curve=crv, Parameters=crv_cp_2.Parameter)  # -> graft(Segments)
lng = ListLength(List=flatten(shatter))  # -> expr("L-2", Length)
viewer = ParamViewer(shatter)
series_4 = Series(Start="1", Step=1, Count=lng)
item_5 = ListItem(List=viewer, Index=series_4, Wrap=False)
series_5 = Series(Start=0, Step=0.001, Count=1001)
branch = TreeBranch(Tree=shatter, Path=item_5, MaintainPaths=True)
eval_2 = EvaluateCurve(Curve=reparameterize(branch), Parameter=series_5)  # -> Point, Tangent, Angle
line = LineSDL(Start=eval_2.Point, Direction=eval_2.Tangent, Length=slider)
end = EndPoints(Curve=line)  # -> Start, End
crv_cp_3 = CurveCP(Point=end.End, Curve=branch)  # -> Point, Parameter, Distance
sort_3 = SortList(Keys=crv_cp_3.Distance, ValuesA=crv_cp_3.Point)  # -> Keys, ValuesA

# ---- group: Inflection Point Output
item_6 = ListItem(List=sort_3.ValuesA, Index=0, Wrap=False)
