# Grasshopper definition Adjustable text and colored circle.gh (Grasshopper 1.0.7)

# ---- group: inputs
panel = Panel("test")
pt = Point([<point referenced from the Rhino model> x238])

# ---- group: Kind of Dots
circle_radius = Slider(5, range=0..10)
medallion_color = ColourSwatch(SwatchColor=RGB(43, 178, 178))
y_shift_down = Slider(1.85, range=0..10)
text_size = Slider(3.374, range=0..10)
text_color = ColourSwatch(SwatchColor=RGB(0, 0, 0))
neg = Negative(Value=y_shift_down)
vec = VectorXYZ(XComponent=0, YComponent=neg, ZComponent=0)  # -> Vector, Length
move = Move(Geometry=pt, Motion=vec.Vector)  # -> Geometry, Transform
Z = UnitZ(Factor=1)
circle = CircleCNR(Center=pt, Normal=Z, Radius=circle_radius)
srf = Surface(circle)
tag = TextTag3D(Location=pt, Text=panel, Size=text_size, Colour=text_color, Justification=5)
preview = CustomPreview(Geometry=srf, Material=medallion_color)

# ---- group: Outer Bubble Cloud
voronoi = Voronoi(Points=pt, Radius=circle_radius, BruteForceOverride=False)
runion = RegionUnion(Curves=voronoi)
cpoly = ControlPolygon(Curve=runion)  # -> Polygon, Points
crvgraph = CurvatureGraph(Curve=runion, Density=5, Scale=105)
len = Length(Curve=runion)
python = GhPythonScript(radius=circle_radius, curves=runion, lengths=len)  # -> out, a; inputs curves: list, lengths: list
# ---------- python: Python ----------
import rhinoscriptsyntax as rs
import math

circle_len = math.pi * radius**2

print circle_len 

def test_crv_len(length, radius):
    if length >= radius:
        print length
        return True
    else:
        print "too small"
        print length
        return False

results = [test_crv_len(x, radius) for x in lengths]
outer = []

for i,r in enumerate(results):
    if r == True:
        outer.append(curves[i])

a = outer
# ---------- end python ----------
