# Grasshopper definition All studies -- fcch sub 2b.gh (Grasshopper 1.0.7)
# plug-ins: Human, EleFront, GH_CPython

# ---- group: Color blocks by area
# Block By Area
crv = Curve([<curve referenced from the Rhino model> x79])
explode = Explode(Curve=crv, Recursive=True)  # -> Segments, Vertices
bnd = Bounds2D(Coordinates=explode.Vertices)
area = Area(Geometry=crv)  # -> Area, Centroid
panel = Panel(bnd)
python = GhPythonScript(run=Button(), bounds=bnd)  # -> out, a, widths, heights; inputs bounds: tree
# ---------- python: Python ----------
import rhinoscriptsyntax as rs
 
import Rhino.Geometry as rg
from clr import AddReference as addr
addr("Grasshopper")
 
from System import Object
from Grasshopper import DataTree
from Grasshopper.Kernel.Data import GH_Path
 
 
def raggedListToDataTree(raggedList):
    rl = raggedList
    result = DataTree[object]()
    for i in range(len(rl)):
        temp = []
        for j in range(len(rl[i])):
            temp.append(rl[i][j])
        #print i, " - ",temp
        path = GH_Path(i)
        result.AddRange(temp, path)
    return result
 
def dataTreeToList(aTree):
    theList = []
    for i in range(aTree.BranchCount ):
        thisListPart = []
        thisBranch = aTree.Branch(i)
        for j in range(len(thisBranch)):
            thisListPart.append( thisBranch[j] )
        theList.append(thisListPart)
    return theList

a = dataTreeToList(bounds)
widths = []
heights = []

for bound in a:
    x_interval = bound[0].U
    y_interval = bound[0].V
    
    width = x_interval[1] - x_interval[0]
    height = y_interval[1] - y_interval[0]
    
    print width, height
    
    widths.append(width)
    heights.append(height)
# ---------- end python ----------
python_2 = GhPythonScript(area=area.Area, center=area.Centroid, region=crv, num=Slider(3.755, range=0..10))  # -> out, result; inputs area: list, center: list, region: list
# ---------- python_2: Python ----------
import rhinoscriptsyntax as rs

def myround(x):
    return num * round(x/num)

rounded_areas = [myround(x) for x in area]
unique_areas = list(set(rounded_areas))

prefix = ["N" for x in area]

suffix = [str(unique_areas.index(x)+1) for x in rounded_areas]

result = zip(prefix, suffix)
result = ["".join(x) for x in result]
# ---------- end python_2 ----------
multiplication = Multiplication(A=python.widths, B=python.heights)
textdot = DefineTextDot(Text=python_2.result, Location=area.Centroid, Font="Arial", Size=14)
gh_cpython = GH_CPython(
    styles=python_2.result,
    areas=area.Area,
    points=area.Centroid,
    widths=python.widths,
    heights=python.heights,
    box_areas=multiplication,
    save=Button())  # -> result, r, g, b, num_colors; inputs styles: list, areas: list, points: list, widths: list, heights: list, box_areas: list, save: list
#   port styles: [required] - [type = int] - [default = None] Descripe your input here * bullet point. * bullet point
#   port result: indicate your output description here. refers to a new line.
# ---------- gh_cpython: Python ----------
import pandas as pd
import random

class block():
    def __init__(self):
        self.name = None
        self.area = None
        self.point = None
        self.width = None
        self.height = None
        self.box_area = None

blocks = []

for i,s in enumerate(styles):
    b = block()
    b.name = s
    b.area = areas[i]
    b.point = points[i]
    b.width = widths[i]
    b.height = heights[i]
    b.box_area = box_areas[i]


    blocks.append(b)



df = pd.DataFrame([vars(f) for f in blocks])

unique = df.name.unique()
def rand_color(x):
    x = list(unique).index(x)
    random.seed(x)
    r,g,b = random.randint(0,255), random.randint(0,255), random.randint(0,255)
    color = r,g,b
    color = '#%02x%02x%02x' % color
    return color
df["color"] = df.name.apply(rand_color)
black = (0,0,0)
black = '#%02x%02x%02x' % black
df.loc[df.area>2500, "color"] = black
df.loc[df.area<50, "color"] = black
def hex_to_rgb(value):
    value = value.lstrip('#')
    lv = len(value)
    return tuple(int(value[i:i + lv // 3], 16) for i in range(0, lv, lv // 3))
df.color = df.color.apply(hex_to_rgb)
print(df)

result = df.color.tolist()
r = [r[0] for r in result]
g = [r[1] for r in result]
b = [r[2] for r in result]

num_colors = len(df.color.unique())

if save == True:
    save_path = r"C:\Users\mkreidler\Desktop\Studies.xlsx"
    df.to_excel(save_path)
# ---------- end gh_cpython ----------
srf = Surface(crv)
rgb = ColourRGB(Alpha=255, Red=gh_cpython.r, Green=gh_cpython.g, Blue=gh_cpython.b)
panel_2 = Panel(gh_cpython.num_colors)
preview = CustomPreview(Geometry=srf, Material=rgb)

# ---- group: Inputs
crv_2 = Curve([<curve referenced from the Rhino model> x64])
id = Guid([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])
id_2 = Guid(crv_2)

# ---- group: RhinoCommon Point in Zone
# Block in Zone
python_3 = GhPythonScript(guids=id, curves=id_2, run=Toggle(True))  # -> out, zone_list, objs, block_names, points; inputs guids: list, curves: list
# ---------- python_3: Python ----------
import rhinoscriptsyntax as rs
import datetime
import Rhino

zone_list = []
blocks = []


class block:
    def __init__(self):
        self.name = None
        self.point = None
        self.zones = []
        self.layer = None

if run == True:
    start = datetime.datetime.now()
    for guid in guids:
        b = block()
        #Rhino.Geometry.TextDot.Point
        obj = Rhino.RhinoDoc.ActiveDoc.Objects.Find(guid)
        point = obj.Geometry.Point
        b.point = point
        b.name = obj.Geometry.Text
        
        
        
        for curve in curves:
            obj = Rhino.RhinoDoc.ActiveDoc.Objects.Find(curve)
            curve = obj.Geometry
            plane = Rhino.Geometry.Plane.WorldXY
            #Rhino.DocObjects.ObjectAttributes.Name
            tolerance = Rhino.RhinoDoc.ActiveDoc.ModelRelativeTolerance
            result = curve.Contains(point, plane, tolerance)
            #containment.append(result)
            #print result
            if str(result) == "Inside":
                #print "yes"
                name = obj.Attributes.Name
                #Rhino.Geometry.PolylineCurve.GetObjectData()
                #Rhino.Geometry.PolylineCurve.
                #Rhino.DocObjects.CurveObject.Name
                #rhinoobjec.Attributes.Name
                b.zones.append(name)
            else:
                #print "no"
                pass
            #print result
            #Rhino.Geometry.Curve.Contains(
        zone_list.append(str(b.zones))
        blocks.append(b)
    end = datetime.datetime.now()
    a = end - start
    
    #Rhino.Geometry.Curve.Contains(


    print a
    print "complete"

    def guid_to_obj(guid):
        obj = Rhino.RhinoDoc.ActiveDoc.Objects.Find(guid)
        return obj

#print obj.Attributes.Name
#print obj.Geometry.Text
#print obj.Geometry.Point
#print obj.Geometry.UserData

    objs = [guid_to_obj(guid) for guid in guids]
    block_names = [obj.Geometry.Text for obj in objs]
    points = [obj.Geometry.Point for obj in objs]


names = [b.name for b in blocks]
# ---------- end python_3 ----------
objatts = ObjectAttributes(ObjectOrAttributes=python_3.objs)  # -> Name, LayerName, LayerFullPath, Color, MaterialName, LinetypeName, GroupIndices, PlotWeight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
panel_3 = Panel(python_3.out)

# ----
toggle = BooleanToggle(True)

# ---- group: make dataframe and reports
gh_cpython_2 = GH_CPython(
    block_zones=python_3.zone_list,
    block_name=python_3.block_names,
    block_pt=python_3.points,
    block_layer=objatts.LayerName,
    block_guid=id,
    run=Button())  # -> output, df_path; inputs block_zones: list, block_name: list, block_pt: list, block_layer: list, block_guid: list, run: list
#   port block_zones: [required] - [type = int] - [default = None] Descripe your input here * bullet point. * bullet point
# ---------- gh_cpython_2: Python ----------
import pandas as pd
import re
import datetime
import os
from reportlab.pdfgen import canvas
import qrcode
import uuid
from natsort import natsorted, ns
from sklearn.cluster import DBSCAN
import numpy as np
import matplotlib.pyplot as plt
from matplotlib.backends.backend_pdf import PdfPages
import seaborn as sns
import random
import matplotlib.pyplot as plt
import numpy as np
from os import path
from PIL import Image
from wordcloud import WordCloud, STOPWORDS, ImageColorGenerator



# CLASSES
class Block():
    """A single piece of terracotta, with all of its attributes
    compiled in a data class"""

    def __init__(self):
        self.guid = None
        self.name = None
        self.point = None
        self.layer = None
        self.zones = None
        self.x = None
        self.y = None
        self.z = None
        self.floor = None
        self.swing_drop = None
        self.elevation = None
        self.priority = None
        self.phase = None


# SETTINGS
class Settings():
    """The general locations of files and
    values that can be modified"""
    # file = r"C:\Users\mkreidler\Desktop\Multisheet_export.xlsx"
    # save = r"C:\Users\mkreidler\Desktop\Block Grouping Scatter Plots.pdf"
    # ONLY USE reportlab version 3.5.20, later versions fail
    # pip install reportlab==3.5.20
    logo_path = r"C:\Users\mkreidler\Desktop\Test Setting Folder\BVTC-Logo-BLACK-horizontal.png"
    pdf_prefix = r"C:\Users\mkreidler\Desktop\Test Setting Folder\\"
    chart_save = r"C:\Users\mkreidler\Desktop\Test Setting Folder\Graphs_export.pdf"
    save_path = r"C:\Users\mkreidler\Desktop\Test Setting Folder\Multisheet_export.xlsx"
    folder = r"C:\Users\mkreidler\Desktop\Test Setting Folder\\"
    radius = 34


# Functions
def rand_color(x):
    """Takes some number and returns a random color"""
    random.seed(x)
    color = random.randint(0, 255), random.randint(0, 255), random.randint(0, 255)
    color = '#%02x%02x%02x' % color
    return color


def my_round(x, base=10):
    """Takes some floating point number
        and rounds to closest base"""
    return base * round(x / base)


def nat_sort(x, df):
    """sort swingdrops alphanumerically the way a human reads numbers/letters"""
    unordered = df.swing_drop.tolist()
    reordered = natsorted(unordered, alg=ns.IGNORECASE)
    return reordered.index(x)


def find_floor(x):
    """Use re to search zone text for floor numbers"""
    pat = r"floor\s*(\d*)"
    result = re.search(pat, str(x), flags=re.IGNORECASE)
    if result:
        return int(result.group(1))


def find_building(x):
    """Use re to search zone text for building labels"""
    pat = r"building\s*([a-z0-9]*)"
    result = re.search(pat, str(x), flags=re.IGNORECASE)
    if result:
        return result.group(1)


def find_sheet(x):
    """Use re to search zone text for sheet title"""
    pat = r"SHEET\s*([a-z0-9]*)"
    result = re.search(pat, str(x), flags=re.IGNORECASE)
    if result:
        return result.group(1)


def find_phase(x):
    """Use re to search zone text for phase number, either Base or CO1, 2, 3...
    Generally we will be getting this from the layer structure in rhino"""
    if "BASE" in x.upper():
        return 0
    else:
        pat = r"CO\s*(\d*)"
        result = re.search(pat, str(x), flags=re.IGNORECASE)
        if result:
            return result.group(1)


def find_priority(x):
    """Use re to search zone text for priority"""
    pat = r"priority\s*(\d*)"
    result = re.search(pat, str(x), flags=re.IGNORECASE)
    if result:
        return int(result.group(1))


def find_elevation(x):
    """Use re to find elevation in zones"""
    pat = r"([a-zA-Z\s]*)\s*ELEVATION"
    result = re.search(pat, str(x), flags=re.IGNORECASE)
    if result:
        return result.group(1)


def get_drop(x):
    """Use re to find drop names in zones"""
    pat = r"drop\s*([a-z]*\d*)"
    match = re.search(pat, str(x), flags=re.IGNORECASE)

    if match:
        return match.group(1)
    else:
        return None


def get_access(x):
    """Use re to find access type in zones"""
    pat = r"access\s*([\w\s]*)"
    match = re.search(pat, str(x), flags=re.IGNORECASE)

    if match:
        return match.group(1)
    else:
        return "Boom Lift"


def get_survey(x):
    """Use re to find survey priority number in zones"""
    pat = r"Survey\s*([\d]*)"
    match = re.search(pat, str(x), flags=re.IGNORECASE)

    if match:
        return int(match.group(1))
    else:
        return 3

def format_floor(x):
    if str(x).upper() == "NAN":
        return "999"
    elif x == None:
        return "555"
    return str(int(x))



def find_qmark(x):
    """Use re to find question marks in zone text"""
    if "?" in x:
        return 1
    else:
        return 0


def format_path(folder, project_name="FCCH", ext=".xlsx"):
    """format path with prefix and timestamp"""
    timestamp = str(datetime.datetime.now()).replace(":", "_")
    path = f"{folder}Project {project_name} Report_{timestamp}.{ext}"
    return path


def sort_groups(x, group_order):
    """Sort groups in df based on an ordered list"""
    for i, g in enumerate(group_order):
        if g == x:
            return i + 1


def sort_drops(x, alphabetical=True):
    """Needs work.  Defaults to alphabetical sorting"""
    if alphabetical != True:
        drop_sort = {"W1": 1, "W2": 2, "W3": 3, "W4": 4, "W5": 5, "W6": 6, "S1": 7, "S2": 8, "S3": 9, "S4": 10}
        return drop_sort[x]
    else:
        pass


def make_wordcloud(df):
    string_value_list = df.name.values
    string_value_list = [x.strip() for x in string_value_list]
    text = " ".join(string_value_list)

    wordcloud = WordCloud(width=1000, height=500, background_color="white", collocations=False).generate(text)

    # Display the generated image:
    plt.figure(figsize=[36,24])
    plt.imshow(wordcloud, interpolation='bilinear')
    plt.axis("off")
    #plt.show()

    save = r"C:\Users\mkreidler\Desktop\Test Setting Folder\word_cloud.png"

    wordcloud.to_file(save)




def start_dataframe(block_zones, block_guid, block_name, block_pt, block_layer):
    """Create the standard dataframe from rhino dots, rhino zones,
    and various attributes"""
    # make an empty list to populate with block objects
    blocks = []
    # connect gh wires to python block classes
    for i, z in enumerate(block_zones):
        b = Block()
        b.guid = block_guid[i]
        b.name = block_name[i]
        b.point = block_pt[i]
        b.layer = block_layer[i]
        b.phase = find_phase(b.layer)
        b.zones = z
        b.x = b.point[0]
        b.y = b.point[1]
        b.z = b.point[2]
        b.floor = find_floor(str(z))
        b.sheet = find_sheet(str(z))
        b.building = find_building(str(z))
        b.elevation = find_elevation(str(z))
        b.swing_drop = get_drop(str(z))
        b.priority = find_priority(str(z))
        b.access = get_access(str(z))
        b.survey = get_survey(str(z))

        # populate list of blocks
        blocks.append(b)

    # turn the above list to a pandas dataframe
    df = pd.DataFrame([vars(f) for f in blocks])

    # append a columns to df to track drop sort order
    df["drop_sort"] = df.swing_drop.apply(lambda x: nat_sort(x, df))

    # further specify dataframe sort order
    df = df.sort_values(["elevation", "priority", "floor", "swing_drop", "y", "x"],
                        ascending=[1, 1, 0, 1, 0, 1])
    df.reset_index(inplace=True, drop=True)
    df["new_order"] = df.index + 1

    # append columns
    df["instance"] = df.groupby("name").cumcount() + 1
    df["sample"] = 0
    df.loc[df.instance == 1, "sample"] = 1

    # export wordcloud
    make_wordcloud(df)

    # create the survey name/bumper sticker name
    df["survey_name"] = df.swing_drop + "-" + df.floor.apply(format_floor) + "-" + df.name + "[" + df.new_order.map(str) + "]"
    # df["survey_name"] = f"{df.swing_drop}-{df.floor.map(str)-{df.name}[{df.new_order.map(str)}]}"
    return df


def make_groups(df, radius=34):
    """Use DBSCAN to find point clusters, add them to df"""
    # df = pd.read_excel(path, sheet_name="Main")
    coords = df[["x", "y"]]
    coords = np.array(coords)
    X = coords

    # perform DBSCAN grouping
    clustering = DBSCAN(eps=radius, min_samples=1).fit(X)

    # add column db to df
    df["db"] = clustering.labels_
    df.db = df.db + 1

    # get the number of groups in df
    size = len(df.groupby("db"))

    # Adjacency groups will be the same color, make new column
    df["color"] = df.db.apply(rand_color)

    # order groups
    ordered_groups_copies = df.db.tolist()
    group_order = []
    for g in ordered_groups_copies:
        if g in group_order:
            pass
        else:
            group_order.append(g)

    df["group_order"] = df["db"].apply(lambda x: sort_groups(x, group_order=group_order))
    return df


def make_summary(df, save_path):
    """Create a multi-page excel file summarizing
    standard data frame information"""
    # first survey blocks
    style_list = df.name.unique()

    # summary data
    num_styles = len(style_list)
    num_units = df.guid.count()
    num_floors = len(df.floor.unique())
    num_phases = len(df.phase.unique())
    num_priority = len(df.priority.unique())
    num_swings = len(df.swing_drop.unique())
    num_groups = len(df.db.unique())
    group_totals = df[["db", "guid"]].groupby("db").count()
    group_totals.reset_index(inplace=True)
    loners = len(group_totals.loc[group_totals.guid == 1, "db"].tolist())
    assemblies = len(group_totals.loc[group_totals.guid != 1, "db"].tolist())

    summary = {"Total_Styles": num_styles,
               "Total_Units": num_units,
               "Total_Floors": num_floors,
               "Total_Phases": num_phases,
               "Total_Priorities": num_priority,
               "Total_Drops": num_swings,
               "Total_Groups": num_groups,
               "Total_Loners": loners,
               "Total_Assemblies": assemblies}
    summary_df = pd.DataFrame(summary, index=[0])
    summary_df = summary_df.T

    # print(assemblies)
    # print(loners)
    # print(num_units)
    # print(list(df))

    # first groups
    # print(df[["group","group_order"]])
    # print(list(df))

    # reports
    floor_counts = df[["floor", "guid"]].groupby("floor").count()
    floor_counts.reset_index(inplace=True)
    # print(floor_counts)

    elevations = df[["elevation", "guid"]].groupby("elevation").count()
    elevations.reset_index(inplace=True)
    # (list(df))

    names = df[["name", "guid"]].groupby("name").count()
    names.reset_index(inplace=True)
    # print(names)

    priorities = df[["priority", "guid"]].groupby("priority").count()
    priorities.reset_index(inplace=True)
    # print(priorities)

    swing = df[["swing_drop", "guid"]].groupby("swing_drop").count()
    swing.reset_index(inplace=True)
    # print(swing)

    phase = df[["phase", "guid"]].groupby("phase").count()
    phase.reset_index(inplace=True)
    # print(phase)

    group_rpt = df[["db", "guid"]].groupby("db").count()
    group_rpt.reset_index(inplace=True)
    # print(group_rpt)

    group_odr = df[["name", "group_order", "guid"]].groupby(["group_order", "name"]).count()
    group_odr.reset_index(inplace=True)
    # print(group_odr)

    samples = df.loc[df.instance == 1, ["survey_name", "priority", "phase"]]
    # print(firsts)




    df["qmarks"] = df.name.apply(find_qmark)
    qmarks = df.loc[df.qmarks == 1, ["name", "guid"]]
    qmarks.reset_index(drop=True, inplace=True)
    qmarks = qmarks.groupby("name").count()

    # Create a Pandas Excel writer using XlsxWriter as the engine.
    writer = pd.ExcelWriter(S.save_path, engine='xlsxwriter')

    # Write each dataframe to a different worksheet.

    summary_df.to_excel(writer, sheet_name='Summary')
    df.to_excel(writer, sheet_name='Main')
    floor_counts.to_excel(writer, sheet_name='Floors')
    names.to_excel(writer, sheet_name='Names')
    elevations.to_excel(writer, sheet_name='Elevations')
    priorities.to_excel(writer, sheet_name='Priorities')
    swing.to_excel(writer, sheet_name='Drops')
    phase.to_excel(writer, sheet_name='Phases')
    group_rpt.to_excel(writer, sheet_name='Groups')
    group_odr.to_excel(writer, sheet_name='Group Order')
    samples.to_excel(writer, sheet_name='Samples Trimmed')
    # first_styles_survey.to_excel(writer, sheet_name='Primary Styles Detail')
    qmarks.to_excel(writer, sheet_name="Question Marks")

    # Close the Pandas Excel writer and output the Excel file.
    writer.save()
    print ("Summaries done!")
    # os.startfile(save_path)
    return df


def make_dataframe(block_zones, block_guid, block_name, block_pt, block_layer):
    df = start_dataframe(block_zones, block_guid, block_name, block_pt, block_layer)
    df = make_groups(df)
    df = make_summary(df, S.save_path)
    return df


def make_qr(df):
    """make pdf qr code sheet, 3 columns by 8 rows"""
    stuff = df.survey_name.tolist()
    df = pd.DataFrame({'stuff': stuff})
    df["num"] = df.index + 1
    df["c"] = df.num % 3
    df.c = df.c.replace(0, 3)
    df["page"] = ((df.num + 23) // 24)
    df["r"] = (((df.num - 1) // 3) + 1) % 8
    df.r = df.r.replace(0, 8)

    dt = str(datetime.datetime.now()).replace(":", "_")
    ext = ".pdf"
    pdf_path = f"{S.pdf_prefix}QR_codes{ext}"

    # MAKE CANVAS
    c = canvas.Canvas(pdf_path)
    c.setPageSize((612, 792))
    last_page = None

    # SPLIT INTO PAGES, COLUMNS, ROWS
    for index, row in df.iterrows():
        page = row["page"]
        if page != last_page:
            if last_page == None:
                last_page = page

            else:
                c.showPage()
                last_page = page

        col = row["c"]
        _row = row["r"]
        i = row["stuff"]
        code = f"{i}"
        # print(f"page {page} row {_row} column {col} info {i}")

        # DRAW QR
        def draw_qr(data, base=r"C:\Users\mkreidler\Desktop\pdf print barcodes\\"):
            # draw QR
            dt = str(datetime.datetime.now()).replace(":", "_")
            random = uuid.uuid4()
            img_path = f"{base}{dt}{random}.png"  ##can't write file paths with certain characters, removing 'i' variable here

            qr = qrcode.QRCode()
            qr.add_data(data)
            img = qr.make_image().save(img_path)
            return img_path

        # DRAW 1 TAG
        def draw_tag(x_num, y_num, code):
            flip_y = {1: 8,
                      2: 7,
                      3: 6,
                      4: 5,
                      5: 4,
                      6: 3,
                      7: 2,
                      8: 1}

            y_num = flip_y[y_num]

            qr = draw_qr(code)
            x_increment = 204
            y_increment = 99

            x = x_increment * (x_num - 1)
            y = y_increment * (y_num - 1)

            c.drawString(102.5491 + x, 33.7174 + y, code)
            c.drawInlineImage(qr, 0 + x, 0 + y, width=99, height=99)
            os.remove(qr)
            c.drawInlineImage(S.logo_path, 102.5491 + x, 71.2396 + y, width=84.2926,height=14.0488)  # replace maroon with bnw later
         

        draw_tag(col, _row, code)

    # SAVE DOCUMENT
    c.save()
    print("QR codes done!")
    return pdf_path


def static_exports(df):
    """This needs work, static meaning grasshopper will always
    be displaying data values.  Need to arrange this in a way
    where calculations are minimal"""
    bumper = str(df["survey_name"].tolist())
    survey = df["new_order"].tolist()
    x = df["x"].tolist()
    y = df["y"].tolist()
    z = df["z"].tolist()
    sorted_guid = df["guid"].tolist()
    return bumper, x, y, z, survey, sorted_guid


def make_pdf_reports(df, path):
    """Use dataframe to create and save pdf reports using matplotlib"""
    with PdfPages(path) as pdf:
        # settings for the file
        base = 10  # threshold for grouping points
        page_size = (11, 8.5)
        point_size = 1.5  # scatter plot point size

        df["color"] = df.db.apply(rand_color)  # adjacency color
        df["fuzzy_y"] = df.y.apply(my_round)  # horizontal group color
        df["y_color"] = df.fuzzy_y.apply(rand_color)
        df["fuzzy_x"] = df.x.apply(my_round)  # vertical group color
        df["x_color"] = df.fuzzy_x.apply(rand_color)

        # Add title and axis names
        plt.figure(figsize=page_size)
        plt.title('Horizontal Grouping Scatter Plot')
        plt.xlabel('x distance')
        plt.ylabel('y distance')
        plt.scatter(df.x, df.y, c=df.y_color, s=point_size)
        pdf.savefig()  # saves the current figure into a pdf page
        plt.close()

        plt.figure(figsize=page_size)
        plt.title('Vertical Grouping Scatter Plot')
        plt.xlabel('x distance')
        plt.ylabel('y distance')
        plt.scatter(df.x, df.y, c=df.x_color, s=point_size)
        pdf.savefig()  # saves the current figure into a pdf page
        plt.close()

        plt.figure(figsize=page_size)
        plt.title('Block Adjacency Grouping Scatter Plot')
        plt.xlabel('x distance')
        plt.ylabel('y distance')
        plt.scatter(df.x, df.y, c=df.color, s=point_size)
        pdf.savefig()  # saves the current figure into a pdf page
        plt.close()

        data1 = df[["floor", "swing_drop", "name"]]
        data = data1.groupby(["floor", "swing_drop"]).count()
        data = data.reset_index()
        data.head()
        data = data.fillna(0)
        pivot = data.pivot(index="floor", columns="swing_drop", values="name")
        pivot = pivot.fillna(0)
        order = sorted(df.floor.unique(), reverse=True)
        pivot = pivot.reindex(order)
        plt.figure(figsize=page_size)
        ax = sns.heatmap(pivot, cmap="BuPu")
        ax.set_title("Block Qty Heatmap")
        pdf.savefig()
        plt.close()

        # bar chart
        plt.rcParams.update({'font.size': 5})
        plt.figure(figsize=page_size)
        plt.title('Block Style Bar Graph')
        plt.xlabel('Names')
        plt.xticks(rotation=90)
        plt.ylabel('Quantities')
        dd = df[['name', "guid"]].groupby("name").count()
        dd = dd.reset_index()
        dd = dd.sort_values("guid")
        plt.bar(dd.name, dd.guid)
        #plt.show()
        pdf.savefig()
        plt.close()

        # We can also set the file's metadata via the PdfPages object:
        d = pdf.infodict()
        d['Title'] = 'Multipage PDF Example'
        d['Author'] = 'Matthew Kreidler'
        d['Subject'] = 'How to create a multipage pdf file and set its metadata'
        d['Keywords'] = 'PdfPages multipage keywords author title subject'
        d['CreationDate'] = datetime.datetime.today()
        d['ModDate'] = datetime.datetime.today()

    
    print ("Graphs and Charts finished!")
    return path


def show_report(*args):
    """Open list of reports in the program the windows
    default program (excel, bluebeam, etc...)"""
    for report in args:
        os.startfile(report)

def main():
    start = datetime.datetime.now()
    print ("Working...")
    df = make_dataframe(block_zones, block_guid, block_name, block_pt, block_layer)
    make_qr(df)
    make_pdf_reports(df, S.chart_save)

    
    stop = datetime.datetime.now()
    duration = stop-start
    print(f"Duration {duration}")
    
S = Settings()
if run==True:
    main()
# ---------- end gh_cpython_2 ----------

# ---- group: Pull df from static file
toggle_2 = BooleanToggle(True)
gh_cpython_3 = GH_CPython(run=Button(), block_names=python_3.block_names)  # -> groups, guids, samples1, sample_labels, x, y, z, r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; inputs run: list, block_names: list
#   port run: [required] - [type = int] - [default = None] Descripe your input here * bullet point. * bullet point
#   port groups: indicate your output description here. refers to a new line.
# ---------- gh_cpython_3: Python ----------
import pandas as pd
import matplotlib.pyplot as plt
import numpy as np
from os import path
from PIL import Image
from wordcloud import WordCloud, STOPWORDS, ImageColorGenerator




file = r"C:\Users\mkreidler\Desktop\Test Setting Folder\Multisheet_export.xlsx"

df = pd.read_excel(file, sheet_name="Main")


def make_wordcloud(df):
    string_value_list = df.name.values
    string_value_list = [x.strip() for x in string_value_list]
    text = " ".join(string_value_list)

    wordcloud = WordCloud(width=1000, height=500, background_color="white", collocations=False).generate(text)

    # Display the generated image:
    plt.figure(figsize=[36,24])
    plt.imshow(wordcloud, interpolation='bilinear')
    plt.axis("off")
    #plt.show()

    save = r"C:\Users\mkreidler\Desktop\Test Setting Folder\word_cloud.png"

    wordcloud.to_file(save)

#make_wordcloud(df)

data = df[["db", "guid"]].groupby("db").cumcount() + 1

groups = []
guids = []

for group_num in df.db.unique():
    guid = df.loc[df.db == group_num, "guid"].tolist()
    guids.append(guid)
    group = df.loc[df.db == group_num, "db"].tolist()
    label = [f"Area {x}" for x in group]
    groups.append(label)

#print(guids)


smpl = df.loc[df["sample"]==1, ["guid", "survey_name"]]

samples = smpl.guid.tolist()
samples1 = samples
sample_labels = str(smpl.survey_name.tolist())


x = df.x.tolist()
y = df.y.tolist()
z = df.z.tolist()

colors = df.color.tolist()

def hex_to_rgb(value):
    value = value.lstrip('#')
    lv = len(value)
    return tuple(int(value[i:i+lv//3], 16) for i in range(0, lv, lv//3))
 

colors = [hex_to_rgb(x) for x in colors]

r = [r for r,g,b in colors]
g = [g for r,g,b in colors]
b = [b for r,g,b in colors]

bumpers = "'" + str(df.survey_name.tolist()) + "'"
numbers = df.new_order.tolist()
numbers = [int(x) for x in numbers]

sample_names = df.loc[df["sample"]== 1, "name"].tolist()
sample_names = [f"Sample {i+1}--{x}" for i,x in enumerate(sample_names)]
sample_names = [x.replace("'","") for x in sample_names]

sample_x = df.loc[df["sample"]== 1, "x"].tolist()
sample_y = df.loc[df["sample"]== 1, "y"].tolist()
sample_z = df.loc[df["sample"]== 1, "z"].tolist()

group_num = df.group_order.tolist()
group_num = [f"Area {x}" for i,x in enumerate(group_num)]
import random

def rand_color(x):
    """Takes some number and returns a random color"""
    random.seed(x)
    color = random.randint(0, 255), random.randint(0, 255), random.randint(0, 255)
    #color = '#%02x%02x%02x' % color
    return color


names = list(set(block_names))
name_color = [rand_color(x) for x in names]

def assign_name_color(x):
    x = x.strip()
    return name_color[names.index(x)]

all_block_colors = [assign_name_color(x) for x in block_names]

name_r = [r for r,g,b in all_block_colors]
name_g = [g for r,g,b in all_block_colors]
name_b = [b for r,g,b in all_block_colors]

#print(df[["name", "name_color"]].sort_values("name"))
#print(block_names)

samples = df["sample"].tolist()

def sample_color(x):
    if x ==1:
        return 255,0,0
    else:
        return 0,0,0

sample_color = [sample_color(x) for x in samples]
sample_r = [r for r,g,b in sample_color]
sample_g = [g for r,g,b in sample_color]
sample_b = [b for r,g,b in sample_color]


distinct_areas = df.group_order.unique()
centers = []
all_areas = []
for area in distinct_areas:
    points = df.loc[df.group_order == area, "point"].tolist()
    points = [x[1:-1].split(",") for x in points]
    new_points = []
    for l in points:
        new_l = []
        for s in l:
            num = float(s)
            new_l.append(num)
        new_points.append(new_l)
    
            
    area = f"Area {area}"
    all_areas.append(area)
    #print(area, points)
    x_vals = [x for x,y,z in new_points]
    y_vals = [y for x,y,z in new_points]
    minx = min(x_vals)
    maxx = max(x_vals)
    miny = min(y_vals)
    maxy = max(y_vals)
    center = None
    if len(x_vals) == 1:
        center = x_vals[0], y_vals[0], 0
    else:

        center = (maxx + minx)/2, (maxy + miny)/2, 0
    centers.append(center)
centerx = [x for x,y,z in centers]
centery = [y for x,y,z in centers]
centerz = [z for x,y,z in centers]
# ---------- end gh_cpython_3 ----------

# ---- group: Sample Zooming
run_script = Button()
add_text_dot = BooleanToggle(False)
add_leaders = BooleanToggle(True)
toggle_3 = BooleanToggle(True)
save_image = BooleanToggle(False)
python_zoom_groups_v2 = GhPythonScript(
    samples=gh_cpython_3.sample_labels,
    delay=Slider(0.001, range=0.001..0.3),
    add_dot_bool=add_text_dot,
    run=run_script,
    guids=gh_cpython_3.samples1,
    save_pic=save_image,
    add_leaders_bool=add_leaders)  # -> out; inputs guids: list
# ---------- python_zoom_groups_v2: Python ----------
import rhinoscriptsyntax as rs
import time
import scriptcontext as sc
import Rhino
import os
import System.Drawing
from itertools import groupby
from operator import itemgetter


samples = samples[1:-1].split(",")


folder = r"C:\Users\mkreidler\Desktop\Test Setting Folder\test folder"
extension = r".png"
guids = [x.replace("'","") for x in guids]

sc.doc = Rhino.RhinoDoc.ActiveDoc
centers = []

def capture(filePath, viewportName,scaleFactor, save=False):
    if save == True:
        RhinoDocument = Rhino.RhinoDoc.ActiveDoc
        view = RhinoDocument.Views.Find(viewportName, False)
        vp = view.ActiveViewport
        size = System.Drawing.Size(vp.Size.Width*scaleFactor,vp.Size.Height*scaleFactor)
        capture = view.CaptureToBitmap(size)
        capture.Save(filePath)


def add_leaders(centers):
    if "Sample Arrows" not in rs.LayerNames():
        rs.AddLayer(name="Sample Arrows")
    points = centers
    rs.EnableRedraw(False)
    for i, p in enumerate(points):
        if i == len(points)-1:
            pass
        else:
            leader = rs.AddLeader([points[i+1], p], view_or_plane="Top", text="")   # MAKE SURE YOU ARE IN THE CORRECT VIEW, THIS WILL FAIL OTHERWISE
            rs.ObjectLayer(leader, layer="Sample Arrows")
    rs.EnableRedraw(True)

def zoom(guids, label, number):
    factor = 50
    box = rs.BoundingBox(guids)
    box = Rhino.Geometry.BoundingBox(box)
    box.Inflate(factor,factor,factor)
    center = box.Center
    centers.append(center)
    if add_dot_bool == True:
        add_dot(center, label)
    box = box.GetCorners()
    rs.ZoomBoundingBox(box, view="Top")
    time.sleep(delay)
    filePath = os.path.join(folder, "Sample "+ str(number)+extension)
    capture(filePath, "Top", 1, save_pic)

def add_dot(center, label):
    if "Samples" not in rs.LayerNames():
        rs.AddLayer(name="Samples")
    rs.EnableRedraw(False)
    dot = rs.AddTextDot(label, center)
    rs.MoveObject(dot, [0,-8,0])
    layer = rs.ObjectLayer(dot, layer="Samples")
    rs.EnableRedraw(True)



def main():
    zipped = zip(samples, guids)
    count = 1
    for sample, guid in zipped:
        zoom(guid, sample, count)
        count += 1
    #for z in zipped:
        #print z

    if add_leaders_bool == True:
        add_leaders(centers)


if run == True:
    main()




sc.doc = ghdoc

print "complete"
# ---------- end python_zoom_groups_v2 ----------
panel_4 = Panel(python_zoom_groups_v2)

# ---- group: Group Zooming in Survey order
run_script_2 = Button()
add_text_dot_2 = BooleanToggle(False)
add_leaders_2 = BooleanToggle(False)
save_image_2 = BooleanToggle(False)
python_zoom_groups_v2_2 = GhPythonScript(
    groups=gh_cpython_3.groups,
    delay=Slider(0.001, range=0.001..0.3),
    add_dot_bool=add_text_dot_2,
    run=run_script_2,
    guids=gh_cpython_3.guids,
    save_pic=save_image_2,
    zones=id_2,
    add_leaders_bool=add_leaders_2)  # -> out; inputs groups: list, guids: list, zones: list
# ---------- python_zoom_groups_v2_2: Python ----------
import rhinoscriptsyntax as rs
import time
import scriptcontext as sc
import Rhino
import os
import System.Drawing
from itertools import groupby
from operator import itemgetter

folder = r"C:\Users\mkreidler\Desktop\Test Setting Folder\test folder"
extension = r".png"
guids = [x.replace("'","") for x in guids]

sc.doc = Rhino.RhinoDoc.ActiveDoc
centers = []

def capture(filePath, viewportName,scaleFactor, save=False):
    if save == True:
        RhinoDocument = Rhino.RhinoDoc.ActiveDoc
        view = RhinoDocument.Views.Find(viewportName, False)
        vp = view.ActiveViewport
        size = System.Drawing.Size(vp.Size.Width*scaleFactor,vp.Size.Height*scaleFactor)
        capture = view.CaptureToBitmap(size)
        capture.Save(filePath)


def add_leaders(centers):
    if "Area Arrows" not in rs.LayerNames():
        rs.AddLayer(name="Area Arrows")
    points = centers
    rs.EnableRedraw(False)
    for i, p in enumerate(points):
        if i == len(points)-1:
            pass
        else:
            leader = rs.AddLeader([points[i+1], p], view_or_plane="Top", text="")   # MAKE SURE YOU ARE IN THE CORRECT VIEW, THIS WILL FAIL OTHERWISE
            rs.ObjectLayer(leader, layer="Area Arrows")
    rs.EnableRedraw(True)

def zoom(guids, label):
    factor = 50
    box = rs.BoundingBox(guids)
    box = Rhino.Geometry.BoundingBox(box)
    box.Inflate(factor,factor,factor)
    center = box.Center
    centers.append(center)
    if add_dot_bool == True:
        add_dot(center, label)
    box = box.GetCorners()
    rs.ZoomBoundingBox(box, view="Top")
    time.sleep(delay)
    filePath = os.path.join(folder, label+extension)
    capture(filePath, "Top", 1, save_pic)

def add_dot(center, label):
    if "Areas" not in rs.LayerNames():
        rs.AddLayer(name="Areas")
    rs.EnableRedraw(False)
    dot = rs.AddTextDot(label, center)
    add_floor_drop(dot, zones)
    rs.MoveObject(dot,[0,15,0])
    layer = rs.ObjectLayer(dot, layer="Areas")
    rs.EnableRedraw(True)

def add_floor_drop(dot, zones):
    point = rs.TextDotPoint(dot)
    new_zones = []
    for z in zones:
        result = rs.PointInPlanarClosedCurve(point, z)
        if result == 1:
            new_zones.append(z)
    drop = None
    floor = None
    for z in new_zones:
        name = rs.ObjectName(z)
        if "FLOOR" in name:
            floor = name.replace("FLOOR ", "")
        if "DROP" in name:
            drop = name.replace("DROP ", "")
    if floor == None:
        floor = ""
    if drop == None:
        drop = ""
    text = rs.TextDotText(dot).replace("'","")
    new_text = text + " (" + drop + "-" + floor + ")"
    #print new_text
    rs.TextDotText(dot, text=new_text)

def main():
    indices = range(len(groups))
    zipped = zip(guids, groups, indices)
    zipped.sort(key = itemgetter(2))
    tree = groupby(zipped, itemgetter(1))
    labs = groupby(zipped, itemgetter(1))
    bunches = [[item[0] for item in data] for (key, data) in tree]
    labels = [[item[1] for item in data][0] for (key, data) in labs]
    
    results = zip(labels, bunches)
    
    for r in results:
        label = r[0] #the area label
        ids = r[1] # the list of guids
        zoom(ids, label)
        #print label
    if add_leaders_bool == True:
        add_leaders(centers)


if run == True:
    main()




sc.doc = ghdoc

print "complete"
# ---------- end python_zoom_groups_v2_2 ----------
panel_5 = Panel(python_zoom_groups_v2_2)

# ---- group: Auto Setting Tag
number_slider = Slider(2, range=0..10)
pt = Point(python_3.points)
python_4 = GhPythonScript(points=pt, width=Slider(4.726, range=0..14), height=Slider(3.0921, range=0..10), side=Slider(0.971, range=0..2))  # -> out, a; inputs points: list of Point3d
# ---------- python_4: Python ----------
import rhinoscriptsyntax as rs
import Rhino

def make_tag(point, w, h, side):
    """origin is bottom left,
    direction is counterclockwise"""
    
    hw = w/2
    hh = h/2
    
    x,y,z = point
    origin = x-hw, y-hh, z
    x,y,z = origin
    pt1 = x-side,y+hh,z
    pt2 = x,y+h,z
    pt3 = x+w,y+h,z
    pt4 = x+w+side,y+hh,z
    pt5 = x+w,y,z
    
    pt_coords = [origin, pt1, pt2, pt3, pt4, pt5, origin]
    pts = [Rhino.Geometry.Point3d(x,y,z) for x,y,z in pt_coords]
    pl = Rhino.Geometry.Polyline(pts)


    return pl

a = []

for p in points:
    tag = make_tag(p, width, height, side)
    a.append(tag)
# ---------- end python_4 ----------
rgb_2 = ColourRGB(Alpha=255, Red=gh_cpython_3.name_r, Green=gh_cpython_3.name_g, Blue=gh_cpython_3.name_b)
rgb_3 = ColourRGB(Alpha=255, Red=gh_cpython_3.sample_r, Green=gh_cpython_3.sample_g, Blue=gh_cpython_3.sample_b)
srf_2 = Surface(python_4.a)
crv_3 = Curve(python_4.a)
preview_2 = CustomPreview(Geometry=srf_2, Material=rgb_2)
previewlw = CustomPreviewLineweights(Geometry=crv_3, Shader=rgb_3, Thickness=number_slider, Absolute=False)
tag = TextTag3D(Location=pt, Text=python_3.block_names, Size=Slider(1.186, range=0..10), Colour=objatts.Color, Justification=5)

# ---- group: Color Proximity Groups
number_slider_2 = Slider(17, range=0..100)
pt_2 = ConstructPoint(XCoordinate=gh_cpython_3.x, YCoordinate=gh_cpython_3.y, ZCoordinate=gh_cpython_3.z)
rgb_4 = ColourRGB(Alpha=255, Red=gh_cpython_3.r, Green=gh_cpython_3.g, Blue=gh_cpython_3.b)
circle = CircleCNR(Center=pt_2, Normal=Vector(0, 0, 1), Radius=number_slider_2)
srf_3 = Surface(circle)
preview_3 = CustomPreview(Geometry=srf_3, Material=rgb_4)

# ---- group: Colored Cloud Maker
voronoi = Voronoi(Points=python_3.points, Radius=number_slider_2, BruteForceOverride=False)
python_5 = GhPythonScript(curves=voronoi)  # -> out, lines, arcs, circles; inputs curves: list of Curve
# ---------- python_5: Python ----------
import rhinoscriptsyntax as rs
import Rhino

arcs = []
lines = []
circles = []

for c in curves:
    if c.IsCircle():
        print "circle"
        circles.append(c)
    else:
        parts = c.Explode()
        for p in parts:
            if type(p) == Rhino.Geometry.LineCurve:
                print "line"
                line = p
                lines.append(line)
            if type(p) == Rhino.Geometry.ArcCurve:
                print "arc"
                arc = p
                arcs.append(p)
    

#Rhino.Geometry.PolyCurve.IsCircle
#Rhino.Geometry.PolyCurve.Explode()
# ---------- end python_5 ----------
crv_4 = Curve(python_5.arcs)
join = JoinCurves(Curves=crv_4, Preserve=False)
python_6 = GhPythonScript(radius=number_slider_2, curves=join)  # -> out, arcs; inputs curves: list of Curve
# ---------- python_6: Python ----------
import rhinoscriptsyntax as rs
import math as m
import Rhino 


circle = 2*m.pi*radius
print circle

arcs = []

for c in curves:
    length = c.GetLength()
    if length < circle:
        print "Too small"
    else:
        arcs.append(c)
# ---------- end python_6 ----------
crv_5 = Curve(flatten([python_6.arcs, python_5.circles]))
previewlw_2 = CustomPreviewLineweights(Geometry=crv_5, Shader=rgb_4, Thickness=number_slider, Absolute=False)

# ---- group: Dots
objatts_2 = ObjectAttributes(ObjectOrAttributes=crv_2)  # -> Name, LayerName, LayerFullPath, Color, MaterialName, LinetypeName, GroupIndices, PlotWeight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
pt_3 = ConstructPoint(XCoordinate=gh_cpython_3.centerx, YCoordinate=gh_cpython_3.centery, ZCoordinate=gh_cpython_3.centerz)
python_7 = GhPythonScript(bumper=gh_cpython_3.bumpers)  # -> out, bumpers
# ---------- python_7: Python ----------
bumpers = bumper[2:-2].split(",")

for b in bumpers:
    print b
# ---------- end python_7 ----------
pt_4 = ConstructPoint(XCoordinate=gh_cpython_3.sample_x, YCoordinate=gh_cpython_3.sample_y, ZCoordinate=gh_cpython_3.sample_z)
python_8 = GhPythonScript(points=pt_3, curves=id_2, curve_names=objatts_2.Name, old_labels=gh_cpython_3.all_areas)  # -> out, new_labels; inputs points: list of Point3d, curves: list, curve_names: list, old_labels: list
# ---------- python_8: Python ----------
import rhinoscriptsyntax as rs
import datetime
import Rhino

labels = []


for point in points:
    
    drop = None
    floor = None
    
    search = ["FLOOR", "DROP"]
    
    for i, curve in enumerate(curves):
        obj = Rhino.RhinoDoc.ActiveDoc.Objects.Find(curve)
        curve = obj.Geometry
        plane = Rhino.Geometry.Plane.WorldXY
        tolerance = Rhino.RhinoDoc.ActiveDoc.ModelRelativeTolerance
        point = Rhino.Geometry.Point3d(point)
        result = curve.Contains(point, plane, tolerance)
        if str(result) == "Inside":
            if "FLOOR" in curve_names[i].upper():
                floor = curve_names[i].upper().replace("FLOOR ", "")
            if "DROP" in curve_names[i].upper():
                drop = curve_names[i].upper().replace("DROP ", "")
    label = "{}-{}".format(drop,floor)
    labels.append(label)

new_labels = []

for i,label in enumerate(labels):
    
    area = old_labels[i].replace("'","")
    new_label = area + " " + label
    new_labels.append(new_label)






def guid_to_obj(guid):
    obj = Rhino.RhinoDoc.ActiveDoc.Objects.Find(guid)
    return obj
# ---------- end python_8 ----------
panel_6 = Panel(python_8.new_labels)
area_with_location_dots = DefineTextDot(Text=python_8.new_labels, Location=pt_3, Font="Arial", Size=14)
vec = VectorXYZ(XComponent=0, YComponent=Slider(15, range=0..100), ZComponent=0)  # -> Vector, Length
bumper_dots = DefineTextDot(Text=python_7.bumpers, Location=pt_2, Font="Arial", Size=14)
number_dots = DefineTextDot(Text=gh_cpython_3.numbers, Location=pt_2, Font="Arial", Size=14)
sample_dots = DefineTextDot(Text=gh_cpython_3.sample_names, Location=pt_4, Font="Arial", Size=14)
group_dots = DefineTextDot(Text=gh_cpython_3.group_num, Location=pt_2, Font="Arial", Size=14)
neg = Negative(Value=Slider(10, range=0..10))
vec_2 = VectorXYZ(XComponent=0, YComponent=neg, ZComponent=0)  # -> Vector, Length
move = Move(Geometry=sample_dots, Motion=vec_2.Vector)  # -> Geometry, Transform
move_2 = Move(Geometry=area_with_location_dots, Motion=vec.Vector)  # -> Geometry, Transform

# ----
number_dots_2 = DefineTextDot(Text=gh_cpython_3.numbers, Location=pt_2, Font="Arial", Size=14)
neg_2 = Negative(Value=Slider(10, range=0..10))
vec_3 = VectorXYZ(XComponent=0, YComponent=neg_2, ZComponent=0)  # -> Vector, Length
move_3 = Move(Geometry=number_dots, Motion=vec_3.Vector)  # -> Geometry, Transform

# ---- group: Scope Comparison Scipy
# Scope Comparison
named_dots = Guid([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])
button = Button()
toggle_4 = BooleanToggle(True)
rp_dots = Guid([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])
python_9 = GhPythonScript(guids=named_dots, run=toggle_4)  # -> out, points, texts, objs; inputs guids: list
# ---------- python_9: Python ----------
import rhinoscriptsyntax as rs
import datetime
import Rhino


points = []
texts = []
objs = []

if run == True:
    for guid in guids:
        #Rhino.Geometry.TextDot.Point
        obj = Rhino.RhinoDoc.ActiveDoc.Objects.Find(guid)
        point = obj.Geometry.Point
        name = obj.Geometry.Text
        points.append(point)
        texts.append(name)
        objs.append(obj)
# ---------- end python_9 ----------
objatts_3 = ObjectAttributes(ObjectOrAttributes=python_9.objs)  # -> Name, LayerName, LayerFullPath, Color, MaterialName, LinetypeName, GroupIndices, PlotWeight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
python_10 = GhPythonScript(guids=rp_dots, run=toggle_4)  # -> out, points, texts, objs; inputs guids: list; same code as python_9
objatts_4 = ObjectAttributes(ObjectOrAttributes=python_10.objs)  # -> Name, LayerName, LayerFullPath, Color, MaterialName, LinetypeName, GroupIndices, PlotWeight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
number_slider_3 = Slider(7.5, range=1..12)
gh_cpython_4 = GH_CPython(
    apt=python_10.points,
    aguid=rp_dots,
    aname=python_10.texts,
    alayer=objatts_4.LayerName,
    bpt=python_9.points,
    bguid=named_dots,
    bname=python_9.texts,
    blayer=objatts_3.LayerName,
    radius=number_slider_3)  # -> x, y, z, xd, yd, zd, xa, ya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; inputs apt: list, aguid: list, aname: list, alayer: list, bpt: list, bguid: list, bname: list, blayer: list, radius: list
#   port apt: [required] - [type = int] - [default = None] Descripe your input here * bullet point. * bullet point
#   port x: indicate your output description here. refers to a new line.
# ---------- gh_cpython_4: Python ----------
import numpy as np
from scipy import spatial
import pandas as pd


class Block:
    def __init__(self):
        self.guid = None
        self.point = None
        self.order = None
        self.name = None
        self.layer = None

ablocks = []
bblocks = []

for i,guid in enumerate(aguid):
    b = Block()
    b.guid = guid
    b.point = apt[i]
    b.x = b.point[0]
    b.y = b.point[1]
    b.z = b.point[2]
    b.order = i
    b.name = aname[i]
    b.layer = alayer[i]
    ablocks.append(b)
    

adf = pd.DataFrame([vars(x) for x in ablocks])

for i,guid in enumerate(bguid):
    b = Block()
    b.guid = guid
    b.point = bpt[i]
    b.x = b.point[0]
    b.y = b.point[1]
    b.z = b.point[2]
    b.order = i
    b.name = bname[i]
    b.layer = blayer[i]
    bblocks.append(b)
    

bdf = pd.DataFrame([vars(x) for x in bblocks])

A = [[x,y] for x,y,z in adf.point.tolist()]
B = [[x,y] for x,y,z in bdf.point.tolist()]





atree = spatial.cKDTree(A)
btree = spatial.cKDTree(B)


result = btree.query_ball_tree(atree, radius)
opp_result = atree.query_ball_tree(btree, radius)
adf["res"] = opp_result
#result = [x for x in result if len(result)> 0]

bdf["res"] = result

#links = adf.loc[adf["res"].str.len() != 0, :]





def first(x):
    if len(x)>0:
        return x[0]
    else:
        return None

bdf.res = bdf.res.apply(first)
adf.res = adf.res.apply(first)

adds = adf.loc[adf["res"].isnull(),:]

links = bdf.loc[bdf["res"].notnull(),:]

dels = bdf.loc[bdf["res"].isnull(),:]



x = links.x.tolist()
y = links.y.tolist()
z = links.z.tolist()


xd = dels.x.tolist()
yd = dels.y.tolist()
zd = dels.z.tolist()

xa = adds.x.tolist()
ya = adds.y.tolist()
za = adds.z.tolist()

#save = r"C:\Users\mkreidler\Desktop\fcch.xlsx"
#adf.to_excel(save)
#print("done")

confirmed = links.guid.tolist()
added = adds.guid.tolist()
deleted = dels.guid.tolist()
# ---------- end gh_cpython_4 ----------
panel_7 = Panel(python_10.texts)
pt_delete = ConstructPoint(XCoordinate=gh_cpython_4.xd, YCoordinate=gh_cpython_4.yd, ZCoordinate=gh_cpython_4.zd)
pt_match = ConstructPoint(XCoordinate=gh_cpython_4.x, YCoordinate=gh_cpython_4.y, ZCoordinate=gh_cpython_4.z)
Z = UnitZ(Factor=1)
Z_2 = UnitZ(Factor=1)
python_change_object_layer = GhPythonScript(
    confirmed=gh_cpython_4.confirmed,
    added=gh_cpython_4.added,
    deleted=gh_cpython_4.deleted,
    run=Button(),
    copy=Toggle(False))  # -> out, a; inputs confirmed: list, added: list, deleted: list
# ---------- python_change_object_layer: Python ----------
import rhinoscriptsyntax as rs
import scriptcontext as sc
import Rhino
import datetime

sc.doc = Rhino.RhinoDoc.ActiveDoc

confirmed = [x.replace("'","") for x in confirmed]
added = [x.replace("'","") for x in added]
deleted = [x.replace("'","") for x in deleted]


def layer_deleted(guids, date_deleted=datetime.date.today().strftime("%B %d, %Y")):
    if "Deleted" not in rs.LayerNames():
        rs.AddLayer(name="Deleted")
    del_layer = str("Deleted::{}".format(date_deleted))
    if  del_layer not in  rs.LayerNames():
        rs.AddLayer(del_layer)
    rs.EnableRedraw(False)
    for g in guids:
        rs.ObjectLayer(g, layer=del_layer)
    rs.EnableRedraw(True)


def add_to_layer(guids, phase, sub=None, copy=False):
    layer = None
    if sub == None:
       layer = phase
    else:
        layer = "{}::{}".format(phase, sub)
    if layer not in rs.LayerNames():
        rs.AddLayer(layer)
    rs.EnableRedraw(False)
    if copy == False:
        for g in guids:
            rs.ObjectLayer(g, layer=layer)
    else:
        for g in guids:
            copy = rs.CopyObject(g)
            rs.ObjectLayer(copy, layer=layer)
    rs.EnableRedraw(True)


if run == True:
    add_to_layer(confirmed, "Base", sub="Presurvey")
    add_to_layer(added, "Base", sub="WJE add after survey 1", copy=copy)
    layer_deleted(deleted)

sc.doc = ghdoc
# ---------- end python_change_object_layer ----------
pt_add = ConstructPoint(XCoordinate=gh_cpython_4.xa, YCoordinate=gh_cpython_4.ya, ZCoordinate=gh_cpython_4.za)
Z_3 = UnitZ(Factor=1)
circle_2 = CircleCNR(Center=pt_match, Normal=Z_2, Radius=number_slider_3)
circle_3 = CircleCNR(Center=pt_delete, Normal=Z, Radius=number_slider_3)
circle_4 = CircleCNR(Center=pt_add, Normal=Z_3, Radius=number_slider_3)
srf_4 = Surface(circle_2)
srf_5 = Surface(circle_3)
srf_6 = Surface(circle_4)
preview_4 = CustomPreview(Geometry=srf_4, Material=ColourSwatch(SwatchColor=RGB(114, 141, 186)))
preview_5 = CustomPreview(Geometry=srf_6, Material=ColourSwatch(SwatchColor=RGB(37, 176, 81)))
preview_6 = CustomPreview(Geometry=srf_5, Material=ColourSwatch(SwatchColor=RGB(255, 13, 13)))

# ----
# Draw Boxes
toggle_5 = BooleanToggle(False)
gh_cpython_5 = GH_CPython(input=toggle_5)  # -> layers, x, y, z, width, height, rec_layers; inputs input: list
#   port input: [required] - [type = int] - [default = None] Descripe your input here * bullet point. * bullet point
#   port layers: indicate your output description here. refers to a new line.
# ---------- gh_cpython_5: Python ----------
import pandas as pd

file = r"C:\Users\mkreidler\Desktop\rectangles.xlsx"

df = pd.read_excel(file)

df["layer"] = df.page.map(str) + "::" + df.color

layers = list(df.layer.unique())

df["z"] = 0

x = df.x.tolist()
y = df.y.tolist()
z = df.z.tolist()

width = df.width.tolist()
height = df.height.tolist()

rec_layers = df.layer.tolist()
# ---------- end gh_cpython_5 ----------
layer = DefineLayer(Name=gh_cpython_5.layers)
pt_5 = ConstructPoint(XCoordinate=gh_cpython_5.x, YCoordinate=gh_cpython_5.y, ZCoordinate=gh_cpython_5.z)
addition = Addition(A=gh_cpython_5.y, B=gh_cpython_5.height)
addition_2 = Addition(A=gh_cpython_5.x, B=gh_cpython_5.width)
bakelayer = BakeModifyLayer(Layer=layer, Bake=False)
pt_6 = ConstructPoint(XCoordinate=addition_2, YCoordinate=addition, ZCoordinate=0)
attributes = DefineObjectAttributes(Layer=gh_cpython_5.rec_layers)
rec_2pt = Rectangle2Pt(Plane=PlaneXY(0, 0, 0), PointA=pt_5, PointB=pt_6, Radius=0)  # -> Rectangle, Length
srf_7 = Surface(rec_2pt.Rectangle)
bake = BakeObjects(Geometry=srf_7, Attributes=attributes, Bake=False)

# ---- group: quote rx like thing
# Quote Rx
button_2 = Button()
guids_a = Guid([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])
generate_report = Button()
python_11 = GhPythonScript(dots=guids_a)  # -> names, points, layers; inputs dots: list
# ---------- python_11: Python ----------
import scriptcontext as sc
import rhinoscriptsyntax as rs
import Rhino

points = []
names = []
layers = []

sc.doc = Rhino.RhinoDoc.ActiveDoc

for d in dots:
    pt = rs.TextDotPoint(d)
    #pt = rs.BlockInstanceInsertPoint(y)
    #pt = rs.TextObjectText(y)
    points.append(pt)
    name = rs.TextDotText(d)
    #name = rs.BlockInstanceName(y)
    names.append(name)
    layer = rs.ObjectLayer(d)
    layers.append(layer)
    

sc.doc = ghdoc
# ---------- end python_11 ----------
gh_cpython_6 = GH_CPython(run=button_2)  # -> output; inputs run: list
#   port run: [required] - [type = int] - [default = None] Descripe your input here * bullet point. * bullet point
#   port output: indicate your output description here. refers to a new line.
# ---------- gh_cpython_6: Python ----------
import pandas as pd
import os

folder = r"C:\Users\mkreidler\Desktop\dataframes"
excels = []
dataframes = []
for root, dirs, files in os.walk(folder, topdown = False):
   for name in files:
      excels.append(os.path.join(root, name))
bases = []
for e in excels:
    df = pd.read_excel(e)
    base = os.path.basename(e).replace(".xlsx","")
    #print(base)
    bases.append(base)
    dataframes.append(df)

master = dataframes[0]

for i,df in enumerate(dataframes):
    if i != 0:
        master = master.merge(df, on="name", how="outer", suffixes=tuple([bases[1],bases[-1]])).fillna(0)
    
master = master.rename(index=str, columns={"guid":"guid"+bases[0]})

print(master)
# ---------- end gh_cpython_6 ----------
gh_cpython_7 = GH_CPython(names=python_11.names, points=python_11.points, layers=python_11.layers, guids=guids_a, run=generate_report)  # -> a; inputs names: list, points: list, layers: list, guids: list, run: list
#   port names: [required] - [type = int] - [default = None] Descripe your input here * bullet point. * bullet point
#   port a: indicate your output description here. refers to a new line.
# ---------- gh_cpython_7: Python ----------
import pandas as pd
import os

folder = r"C:\Users\mkreidler\Desktop\dataframes"

class block:
    def __init__(self):
        self.name = None
        self.point = None
        self.layer = None
        self.guid = None


blocks = []

for i,g in enumerate(guids):
    b = block()
    b.name = names[i]
    b.point = points[i]
    b.layer = layers[i]
    b.guid = guids[i]
    blocks.append(b)


df = pd.DataFrame([vars(f) for f in blocks])

df = df[["name","guid"]].groupby("name").count().reset_index()

file_path = os.path.join(folder, "1-Estimate.xlsx")

if run==True:
    df.to_excel(file_path)
# ---------- end gh_cpython_7 ----------
