# Grasshopper definition All studies Zone-Zoom-Heat-Leader-dataframe-fuzzygrouping -- PS 171 try 4 --WORKING.gh (Grasshopper 1.0.7)
# plug-ins: Heteroptera, Human, EleFront, GH_CPython

# ---- group: inputs
id_block_dots = Guid([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])
crv_zones = Curve([<curve referenced from the Rhino model> x38])

# ---- group: quoteRx testing
guids_c = Guid([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])
guids_a = Guid(id_block_dots)
guids_b = Guid([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])
generate_report = Button()
python = GhPythonScript(dots=guids_c)  # -> names, points, layers; inputs dots: list
# ---------- python: Python ----------
import scriptcontext as sc
import rhinoscriptsyntax as rs
import Rhino

points = []
names = []
layers = []

sc.doc = Rhino.RhinoDoc.ActiveDoc

for d in dots:
    pt = rs.TextDotPoint(d)
    #pt = rs.BlockInstanceInsertPoint(y)
    #pt = rs.TextObjectText(y)
    points.append(pt)
    name = rs.TextDotText(d)
    #name = rs.BlockInstanceName(y)
    names.append(name)
    layer = rs.ObjectLayer(d)
    layers.append(layer)
    

sc.doc = ghdoc
# ---------- end python ----------
python_2 = GhPythonScript(dots=guids_a)  # -> names, points, layers; inputs dots: list; same code as python
python_3 = GhPythonScript(dots=guids_b)  # -> names, points, layers; inputs dots: list; same code as python
gh_cpython = GH_CPython(names=python.names, points=python.points, layers=python.layers, guids=guids_c, run=generate_report)  # -> a; inputs names: list, points: list, layers: list, guids: list, run: list
#   port names: [required] - [type = int] - [default = None] Descripe your input here * bullet point. * bullet point
#   port a: indicate your output description here. refers to a new line.
# ---------- gh_cpython: Python ----------
import pandas as pd
import os

folder = r"C:\Users\mkreidler\Desktop\dataframes"

class block:
    def __init__(self):
        self.name = None
        self.point = None
        self.layer = None
        self.guid = None


blocks = []

for i,g in enumerate(guids):
    b = block()
    b.name = names[i]
    b.point = points[i]
    b.layer = layers[i]
    b.guid = guids[i]
    blocks.append(b)


df = pd.DataFrame([vars(f) for f in blocks])

df = df[["name","guid"]].groupby("name").count().reset_index()

file_path = os.path.join(folder, "3-CO2.xlsx")


if run==True:
    df.to_excel(file_path)
# ---------- end gh_cpython ----------
gh_cpython_2 = GH_CPython(names=python_2.names, points=python_2.points, layers=python_2.layers, guids=guids_a, run=generate_report)  # -> a; inputs names: list, points: list, layers: list, guids: list, run: list
#   port names: [required] - [type = int] - [default = None] Descripe your input here * bullet point. * bullet point
#   port a: indicate your output description here. refers to a new line.
# ---------- gh_cpython_2: Python ----------
import pandas as pd
import os

folder = r"C:\Users\mkreidler\Desktop\dataframes"

class block:
    def __init__(self):
        self.name = None
        self.point = None
        self.layer = None
        self.guid = None


blocks = []

for i,g in enumerate(guids):
    b = block()
    b.name = names[i]
    b.point = points[i]
    b.layer = layers[i]
    b.guid = guids[i]
    blocks.append(b)


df = pd.DataFrame([vars(f) for f in blocks])

df = df[["name","guid"]].groupby("name").count().reset_index()

file_path = os.path.join(folder, "1-Estimate.xlsx")

if run==True:
    df.to_excel(file_path)
# ---------- end gh_cpython_2 ----------
gh_cpython_3 = GH_CPython(names=python_3.names, points=python_3.points, layers=python_3.layers, guids=guids_b, run=generate_report)  # -> a; inputs names: list, points: list, layers: list, guids: list, run: list
#   port names: [required] - [type = int] - [default = None] Descripe your input here * bullet point. * bullet point
#   port a: indicate your output description here. refers to a new line.
# ---------- gh_cpython_3: Python ----------
import pandas as pd
import os

folder = r"C:\Users\mkreidler\Desktop\dataframes"

class block:
    def __init__(self):
        self.name = None
        self.point = None
        self.layer = None
        self.guid = None


blocks = []

for i,g in enumerate(guids):
    b = block()
    b.name = names[i]
    b.point = points[i]
    b.layer = layers[i]
    b.guid = guids[i]
    blocks.append(b)


df = pd.DataFrame([vars(f) for f in blocks])

df = df[["name","guid"]].groupby("name").count().reset_index()

file_path = os.path.join(folder, "2-Survey.xlsx")


if run==True:
    df.to_excel(file_path)
# ---------- end gh_cpython_3 ----------
gh_cpython_4 = GH_CPython(run=Button())  # -> output; inputs run: list
#   port run: [required] - [type = int] - [default = None] Descripe your input here * bullet point. * bullet point
#   port output: indicate your output description here. refers to a new line.
# ---------- gh_cpython_4: Python ----------
import pandas as pd
import os

folder = r"C:\Users\mkreidler\Desktop\dataframes"
excels = []
dataframes = []
for root, dirs, files in os.walk(folder, topdown = False):
   for name in files:
      excels.append(os.path.join(root, name))
bases = []
for e in excels:
    df = pd.read_excel(e)
    base = os.path.basename(e).replace(".xlsx","")
    #print(base)
    bases.append(base)
    dataframes.append(df)

master = dataframes[0]

for i,df in enumerate(dataframes):
    if i != 0:
        master = master.merge(df, on="name", how="outer", suffixes=tuple([bases[1],bases[-1]])).fillna(0)
    
master = master.rename(index=str, columns={"guid":"guid"+bases[0]})

print(master)
# ---------- end gh_cpython_4 ----------

# ----
Z = UnitZ(Factor=1)
add_text_dot = BooleanToggle(False)
save_image = BooleanToggle(True)
summary_excel_to_desktop = Button()
add_leaders = BooleanToggle(True)

# ---- group: fuzzy grouping
id_block_dots_2 = Guid(id_block_dots)
id_block_dots_3 = Guid(id_block_dots_2)
id_block_dots_4 = Guid(id_block_dots_3)
fuzzy_threshold = Slider(10, range=0..100)
python_4 = GhPythonScript(dots=id_block_dots_3)  # -> points, names, layers; inputs dots: list
# ---------- python_4: Python ----------
import scriptcontext as sc
import rhinoscriptsyntax as rs
import Rhino

points = []
names = []
layers = []

sc.doc = Rhino.RhinoDoc.ActiveDoc

for y in dots:
    #pt = rs.BlockInstanceInsertPoint(y)
    #pt = rs.TextObjectText(y)
    pt = rs.TextDotPoint(y)
    points.append(pt)
    #name = rs.BlockInstanceName(y)
    name = rs.TextDotText(y)
    names.append(name)
    layer = rs.ObjectLayer(y)
    layers.append(layer)
    

sc.doc = ghdoc

points
names
layers
# ---------- end python_4 ----------
python_5 = GhPythonScript(dots=id_block_dots_2)  # -> points, names, layers; inputs dots: list; same code as python_4
python_6 = GhPythonScript(dots=id_block_dots_4)  # -> points, names, layers; inputs dots: list; same code as python_4
gh_cpython_5 = GH_CPython(guids=id_block_dots_3, points=python_4.points, names=python_4.names, base=fuzzy_threshold)  # -> x, y, z, r, g, b; inputs guids: list, points: list, names: list, base: list
#   port guids: [required] - [type = int] - [default = None] Descripe your input here * bullet point. * bullet point
#   port x: indicate your output description here. refers to a new line.
# ---------- gh_cpython_5: Python ----------
import pandas as pd
import random


class Block():
    def __init__(self):
        self.guid = None
        self.name = None
        self.point = None
        #self.layer = None
        #self.zones = None
        self.x = None
        self.y = None
        self.z = None
        #self.floor = None
        #self.swing_drop = None
        #self.elevation = None
        #self.priority = None
        #self.phase = None

# make an empty list to populate with block objects
blocks = []
# connect gh wires to python block classes
for i, z in enumerate(guids):
    b = Block()
    b.guid = guids[i]
    b.point = points[i]
    b.name = names[i]
    b.x,b.y,b.z = points[i]



# populate list of blocks
    blocks.append(b)

# turn the above list to a pandas dataframe
df = pd.DataFrame([vars(f) for f in blocks])





def round_ten(x):
    return round(x,-1)

def myround(x):
    return base * round(x/base)

df["fuzzy_x"] = df.x.apply(myround)

x = df.x.tolist()
y = df.y.tolist()
z = df.z.tolist()

def random_color(x):
    random.seed(x)
    r = random.randint(0,255)
    g = random.randint(0,255) 
    b = random.randint(0,255)
    return [r,g,b]

df["color"]=df.fuzzy_x.apply(random_color)
colors = df.color.tolist()
r = [r for r,g,b in colors]
g = [g for r,g,b in colors]
b = [b for r,g,b in colors]
# ---------- end gh_cpython_5 ----------
gh_cpython_6 = GH_CPython(
    guids=id_block_dots_4,
    points=python_6.points,
    names=python_6.names,
    base=Slider(25, range=0..100),
    selection=Slider(150, range=0..301))  # -> x, y, z, options; inputs guids: list, points: list, names: list, base: list, selection: list
#   port guids: [required] - [type = int] - [default = None] Descripe your input here * bullet point. * bullet point
#   port x: indicate your output description here. refers to a new line.
# ---------- gh_cpython_6: Python ----------
import pandas as pd

class Block():
    def __init__(self):
        self.guid = None
        self.name = None
        self.point = None
        #self.layer = None
        #self.zones = None
        self.x = None
        self.y = None
        self.z = None
        #self.floor = None
        #self.swing_drop = None
        #self.elevation = None
        #self.priority = None
        #self.phase = None

# make an empty list to populate with block objects
blocks = []
# connect gh wires to python block classes
for i, z in enumerate(guids):
    b = Block()
    b.guid = guids[i]
    b.point = points[i]
    b.name = names[i]
    b.x,b.y,b.z = points[i]



# populate list of blocks
    blocks.append(b)

# turn the above list to a pandas dataframe
df = pd.DataFrame([vars(f) for f in blocks])





def round_ten(x):
    return round(x,-1)

def myround(x):
    return base * round(x/base)

df["fuzzy_x"] = df.x.apply(myround)




options = sorted(list(set(df.fuzzy_x.tolist())))

number = options[selection]

x = df.loc[df.fuzzy_x == number, "x"].tolist()
y = df.loc[df.fuzzy_x == number, "y"].tolist()
z = df.loc[df.fuzzy_x == number, "z"].tolist()

x = [float(i) for i in x]
y = [float(i) for i in y]
z = [float(i) for i in z]
# ---------- end gh_cpython_6 ----------
gh_cpython_7 = GH_CPython(guids=id_block_dots_2, points=python_5.points, names=python_5.names, base=fuzzy_threshold)  # -> x, y, z, r, g, b; inputs guids: list, points: list, names: list, base: list
#   port guids: [required] - [type = int] - [default = None] Descripe your input here * bullet point. * bullet point
#   port x: indicate your output description here. refers to a new line.
# ---------- gh_cpython_7: Python ----------
import pandas as pd
import random


class Block():
    def __init__(self):
        self.guid = None
        self.name = None
        self.point = None
        #self.layer = None
        #self.zones = None
        self.x = None
        self.y = None
        self.z = None
        #self.floor = None
        #self.swing_drop = None
        #self.elevation = None
        #self.priority = None
        #self.phase = None

# make an empty list to populate with block objects
blocks = []
# connect gh wires to python block classes
for i, z in enumerate(guids):
    b = Block()
    b.guid = guids[i]
    b.point = points[i]
    b.name = names[i]
    b.x,b.y,b.z = points[i]



# populate list of blocks
    blocks.append(b)

# turn the above list to a pandas dataframe
df = pd.DataFrame([vars(f) for f in blocks])





def round_ten(x):
    return round(x,-1)

def myround(x):
    return base * round(x/base)

df["fuzzy_y"] = df.y.apply(myround)

x = df.x.tolist()
y = df.y.tolist()
z = df.z.tolist()

def random_color(x):
    random.seed(x)
    r = random.randint(0,255)
    g = random.randint(0,255) 
    b = random.randint(0,255)
    return [r,g,b]

df["color"]=df.fuzzy_y.apply(random_color)
colors = df.color.tolist()
r = [r for r,g,b in colors]
g = [g for r,g,b in colors]
b = [b for r,g,b in colors]
# ---------- end gh_cpython_7 ----------
number_slider = Slider(23, range=0..100)
lng = ListLength(List=gh_cpython_6.options)
rgb = ColourRGB(Alpha=255, Red=gh_cpython_5.r, Green=gh_cpython_5.g, Blue=gh_cpython_5.b)
rgb_2 = ColourRGB(Alpha=255, Red=gh_cpython_7.r, Green=gh_cpython_7.g, Blue=gh_cpython_7.b)
pt = ConstructPoint(XCoordinate=gh_cpython_5.x, YCoordinate=gh_cpython_5.y, ZCoordinate=gh_cpython_5.z)
pt_2 = ConstructPoint(XCoordinate=gh_cpython_7.x, YCoordinate=gh_cpython_7.y, ZCoordinate=gh_cpython_7.z)
pt_3 = ConstructPoint(XCoordinate=gh_cpython_6.x, YCoordinate=gh_cpython_6.y, ZCoordinate=gh_cpython_6.z)
sph = Sphere(Base=pt, Radius=number_slider)
sph_2 = Sphere(Base=pt_2, Radius=number_slider)
sph_3 = Sphere(Base=pt_3, Radius=Slider(10, range=0..100))
preview_x_vertical_grouping = CustomPreview(Geometry=sph, Material=rgb)
preview_y_horizontal_grouping = CustomPreview(Geometry=sph_2, Material=rgb_2)

# ---- group: Select by layer or guid
geo = Geometry(<curve referenced from the Rhino model>)
id = Guid(geo)
objsbylayer = ObjectsByLayer(Layer="Default")  # -> RhinoObjects, ObjectAttributes; disabled
selectobjs = CSharpScript(run=Button(), O=objsbylayer.RhinoObjects)  # -> out, A; inputs run: Boolean
# ---------- selectobjs: C# ----------
    if(run){
      Rhino.DocObjects.RhinoObject rhObj = O as Rhino.DocObjects.RhinoObject;
      doc.Objects.Select(rhObj.Id);
    }
# ---------- end selectobjs ----------
selectobjs_2 = CSharpScript(run=Button(), ID=id)  # -> out, A; inputs run: Boolean, ID: Guid
# ---------- selectobjs_2: C# ----------
    if(run){
      doc.Objects.Select(ID);
    }
# ---------- end selectobjs_2 ----------

# ---- group: Select by Survey Scope by saved GUID
id_hatches_blocks_etc = Guid([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])
selectobjs_3 = CSharpScript(run=Button(), ID=id_hatches_blocks_etc)  # -> out, A; inputs run: Boolean, ID: Guid; same code as selectobjs_2

# ---- group: make dataframe and reports
panel = Panel(id_block_dots)
panel_2 = Panel(crv_zones)
python_7 = GhPythonScript(dots=id_block_dots)  # -> out, points, names, layers; inputs dots: list; same code as python_4
objatts = ObjectAttributes(ObjectOrAttributes=crv_zones)  # -> Name, LayerName, LayerFullPath, Color, MaterialName, LinetypeName, GroupIndices, PlotWeight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
panel_3 = Panel(objatts.Name)
panel_4 = Panel(python_7.layers)
panel_5 = Panel(python_7.names)
panel_6 = Panel(python_7.points)
incurve = PointInCurve(Point=python_7.points, Curve=crv_zones)  # -> Relationship, Point
python_8 = GhPythonScript(
    block_guid=id_block_dots,
    block_name=python_7.names,
    block_pt=python_7.points,
    block_layer=python_7.layers,
    zone_guid=crv_zones,
    zone_pt=crv_zones,
    zone_name=objatts.Name,
    zone_crv=crv_zones)  # -> out, a; inputs block_guid: list, block_name: list, block_pt: list, block_layer: list, zone_guid: list, zone_pt: list, zone_name: list, zone_crv: list
# ---------- python_8: Python ----------
import scriptcontext as sc
import rhinoscriptsyntax as rs
import Rhino



class block:
    
    def __init__(self):
        self.point = None
        self.layer = None
        self.name = None
        self.drop = None
        self.floor = None
        self.guid = None
        self.zones = []


class zone:
    
    def __init__(self):
        self.name = None
        self.guid = None
        self.curve = None




def point_in_zone(point, zone):
    result = True if rs.PointInPlanarClosedCurve(point, zone.curve) == 1 else False
    return result

def point_zones(point, zones):
    matches = [x.name for x in zones if point_in_zone(point, x) is True]
    #print "Point in {}".format(matches)
    return matches

def load_zones(file):
    
    with open(file, "r") as f:
        content = f.readlines()
        content = [x.strip() for x in content] 
        return content


blocks = []

for i,id in enumerate(block_guid):
    b = block()
    b.guid = id
    b.name = block_name[i]
    b.point = block_pt[i]
    b.layer = block_layer[i]
    blocks.append(b)

zones = []

for i, id in enumerate(zone_guid):
    z = zone()
    z.name = zone_name[i] 
    z.guid = id
    z.curve = zone_crv[i]
    zones.append(z)

#sc.doc = Rhino.RhinoDoc.ActiveDoc
block_zones = []

for b in blocks:
    for z in zones:
        test = rs.PointInPlanarClosedCurve(b.point, z.curve)
        if test > 0:
            #print test
            b.zones.append(z.name)
            print "{} in {}".format(b.name, z.name)
        #print b.point

#sc.doc = ghdoc

for b in blocks:
    block_zones.append(str(b.zones))


a = block_zones
# ---------- end python_8 ----------
panel_7 = Panel(incurve.Relationship)
show_report_and_barcodes = Button()
show_report = Button()
generate_report_only = Button()

# ---- group: Block Adjacency Clustering
number_slider_2 = Slider(34, range=0..100)
pgroups = PointGroups(Points=python_7.points, Distance=number_slider_2)  # -> simplify(Groups), Indices
item = ListItem(List=id_block_dots, Index=pgroups.Indices, Wrap=True)
tstat = TreeStatistics(Tree=pgroups.Groups)  # -> Paths, Length, Count
division = Division(A=number_slider_2, B=2)
python_tree_to_lists = PythonScript(x=item, y=Toggle(True))  # -> out, a, group, id; inputs x: tree
# ---------- python_tree_to_lists: Python ----------
if y == True:
    
    import rhinoscriptsyntax as rs
     
    import Rhino.Geometry as rg
    from clr import AddReference as addr
    addr("Grasshopper")
     
    from System import Object
    from Grasshopper import DataTree
    from Grasshopper.Kernel.Data import GH_Path
     
     
    def raggedListToDataTree(raggedList):
        rl = raggedList
        result = DataTree[object]()
        for i in range(len(rl)):
            temp = []
            for j in range(len(rl[i])):
                temp.append(rl[i][j])
            #print i, " - ",temp
            path = GH_Path(i)
            result.AddRange(temp, path)
        return result
     
    def dataTreeToList(aTree):
        theList = []
        for i in range(aTree.BranchCount ):
            thisListPart = []
            thisBranch = aTree.Branch(i)
            for j in range(len(thisBranch)):
                thisListPart.append( thisBranch[j] )
            theList.append(thisListPart)
        return theList
    
    # take gh data tree and turn it into lists of lists
    # for python, the tree in this case groups points
    # based on threshold
    
    a = dataTreeToList(x)
    # enumerate the branches, which is telling you 
    # the group number
    
    b = []
    
    group = []
    id = []
    
    print "group, guid"
    for i, b in enumerate(a):
        i += 1
        for c in b:
            print "{},{}".format(i, c)
            group.append(i)
            id.append(str(c))
# ---------- end python_tree_to_lists ----------
random = Random(Range=Domain(0, 255), Number=tstat.Count, Seed=52)
random_2 = Random(Range=Domain(0, 255), Number=tstat.Count, Seed=785)
random_3 = Random(Range=Domain(0, 255), Number=tstat.Count, Seed=563)
viewer = ParamViewer(pgroups.Groups)
int = Integer(random)
int_2 = Integer(random_3)
int_3 = Integer(random_2)
panel_8 = Panel(python_tree_to_lists.a)
rgb_3 = ColourRGB(Alpha=Slider(10, range=0..10), Red=int, Green=int_3, Blue=int_2)  # -> graft(Colour)
sph_4 = Sphere(Base=pgroups.Groups, Radius=division)
preview = CustomPreview(Geometry=sph_4, Shader=rgb_3)

# ---- group: Circle cloud outlines -- VERY SLOW
circle = CircleCNR(Center=pgroups.Groups, Normal=Z, Radius=division)
runion = RegionUnion()

# ---- group: make dataframe and reports (continued)
gh_cpython_8 = GH_CPython(
    block_zones=python_8.a,
    block_name=python_7.names,
    block_pt=python_7.points,
    block_layer=python_7.layers,
    block_guid=id_block_dots,
    group=python_tree_to_lists.group,
    id=python_tree_to_lists.id,
    report=generate_report_only,
    open_report=show_report,
    show_bc_rpt=show_report_and_barcodes,
    show_static=Toggle(True),
    summary_bool=summary_excel_to_desktop,
    base=Slider(10, range=0..10))  # -> bumper, x, y, z, survey_num, sorted_guid, primary, label; inputs block_zones: list, block_name: list, block_pt: list, block_layer: list, block_guid: list, group: list, id: list, report: list, open_report: list, show_bc_rpt: list, show_static: list, summary_bool: list, base: list
#   port block_zones: [required] - [type = int] - [default = None] Descripe your input here * bullet point. * bullet point
# ---------- gh_cpython_8: Python ----------
import pandas as pd
import re
import datetime
import os
from reportlab.pdfgen import canvas
import qrcode
import uuid
from natsort import natsorted, ns


###CLASSES AND FUNCTIONS###

class Block():
    def __init__(self):
        self.guid = None
        self.name = None
        self.point = None
        self.layer = None
        self.zones = None
        self.x = None
        self.y = None
        self.z = None
        self.floor = None
        self.swing_drop = None
        self.elevation = None
        self.priority = None
        self.phase = None

class Group():
    def __init__(self):
        self.group = None
        self.guid = None     

def find_floor(x):
    pat = r"floor\s*(\d*)"
    result = re.search(pat, str(x), flags=re.IGNORECASE)
    if result:
        return int(result.group(1))    

def find_phase(x):
    if "BASE" in x.upper():
        return 0
    else:
        pat = r"CO\s*(\d*)"
        result = re.search(pat, str(x), flags=re.IGNORECASE)
        if result:
            return int(result.group(1)) 

def find_priority(x):
    pat = r"priority\s*(\d*)"
    result = re.search(pat, str(x), flags=re.IGNORECASE)
    if result:
        return int(result.group(1))   

def find_elevation(x):
    pat = r"([a-zA-Z\s]*)\s*ELEVATION"
    result = re.search(pat, str(x), flags=re.IGNORECASE)
    if result:
        return result.group(1)

def get_drop(x):
    pat = r"drop\s*([a-z]*\d*)"
    match = re.search(pat, str(x), flags=re.IGNORECASE)

    if match:
        return match.group(1)
    else:
        return None

def sort_drops(x, alphabetical = True):
    if alphabetical != True:
        drop_sort = {   "W1":1,"W2":2,"W3":3, "W4":4, "W5":5, "W6":6, "S1":7, "S2":8, "S3":9, "S4":10}
        return drop_sort[x]
    else:
        pass
    
### MAKE QR CODES###

def make_barcodes(path):

    data = pd.read_excel(path)
    stuff = data.survey_name.tolist()
    df = pd.DataFrame({'stuff': stuff})
    df["num"] = df.index + 1
    df["c"] = df.num % 3
    df.c = df.c.replace(0, 3)
    df["page"] = ((df.num + 23) // 24)
    df["r"] = (((df.num - 1) // 3) + 1) % 8
    df.r = df.r.replace(0, 8)

    # FILE LOCATIONS
    logo_path = r"C:\Users\mkreidler\Desktop\pdf print barcodes\BVTC-Logo-BLACK-horizontal.png"
    pdf_suffix = r"C:\Users\mkreidler\Desktop\pdf print barcodes\\" ##actually this is a prefix
    dt = str(datetime.datetime.now()).replace(":", "_")
    ext = ".pdf"
    pdf_path = f"{pdf_suffix}{dt}{ext}"

    # MAKE CANVAS
    c = canvas.Canvas(pdf_path)
    c.setPageSize((612, 792))
    last_page = None

    # SPLIT INTO PAGES, COLUMNS, ROWS
    for index, row in df.iterrows():
        page = row["page"]
        if page != last_page:
            if last_page == None:
                last_page = page

            else:
                c.showPage()
                last_page = page

        col = row["c"]
        _row = row["r"]
        i = row["stuff"]
        code = f"{i}"
        print(f"page {page} row {_row} column {col} info {i}")

        # DRAW QR
        def draw_qr(data, base=r"C:\Users\mkreidler\Desktop\pdf print barcodes\\"):
            # draw QR
            dt = str(datetime.datetime.now()).replace(":", "_")
            random = uuid.uuid4()
            img_path = f"{base}{dt}{random}.png" ##can't write file paths with certain characters, removing 'i' variable here

            qr = qrcode.QRCode()
            qr.add_data(data)
            img = qr.make_image().save(img_path)
            return img_path


        # DRAW 1 TAG
        def draw_tag(x_num, y_num, code):
            flip_y = {1: 8,
                      2: 7,
                      3: 6,
                      4: 5,
                      5: 4,
                      6: 3,
                      7: 2,
                      8: 1}

            y_num = flip_y[y_num]

            qr = draw_qr(code)
            x_increment = 204
            y_increment = 99

            x = x_increment * (x_num - 1)
            y = y_increment * (y_num - 1)

            c.drawString(102.5491 + x, 33.7174 + y, code)
            c.drawInlineImage(qr, 0 + x, 0 + y, width=99, height=99)
            os.remove(qr)
            c.drawInlineImage(logo_path, 102.5491 + x, 71.2396 + y, width=84.2926,
                              height=14.0488)  # replace maroon with bnw later


        draw_tag(col, _row, code)
    

    # SAVE DOCUMENT
    c.save()
    print()
    print("Done!")
    return pdf_path


#############################


###MAKE EXCEL REPORTS###

def make_dataframe():
# make an empty list to populate with block objects
    blocks = []
# connect gh wires to python block classes
    for i, z in enumerate(block_zones):
        b = Block()
        b.guid = block_guid[i]
        b.name = block_name[i]
        b.point = block_pt[i]
        b.layer = block_layer[i]
        b.phase = find_phase(b.layer)
        b.zones = z
        b.x = b.point[0]
        b.y = b.point[1]
        b.z = b.point[2]
        b.floor = find_floor(str(z))
        b.elevation = find_elevation(str(z))
        b.swing_drop = get_drop(str(z))
        b.priority = find_priority(str(z))

# populate list of blocks
        blocks.append(b)

# turn the above list to a pandas dataframe
    df = pd.DataFrame([vars(f) for f in blocks])

# make an empty list to populate groups
    groups = []

# connect groups classes to rhino ids
    for i, g in enumerate(group):
        gr = Group()
        gr.group = g
        gr.guid = id[i]
        groups.append(gr)

# make a separate dataframe with groups
    group_df = pd.DataFrame([vars(f) for f in groups])

# merge main dataframe with groups
    merge = df.merge(group_df, on="guid", how="outer")

# sort swingdrops alphanumerically the way a human reads numbers/letters
    def nat_sort(x):
        unordered = merge.swing_drop.tolist()
        reordered = natsorted(unordered,alg=ns.IGNORECASE)
        return reordered.index(x)

# append a columns to df to track drop sort order
    merge["drop_sort"] = merge.swing_drop.apply(nat_sort)

# further specify dataframe sort order
    merge = merge.sort_values(["elevation", "floor", "drop_sort", "x","y"], ascending=[True, False, True, True,False])
    merge.reset_index(inplace = True, drop=True )
    merge["new_order"] = merge.index + 1

# append columns 
    merge["instance"] = merge.groupby("name").cumcount() + 1

    # order groups
    ordered_groups_copies = merge.group.tolist()
    group_order = []
    for g in ordered_groups_copies:
        if g in group_order:
            pass
        else:
            group_order.append(g)
    def sort_groups(x):
        for i,g in enumerate(group_order):
            if g == x:
                return i + 1
    merge["group_order"] = merge["group"].apply(sort_groups)

    # make fuzzy grouping (vertical + horizontal)

    def myround(x):
        return base * round(x/base)

    merge["fuzzy_vertical"] = merge.x.apply(myround)
    merge["fuzzy_horizontal"] = merge.y.apply(myround)


# create the survey name/bumper sticker name
    merge["survey_name"] = merge.swing_drop +"-"+ merge.floor.map(str) +"-"+ merge.name + "[" +merge.new_order.map(str) +"]"
    return merge




def static_exports():
    merge = make_dataframe()
    bumper = str(merge["survey_name"].tolist())
    survey = merge["new_order"].tolist()
    x = merge["x"].tolist()
    y = merge["y"].tolist()
    z = merge["z"].tolist()
    sorted_guid = merge["guid"].tolist()

    return bumper, x,y,z,survey, sorted_guid
    
#####################################

###SHOW REPORTS###
folder = r"V:\Field Survey\Moynihan Station Phase II\Moynihan Phase II CO17 + CO19\Deliverables\Setting Reports\\"
path = folder + "ProjectReport_" + str(datetime.datetime.now()).replace(":","_") + ".xlsx"

#if show_barcodes == True:
   # make_dataframe()
   # barcodes = make_barcodes(path)
    #os.startfile(barcodes)

if open_report == True:
    df = make_dataframe()
    df.to_excel(path)
    os.startfile(path) # open report after pressing button

if report == True:
    make_dataframe() # make report, do not open

# Regenerate + Show Both Reports
if show_bc_rpt == True:
    df = make_dataframe()
    df.to_excel(path)
    os.startfile(path)
    barcodes = make_barcodes(path)
    os.startfile(barcodes)

# Static reports always port information to grasshopper
if show_static == True:
    merge = make_dataframe()
    bumper = str(merge["survey_name"].tolist())
    survey_num = merge["new_order"].tolist()
    x = merge["x"].tolist()
    y = merge["y"].tolist()
    z = merge["z"].tolist()
    sorted_guid = merge["guid"].tolist()


# Summary reports
if summary_bool == True:
    # first survey blocks
    df = make_dataframe()
    first_styles_survey = df[df.instance == 1]
    style_list = df.name.unique()

    # summary data
    num_styles = len(style_list)
    num_units = df.guid.count()
    num_floors = len(df.floor.unique())
    num_phases = len(df.phase.unique())
    num_priority = len(df.priority.unique())
    num_swings = len(df.swing_drop.unique())
    num_groups = len(df.group.unique())
    group_totals = df[["group","guid"]].groupby("group").count()
    group_totals.reset_index(inplace=True)
    loners = len(group_totals.loc[group_totals.guid == 1, "group"].tolist())
    assemblies = len(group_totals.loc[group_totals.guid != 1, "group"].tolist())


    summary = { "Total_Styles":num_styles,
                "Total_Units":num_units,
                "Total_Floors":num_floors,
                "Total_Phases":num_phases,
                "Total_Priorities":num_priority,
                "Total_Drops":num_swings,
                "Total_Groups":num_groups,
                "Total_Loners":loners,
                "Total_Assemblies":assemblies}
    summary_df = pd.DataFrame(summary, index=[0])
    summary_df = summary_df.T

    #print(assemblies)
    #print(loners)
    #print(num_units)
    #print(list(df))

    # first groups
    #print(df[["group","group_order"]])
    #print(list(df))

    #reports
    floor_counts = df[["floor","guid"]].groupby("floor").count()
    floor_counts.reset_index(inplace=True)
    #print(floor_counts)

    elevations = df[["elevation","guid"]].groupby("elevation").count()
    elevations.reset_index(inplace=True)
    print(list(df))

    names = df[["name","guid"]].groupby("name").count()
    names.reset_index(inplace=True)
    #print(names)

    priorities = df[["priority","guid"]].groupby("priority").count()
    priorities.reset_index(inplace=True)
    #print(priorities)

    swing = df[["swing_drop","guid"]].groupby("swing_drop").count()
    swing.reset_index(inplace=True)
    #print(swing)

    phase = df[["phase","guid"]].groupby("phase").count()
    phase.reset_index(inplace=True)
    #print(phase)

    group_rpt = df[["group","guid"]].groupby("group").count()
    group_rpt.reset_index(inplace=True)
    #print(group_rpt)

    group_odr = df[["name","group_order","guid"]].groupby(["group_order","name"]).count()
    group_odr.reset_index(inplace=True)
    #print(group_odr)

    firsts = df.loc[df.instance == 1,["survey_name", "priority", "phase" ]]
    #print(firsts)


    #question marks
    def find_qmark(x):
        if "?" in x:
            return 1
        else:
            return 0
    
    df["qmarks"] = df.name.apply(find_qmark)
    qmarks = df.loc[df.qmarks == 1, ["name", "guid"]]
    qmarks.reset_index(drop=True, inplace=True)
    qmarks = qmarks.groupby("name").count()

    
    # fuzzy groupings
    fuzzy_vert_groups = df[["guid", "fuzzy_vertical"]].groupby("fuzzy_vertical").count() 
    fuzzy_horz_groups = df[["guid", "fuzzy_horizontal"]].groupby("fuzzy_horizontal").count() 
    

    ##########################

    save_path = r"C:\Users\mkreidler\Desktop\PS171_multisheet.xlsx"

    # Create a Pandas Excel writer using XlsxWriter as the engine.
    writer = pd.ExcelWriter(save_path, engine='xlsxwriter')

    # Write each dataframe to a different worksheet.

    summary_df.to_excel(writer, sheet_name='Summary')
    df.to_excel(writer, sheet_name='Main')
    floor_counts.to_excel(writer, sheet_name='Floors')
    names.to_excel(writer, sheet_name='Names')
    elevations.to_excel(writer, sheet_name='Elevations')
    priorities.to_excel(writer, sheet_name='Priorities')
    swing.to_excel(writer, sheet_name='Drops')
    phase.to_excel(writer, sheet_name='Phases')
    group_rpt.to_excel(writer, sheet_name='Groups')
    group_odr.to_excel(writer, sheet_name='Group Order')
    firsts.to_excel(writer, sheet_name='Primary Styles Trimmed')
    first_styles_survey.to_excel(writer, sheet_name='Primary Styles Detail')
    qmarks.to_excel(writer, sheet_name="Question Marks")
    fuzzy_vert_groups.to_excel(writer, sheet_name="Fuzzy Vertical Groups")
    fuzzy_horz_groups.to_excel(writer, sheet_name="Fuzzy Horizontal Groups")

    # Close the Pandas Excel writer and output the Excel file.
    writer.save()
    os.startfile(save_path)


#########################

###ZOOM PRIMARY SURVEY STYLES###
df = make_dataframe()
primary = df.loc[df.instance==1, "guid"].tolist()
labels = df.loc[df.instance==1, ["survey_name"]]
labels.reset_index(inplace=True)
labels["cnt"] = labels.index + 1 
labels["label"] = "Sample " + labels.cnt.map(str) +" "+ labels.survey_name
label = str(labels.label.tolist())

#########################
print("Complete")
# ---------- end gh_cpython_8 ----------

# ---- group: Group Zooming in Survey Order
python_zoom_groups_v2 = GhPythonScript(
    groups=python_tree_to_lists.a,
    delay=Slider(0.1, range=0.1..1),
    add_dot=add_text_dot,
    run=Button(),
    guids=gh_cpython_8.sorted_guid,
    save_pic=save_image)  # -> out, areas, centers; inputs groups: list, guids: list
# ---------- python_zoom_groups_v2: Python ----------
import rhinoscriptsyntax as rs
import time
import scriptcontext as sc
import Rhino
import os
import System.Drawing


folder = r"V:\Projects\PS 171M_P18-1593\Documents\Test Survey Areas"
extension = r".png"


sc.doc = Rhino.RhinoDoc.ActiveDoc

areas = []
centers = []

def capture(filePath, viewportName,scaleFactor, save=False):
    if save == True:
        RhinoDocument = Rhino.RhinoDoc.ActiveDoc
        view = RhinoDocument.Views.Find(viewportName, False)
        vp = view.ActiveViewport
        size = System.Drawing.Size(vp.Size.Width*scaleFactor,vp.Size.Height*scaleFactor)
        capture = view.CaptureToBitmap(size)
        capture.Save(filePath)

if run==True:
    # clean
    
    guids = [i.replace("'","").strip() for i in guids]
    order = dict()
    
    for i, g in enumerate(guids):
        #print i+ 1, g
        order[g] = i+1
    
    
    groups2 = []
    for g in groups:
        g2 = [str(i).strip() for i in g]
        groups2.append(g2)
    
    step = []
    
    for id in guids:
        for g in groups2:
            if id in g:
                step.append(g)
    
    first_step = []
    
    for s in step:
        if s in first_step:
            pass
        else:
            first_step.append(s)
    
    area = 1

    for f in first_step:
        factor = 50
        box = rs.BoundingBox(f)
        box = Rhino.Geometry.BoundingBox(box)
        box.Inflate(factor,factor,factor)
        center = box.Center
        centers.append(center)
        box = box.GetCorners()
        rs.ZoomBoundingBox(box, view="Top")
        label = "Area " + str(area)
        if add_dot == True:
            dot = rs.AddTextDot(label, center)
            layer = rs.ObjectLayer(dot, layer="Areas")
        path = os.path.join(folder, "Area "+ str(area) + extension)
        
        time.sleep(delay)
        capture(path, "Top", 1, save_pic)
        
        areas.append(label)
        area += 1


sc.doc = ghdoc

print "complete"
# ---------- end python_zoom_groups_v2 ----------

# ---- group: Sample Zooming
save_image_2 = BooleanToggle(True)
add_text_dot_2 = BooleanToggle(True)
run_sample_zoom_script = Button()
sample_zooming = GhPythonScript(
    add_dot=add_text_dot_2,
    run=run_sample_zoom_script,
    guids=gh_cpython_8.primary,
    save_pic=save_image_2,
    delay=Slider(0.1, range=0.1..1),
    label=gh_cpython_8.label,
    leaders=add_leaders)  # -> out, areas, centers; inputs guids: list
# ---------- sample_zooming: Python ----------
import rhinoscriptsyntax as rs
import time
import scriptcontext as sc
import Rhino
import os
import System.Drawing


folder = r"V:\Projects\PS 171M_P18-1593\Documents\Test Survey Areas"
extension = r".png"


sc.doc = Rhino.RhinoDoc.ActiveDoc
label = label[1:-1]
label = label.split(',')
label = [x.replace("'","") for x in label]
guids = [x.strip().lower().replace("'","") for x in guids]
areas = []


def capture(filePath, viewportName,scaleFactor, save=False):
    if save == True:
        RhinoDocument = Rhino.RhinoDoc.ActiveDoc
        view = RhinoDocument.Views.Find(viewportName, False)
        vp = view.ActiveViewport
        size = System.Drawing.Size(vp.Size.Width*scaleFactor,vp.Size.Height*scaleFactor)
        capture = view.CaptureToBitmap(size)
        capture.Save(filePath)

if run==True:
    centers = []
    area = 0
    for g in guids:
        factor = 50
        box = rs.BoundingBox([g])
        box = Rhino.Geometry.BoundingBox(box)
        box.Inflate(factor,factor,factor)
        center = box.Center
        centers.append(center)
        box = box.GetCorners()
        rs.ZoomBoundingBox(box, view="Top")
        
        if add_dot == True:
            rs.EnableRedraw(False)
            dot = rs.AddTextDot(label[area], center)
            layer = rs.ObjectLayer(dot, layer="Samples")
            rs.EnableRedraw(True)
        path = os.path.join(folder, "Sample "+ str(area + 1) + extension)
        capture(path, "Top", 1, save_pic)
        time.sleep(delay)
        
        areas.append(label)
        area += 1
        
    if leaders == True:
        rs.EnableRedraw(False)
        for i,c in enumerate(centers):
            if i == len(centers) -1:
                pass
            else:
                points = [c, centers[i+1]]
                leader = rs.AddLeader(points,  view_or_plane="Top", text=None) 
                rs.ObjectLayer(leader, layer="leaders")
        rs.EnableRedraw(True)


sc.doc = ghdoc

print "complete"
# ---------- end sample_zooming ----------

# ---- group: heat maps
pt_4 = Point(python_7.points)
srf = Surface(<surface referenced from the Rhino model>)
crossref = CrossReference(ListA=pt_4, ListB=pt_4, CrossMode=1)  # -> ListA, ListB
xz = XZPlane(Origin=Point(0, 0, 0))
voronoi = Voronoi(Points=pt_4, Boundary=srf, BruteForceOverride=False)
area = Area(Geometry=voronoi)  # -> Area, Centroid
extremums = MinMax(Number=area.Area)  # -> Minimum, Maximum
prox = Proximity2D(
    Points=pt_4,
    Plane=xz,
    Group=Slider(11, range=0..100),
    MinRadius=Slider(0, range=0..100),
    MaxRadius=Slider(3500, range=2..3500))  # -> Links, Topology
python_9 = GhPythonScript(area=area.Area, denominator=extremums.Maximum, x=Slider(18.62, range=0..30))  # -> r; inputs area: list
# ---------- python_9: Python ----------
print sum(area)/len(area)

def normalize(number):
    minimum = min(area)
    maximum = max(area)
    delta = maximum - minimum
    ratio = (number - minimum)/(denominator/x)
    
    rgb = ratio * 255
    return rgb

r = []

for ar in area:
    value = normalize(ar)
    r.append(value)
# ---------- end python_9 ----------
sort = SortList(Keys=area.Area)  # -> Keys, ValuesA
len = Length(Curve=prox.Links)
python_tree_to_lists_2 = PythonScript(x=len, y=Toggle(True), adjust=Slider(1, range=1..10))  # -> out, a, z, normalize; inputs x: tree
# ---------- python_tree_to_lists_2: Python ----------
if y == True:
    
    import rhinoscriptsyntax as rs
     
    import Rhino.Geometry as rg
    from clr import AddReference as addr
    addr("Grasshopper")
     
    from System import Object
    from Grasshopper import DataTree
    from Grasshopper.Kernel.Data import GH_Path
     
     
    def raggedListToDataTree(raggedList):
        rl = raggedList
        result = DataTree[object]()
        for i in range(len(rl)):
            temp = []
            for j in range(len(rl[i])):
                temp.append(rl[i][j])
            #print i, " - ",temp
            path = GH_Path(i)
            result.AddRange(temp, path)
        return result
     
    def dataTreeToList(aTree):
        theList = []
        for i in range(aTree.BranchCount ):
            thisListPart = []
            thisBranch = aTree.Branch(i)
            for j in range(len(thisBranch)):
                thisListPart.append( thisBranch[j] )
            theList.append(thisListPart)
        return theList
    
    # take gh data tree and turn it into lists of lists
    # for python, the tree in this case groups points
    # based on threshold
    
    a = dataTreeToList(x)
    # enumerate the branches, which is telling you 
    # the group number
    
    z = []
    
    
    for length in a:
        #print length
        total =  sum(length)
        z.append(total)
        
    maximum = max(z)
    normalize = [x/(maximum/adjust) for x in z]
# ---------- end python_tree_to_lists_2 ----------
mesh = MeshBrep(
    Brep=voronoi,
    Settings={GridMaxCount=0, GridMinCount=16, JaggedSeams=False, MaxEdgeLength=0, MinEdgeLength=0.0001, MinTolerance=0, Refine=True, RefineAngle=0, RelativeTolerance=0.65, SimplePlanes=True, Tolerance=0})
rgb_4 = ColourRGB(Alpha=255, Red=python_9, Green=Slider(255, range=0..255), Blue=Slider(255, range=0..255))
graph = QuickGraph(sort.Keys, SortOrder=0)
gradient = Gradient(
    LowerLimit=0,
    UpperLimit=1,
    Parameter=python_tree_to_lists_2.normalize,
    stops=[0.174: RGB(0, 128, 0), 0.314: RGB(255, 255, 0), 0.903: RGB(222, 9, 9)])
preview_2 = CustomPreview(Geometry=mesh, Material=rgb_4)
sph_5 = Sphere(Base=pt_4, Radius=Slider(6, range=0..100))
preview_3 = CustomPreview(Geometry=sph_5, Material=gradient)

# ----
panel_9 = Panel(gh_cpython_8.survey_num)

# ---- group: Reporting Data in Rhino, working on Leaders
python_10 = GhPythonScript(label=gh_cpython_8.bumper)  # -> out, a
# ---------- python_10: Python ----------
import Rhino
label = label[1:-1]
a = label.split(",")
# ---------- end python_10 ----------
fonts = FontTable()
list = ValueList({"One": 1, "Two": 2, "Three": 2² - 1, "Four": Sqrt(16), "Five": 5, "6", "7", "8", "9", "10"}, selected="9")
number_slider_3 = Slider(12, range=0..100)
pt_5 = ConstructPoint(XCoordinate=gh_cpython_8.x, YCoordinate=gh_cpython_8.y, ZCoordinate=gh_cpython_8.z)
item_2 = ListItem(List=fonts, Index=list, Wrap=True)
screentext = ScreenOrientedText(
    Text=python_10.a,
    Font=item_2,
    Justification=5,
    Location=pt_5,
    SizeFactor=number_slider_3,
    Color=RGB(3, 37, 48),
    Depth=1,
    Absolute=False)
tag = TextTag(Location=pt_5, Text=python_10.a)
leader = DefineLeader(Text=python_10.a, Points=pt_5, Plane=PlaneXY(0, 0, 0), DimensionStyle="Synch Template")
voronoi_2 = Voronoi(Points=pt_5, Radius=Slider(37, range=0..100), BruteForceOverride=False)
bake = BakeObjects(Geometry=leader, Bake=False)
textdot_bumpers = DefineTextDot(Text=python_10.a, Location=pt_5, Font="Arial", Size=number_slider_3)
textdot_numbers = DefineTextDot(Text=gh_cpython_8.survey_num, Location=pt_5, Font="Arial", Size=14)

# ----
panel_10 = Panel(python_10.a)

# ---- group: learning about point attractors for leaders
pgroups_2 = PointGroups(Points=pt_5, Distance=Slider(100, range=0..100))  # -> Groups, Indices
avr = Average(Input=pgroups_2.Groups)
neg = Negative(Value=Slider(68, range=0..100))
vec = VectorXYZ(XComponent=0, YComponent=0, ZComponent=neg)  # -> Vector, Length
move = Move(Geometry=avr, Motion=vec.Vector)  # -> flatten(Geometry), Transform
pcharge = PointCharge(Point=move.Geometry, Charge=1, Decay=2)
mergef = MergeFields(Fields=pcharge)
fline = FieldLine(Field=mergef, Point=pt_5, Steps=1000, Accuracy=0.1, Method=3)

# ---- group: Trying to improve leaders
number_slider_4 = Slider(69, range=0..100)
vec_2 = VectorXYZ(XComponent=number_slider_4, YComponent=number_slider_4, ZComponent=0)  # -> Vector, Length
start = Point(pt_5)
move_2 = Move(Geometry=start, Motion=vec_2.Vector)  # -> Geometry, Transform
vec_3 = VectorXYZ(XComponent=Slider(21, range=0..100), YComponent=0, ZComponent=0)  # -> Vector, Length
multiplication = Multiplication(A=number_slider_4, B=Slider(3, range=0..10))
middle = Point(move_2.Geometry)
end = EndPoints(Curve=fline)  # -> Start, End
vec_4 = VectorXYZ(XComponent=number_slider_4, YComponent=0, ZComponent=0)  # -> Vector, Length
vec_5 = VectorXYZ(XComponent=number_slider_4, YComponent=0, ZComponent=0)  # -> Vector, Length
move_3 = Move(Geometry=end.End, Motion=vec_3.Vector)  # -> Geometry, Transform
move_4 = Move(Geometry=middle, Motion=vec_4.Vector)  # -> Geometry, Transform
end_2 = Point(move_4.Geometry)
voronoi_3 = Voronoi(Points=middle, BruteForceOverride=False)
pcen = PolygonCenter(Polyline=voronoi_3)  # -> CenterV, CenterE, CenterA
move_5 = Move(Geometry=pcen.CenterA, Motion=vec_5.Vector)  # -> Geometry, Transform
voronoi_4 = Voronoi(Points=end_2, BruteForceOverride=False)
voronoi_5 = Voronoi(Points=start, BruteForceOverride=False)
number_slider_5 = Slider(69, range=0..100)
python_11 = GhPythonScript(
    text=python_10.a,
    start=end.Start,
    middle=pcen.CenterA,
    end=move_5.Geometry,
    bake_leaders=Button(),
    mv_rng=multiplication)  # -> out, a; inputs text: list, start: list of Point3d, middle: list of Point3d, end: list of Point3d
# ---------- python_11: Python ----------
import rhinoscriptsyntax as rs
import scriptcontext as sc
import Rhino
import random

if bake_leaders == True:
    rs.EnableRedraw(False)
    sc.doc = Rhino.RhinoDoc.ActiveDoc
    
    for i, t in enumerate(text):
        move = random.randint(mv_rng*-1,mv_rng)
        move2 = random.randint(mv_rng*-1,mv_rng)
        translation = Rhino.Geometry.Vector3d(0,0,0)
        new_mid = rs.MoveObject(middle[i], translation)
        new_end = rs.MoveObject(end[i], translation)
        pt_lst = [start[i],new_mid,new_end]
        rs.AddLeader(pt_lst,view_or_plane=Rhino.Geometry.Plane.WorldXY, text=t)

        rs.DeleteObjects([new_mid, new_end])
        print pt_lst
    #a = rs.AddLeader([start, middle, end], text=text)
    
    sc.doc = ghdoc
    rs.EnableRedraw(True)
# ---------- end python_11 ----------
item_3 = ListItem(List=voronoi_3, Index=number_slider_5, Wrap=True)
item_4 = ListItem(List=voronoi_5, Index=number_slider_5, Wrap=True)
item_5 = ListItem(List=voronoi_4, Index=number_slider_5, Wrap=True)
explode = Explode(Curve=item_4, Recursive=True)  # -> Segments, Vertices
explode_2 = Explode(Curve=item_3, Recursive=True)  # -> Segments, Vertices
explode_3 = Explode(Curve=item_5, Recursive=True)  # -> Segments, Vertices
pt_6 = Point([explode_2.Vertices, explode_3.Vertices, explode.Vertices])
hull = ConvexHull(Points=pt_6, Plane=PlaneXY(0, 0, 0))  # -> Hull, HullZ, Indices
pcen_2 = PolygonCenter(Polyline=hull.Hull)  # -> CenterV, CenterE, CenterA
item_6 = ListItem(List=voronoi_5, Index=number_slider_5, Wrap=True)
