# Grasshopper definition Area to random color studu.gh (Grasshopper 1.0.7)
# plug-ins: Human, EleFront, GH_CPython

# ---- group: name block by area
crv = Curve([<curve referenced from the Rhino model> x1265])
area = Area(Geometry=crv)  # -> Area, Centroid
python = GhPythonScript(area=area.Area, center=area.Centroid, region=crv, num=Slider(0.1119, range=0..1))  # -> out, result; inputs area: list, center: list, region: list
# ---------- python: Python ----------
import rhinoscriptsyntax as rs

def myround(x):
    return num * round(x/num)

rounded_areas = [myround(x) for x in area]
unique_areas = list(set(rounded_areas))

prefix = ["N" for x in area]

suffix = [str(unique_areas.index(x)+1) for x in rounded_areas]

result = zip(prefix, suffix)
result = ["".join(x) for x in result]
# ---------- end python ----------
textdot = DefineTextDot(Text=python.result, Location=area.Centroid, Font="Arial", Size=14)

# ----
explode = Explode(Curve=crv, Recursive=True)  # -> Segments, Vertices
bnd = Bounds2D(Coordinates=explode.Vertices)
number_slider = Slider(0.174, range=0..10)
objatts = ObjectAttributes()  # -> Name, LayerName, LayerFullPath, Color, MaterialName, LinetypeName, GroupIndices, PlotWeight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
panel = Panel(bnd)
python_2 = GhPythonScript(run=Button(), bounds=bnd)  # -> out, a, widths, heights; inputs bounds: tree
# ---------- python_2: Python ----------
import rhinoscriptsyntax as rs
 
import Rhino.Geometry as rg
from clr import AddReference as addr
addr("Grasshopper")
 
from System import Object
from Grasshopper import DataTree
from Grasshopper.Kernel.Data import GH_Path
 
 
def raggedListToDataTree(raggedList):
    rl = raggedList
    result = DataTree[object]()
    for i in range(len(rl)):
        temp = []
        for j in range(len(rl[i])):
            temp.append(rl[i][j])
        #print i, " - ",temp
        path = GH_Path(i)
        result.AddRange(temp, path)
    return result
 
def dataTreeToList(aTree):
    theList = []
    for i in range(aTree.BranchCount ):
        thisListPart = []
        thisBranch = aTree.Branch(i)
        for j in range(len(thisBranch)):
            thisListPart.append( thisBranch[j] )
        theList.append(thisListPart)
    return theList

a = dataTreeToList(bounds)
widths = []
heights = []

for bound in a:
    x_interval = bound[0].U
    y_interval = bound[0].V
    
    width = x_interval[1] - x_interval[0]
    height = y_interval[1] - y_interval[0]
    
    print width, height
    
    widths.append(width)
    heights.append(height)
# ---------- end python_2 ----------
panel_2 = Panel(objatts.Name)
multiplication = Multiplication(A=python_2.widths, B=python_2.heights)
srf = Surface(crv)
gh_cpython = GH_CPython(
    styles=python.result,
    areas=area.Area,
    points=area.Centroid,
    widths=python_2.widths,
    heights=python_2.heights,
    box_areas=multiplication)  # -> result, r, g, b, num_colors; inputs styles: list, areas: list, points: list, widths: list, heights: list, box_areas: list
#   port styles: [required] - [type = int] - [default = None] Descripe your input here * bullet point. * bullet point
#   port result: indicate your output description here. refers to a new line.
# ---------- gh_cpython: Python ----------
import pandas as pd
import random

class block():
    def __init__(self):
        self.name = None
        self.area = None
        self.point = None
        self.width = None
        self.height = None
        self.box_area = None

blocks = []

for i,s in enumerate(styles):
    b = block()
    b.name = s
    b.area = areas[i]
    b.point = points[i]
    b.width = widths[i]
    b.height = heights[i]
    b.box_area = box_areas[i]


    blocks.append(b)



df = pd.DataFrame([vars(f) for f in blocks])

unique = df.name.unique()
def rand_color(x):
    x = list(unique).index(x)
    random.seed(x)
    r,g,b = random.randint(0,255), random.randint(0,255), random.randint(0,255)
    color = r,g,b
    color = '#%02x%02x%02x' % color
    return color
df["color"] = df.name.apply(rand_color)
#black = (0,0,0)
#black = '#%02x%02x%02x' % black
#df.loc[df.area>2500, "color"] = black
#df.loc[df.area<50, "color"] = black
def hex_to_rgb(value):
    value = value.lstrip('#')
    lv = len(value)
    return tuple(int(value[i:i + lv // 3], 16) for i in range(0, lv, lv // 3))
df.color = df.color.apply(hex_to_rgb)
print(df)

result = df.color.tolist()
r = [r[0] for r in result]
g = [r[1] for r in result]
b = [r[2] for r in result]

num_colors = len(df.color.unique())

save_path = r"C:\Users\mkreidler\Desktop\Studies.xlsx"
df.to_excel(save_path)
# ---------- end gh_cpython ----------
rgb = ColourRGB(Alpha=255, Red=gh_cpython.r, Green=gh_cpython.g, Blue=gh_cpython.b)
panel_3 = Panel(gh_cpython.num_colors)
preview = CustomPreview(Geometry=srf, Material=rgb)

# ---- group: block in zone
crv_2 = Curve([<curve referenced from the Rhino model> x61])
id = Guid([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])

# ----
id_2 = Guid(crv_2)

# ---- group: block in zone (continued)
python_3 = GhPythonScript(guids=id, curves=id_2, run=Button())  # -> out, a, zone_list; inputs guids: list, curves: list
# ---------- python_3: Python ----------
import rhinoscriptsyntax as rs
import datetime
import Rhino

zone_list = []
blocks = []


class block:
    def __init__(self):
        self.name = None
        self.point = None
        self.zones = []
        self.layer = None

if run == True:
    start = datetime.datetime.now()
    for guid in guids:
        b = block()
        #Rhino.Geometry.TextDot.Point
        obj = Rhino.RhinoDoc.ActiveDoc.Objects.Find(guid)
        point = obj.Geometry.Point
        b.point = point
        b.name = obj.Geometry.Text
        
        
        
        for curve in curves:
            obj = Rhino.RhinoDoc.ActiveDoc.Objects.Find(curve)
            curve = obj.Geometry
            plane = Rhino.Geometry.Plane.WorldXY
            #Rhino.DocObjects.ObjectAttributes.Name
            tolerance = Rhino.RhinoDoc.ActiveDoc.ModelRelativeTolerance
            result = curve.Contains(point, plane, tolerance)
            #containment.append(result)
            #print result
            if str(result) == "Inside":
                print "yes"
                name = obj.Attributes.Name
                #Rhino.Geometry.PolylineCurve.GetObjectData()
                #Rhino.Geometry.PolylineCurve.
                #Rhino.DocObjects.CurveObject.Name
                #rhinoobjec.Attributes.Name
                b.zones.append(name)
            else:
                print "no"
            #print result
            #Rhino.Geometry.Curve.Contains(
        zone_list.append(str(b.zones))
        blocks.append(b)
    end = datetime.datetime.now()
    a = end - start
    
    #Rhino.Geometry.Curve.Contains(


    print a
    print "complete"

names = [b.name for b in blocks]
# ---------- end python_3 ----------
panel_4 = Panel(python_3.out)
panel_5 = Panel(python_3.a)

# ----
panel_6 = Panel(python_3.zone_list)
