# Grasshopper definition BVTC_3DModel_straightened_LineDimensionGen.gh (Grasshopper 0.9.76)
# plug-ins: Python Interpreter

python = PythonScript()  # -> Out, A
crv = Curve([<curve referenced from the Rhino model> x213])
len = Length(Curve=crv)
panel = Panel(len)
panel_2 = Panel("""1.81614034064
1.83469748967
1.92062408477
3.94252840243
24.7902014299
29.4050613435
30.0
42.3874429222
46.9999999981
59.8527515591
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""")
sort = SortList(Keys=len, ValuesA=crv)  # -> Keys, ValuesA
panel_3 = Panel(sort.Keys)
avr = Average(Input=sort.Keys)
graph = QuickGraph(sort.Keys)
panel_4 = Panel(avr)
python_2 = PythonScript(lines=sort.ValuesA, lineLengths=sort.Keys, maxLen=Slider(611, range=0..1000))  # -> out, a; inputs lines: list of Line, lineLengths: list
# ---------- python_2: Python ----------
keepers = []
for i in range(len(lines)):
    if lineLengths[i] > maxLen:
        keepers.append(lines[i])
        
        
a = keepers
# ---------- end python_2 ----------
