# Grasshopper definition BigInscribedRect2.gh (Grasshopper 0.9.76)
# plug-ins: Python Interpreter

crv = Curve(<curve referenced from the Rhino model>)
python = PythonScript(numPoints=Slider(79, range=0..100), crv=crv, topN=Slider(44, range=0..100))  # -> out, finalLines, test; inputs numPoints: Int32, crv: Curve, topN: Int32
# ---------- python: Python ----------
import rhinoscriptsyntax as rs
import itertools
import scriptcontext as sc
import Rhino
import Rhino.Geometry as rg


def getCombs(number):
    indexes = []
    for i in range(number):
        indexes.append(i)    
    combs = list(itertools.combinations(indexes,2))
    return combs

def addLines(options, ptList):
    lines = []
    for option in options:
        line = rs.AddLine(ptList[option[0]], ptList[option[1]])
        lines.append(line)
    return lines

def removeIntersectLines(lineList, curve):
    goodLines = []
    for line in lineList:
        int = rs.CurveCurveIntersection(curve, line)
        
        if len(int) == 2:
            #print "good line"
            goodLines.append(line)
        else:
            #print "delete this"
            rs.DeleteObject(line)
    return goodLines

def removeOutLines(lineList, curveBoundary):
    goodLines = []
    for line in lineList:
        
        #get midpoint
        point = rs.CurveMidPoint(line)
        
        isInside = rs.PointInPlanarClosedCurve (point, curveBoundary)
        if isInside:
            #print "line inside"
            goodLines.append(line)
        else:
            #print "line to be deleted, outside"
            rs.DeleteObject(line)
    return goodLines




###sc.doc = Rhino.RhinoDoc.ActiveDoc

#disable redraw
#rs.EnableRedraw(False)

#settings
#numPoints = 40

#get curve
#crv = rs.GetCurveObject("Click curve")[0]

#get points around curve
points = rs.DivideCurve(crv, numPoints)
combs = getCombs(numPoints)
lines = addLines(combs, points)

#check for intersections    
goodLines = removeIntersectLines(lines, crv)

#delete lines outside of shape
finalLines = []
finalLines = removeOutLines(goodLines, crv)
#print finalLines
#enable redraw
#rs.EnableRedraw(True)
###sc.doc = ghdoc
#[x for (y,x) in sorted(zip(Y,X), key=lambda pair: pair[0])] 


lengths = []
for line in finalLines:
    length = rs.CurveLength(line)
    lengths.append(length)

lnLen = zip(lengths, finalLines)
lnLen.sort()
lnLen.reverse()



sortedList = [x for y,x in lnLen[:topN]]
print sortedList
test = sortedList
# ---------- end python ----------
crv_2 = Curve(python.test)
