# Grasshopper definition BrickLayer.gh (Grasshopper 0.9.76)

number_slider = Slider(7.05, range=0..10)
number_slider_2 = Slider(7, range=0..100)
construct_domain = ConstructDomain(DomainStart=0, DomainEnd=Slider(5, range=0..100))
construct_domain_2 = ConstructDomain(DomainStart=0, DomainEnd=Slider(2, range=0..100))
division = Division(A=number_slider_2, B=2)
construct_point = ConstructPoint(XCoordinate=number_slider, YCoordinate=number_slider_2, ZCoordinate=0)
domain_box = DomainBox(Base=PlaneXY(0, 0, 0), X=construct_domain, Y=construct_domain_2, Z=construct_domain)
division_2 = Division(A=number_slider, B=2)
rectangle_2pt = Rectangle2Pt(Plane=PlaneXY(0, 0, 0), PointA=Point(0, 0, 0), PointB=construct_point, Radius=0)  # -> Rectangle, Length
number_slider_3 = Slider(8, range=0..100)
vector_xyz = VectorXYZ(XComponent=division_2, YComponent=division, ZComponent=0)  # -> Vector, Length
rectangular_array = RectangularArray(Geometry=domain_box, Cell=rectangle_2pt.Rectangle, XCount=number_slider_3, YCount=number_slider_3)  # -> Geometry, Transform
move = Move(Geometry=rectangular_array.Geometry, Motion=vector_xyz.Vector)  # -> Geometry, Transform
