# Grasshopper definition CabinetGenerator.gh (Grasshopper 0.9.76)

width = Panel("44")
height = Panel("43")
depth = Panel("13")
division = Division(A=height, B="21")
division_2 = Division(A=depth, B="7")
division_3 = Division(A=width, B="21")
brep = Brep([<brep referenced from the Rhino model> x3])
scale_nu = ScaleNU(Geometry=brep, Plane=PlaneXY(0, 0, 0), ScaleX=division_3, ScaleY=division_2, ScaleZ=division)  # -> Geometry, Transform
brep_2 = Brep(scale_nu.Geometry)
