# Grasshopper definition CurveFinder.gh (Grasshopper 0.9.76)
# plug-ins: Python Interpreter

crv = Curve(<curve referenced from the Rhino model>)
simplify = SimplifyCurve(Curve=crv, Tolerance=Slider(0.2, range=0..1), AngleTolerance=Slider(0.3, range=0..1))  # -> Curve, Simplified
crv_2 = Curve(<curve referenced from the Rhino model>)
panel = Panel(simplify.Simplified)
crv_3 = Curve(simplify.Curve)
end = EndPoints(Curve=crv_2)  # -> Start, End
python = PythonScript(input_curve=crv_2, rad=Slider(0.1, range=0..1), threshold=Slider(0.008, range=0..0.01))  # -> out, a, b3; inputs input_curve: Curve
# ---------- python: Python ----------
import rhinoscriptsyntax as rs


curve = input_curve

segments = rs.ExplodeCurves(curve)



a = []
b3 = []
def slope(a,b):
    slope = ( b[1]-a[1])/(b[0]-a[0])
    return slope

count = 0 
for seg in segments: 

    start = rs.coerce3dpoint(rs.CurveStartPoint(seg))
    end = rs.coerce3dpoint(rs.CurveEndPoint(seg))
    slope1 = slope(start,end)
    a.append(slope1)
    
    if count == len(segments)+1:
        continue
    if abs(a[count] - a[count-1])< threshold:
        circle = rs.AddCircle(start, rad)
        b3.append(circle)
    count += 1

    print count
# ---------- end python ----------
panel_2 = Panel(python.b3)
panel_3 = Panel(python.a)
