# Grasshopper definition Draw rhino boxes from pdf bluebeam csv parameters.gh (Grasshopper 1.0.7)
# plug-ins: EleFront, GH_CPython

gh_cpython = GH_CPython(input=Toggle(False))  # -> layers, x, y, z, width, height, rec_layers; inputs input: list
#   port input: [required] - [type = int] - [default = None] Descripe your input here * bullet point. * bullet point
#   port layers: indicate your output description here. refers to a new line.
# ---------- gh_cpython: Python ----------
import pandas as pd

file = r"C:\Users\mkreidler\Desktop\rectangles.xlsx"

df = pd.read_excel(file)

df["layer"] = df.page.map(str) + "::" + df.color

layers = list(df.layer.unique())

df["z"] = 0

x = df.x.tolist()
y = df.y.tolist()
z = df.z.tolist()

width = df.width.tolist()
height = df.height.tolist()

rec_layers = df.layer.tolist()
# ---------- end gh_cpython ----------
layer = DefineLayer(Name=gh_cpython.layers)
pt = ConstructPoint(XCoordinate=gh_cpython.x, YCoordinate=gh_cpython.y, ZCoordinate=gh_cpython.z)
addition = Addition(A=gh_cpython.y, B=gh_cpython.height)
addition_2 = Addition(A=gh_cpython.x, B=gh_cpython.width)
bakelayer = BakeModifyLayer(Layer=layer, Bake=False)
pt_2 = ConstructPoint(XCoordinate=addition_2, YCoordinate=addition, ZCoordinate=0)
attributes = DefineObjectAttributes(Layer=gh_cpython.rec_layers)
rec_2pt = Rectangle2Pt(Plane=PlaneXY(0, 0, 0), PointA=pt, PointB=pt_2, Radius=0)  # -> Rectangle, Length
srf = Surface(rec_2pt.Rectangle)
bake = BakeObjects(Geometry=srf, Attributes=attributes, Bake=False)
