# Grasshopper definition Find close dots or blocks based on distance.gh (Grasshopper 0.9.76)

pt = Point([<point referenced from the Rhino model> x949])
panel = Panel(pt)
pgroups = PointGroups(Points=pt, Distance=Slider(1, range=0..100))  # -> Groups, Indices
Y = UnitY(Factor=1)
cullpt = CullDuplicates(Points=pt, Tolerance=Slider(6.053, range=0..10), CullMode=3)  # -> Points, Indices, Valence
cull_i = CullIndex(List=pt, Indices=cullpt.Indices, Wrap=True)
circle = CircleCNR(Center=cull_i, Normal=Y, Radius=Slider(100, range=0..100))
circle_2 = CircleCNR(Center=cull_i, Normal=Y, Radius=Slider(8, range=0..10))
lng = ListLength(List=circle)
lng_2 = ListLength(List=circle_2)
panel_2 = Panel(lng)
panel_3 = Panel(lng_2)
