# Grasshopper definition GPS visualization.gh (Grasshopper 0.9.76)

pt_spherecen2 = Point(<point referenced from the Rhino model>)
pt_spherecen1 = Point(<point referenced from the Rhino model>)
pt_spherecen3 = Point(<point referenced from the Rhino model>)
pt_spherecen4 = Point(<point referenced from the Rhino model>)
pt_target = Point(<point referenced from the Rhino model>)
dist = Distance(PointA=pt_spherecen1, PointB=pt_target)
dist_2 = Distance(PointA=pt_spherecen4, PointB=pt_target)
dist_3 = Distance(PointA=pt_spherecen2, PointB=pt_target)
dist_4 = Distance(PointA=pt_spherecen3, PointB=pt_target)
sph = Sphere(Base=pt_spherecen2, Radius=dist_3)
sph_2 = Sphere(Base=pt_spherecen1, Radius=dist)
sph_3 = Sphere(Base=pt_spherecen4, Radius=dist_2)
sph_4 = Sphere(Base=pt_spherecen3, Radius=dist_4)
crossref = CrossReference(ListA=[sph_2, sph, sph_4, sph_3], ListB=[sph_3, sph_4, sph, sph_2], CrossMode=1)  # -> ListA, ListB
bbx = BrepBrep(BrepA=crossref.ListA, BrepB=crossref.ListB)  # -> Curves, Points
