# Grasshopper definition Geometry arrayer.gh (Grasshopper 0.9.76)

vec = VectorXYZ(XComponent=0, YComponent=Slider(3, range=0..10), ZComponent=0)  # -> Vector, Length
brep = Brep(<brep referenced from the Rhino model>)
arrlinear = LinearArray(Geometry=brep, Direction=vec.Vector, Count=Slider(32, range=0..100))  # -> Geometry, Transform
