# Grasshopper definition PanelGeneratorAviation.gh (Grasshopper 0.9.76)
# plug-ins: Python Interpreter

number_slider = Slider(7, range=0..10)
number_slider_2 = Slider(23.75, range=0..100)
crv = Curve(<curve referenced from the Rhino model>)
crv_2 = Curve(<curve referenced from the Rhino model>)
crv_3 = Curve(<curve referenced from the Rhino model>)
crv_4 = Curve(<curve referenced from the Rhino model>)
pt = Point(<point referenced from the Rhino model>)
pt_2 = Point(<point referenced from the Rhino model>)
division = Division(A=Slider(276, range=0..1000), B=Slider(12, range=0..100))
number_slider_3 = Slider(27, range=0..100)
number_slider_4 = Slider(2, range=0..10)
number_slider_5 = Slider(12, range=0..100)
divide = DivideCurve(Curve=crv_3, Count=number_slider, Kinks=False)  # -> Points, Tangents, Parameters
crv_5 = Curve(<curve referenced from the Rhino model>)
number_slider_6 = Slider(8, range=0..12)
divide_2 = DivideCurve(Curve=crv_4, Count=number_slider, Kinks=False)  # -> Points, Tangents, Parameters
pt_3 = Point(<point referenced from the Rhino model>)
division_2 = Division(A=Slider(276, range=0..1000), B=Slider(12, range=0..100))
ln = Line(StartPoint=divide_2.Points, EndPoint=divide.Points)
vec = Vector(Vector(873.502389, 0, 0))
panel = Panel(division)
crv_6 = Curve(<curve referenced from the Rhino model>)
python = PythonScript(x=pt, y=pt_2, z=pt_3)  # -> out, a; inputs x: Point3d, y: Point3d, z: Point3d
# ---------- python: Python ----------
import Rhino 
import Rhino.Geometry as rg



a = [Rhino.Geometry.Line(x,y), rg.Line(x,z)]
# ---------- end python ----------
panel_2 = Panel("sssssssskkvv")
panel_3 = Panel(division_2)
panel_4 = Panel("ssssssssssss")
panel_5 = Panel("kssssvvssssk")
python_2 = PythonScript(
    QtyStandard=number_slider_6,
    WidthStandard=Slider(20.8, range=0..100),
    QtyKnown2=number_slider_4,
    WidthKnown2=number_slider_3)  # -> out, WidthVariable, QtyVariable, WidthStandard; inputs QtyStandard: Int32, QtyKnown2: Int32
# ---------- python_2: Python ----------
###panel calculator
"""
overall = (standardWidth * standardQty) + (variableWidth * variableQty)



"""


###Constants###
WidthOverall = 276
QtyOverall = 12
#WidthStandard = 24

#solve for QtyVariable
QtyVariable = QtyOverall - QtyStandard - QtyKnown2

#solve for WidthVariable
if QtyVariable == 0:
    WidthVariable = 0
    WidthStandard = WidthOverall / 12
else:

    WidthVariable = (WidthOverall - (QtyStandard * WidthStandard) - (QtyKnown2 * WidthKnown2))/QtyVariable
    
print WidthVariable
# ---------- end python_2 ----------
python_3 = PythonScript(in_crv=crv_6, in_dist=division, in_dir=vec, in_numPan=Slider(12, range=0..100))  # -> out, a; inputs in_crv: Curve, in_dir: Vector3d, in_numPan: Int32
# ---------- python_3: Python ----------
import Rhino
import Rhino.Geometry as rg

doc = Rhino.RhinoDoc.ActiveDoc





a = []

for i in range(in_numPan):
    mvCrv = in_crv.Duplicate()
    count = i + 1
    dist = in_dist * count
    print dist
    offset = rg.Transform.Translation(dist, 0, 0)
    success = mvCrv.Transform(offset)
    newCrv = mvCrv.Duplicate()
    mvCrv = in_crv
    print success
    a.append(newCrv)
    dist = in_dist
# ---------- end python_3 ----------
crv_7 = Curve(<curve referenced from the Rhino model>)
divide_3 = DivideCurve(Curve=crv_2, Count=number_slider_5, Kinks=False)  # -> Points, Tangents, Parameters
divide_4 = DivideCurve(Curve=crv, Count=number_slider_5, Kinks=False)  # -> Points, Tangents, Parameters
vec_2 = Vector(Vector(873.502389, 0, 0))
panel_6 = Panel(python.a)
ln_2 = Line(StartPoint=divide_4.Points, EndPoint=divide_3.Points)
panel_7 = Panel(python_2.WidthVariable)
panel_8 = Panel(python_2.QtyVariable)
python_4 = PythonScript(
    in_crv=crv_7,
    in_dist=division_2,
    in_dir=vec_2,
    in_numPan=Slider(12, range=0..100),
    StdQty=number_slider_6,
    StdWid=python_2.WidthStandard,
    KnownQty=number_slider_4,
    KnownWid=number_slider_3,
    VarQty=python_2.QtyVariable,
    VarWid=python_2.WidthVariable,
    Pattern="kvssssssssvk")  # -> out, a; inputs in_crv: Curve, in_dir: Vector3d, in_numPan: Int32
# ---------- python_4: Python ----------
import Rhino
import Rhino.Geometry as rg

doc = Rhino.RhinoDoc.ActiveDoc





a = []
"""
for i in range(in_numPan):
    mvCrv = in_crv.Duplicate()
    count = i + 1
    dist = in_dist * count
    #print dist
    offset = rg.Transform.Translation(dist, 0, 0)
    success = mvCrv.Transform(offset)
    newCrv = mvCrv.Duplicate()
    mvCrv = in_crv
    #print success
    a.append(newCrv)
    dist = in_dist
"""

dist = 0


for letter in Pattern:
    mvCrv = in_crv.Duplicate()
    if letter == "s":
        dist += StdWid
    if letter == "k":
        dist += KnownWid
    if letter == "v":
        dist += VarWid
    print dist
    offset = rg.Transform.Translation(dist, 0, 0)
    mvCrv.Transform(offset)
    newCrv = mvCrv.Duplicate()
    a.append(newCrv)
# ---------- end python_4 ----------
panel_9 = Panel(python_3.a)
panel_10 = Panel(python_4.a)
python_5 = PythonScript()  # -> out, WidthVariable, QtyVariable; inputs QtyStandard: Int32, QtyKnown2: Int32; disabled
# ---------- python_5: Python ----------
###panel calculator
"""
overall = (standardWidth * standardQty) + (variableWidth * variableQty)



"""


###Constants###
WidthOverall = 276
QtyOverall = 12
#WidthStandard = 24

#solve for QtyVariable
QtyVariable = QtyOverall - QtyStandard - QtyKnown2

#solve for WidthVariable
WidthVariable = (WidthOverall - (QtyStandard * WidthStandard) - (QtyKnown2 * WidthKnown2))/QtyVariable

print WidthVariable
# ---------- end python_5 ----------
