# Grasshopper definition Parametric Shipping Aisles-Rollers.gh (Grasshopper 0.9.76)
# plug-ins: Python Interpreter

crv_rail = Curve(<curve referenced from the Rhino model>)

# ---- group: Parametric Aisles
crv_width = Curve(<curve referenced from the Rhino model>)
pt = Point(<point referenced from the Rhino model>)
crv_length = Curve(<curve referenced from the Rhino model>)
python = PythonScript(crv=crv_length, width=crv_width, rollerWidth=Slider(48, range=0..100), aisleWidth=Slider(36, range=0..100), point=pt)  # -> out, locationList, rollerCount; inputs crv: Curve, width: Curve, point: Point3d
# ---------- python: Python ----------
import rhinoscriptsyntax as rs
a = []
location = 0
locationList = []
rollerCount = 0

while location < width.GetLength():
    print width.GetLength()
    location += rollerWidth
    print location
    if location < width.GetLength():
        locationList.append(location)
        rollerCount += 1
    
    if location < width.GetLength():
        location += aisleWidth
        print location
        if location < width.GetLength():
            locationList.append(location)
# ---------- end python ----------
python_2 = PythonScript(locationList=python.locationList, crv=crv_length, point=pt)  # -> out, a; inputs locationList: list, crv: Curve, point: Point3d
# ---------- python_2: Python ----------
import rhinoscriptsyntax as rs
a = []

for loc in locationList:
    print loc
    line = rs.coercecurve(rs.OffsetCurve(crv, point, loc))
    a.append(line)
# ---------- end python_2 ----------
panel = Panel(python.rollerCount)

# ----
crv_post = Curve(<curve referenced from the Rhino model>)
len = Length(Curve=crv_rail)
division = Division(A=len, B=Slider(48, range=0..100))
arrcurve = CurveArray(Geometry=crv_post, Curve=crv_rail, Count=division)  # -> Geometry, Transform
