# Grasshopper definition ParametricExtrusion.gh (Grasshopper 0.9.76)

pt = Point(<point referenced from the Rhino model>)
pt_2 = Point(<point referenced from the Rhino model>)
brep = Brep(<brep referenced from the Rhino model>)
vec2pt = Vector2Pt(PointA=pt_2, PointB=pt, Unitize=False)  # -> Vector, Length
extr = Extrude(Base=brep, Direction=vec2pt.Vector)
brep_2 = Brep(extr)
