# Grasshopper definition ParametricPipeRailing.gh (Grasshopper 0.9.76)
# plug-ins: PTComponentLibrary

number_slider = Slider(1.5, range=0..10)
crv = Curve([<curve referenced from the Rhino model> x4])
ptdividelen = DivideLength(Curve=crv, Distance=Slider(50, range=0..100), RoundUp=False, RoundDn=False)
vec = VectorXYZ(XComponent=0, YComponent=0, ZComponent=Slider(20, range=0..100))  # -> Vector, Length
vec_2 = VectorXYZ(XComponent=0, YComponent=0, ZComponent=Slider(38, range=0..100))  # -> Vector, Length
circle = CircleCNR(Center=ptdividelen, Normal=Vector(0, 0, 1), Radius=number_slider)
pipe = Pipe(Curve=crv, Radius=number_slider, Caps=1)
move = Move(Geometry=pipe, Motion=[vec_2.Vector, vec.Vector])  # -> Geometry, Transform
extr = Extrude(Base=circle, Direction=vec_2.Vector)
cap = CapHoles(Brep=[move.Geometry, extr])
panel = Panel(cap)
