# Grasshopper definition ParametricTable.gh (Grasshopper 0.9.76)

tableoffset = Slider(7, range=0..10)
length = Slider(91, range=0..100)
height = Slider(43, range=0..100)
thickness = Slider(3, range=0..10)
width = Slider(38, range=0..100)

xy = XYPlane(Origin=Point(0, 0, 0))
vec = VectorXYZ(XComponent=0, YComponent=0, ZComponent=height)  # -> Vector, Length
rectangle = Rectangle(Plane=xy, XSize=width, YSize=length, Radius=0)  # -> Rectangle, Length
cpoly = ControlPolygon(Curve=rectangle.Rectangle)  # -> Polygon, Points
cullpt = CullDuplicates(Points=cpoly.Points, Tolerance=0.1, CullMode=3)  # -> Points, Indices, Valence
move = Move(Geometry=rectangle.Rectangle, Motion=vec.Vector)  # -> Geometry, Transform
move_2 = Move(Geometry=cullpt.Points, Motion=vec.Vector)  # -> Geometry, Transform
ln = Line(StartPoint=cullpt.Points, EndPoint=move_2.Geometry)
vec_2 = VectorXYZ(XComponent=0, YComponent=0, ZComponent=thickness)  # -> Vector, Length
pipe = Pipe(Curve=ln, Radius=Slider(2, range=0..10), Caps=0)

join = JoinCurves(Curves=move.Geometry, Preserve=False)

offset = Offset(Curve=join, Distance=tableoffset, Plane=PlaneXY(0, 0, 0), Corners=1)
extr = Extrude(Base=offset, Direction=vec_2.Vector)

cap = CapHoles(Brep=extr)
cap_2 = CapHoles(Brep=pipe)
