# Grasshopper definition Point-Block Clustering with random colors for survey.gh (Grasshopper 1.0.7)

number_slider = Slider(22, range=0..100)
id = Guid([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])
python = PythonScript(x=id)  # -> out, a; inputs x: list
# ---------- python: Python ----------
import scriptcontext as sc
import rhinoscriptsyntax as rs
import Rhino

points = []

sc.doc = Rhino.RhinoDoc.ActiveDoc

for y in x:
    pt = rs.BlockInstanceInsertPoint(y)
    points.append(pt)
    

sc.doc = ghdoc

a = points
# ---------- end python ----------
pgroups = PointGroups(Points=python.a, Distance=number_slider)  # -> simplify(Groups), Indices
item = ListItem(List=id, Index=pgroups.Indices, Wrap=True)
tstat = TreeStatistics(Tree=pgroups.Groups)  # -> Paths, Length, Count
division = Division(A=number_slider, B=2)
python_tree_to_lists = PythonScript(x=item, y=Toggle(True))  # -> out, a; inputs x: tree
# ---------- python_tree_to_lists: Python ----------
if y == True:
    
    import rhinoscriptsyntax as rs
     
    import Rhino.Geometry as rg
    from clr import AddReference as addr
    addr("Grasshopper")
     
    from System import Object
    from Grasshopper import DataTree
    from Grasshopper.Kernel.Data import GH_Path
     
     
    def raggedListToDataTree(raggedList):
        rl = raggedList
        result = DataTree[object]()
        for i in range(len(rl)):
            temp = []
            for j in range(len(rl[i])):
                temp.append(rl[i][j])
            #print i, " - ",temp
            path = GH_Path(i)
            result.AddRange(temp, path)
        return result
     
    def dataTreeToList(aTree):
        theList = []
        for i in range(aTree.BranchCount ):
            thisListPart = []
            thisBranch = aTree.Branch(i)
            for j in range(len(thisBranch)):
                thisListPart.append( thisBranch[j] )
            theList.append(thisListPart)
        return theList
    
    # take gh data tree and turn it into lists of lists
    # for python, the tree in this case groups points
    # based on threshold
    
    a = dataTreeToList(x)
    # enumerate the branches, which is telling you 
    # the group number
    
    b = []
    print "group, guid"
    for i, b in enumerate(a):
        i += 1
        for c in b:
            print "{},{}".format(i, c)
# ---------- end python_tree_to_lists ----------
random = Random(Range=Domain(0, 255), Number=tstat.Count, Seed=52)
random_2 = Random(Range=Domain(0, 255), Number=tstat.Count, Seed=785)
random_3 = Random(Range=Domain(0, 255), Number=tstat.Count, Seed=563)
viewer = ParamViewer(pgroups.Groups)
int = Integer(random)
int_2 = Integer(random_3)
int_3 = Integer(random_2)
panel = Panel(python_tree_to_lists.a)
rgb = ColourRGB(Alpha=255, Red=int, Green=int_3, Blue=int_2)  # -> graft(Colour)
sph = Sphere(Base=pgroups.Groups, Radius=division)
preview = CustomPreview(Geometry=sph, Shader=rgb)
