# Grasshopper definition PointTextFromDots.gh (Grasshopper 0.9.76)
# plug-ins: Python Interpreter, Human

objects_by_selection = ObjectsBySelection(Reset=Toggle(True))
python_script = PythonScript(dots=objects_by_selection)  # -> out, points, texts; inputs dots: list
# ---------- python_script: Python ----------
import Rhino
import Rhino.Geometry as rg

points = [x.Geometry.Point for x in dots]
texts  = [x.Geometry.Text for x in dots]
# ---------- end python_script ----------
panel = Panel(objects_by_selection)
justifiedtext3d = JustifiedText3d(
    Location=python_script.points,
    Text=python_script.texts,
    Size=Slider(76, range=0..100),
    HorizontalAlignment=1,
    VerticalAlginment=1,
    UseMeshes=False,
    Bake=False)
