# Grasshopper definition SectionBlock.gh (Grasshopper 0.9.76)

vec = VectorXYZ(XComponent=Slider(19, range=0..40), YComponent=0, ZComponent=0)  # -> Vector, Length
yz = YZPlane(Origin=Point(0, 0, 0))
mesh = Mesh(<mesh referenced from the Rhino model>)
move = Move(Geometry=yz, Motion=vec.Vector)  # -> Geometry, Transform
sec = MeshPlane(Mesh=mesh, Plane=move.Geometry)
redpline = Reduce(Polyline=sec, Tolerance=Slider(0, range=-0.9..0.9))  # -> Polyline, Reduction
