# Grasshopper definition SectionBox.gh (Grasshopper 0.9.76)
# plug-ins: Python Interpreter

layername = Panel("clippingPlane")
geo = Geometry(<brep referenced from the Rhino model>)
explode = BrepComponents(Brep=geo)  # -> Faces, Edges, Vertices
explode_2 = BrepComponents(Brep=explode.Faces)  # -> Faces, Edges, simplify(Vertices)
join = JoinCurves(Curves=explode_2.Edges, Preserve=False)
planar = PlanarSrf(Edges=join)
explode_3 = BrepComponents(Brep=planar)  # -> Faces, Edges, reverse(simplify(Vertices))
item = ListItem(List=explode_3.Vertices, Index=1, Wrap=False)
item_2 = ListItem(List=explode_3.Vertices, Index=0, Wrap=False)
item_3 = ListItem(List=explode_3.Vertices, Index=2, Wrap=False)
pt = Point(flatten(item))
pt_2 = Point(flatten(item_2))
pt_3 = Point(flatten(item_3))
python_sectionboxer = PythonScript(p1=pt_2, p2=pt, p3=pt_3, activate=Toggle(True), clippingPlaneLayer=layername)  # -> out, a; inputs p1: list of Point3d, p2: list of Point3d, p3: list of Point3d
# ---------- python_sectionboxer: Python ----------
import math
import rhinoscriptsyntax as rs
import scriptcontext as sc
import Rhino
sc.doc = Rhino.RhinoDoc.ActiveDoc

layerName=clippingPlaneLayer
if activate:
    lay=rs.CurrentLayer()
    rs.AddLayer(layerName)
    rs.CurrentLayer(layerName)
    rs.LayerVisible(layerName,True,True)
    objectlist= rs.ObjectsByLayer(layerName)
    for j in range (0,len(objectlist)):
        if rs.ObjectType(objectlist[j])==536870912:
            rs.DeleteObject(objectlist[j])
    for i in range(0, len(p1)):
        plane = rs.Command("-_ClippingPlane P " +str(p1[i])+" "+str(p2[i])+" "+str(p3[i])+" "+"_Enter")
        rs.Command("_Flip _SelLast _enter")
    if rs.CurrentLayer(lay)==rs.CurrentLayer():
        rs.CurrentLayer("Default")
    else:
        rs.CurrentLayer(lay)
    rs.LayerVisible(layerName,False,False)
# ---------- end python_sectionboxer ----------
