# Grasshopper definition Stone wall layer.gh (Grasshopper 0.9.76)
# plug-ins: Python Interpreter

pt = Point(<point referenced from the Rhino model>)
pt_2 = Point([<point referenced from the Rhino model> x34])
pt_3 = Point(<point referenced from the Rhino model>)
rec_2pt = Rectangle2Pt(Plane=PlaneXY(0, 0, 0), PointA=pt_3, PointB=pt, Radius=0)  # -> Rectangle, Length
voronoi = Voronoi(Points=pt_2, Boundary=rec_2pt.Rectangle, BruteForceOverride=False)
neg = Negative(Value=Slider(0.34, range=0..1))
panel = Panel(voronoi)
offset = Offset(Curve=voronoi, Distance=neg, Plane=PlaneXY(0, 0, 0), Corners=1)  # -> flatten(Curve)
item = ListItem(List=offset, Index=Slider(1, range=0..100), Wrap=True)
crv = Curve(item)
divide = DivideCurve(Curve=offset, Count=Slider(29, range=0..100), Kinks=False)  # -> Points, Tangents, Parameters
python = PythonScript(points=divide.Points, dist_max=Slider(0.4, range=0..1))  # -> out, r_rot, r_dist; inputs points: list of Point3d
# ---------- python: Python ----------
import rhinoscriptsyntax as rs
import Rhino 
import Rhino.Geometry as rg
import random



r_rot = []
r_dist = []


for pt in points:
    r_rot.append(random.uniform(0.0, 6.28))
    r_dist.append(random.uniform(0.0, dist_max))
# ---------- end python ----------
pt_4 = PointPolar(BasePlane=PlaneXY(0, 0, 0), XYAngle=python.r_rot, ZAngle=0, Offset=python.r_dist)
move = Move(Geometry=pt_4, Motion=divide.Points)  # -> Geometry, Transform
pline = PolyLine(Vertices=move.Geometry, Closed=True)
