# Grasshopper definition Verizon Building F4 Assembly.gh (Grasshopper 1.0.7)

crv = Curve(<curve referenced from the Rhino model>)
pipe = Pipe(Curve=crv, Radius=Slider(4.58, range=0..10), Caps=0)
pipe_2 = Pipe(Curve=crv, Radius=Slider(3.11, range=0..10), Caps=0)
