# Grasshopper definition Zone Solver -- 35 Wacker BVTC Survey 2 v3.gh (Grasshopper 1.0.7)
# plug-ins: Human, EleFront, GH_CPython

id_block_dots = Guid([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])
crv_zones = Curve([<curve referenced from the Rhino model> x38])

# ---- group: Select by Survey Scope by saved GUID
id_hatches_blocks_etc = Guid([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])
selectobjs = CSharpScript(run=Button(), ID=id_hatches_blocks_etc)  # -> out, A; inputs run: Boolean, ID: Guid
# ---------- selectobjs: C# ----------
    if(run){
      doc.Objects.Select(ID);
    }
# ---------- end selectobjs ----------

# ---- group: Select by layer or guid
geo = Geometry(<curve referenced from the Rhino model>)
id = Guid(geo)
objsbylayer = ObjectsByLayer(Layer="Default")  # -> RhinoObjects, ObjectAttributes; disabled
selectobjs_2 = CSharpScript(run=Button(), O=objsbylayer.RhinoObjects)  # -> out, A; inputs run: Boolean
# ---------- selectobjs_2: C# ----------
    if(run){
      Rhino.DocObjects.RhinoObject rhObj = O as Rhino.DocObjects.RhinoObject;
      doc.Objects.Select(rhObj.Id);
    }
# ---------- end selectobjs_2 ----------
selectobjs_3 = CSharpScript(run=Button(), ID=id)  # -> out, A; inputs run: Boolean, ID: Guid; same code as selectobjs

# ----
panel = Panel(id_block_dots)
panel_2 = Panel(crv_zones)
python = GhPythonScript(dots=id_block_dots)  # -> out, points, names, layers; inputs dots: list
# ---------- python: Python ----------
import scriptcontext as sc
import rhinoscriptsyntax as rs
import Rhino

points = []
names = []
layers = []

sc.doc = Rhino.RhinoDoc.ActiveDoc

for y in dots:
    #pt = rs.BlockInstanceInsertPoint(y)
    #pt = rs.TextObjectText(y)
    pt = rs.TextDotPoint(y)
    points.append(pt)
    #name = rs.BlockInstanceName(y)
    name = rs.TextDotText(y)
    names.append(name)
    layer = rs.ObjectLayer(y)
    layers.append(layer)
    

sc.doc = ghdoc

points
names
layers
# ---------- end python ----------
objatts = ObjectAttributes(ObjectOrAttributes=crv_zones)  # -> Name, LayerName, LayerFullPath, Color, MaterialName, LinetypeName, GroupIndices, PlotWeight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
panel_3 = Panel(objatts.Name)
panel_4 = Panel(python.layers)
panel_5 = Panel(python.names)
panel_6 = Panel(python.points)
incurve = PointInCurve(Point=python.points, Curve=crv_zones)  # -> Relationship, Point
python_2 = GhPythonScript(
    block_guid=id_block_dots,
    block_name=python.names,
    block_pt=python.points,
    block_layer=python.layers,
    zone_guid=crv_zones,
    zone_pt=crv_zones,
    zone_name=objatts.Name,
    zone_crv=crv_zones)  # -> out, a; inputs block_guid: list, block_name: list, block_pt: list, block_layer: list, zone_guid: list, zone_pt: list, zone_name: list, zone_crv: list
# ---------- python_2: Python ----------
import scriptcontext as sc
import rhinoscriptsyntax as rs
import Rhino



class block:
    
    def __init__(self):
        self.point = None
        self.layer = None
        self.name = None
        self.drop = None
        self.floor = None
        self.guid = None
        self.zones = []


class zone:
    
    def __init__(self):
        self.name = None
        self.guid = None
        self.curve = None




def point_in_zone(point, zone):
    result = True if rs.PointInPlanarClosedCurve(point, zone.curve) == 1 else False
    return result

def point_zones(point, zones):
    matches = [x.name for x in zones if point_in_zone(point, x) is True]
    #print "Point in {}".format(matches)
    return matches

def load_zones(file):
    
    with open(file, "r") as f:
        content = f.readlines()
        content = [x.strip() for x in content] 
        return content


blocks = []

for i,id in enumerate(block_guid):
    b = block()
    b.guid = id
    b.name = block_name[i]
    b.point = block_pt[i]
    b.layer = block_layer[i]
    blocks.append(b)

zones = []

for i, id in enumerate(zone_guid):
    z = zone()
    z.name = zone_name[i] 
    z.guid = id
    z.curve = zone_crv[i]
    zones.append(z)

#sc.doc = Rhino.RhinoDoc.ActiveDoc
block_zones = []

for b in blocks:
    for z in zones:
        test = rs.PointInPlanarClosedCurve(b.point, z.curve)
        if test > 0:
            #print test
            b.zones.append(z.name)
            print "{} in {}".format(b.name, z.name)
        #print b.point

#sc.doc = ghdoc

for b in blocks:
    block_zones.append(str(b.zones))


a = block_zones
# ---------- end python_2 ----------
panel_7 = Panel(incurve.Relationship)
show_report_and_barcodes = Button()
show_barcodes = Button()
generate_report_only = Button()
show_report = Button()

# ---- group: Block Adjacency Clustering
number_slider = Slider(34, range=0..100)
pgroups = PointGroups(Points=python.points, Distance=number_slider)  # -> simplify(Groups), Indices
item = ListItem(List=id_block_dots, Index=pgroups.Indices, Wrap=True)
tstat = TreeStatistics(Tree=pgroups.Groups)  # -> Paths, Length, Count
division = Division(A=number_slider, B=2)
python_tree_to_lists = PythonScript(x=item, y=Toggle(True))  # -> out, a, group, id; inputs x: tree
# ---------- python_tree_to_lists: Python ----------
if y == True:
    
    import rhinoscriptsyntax as rs
     
    import Rhino.Geometry as rg
    from clr import AddReference as addr
    addr("Grasshopper")
     
    from System import Object
    from Grasshopper import DataTree
    from Grasshopper.Kernel.Data import GH_Path
     
     
    def raggedListToDataTree(raggedList):
        rl = raggedList
        result = DataTree[object]()
        for i in range(len(rl)):
            temp = []
            for j in range(len(rl[i])):
                temp.append(rl[i][j])
            #print i, " - ",temp
            path = GH_Path(i)
            result.AddRange(temp, path)
        return result
     
    def dataTreeToList(aTree):
        theList = []
        for i in range(aTree.BranchCount ):
            thisListPart = []
            thisBranch = aTree.Branch(i)
            for j in range(len(thisBranch)):
                thisListPart.append( thisBranch[j] )
            theList.append(thisListPart)
        return theList
    
    # take gh data tree and turn it into lists of lists
    # for python, the tree in this case groups points
    # based on threshold
    
    a = dataTreeToList(x)
    # enumerate the branches, which is telling you 
    # the group number
    
    b = []
    
    group = []
    id = []
    
    print "group, guid"
    for i, b in enumerate(a):
        i += 1
        for c in b:
            print "{},{}".format(i, c)
            group.append(i)
            id.append(str(c))
# ---------- end python_tree_to_lists ----------
random = Random(Range=Domain(0, 255), Number=tstat.Count, Seed=52)
random_2 = Random(Range=Domain(0, 255), Number=tstat.Count, Seed=785)
random_3 = Random(Range=Domain(0, 255), Number=tstat.Count, Seed=563)
viewer = ParamViewer(pgroups.Groups)
int = Integer(random)
int_2 = Integer(random_3)
int_3 = Integer(random_2)
panel_8 = Panel(python_tree_to_lists.a)
rgb = ColourRGB(Alpha=255, Red=int, Green=int_3, Blue=int_2)  # -> graft(Colour)
sph = Sphere(Base=pgroups.Groups, Radius=division)
preview = CustomPreview(Geometry=sph, Shader=rgb)

# ----
gh_cpython = GH_CPython(
    block_zones=python_2.a,
    block_name=python.names,
    block_pt=python.points,
    block_layer=python.layers,
    block_guid=id_block_dots,
    group=python_tree_to_lists.group,
    id=python_tree_to_lists.id,
    report=generate_report_only,
    open_report=show_report,
    show_barcodes=show_barcodes,
    show_bc_rpt=show_report_and_barcodes,
    show_static=Toggle(True))  # -> bumper, x, y, z, survey_num, sorted_guid; inputs block_zones: list, block_name: list, block_pt: list, block_layer: list, block_guid: list, group: list, id: list, report: list, open_report: list, show_barcodes: list, show_bc_rpt: list, show_static: list
#   port block_zones: [required] - [type = int] - [default = None] Descripe your input here * bullet point. * bullet point
# ---------- gh_cpython: Python ----------
import pandas as pd
import re
import datetime
import os
from reportlab.pdfgen import canvas
import qrcode
import uuid
from natsort import natsorted, ns

class Block():
    def __init__(self):
        self.guid = None
        self.name = None
        self.point = None
        self.layer = None
        self.zones = None
        self.x = None
        self.y = None
        self.z = None
        self.floor = None
        self.swing_drop = None
        self.elevation = None
        self.priority = None
        self.phase = None
        

def find_floor(x):
    pat = r"floor\s*(\d*)"
    result = re.search(pat, str(x), flags=re.IGNORECASE)
    if result:
        return int(result.group(1))    

def find_phase(x):
    if "BASE" in x.upper():
        return 0
    else:
        pat = r"CO\s*(\d*)"
        result = re.search(pat, str(x), flags=re.IGNORECASE)
        if result:
            return int(result.group(1)) 

def find_priority(x):
    pat = r"priority\s*(\d*)"
    result = re.search(pat, str(x), flags=re.IGNORECASE)
    if result:
        return int(result.group(1))   

def find_elevation(x):
    pat = r"([a-zA-Z\s]*)\s*ELEVATION"
    result = re.search(pat, str(x), flags=re.IGNORECASE)
    if result:
        return result.group(1)

def get_drop(x):
    pat = r"drop\s*([a-z]*\d*)"
    match = re.search(pat, str(x), flags=re.IGNORECASE)

    if match:
        # print("Found Match")
        return match.group(1)
    else:
        # print("Not Found")
        return None

class Group():
    def __init__(self):
        self.group = None
        self.guid = None

#def sort_drops(x):
    #drop_sort = {   "W1":1,"W2":2,"W3":3, "W4":4, "W5":5, "W6":6, "S1":7, "S2":8, "S3":9, "S4":10
             #}
    #return drop_sort[x]



def gen_report():

    blocks = []

    for i, z in enumerate(block_zones):
        b = Block()
        b.guid = block_guid[i]
        b.name = block_name[i]
        b.point = block_pt[i]
        b.layer = block_layer[i]
        b.phase = find_phase(b.layer)
        b.zones = z
        b.x = b.point[0]
        b.y = b.point[1]
        b.z = b.point[2]
        b.floor = find_floor(str(z))
        b.elevation = find_elevation(str(z))
        b.swing_drop = get_drop(str(z))
        b.priority = find_priority(str(z))

        blocks.append(b)

    df = pd.DataFrame([vars(f) for f in blocks])

    #print(df)
    #df.to_excel(r"C:\Users\mkreidler\Desktop\test.xlsx")

    groups = []


    for i, g in enumerate(group):
        gr = Group()
        gr.group = g
        gr.guid = id[i]
        groups.append(gr)

    group_df = pd.DataFrame([vars(f) for f in groups])

    #print(group_df)

    merge = df.merge(group_df, on="guid", how="outer")

    def nat_sort(x):
        unordered = merge.swing_drop.tolist()
        reordered = natsorted(unordered,alg=ns.IGNORECASE)
        return reordered.index(x)


    merge["drop_sort"] = merge.swing_drop.apply(nat_sort)
    
    merge = merge.sort_values(["elevation", "drop_sort", "floor", "y"], ascending=[True, True, False,False])


    merge.reset_index(inplace = True, drop=True )
    merge["new_order"] = merge.index + 1

    merge["survey_name"] = merge.swing_drop +"-"+ merge.floor.map(str) +"-"+ merge.name + "[" +merge.new_order.map(str) +"]"
    bumper = merge["survey_name"].tolist()
    points = merge["point"].tolist()
    #if report == True:
    merge.to_excel(path)

    #if open_report == True:
    #merge.to_excel(path)
    #os.startfile(path)

    print(path)
    return path



###############################################################

def make_barcodes(path):

    data = pd.read_excel(path)
    stuff = data.survey_name.tolist()
    df = pd.DataFrame({'stuff': stuff})
    df["num"] = df.index + 1
    df["c"] = df.num % 3
    df.c = df.c.replace(0, 3)
    df["page"] = ((df.num + 23) // 24)
    df["r"] = (((df.num - 1) // 3) + 1) % 8
    df.r = df.r.replace(0, 8)

    # FILE LOCATIONS
    logo_path = r"C:\Users\mkreidler\Desktop\pdf print barcodes\BVTC-Logo-BLACK-horizontal.png"
    pdf_suffix = r"C:\Users\mkreidler\Desktop\pdf print barcodes\\" ##actually this is a prefix
    dt = str(datetime.datetime.now()).replace(":", "_")
    ext = ".pdf"
    pdf_path = f"{pdf_suffix}{dt}{ext}"

    # MAKE CANVAS
    c = canvas.Canvas(pdf_path)
    c.setPageSize((612, 792))
    last_page = None

    # SPLIT INTO PAGES, COLUMNS, ROWS
    for index, row in df.iterrows():
        page = row["page"]
        if page != last_page:
            if last_page == None:
                last_page = page

            else:
                c.showPage()
                last_page = page

        col = row["c"]
        _row = row["r"]
        i = row["stuff"]
        code = f"{i}"
        print(f"page {page} row {_row} column {col} info {i}")

        # DRAW QR
        def draw_qr(data, base=r"C:\Users\mkreidler\Desktop\pdf print barcodes\\"):
            # draw QR
            dt = str(datetime.datetime.now()).replace(":", "_")
            random = uuid.uuid4()
            img_path = f"{base}{dt}{random}.png" ##can't write file paths with certain characters, removing 'i' variable here

            qr = qrcode.QRCode()
            qr.add_data(data)
            img = qr.make_image().save(img_path)
            return img_path


        # DRAW 1 TAG
        def draw_tag(x_num, y_num, code):
            flip_y = {1: 8,
                      2: 7,
                      3: 6,
                      4: 5,
                      5: 4,
                      6: 3,
                      7: 2,
                      8: 1}

            y_num = flip_y[y_num]

            qr = draw_qr(code)
            x_increment = 204
            y_increment = 99

            x = x_increment * (x_num - 1)
            y = y_increment * (y_num - 1)

            c.drawString(102.5491 + x, 33.7174 + y, code)
            c.drawInlineImage(qr, 0 + x, 0 + y, width=99, height=99)
            os.remove(qr)
            c.drawInlineImage(logo_path, 102.5491 + x, 71.2396 + y, width=84.2926,
                              height=14.0488)  # replace maroon with bnw later


        draw_tag(col, _row, code)
    

    # SAVE DOCUMENT
    c.save()
    print()
    print("Done!")
    return pdf_path




#############################


def print_bumpers():

    blocks = []

    for i, z in enumerate(block_zones):
        b = Block()
        b.guid = block_guid[i]
        b.name = block_name[i]
        b.point = block_pt[i]
        b.layer = block_layer[i]
        b.phase = find_phase(b.layer)
        b.zones = z
        b.x = b.point[0]
        b.y = b.point[1]
        b.z = b.point[2]
        b.floor = find_floor(str(z))
        b.elevation = find_elevation(str(z))
        b.swing_drop = get_drop(str(z))
        b.priority = find_priority(str(z))

        blocks.append(b)

    df = pd.DataFrame([vars(f) for f in blocks])

    #print(df)
    #df.to_excel(r"C:\Users\mkreidler\Desktop\test.xlsx")

    groups = []


    for i, g in enumerate(group):
        gr = Group()
        gr.group = g
        gr.guid = id[i]
        groups.append(gr)

    group_df = pd.DataFrame([vars(f) for f in groups])
    #print(group_df)

    merge = df.merge(group_df, on="guid", how="outer")

    def nat_sort(x):
        unordered = merge.swing_drop.tolist()
        reordered = natsorted(unordered,alg=ns.IGNORECASE)
        return reordered.index(x)


    merge["drop_sort"] = merge.swing_drop.apply(nat_sort)
    
    merge = merge.sort_values(["elevation", "drop_sort", "floor", "z","x"], ascending=[True, True, False,False,True])


    merge.reset_index(inplace = True, drop=True )
    merge["new_order"] = merge.index + 1
    #print(group_df)

    #merge = df.merge(group_df, on="guid", how="outer")

    
    #merge["drop_sort"] = merge.swing_drop.apply(sort_drops)

    #merge = merge.sort_values(["elevation", "swing_drop", "floor", "y", "x", "group"], ascending=[True, True, False,False,True,True])


    #merge.reset_index(inplace = True, drop=True )
    #merge["new_order"] = merge.index + 1

    merge["survey_name"] = merge.swing_drop +"-"+ merge.floor.map(str) +"-"+ merge.name + "[" +merge.new_order.map(str) +"]"
    bumper = str(merge["survey_name"].tolist())
    survey = merge["new_order"].tolist()
    x = merge["x"].tolist()
    y = merge["y"].tolist()
    z = merge["z"].tolist()
    sorted_guid = merge["guid"].tolist()
    return bumper, x,y,z,survey, sorted_guid
    
########################################





folder = r"V:\Field Survey\Moynihan Station Phase II\Moynihan Phase II CO17 + CO19\Deliverables\Setting Reports\\"
path = folder + "ProjectReport_" + str(datetime.datetime.now()).replace(":","_") + ".xlsx"

if show_barcodes == True:
    rpt = gen_report()
    #os.startfile(rpt) ###don't show report if you press barcode button
    barcodes = make_barcodes(path)
    os.startfile(barcodes)

if open_report == True:
    rpt = gen_report()
    os.startfile(rpt) # open report after pressing button

if report == True:
    gen_report() # make report, do not open

if show_bc_rpt == True:
    rpt = gen_report()
    os.startfile(rpt) 
    barcodes = make_barcodes(path)
    os.startfile(barcodes)

if show_static == True:
    bumper = print_bumpers()[0]
    print (bumper)
    x = print_bumpers()[1]
    y = print_bumpers()[2]
    z = print_bumpers()[3]
    survey_num = print_bumpers()[4]
    sorted_guid = print_bumpers()[5]
# ---------- end gh_cpython ----------

# ---- group: Group Zooming in Survey Order
python_zoom_groups = GhPythonScript(group_lists=python_tree_to_lists.a, delay=Slider(0.1, range=0.1..1), run=Button(), sorted_guid=gh_cpython.sorted_guid)  # -> out, a; inputs group_lists: list, sorted_guid: list
# ---------- python_zoom_groups: Python ----------
import rhinoscriptsyntax as rs
import time
import scriptcontext as sc
import Rhino
import os
import System.Drawing

def capture(filePath, viewportName,scaleFactor):
    RhinoDocument = Rhino.RhinoDoc.ActiveDoc
    view = RhinoDocument.Views.Find(viewportName, False)
    vp = view.ActiveViewport
    size = System.Drawing.Size(vp.Size.Width*scaleFactor,vp.Size.Height*scaleFactor)
    capture = view.CaptureToBitmap(size)
    capture.Save(filePath);
#Command: -ViewCaptureToFile
#Save file name ( Unit=pixels  Width=1317  Height=712  Scale=1  LockAspectRatio=No  DrawGrid=No  DrawWorldAxes=No  DrawCPlaneAxes=No  ScaleDrawing=No  TransparentBackground=No  NumberOfPasses=500  Browse )


folder = r"V:\Projects\35 East Wacker\Field Work\BVTC Survey #2\Survey Images"
extension = r".png"


sc.doc = Rhino.RhinoDoc.ActiveDoc

group_lists_copy = []

for g in group_lists:
    g = [str(id).strip().lower() for id in g]
    group_lists_copy.append(g)

sorted_guid2 = [str(i).strip().lower().replace("'","") for i in sorted_guid]
area = 1

if run==True:

    for i in sorted_guid2:
        for g in group_lists_copy:
            if i in g:
                #print g
                factor = 50
                box = rs.BoundingBox(g)
                box = Rhino.Geometry.BoundingBox(box)
                box.Inflate(factor,factor,factor)
                box = box.GetCorners()
                rs.ZoomBoundingBox(box, view="Front")
                path = os.path.join(folder, str(area) + extension)
                #rs.Command("-ViewCaptureToFile {} enter".format(path))
                capture(path, "Front", 1)
                time.sleep(delay)
                for guid in g:
                    sorted_guid2.remove(guid)
                area += 1

print "complete"

print sorted_guid2[1]

sc.doc = ghdoc
# ---------- end python_zoom_groups ----------

python_zoom_groups_v2 = GhPythonScript(
    groups=python_tree_to_lists.a,
    delay=Slider(0.1, range=0.1..1),
    run=Button(),
    guids=gh_cpython.sorted_guid,
    save_pic=Toggle(False))  # -> out, a; inputs groups: list, guids: list
# ---------- python_zoom_groups_v2: Python ----------
import rhinoscriptsyntax as rs
import time
import scriptcontext as sc
import Rhino
import os
import System.Drawing


folder = r"V:\Projects\35 East Wacker\Field Work\BVTC Survey #2\Survey Images"
extension = r".png"


sc.doc = Rhino.RhinoDoc.ActiveDoc


def capture(filePath, viewportName,scaleFactor, save=False):
    if save == True:
        RhinoDocument = Rhino.RhinoDoc.ActiveDoc
        view = RhinoDocument.Views.Find(viewportName, False)
        vp = view.ActiveViewport
        size = System.Drawing.Size(vp.Size.Width*scaleFactor,vp.Size.Height*scaleFactor)
        capture = view.CaptureToBitmap(size)
        capture.Save(filePath)

if run==True:
    # clean
    
    guids = [i.replace("'","").strip() for i in guids]
    order = dict()
    
    for i, g in enumerate(guids):
        #print i+ 1, g
        order[g] = i+1
    
    
    groups2 = []
    for g in groups:
        g2 = [str(i).strip() for i in g]
        groups2.append(g2)
    
    step = []
    
    for id in guids:
        for g in groups2:
            if id in g:
                step.append(g)
    
    first_step = []
    
    for s in step:
        if s in first_step:
            pass
        else:
            first_step.append(s)
    #    for guid in s:
    #        print order[guid]
    
    area = 1
    
    for f in first_step:
        #print f
        #for guid in f:
            #print order[guid]
        factor = 50
        box = rs.BoundingBox(f)
        box = Rhino.Geometry.BoundingBox(box)
        box.Inflate(factor,factor,factor)
        box = box.GetCorners()
        rs.ZoomBoundingBox(box, view="Front")
        path = os.path.join(folder, str(area) + extension)
        capture(path, "Front", 1, save_pic)
        time.sleep(delay)
        area += 1


"""





if run==True:

    for i in sorted_guid2:
        factor = 50
        box = rs.BoundingBox([i])
        box = Rhino.Geometry.BoundingBox(box)
        box.Inflate(factor,factor,factor)
        box = box.GetCorners()
        rs.ZoomBoundingBox(box, view="Front")
        path = os.path.join(folder, str(area) + extension)
        #rs.Command("-ViewCaptureToFile {} enter".format(path))
        capture(path, "Front", 1, save_pic)
        time.sleep(delay)
        area += 1






"""

sc.doc = ghdoc

print "complete"
# ---------- end python_zoom_groups_v2 ----------

# ---- group: Reporting Data in Rhino, working on Leaders
python_3 = GhPythonScript(label=gh_cpython.bumper)  # -> out, a
# ---------- python_3: Python ----------
import Rhino
label = label[1:-1]
a = label.split(",")
# ---------- end python_3 ----------
fonts = FontTable()
list = ValueList({"One": 1, "Two": 2, "Three": 2² - 1, "Four": Sqrt(16), "Five": 5, "6", "7", "8", "9", "10"}, selected="9")
number_slider_2 = Slider(12, range=0..100)
pt = ConstructPoint(XCoordinate=gh_cpython.x, YCoordinate=gh_cpython.y, ZCoordinate=gh_cpython.z)
item_2 = ListItem(List=fonts, Index=list, Wrap=True)
screentext = ScreenOrientedText(
    Text=python_3.a,
    Font=item_2,
    Justification=5,
    Location=pt,
    SizeFactor=number_slider_2,
    Color=RGB(3, 37, 48),
    Depth=1,
    Absolute=False)
tag = TextTag(Location=pt, Text=python_3.a)
leader = DefineLeader(Text=python_3.a, Points=pt, Plane=PlaneXY(0, 0, 0), DimensionStyle="Synch Template")
voronoi = Voronoi(Points=pt, Radius=Slider(37, range=0..100), BruteForceOverride=False)
bake = BakeObjects(Geometry=leader, Bake=False)
textdot_bumpers = DefineTextDot(Text=python_3.a, Location=pt, Font="Arial", Size=number_slider_2)
textdot_numbers = DefineTextDot(Text=gh_cpython.survey_num, Location=pt, Font="Arial", Size=14)

# ----
pgroups_2 = PointGroups(Points=pt, Distance=Slider(100, range=0..100))  # -> Groups, Indices
avr = Average(Input=pgroups_2.Groups)
neg = Negative(Value=Slider(68, range=0..100))
vec = VectorXYZ(XComponent=0, YComponent=0, ZComponent=neg)  # -> Vector, Length
move = Move(Geometry=avr, Motion=vec.Vector)  # -> flatten(Geometry), Transform
pcharge = PointCharge(Point=move.Geometry, Charge=1, Decay=2)
mergef = MergeFields(Fields=pcharge)
fline = FieldLine(Field=mergef, Point=pt, Steps=1000, Accuracy=0.1, Method=3)

panel_9 = Panel(python_3.a)

# ---- group: Trying to improve leaders
number_slider_3 = Slider(69, range=0..100)
vec_2 = VectorXYZ(XComponent=number_slider_3, YComponent=number_slider_3, ZComponent=0)  # -> Vector, Length
start = Point(pt)
move_2 = Move(Geometry=start, Motion=vec_2.Vector)  # -> Geometry, Transform
vec_3 = VectorXYZ(XComponent=Slider(21, range=0..100), YComponent=0, ZComponent=0)  # -> Vector, Length
multiplication = Multiplication(A=number_slider_3, B=Slider(3, range=0..10))
middle = Point(move_2.Geometry)
end = EndPoints(Curve=fline)  # -> Start, End
vec_4 = VectorXYZ(XComponent=number_slider_3, YComponent=0, ZComponent=0)  # -> Vector, Length
vec_5 = VectorXYZ(XComponent=number_slider_3, YComponent=0, ZComponent=0)  # -> Vector, Length
move_3 = Move(Geometry=end.End, Motion=vec_3.Vector)  # -> Geometry, Transform
move_4 = Move(Geometry=middle, Motion=vec_4.Vector)  # -> Geometry, Transform
end_2 = Point(move_4.Geometry)
voronoi_2 = Voronoi(Points=middle, BruteForceOverride=False)
pcen = PolygonCenter(Polyline=voronoi_2)  # -> CenterV, CenterE, CenterA
move_5 = Move(Geometry=pcen.CenterA, Motion=vec_5.Vector)  # -> Geometry, Transform
voronoi_3 = Voronoi(Points=end_2, BruteForceOverride=False)
voronoi_4 = Voronoi(Points=start, BruteForceOverride=False)
number_slider_4 = Slider(69, range=0..100)
python_4 = GhPythonScript(text=python_3.a, start=end.Start, middle=pcen.CenterA, end=move_5.Geometry, bake_leaders=Button(), mv_rng=multiplication)  # -> out, a; inputs text: list, start: list of Point3d, middle: list of Point3d, end: list of Point3d
# ---------- python_4: Python ----------
import rhinoscriptsyntax as rs
import scriptcontext as sc
import Rhino
import random

if bake_leaders == True:
    rs.EnableRedraw(False)
    sc.doc = Rhino.RhinoDoc.ActiveDoc
    
    for i, t in enumerate(text):
        move = random.randint(mv_rng*-1,mv_rng)
        move2 = random.randint(mv_rng*-1,mv_rng)
        translation = Rhino.Geometry.Vector3d(0,0,0)
        new_mid = rs.MoveObject(middle[i], translation)
        new_end = rs.MoveObject(end[i], translation)
        pt_lst = [start[i],new_mid,new_end]
        rs.AddLeader(pt_lst,view_or_plane=Rhino.Geometry.Plane.WorldXY, text=t)

        rs.DeleteObjects([new_mid, new_end])
        print pt_lst
    #a = rs.AddLeader([start, middle, end], text=text)
    
    sc.doc = ghdoc
    rs.EnableRedraw(True)
# ---------- end python_4 ----------
item_3 = ListItem(List=voronoi_2, Index=number_slider_4, Wrap=True)
item_4 = ListItem(List=voronoi_4, Index=number_slider_4, Wrap=True)
item_5 = ListItem(List=voronoi_3, Index=number_slider_4, Wrap=True)
explode = Explode(Curve=item_4, Recursive=True)  # -> Segments, Vertices
explode_2 = Explode(Curve=item_3, Recursive=True)  # -> Segments, Vertices
explode_3 = Explode(Curve=item_5, Recursive=True)  # -> Segments, Vertices
pt_2 = Point([explode_2.Vertices, explode_3.Vertices, explode.Vertices])
hull = ConvexHull(Points=pt_2, Plane=PlaneXY(0, 0, 0))  # -> Hull, HullZ, Indices
pcen_2 = PolygonCenter(Polyline=hull.Hull)  # -> CenterV, CenterE, CenterA
item_6 = ListItem(List=voronoi_4, Index=number_slider_4, Wrap=True)
