# Grasshopper definition aligning_rectangles.gh (Grasshopper 0.9.76)

number_slider = Slider(3, range=0..10)
cluster = Cluster(x_component=number_slider, value=number_slider, x_size=Slider(30, range=0..100), y_size=Slider(37, range=0..100))  # -> line_5, geometry, line_8, i, geometry_2, line_6, i_2, line_7
curve_top = Curve(<curve referenced from the Rhino model>)
curve_bound = Curve(<curve referenced from the Rhino model>)
curve_r = Curve(<curve referenced from the Rhino model>)
curve_l = Curve(<curve referenced from the Rhino model>)
join_curves = JoinCurves(Curves=[cluster.line_5, cluster.geometry, cluster.i, cluster.line_6], Preserve=False)
join_curves_2 = JoinCurves(Curves=[cluster.line_8, cluster.geometry_2, cluster.i_2, cluster.line_7], Preserve=False)
bounding_box = BoundingBox(Content=curve_l, Plane=PlaneXY(0, 0, 0))  # -> Box, Box_2
bounding_box_2 = BoundingBox(Content=curve_top, Plane=PlaneXY(0, 0, 0))  # -> Box, Box_2
bounding_box_3 = BoundingBox(Content=curve_bound, Plane=PlaneXY(0, 0, 0))  # -> Box, Box_2
deconstruct_box = DeconstructBox(Box=bounding_box_2.Box)  # -> Plane, X, Y, Z
deconstruct_box_2 = DeconstructBox(Box=bounding_box.Box)  # -> Plane, X, Y, Z
deconstruct_box_3 = DeconstructBox(Box=bounding_box_3.Box)  # -> Plane, X, Y, Z
deconstruct_domain = DeconstructDomain(Domain=deconstruct_box.Y)  # -> Start, End
deconstruct_domain_2 = DeconstructDomain(Domain=deconstruct_box_2.X)  # -> Start, End
deconstruct_domain_3 = DeconstructDomain(Domain=deconstruct_box_3.X)  # -> Start, End
panel = Panel(deconstruct_domain_2.Start)
deconstruct_domain_4 = DeconstructDomain(Domain=deconstruct_box_3.Y)  # -> Start, End
panel_2 = Panel(deconstruct_domain_3.Start)
subtraction = Subtraction(A=deconstruct_domain_3.Start, B=deconstruct_domain_2.Start)
subtraction_2 = Subtraction(A=deconstruct_domain_4.End, B=deconstruct_domain.End)
vector_xyz = VectorXYZ(XComponent=subtraction, YComponent=0, ZComponent=0)  # -> Vector, Length
vector_xyz_2 = VectorXYZ(XComponent=0, YComponent=subtraction_2, ZComponent=0)  # -> Vector, Length
move = Move(Geometry=curve_top, Motion=vector_xyz_2.Vector)  # -> Geometry, Transform
move_2 = Move(Geometry=curve_l, Motion=vector_xyz.Vector)  # -> Geometry, Transform

# ==== cluster Cluster
x_size = ClusterInput()
y_size = ClusterInput()
rectangle = Rectangle(Plane=PlaneXY(0, 0, 0), XSize=x_size, YSize=y_size, Radius=0)  # -> Rectangle, Length
explode = Explode(Curve=rectangle.Rectangle, Recursive=True)  # -> Segments, Vertices
list_item = ListItem(List=explode.Segments, Index=Slider(3, range=0..10), Wrap=True)
list_item_2 = ListItem(List=explode.Segments, Index=Slider(1, range=0..1), Wrap=True)
i = ClusterOutput(list_item)
i_2 = ClusterOutput(list_item_2)
x_component = ClusterInput()
value = ClusterInput()
vector_xyz = VectorXYZ(XComponent=x_component, YComponent=0, ZComponent=0)  # -> Vector, Length
negative = Negative(Value=value)
vector_xyz_2 = VectorXYZ(XComponent=negative, YComponent=0, ZComponent=0)  # -> Vector, Length
move = Move(Geometry=list_item, Motion=vector_xyz.Vector)  # -> Geometry, Transform
move_2 = Move(Geometry=list_item_2, Motion=vector_xyz_2.Vector)  # -> Geometry, Transform
geometry = ClusterOutput(move.Geometry)
end_points = EndPoints(Curve=move.Geometry)  # -> Start, End
end_points_2 = EndPoints(Curve=list_item)  # -> Start, End
end_points_3 = EndPoints(Curve=list_item_2)  # -> Start, End
end_points_4 = EndPoints(Curve=move_2.Geometry)  # -> Start, End
geometry_2 = ClusterOutput(move_2.Geometry)
line = Line(StartPoint=end_points.Start, EndPoint=end_points_2.Start)
line_2 = Line(StartPoint=end_points.End, EndPoint=end_points_2.End)
line_3 = Line(StartPoint=end_points_4.End, EndPoint=end_points_3.End)
line_4 = Line(StartPoint=end_points_4.Start, EndPoint=end_points_3.Start)
line_5 = ClusterOutput(line)
line_6 = ClusterOutput(line_2)
line_7 = ClusterOutput(line_3)
line_8 = ClusterOutput(line_4)
