# Grasshopper definition area study.gh (Grasshopper 1.0.7)

crv = Curve([<curve referenced from the Rhino model> x760])
area = Area(Geometry=crv)  # -> Area, Centroid
sqr = Square(Value=Slider(7, range=0..10))
sqr_2 = Square(Value=Slider(49, range=0..100))
panel = Panel(sqr)
panel_2 = Panel(sqr_2)
python = GhPythonScript(num=Slider(1.192, range=0..50), area=area.Area, curves=crv, minimum=sqr, maximum=sqr_2)  # -> out, a, b, c, rs, gs, b2s; inputs area: list, curves: list
# ---------- python: Python ----------
import rhinoscriptsyntax as rs
import math
import random



results = []
b = []
c = []
rs = []
gs = []
b2s = []


def myround(x):
    return num * round(x/num)



for i,a in enumerate(area):
    if minimum<a<maximum:
        results.append( curves[i] )
        b.append(a)
        c.append(math.sqrt(a))
        random.seed(myround(a))
        r = random.randint(0,255)
        g = random.randint(0,255)
        b2 = random.randint(0,255)
        
        rs.append(r)
        gs.append(g)
        b2s.append(b2)

a = results
# ---------- end python ----------
rgb = ColourRGB(Alpha=255, Red=python.rs, Green=python.gs, Blue=python.b2s)
srf = Surface(python.a)
sort = SortList(Keys=python.b)  # -> Keys, ValuesA
preview = CustomPreview(Geometry=srf, Material=rgb)
graph = QuickGraph(sort.Keys, SortOrder=0)
