# Grasshopper definition area voronoi.gh (Grasshopper 1.0.7)

id_area_dots = Guid([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])
python = GhPythonScript(dots=id_area_dots)  # -> area_num, drop, floor, points; inputs dots: list
# ---------- python: Python ----------
import rhinoscriptsyntax as rs
import Rhino
import re


area_num = []
drop = []
floor = []
points = []

for d in dots:
    #print d
    obj = Rhino.RhinoDoc.ActiveDoc.Objects.Find(d)
    text = obj.Geometry.Text
    pat = r"Area\s([\d]*)\s"
    area = int(re.search(pat, text).group(1))
    pat = r"Area\s[\d]*\s([A-Z0-9]*)-([\d]*)"
    _drop = re.search(pat, text).group(1)
    _floor = re.search(pat, text).group(2)
    area_num.append(area)
    drop.append(_drop)
    floor.append(_floor)
    point = obj.Geometry.Point
    points.append(point)
# ---------- end python ----------
xy = XYPlane(Origin=Point(0, 0, 0))
id_scope = Guid([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])
voronoi = Voronoi(Points=python.points, Radius=Slider(504, range=0..1000), Plane=xy, BruteForceOverride=False)
python_2 = GhPythonScript(dots=id_scope)  # -> names, points; inputs dots: list
# ---------- python_2: Python ----------
import rhinoscriptsyntax as rs
import Rhino
import re


names = []
points = []

for d in dots:
    #print d
    obj = Rhino.RhinoDoc.ActiveDoc.Objects.Find(d)
    text = obj.Geometry.Text
    names.append(text)
    point = obj.Geometry.Point
    points.append(point)
# ---------- end python_2 ----------
