# Grasshopper definition assign priority phase to dots from excel.gh (Grasshopper 1.0.7)
# plug-ins: GH_CPython

xy = XYPlane(Origin=Point(0, 0, 0))
id_scope = Guid([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])
python = GhPythonScript(dots=id_scope)  # -> names, points, guids; inputs dots: list
# ---------- python: Python ----------
import rhinoscriptsyntax as rs
import Rhino
import re


names = []
points = []
guids = []

for d in dots:
    guids.append(str(d))
    obj = Rhino.RhinoDoc.ActiveDoc.Objects.Find(d)
    text = obj.Geometry.Text
    names.append(text)
    point = obj.Geometry.Point
    points.append(point)
# ---------- end python ----------
panel = Panel(python.guids)
voronoi = Voronoi(Points=python.points, Radius=Slider(504, range=0..1000), Plane=xy, BruteForceOverride=False)
gh_cpython = GH_CPython(input=Button(), guid=python.guids, names=python.names)  # -> output, phases, priorities, guid, statuses, names; inputs input: list, guid: list, names: list
#   port input: [required] - [type = int] - [default = None] Descripe your input here * bullet point. * bullet point
#   port output: indicate your output description here. refers to a new line.
# ---------- gh_cpython: Python ----------
import pandas as pd
import os



file = r"V:\Projects\35 East Wacker\Field Work\BVTC Survey #3\South Elevation.xlsx"

df = pd.read_excel(file, sheet_name="Raw data South")

phases = []
priorities = []
statuses = []


for g in guid:
    print(g)
    phase = df.loc[df.guid == g, "phase"].values
    if len(phase) > 0:
        phase = phase[0]
    else:   
        phase = None
    phases.append(phase)

    priority = df.loc[df.guid == g, "priority"].values
    if len(priority) > 0:
        priority = priority[0]
    else:   
        priority = None
    priorities.append(priority)

    status = df.loc[df.guid == g, "status"].values
    if len(status) > 0:
        status = status[0]
    else:   
        status = None
    statuses.append(status)
# ---------- end gh_cpython ----------
panel_2 = Panel(gh_cpython.output)
python_2 = GhPythonScript(phases=gh_cpython.phases, priorities=gh_cpython.priorities, guids=gh_cpython.guid, statuses=gh_cpython.statuses)  # -> out, a; inputs priorities: list, guids: list, statuses: list
# ---------- python_2: Python ----------
import rhinoscriptsyntax as rs
import Rhino

for g in guids:
    print g
# ---------- end python_2 ----------
