# Grasshopper definition auto quoin.gh (Grasshopper 1.0.7)

number_slider = Slider(0, range=0..100)
pt = ConstructPoint(XCoordinate=number_slider, YCoordinate=number_slider, ZCoordinate=number_slider)
python = GhPythonScript(
    start_point=pt,
    thickness=Slider(1.25, range=0..10),
    draft_angle=Slider(30, range=0..100),
    indent=Slider(0.5, range=0..1),
    max_clear=Slider(7, range=0..10),
    shelf=Toggle(True),
    L=Slider(31, range=0..100),
    H=Slider(22.625, range=0..100),
    R=Slider(15.5, range=0..100),
    bed_depth=Slider(3.75, range=0..10))  # -> out, a
# ---------- python: Python ----------
import rhinoscriptsyntax as rs
import Rhino
import Rhino.Geometry as rg
import math as m

a = []


def silhouette():
    
    # turn the dims into usable vectors for addition
    Lvec = Rhino.Geometry.Vector3d(L,0,0)
    Hvec = rg.Vector3d(0,0,H)
    Rvec = rg.Vector3d(0,R,0)
    
    # start at origin with a point
    fbl = rg.Point3d(0,0,0)
    fbr = fbl + Lvec
    ftl = fbl + Hvec 
    ftr = ftl + Lvec
    
    # add these outer points to doc
    a.append(fbl)
    a.append(fbr)
    a.append(ftr)
    a.append(ftl)
    
    # outline the overall box
    bbl = fbl + Rvec
    bbr = fbr + Rvec
    btr = ftr + Rvec
    btl = ftl + Rvec
    
    # add points to document
    a.append(bbl)
    a.append(bbr)
    a.append(btr)
    a.append(btl)
    
    
    # offset the bed depth
    BvecY = rg.Vector3d(0,bed_depth,0)
    BvecnegX = rg.Vector3d(-1*bed_depth, 0,0)
    
    mbl = fbl + BvecY
    mbr = fbr + BvecY + BvecnegX
    mtl = ftl + BvecY
    mtr = ftr + BvecY + BvecnegX
    mbb = bbr + BvecnegX 
    mbt = btr + BvecnegX
    
    a.append(mbl)
    a.append(mbr)
    a.append(mtl)
    a.append(mtr)
    a.append(mbb)
    a.append(mbt)
    
    # add front face
    a.append(rg.NurbsSurface.CreateFromPoints([fbl, fbr, ftl, ftr],2,2,2,2))
    
    # add return face
    a.append(rg.NurbsSurface.CreateFromPoints([fbr, bbr, ftr, btr],2,2,2,2))
    
    
    #rg.NurbsSurface.CreateFromPoints(

silhouette()
# ---------- end python ----------
