# Grasshopper definition auto setting tag hexagon thing.gh (Grasshopper 1.0.7)
# plug-ins: EleFront

pt = Point([<point referenced from the Rhino model> x6])
textdot = DefineTextDot(Text="TEST", Location=pt, Font="Arial", Size=14)
python = GhPythonScript(points=pt, width=Slider(3.593, range=0..10), height=Slider(2.4751, range=0..10), side=Slider(0.503, range=0..1))  # -> out, a; inputs points: list of Point3d
# ---------- python: Python ----------
import rhinoscriptsyntax as rs
import Rhino

def make_tag(point, w, h, side):
    """origin is bottom left,
    direction is counterclockwise"""
    
    hw = w/2
    hh = h/2
    
    x,y,z = point
    origin = x-hw, y-hh, z
    x,y,z = origin
    pt1 = x-side,y+hh,z
    pt2 = x,y+h,z
    pt3 = x+w,y+h,z
    pt4 = x+w+side,y+hh,z
    pt5 = x+w,y,z
    
    pt_coords = [origin, pt1, pt2, pt3, pt4, pt5, origin]
    pts = [Rhino.Geometry.Point3d(x,y,z) for x,y,z in pt_coords]
    pl = Rhino.Geometry.Polyline(pts)


    return pl

a = []

for p in points:
    tag = make_tag(p, width, height, side)
    a.append(tag)
# ---------- end python ----------
tag = TextTag3D(Location=pt, Text="TEST", Size=1, Justification=5)
srf = Surface(python.a)
crv = Curve(python.a)
