# Grasshopper definition autoMortar.gh (Grasshopper 0.9.76)
# plug-ins: Python Interpreter

pt = Point(<point referenced from the Rhino model>)
pt_2 = Point(<point referenced from the Rhino model>)
pt_3 = Point(<point referenced from the Rhino model>)
box = Box2Pt(PointA=pt_2, PointB=pt, Plane=PlaneXY(0, 0, 0))
python = PythonScript(p1=pt_3, w=Slider(15, range=0..100), h=Slider(25, range=0..100), offset=Slider(1.25, range=0..10))  # -> out, a, b; inputs p1: Point3d
# ---------- python: Python ----------
import rhinoscriptsyntax as rs
import Rhino
import Rhino.Geometry as rg

doc = Rhino.RhinoDoc.ActiveDoc



p2 = rg.Point3d(p1.X, p1.Y + h, p1.Z)
p3 = rg.Point3d(p1.X + w, p1.Y + h, p1.Z)
p4 = rg.Point3d(p1.X + w, p1.Y, p1.Z)

l1 = rg.Line(p1, p2)
l2 = rg.Line(p2, p3)
l3 = rg.Line(p3, p4)
l4 = rg.Line(p4, p1)




p5 = rg.Point3d(p1.X + offset, p1.Y + offset, p1.Z)
p6 = rg.Point3d(p1.X + offset, p2.Y - offset, p1.Z)
p7 = rg.Point3d(p3.X, p2.Y - offset, p1.Z)
p8 = rg.Point3d(p4.X, p5.Y, p1.Z)

points = [p5, p6, p7, p8]

l5 = rg.Line(p5, p6)
l6 = rg.Line(p6, p7)
l7 = rg.Line(p7, p8)
l8 = rg.Line(p8, p5)

lines = [l1, l2, l3, l4, l5, l6, l7, l8]

a = lines

b = points
# ---------- end python ----------
debox = DeconstructBox(Box=box)  # -> Plane, X, Y, Z
