# Grasshopper definition average plane from points for cutting extrusion.gh (Grasshopper 0.9.76)
# plug-ins: Python Interpreter

pt = Point([<point referenced from the Rhino model> x7])
pt_2 = Point([<point referenced from the Rhino model> x5])
python = GhPythonScript(pts=pt)  # -> out, avg_x; inputs pts: list of Point3d
# ---------- python: Python ----------
__author__ = "mkreidler"
__version__ = "2018.03.29"

import rhinoscriptsyntax as rs

x_list = []

for pt in pts:
    x, y, z = pt
    x_list.append(x)

avg_x = sum(x_list)/len(x_list)

print avg_x
# ---------- end python ----------
python_2 = GhPythonScript(pts=pt_2)  # -> out, avg_x; inputs pts: list of Point3d; same code as python
pt_3 = ConstructPoint(XCoordinate=python_2.avg_x, YCoordinate=0, ZCoordinate=0)
pt_4 = ConstructPoint(XCoordinate=python.avg_x, YCoordinate=0, ZCoordinate=0)
yz = YZPlane(Origin=pt_3)
yz_2 = YZPlane(Origin=pt_4)
planesrf = PlaneSurface(Plane=yz, XSize=Domain(-50, 50), YSize=Domain(-50, 50))
planesrf_2 = PlaneSurface(Plane=yz_2, XSize=Domain(-50, 50), YSize=Domain(-50, 50))
srf = Surface([planesrf, planesrf_2])
