# Grasshopper definition bake_into_rhino.gh (Grasshopper 0.9.61)
# plug-ins: Python Interpreter

line = Line(Line((-0.7725894925, -2.027281902, 0), (8.217201281, 3.227537284, 0)))
bake = PythonScript(line=line, color=ColourSwatch(SwatchColor=RGB(255, 179, 38)), active=Toggle(False))  # -> out, a; inputs color: Color
# ---------- bake: Python ----------
import rhinoscriptsyntax as rs
import scriptcontext
import Rhino

if active:
    
    #we create or use some geometry
    line_id = line # or rs.AddLine((0,1,2), (9,8,7))
    #(we could do all operations here...
    
    #we obtain the reference in the Rhino doc
    doc_object = rs.coercerhinoobject(line_id)
    print(type(doc_object))
    
    attributes = doc_object.Attributes
    print('the type of attributes is: ' + str(type(attributes)))
    geometry = doc_object.Geometry
    print('the type of geometry is: ' + str(type(geometry)))
    
    #we change the scriptcontext
    scriptcontext.doc = Rhino.RhinoDoc.ActiveDoc
    
    #we add both the geometry and the attributes to the Rhino doc
    rhino_line = scriptcontext.doc.Objects.Add(geometry, attributes)
    print('the Rhino doc ID is: ' + str(rhino_line))
    
    #we can for example change color in Rhino...
    rs.ObjectColor(rhino_line, color)
    
    #we put back the original Grasshopper document as default
    scriptcontext.doc = ghdoc
# ---------- end bake ----------
