# Grasshopper definition block generator.gh (Grasshopper 0.9.76)

crv_profile = Curve(<curve referenced from the Rhino model>)
crv_inside = Curve(<curve referenced from the Rhino model>)
crv_rail = Curve(<curve referenced from the Rhino model>)
crv = Curve(<curve referenced from the Rhino model>)
swp1 = Sweep1(Rail=crv, Sections=crv_inside, Miter=1)
swp1_2 = Sweep1(Rail=crv_rail, Sections=crv_profile, Miter=1)
join = BrepJoin(Breps=swp1)  # -> Breps, Closed
join_2 = BrepJoin(Breps=swp1_2)  # -> Breps, Closed
cap = CapHoles(Brep=join.Breps)
brep = Brep(<brep referenced from the Rhino model>)
brep_2 = Brep(<brep referenced from the Rhino model>)
brep_3 = Brep(<brep referenced from the Rhino model>)
cap_2 = CapHoles(Brep=join_2.Breps)
sint = SolidIntersection(BrepsA=cap, BrepsB=brep)
sint_2 = SolidIntersection(BrepsA=cap, BrepsB=brep_2)
sint_3 = SolidIntersection(BrepsA=cap, BrepsB=brep_3)
sdiff = SolidDifference(BrepsA=cap_2, BrepsB=cap)
sunion = SolidUnion(Breps=[sdiff, sint_2, sint, sint_3])
sint_4 = SolidIntersection(BrepsA=cap_2, BrepsB=sunion)
