# Grasshopper definition blockgen.gh (Grasshopper 0.9.76)
# plug-ins: Python Interpreter

number_slider = Slider(27.75, range=0..100)
w = Slider(3.63, range=0..10)
h = Slider(3, range=0..10)
l = Slider(8.692, range=0..10)
crv_basegeometry = Curve(<curve referenced from the Rhino model>)
vec = VectorXYZ(XComponent=0, YComponent=0, ZComponent=number_slider)  # -> Vector, Length
pt = Point(<point referenced from the Rhino model>)
python = PythonScript(blklen=number_slider, numwalls=Slider(3, range=0..10))  # -> out, a
# ---------- python: Python ----------
a = []

a = (blklen-3.5-(numwalls))/(numwalls+1)
print a
# ---------- end python ----------
extr = Extrude(Base=crv_basegeometry, Direction=vec.Vector)
python_2 = PythonScript(pt1=pt, w=w, l=l, h=h)  # -> out, a, pt1, pt7, plane; inputs pt1: Point3d
# ---------- python_2: Python ----------
import rhinoscriptsyntax as rs

x = pt1[0]
y = pt1[1]
z = pt1[2]


pt2 = rs.coerce3dpoint([x,y+w,z])
pt3 = rs.coerce3dpoint([x+l,y+w,z])
pt4 = rs.coerce3dpoint([x+l,y,z])
pt5 = rs.coerce3dpoint([x,y,z+h])
pt6 = rs.coerce3dpoint([x,y+w,z+h])
pt7 = rs.coerce3dpoint([x+l,y+w,z+h])
pt8 = rs.coerce3dpoint([x+l,y,z+h])

a = []
a = rs.AddPoint(pt2), rs.AddPoint(pt3), rs.AddPoint(pt4),rs.AddPoint(pt5),rs.AddPoint(pt6),rs.AddPoint(pt7),rs.AddPoint(pt8)
# ---------- end python_2 ----------
offset = Offset(Curve=crv_basegeometry, Distance=Slider(1.25, range=0..10), Plane=PlaneXY(0, 0, 0), Corners=1)
box = Box2Pt(PointA=python_2.pt1, PointB=python_2.pt7, Plane=PlaneXY(48.05172097, -68.09781161, 0))
vec_2 = VectorXYZ(XComponent=0, YComponent=0, ZComponent=python.a)  # -> Vector, Length
arrbox = BoxArray(Geometry=box, Cell=box, XCount=Slider(8, range=0..10), YCount=Slider(1, range=0..1), ZCount=Slider(10, range=0..10))  # -> Geometry, Transform
extr_2 = Extrude(Base=offset, Direction=vec_2.Vector)
cap = CapHoles(Brep=extr_2)
cap_2 = CapHoles(Brep=extr)
sdiff = SolidDifference(BrepsA=cap_2, BrepsB=cap)
crv = Curve(<curve referenced from the Rhino model>)
offset_2 = Offset(Curve=crv, Distance=Slider(1.25, range=0..10), Plane=PlaneXY(0, 0, 0), Corners=1)
vec_3 = VectorXYZ(XComponent=0, YComponent=0, ZComponent=0.5)  # -> Vector, Length
move = Move(Geometry=offset_2, Motion=vec_3.Vector)  # -> Geometry, Transform
loft_opt = LoftOptions(Closed=True, Adjust=False, Rebuild=0, Refit=0, Type=2)
offset_3 = Offset(Curve=move.Geometry, Distance=0.375, Plane=PlaneXY(0, 0, 0), Corners=1)
loft = Loft(Curves=[offset_3, offset_2], Options=loft_opt)
