# Grasshopper definition bounded_solid_fromPlanes.gh (Grasshopper 0.9.76)

point = Point(<point referenced from the Rhino model>)
xy_plane = XYPlane(Origin=Point(0, 0, 0))
yz_plane = YZPlane(Origin=point)
xy_plane_2 = XYPlane(Origin=point)
vector_xyz = VectorXYZ(XComponent=Slider(7, range=0..100), YComponent=0, ZComponent=0)  # -> Vector, Length
xz_plane = XZPlane(Origin=point)
move = Move(Geometry=yz_plane, Motion=vector_xyz.Vector)  # -> Geometry, Transform
plane_surface = PlaneSurface(Plane=xy_plane, XSize=Domain(-100, 100), YSize=Domain(-100, 100))
plane_surface_2 = PlaneSurface(Plane=xy_plane_2, XSize=Domain(-100, 100), YSize=Domain(-100, 100))
plane_surface_3 = PlaneSurface(Plane=xz_plane, XSize=Domain(-100, 100), YSize=Domain(-100, 100))
plane_surface_4 = PlaneSurface(Plane=yz_plane, XSize=Domain(-100, 100), YSize=Domain(-100, 100))
plane_surface_5 = PlaneSurface(Plane=move.Geometry, XSize=Domain(-100, 100), YSize=Domain(-100, 100))
vector_xyz_2 = VectorXYZ(XComponent=0, YComponent=Slider(38, range=0..100), ZComponent=0)  # -> Vector, Length
plane_surface_6 = PlaneSurface(Plane=xy_plane, XSize=Domain(-100, 100), YSize=Domain(-100, 100))
move_2 = Move(Geometry=xz_plane, Motion=vector_xyz_2.Vector)  # -> Geometry, Transform
plane_surface_7 = PlaneSurface(Plane=move_2.Geometry, XSize=Domain(-100, 100), YSize=Domain(-100, 100))
boundary_volume = BoundaryVolume(Boundaries=[plane_surface, plane_surface_2, plane_surface_3, plane_surface_4, plane_surface_7, plane_surface_5])
