# Grasshopper definition box drawer from excel to plot.gh (Grasshopper 1.0.7)
# plug-ins: GH_CPython

number_slider = Slider(0, range=0..100)
pt = ConstructPoint(XCoordinate=number_slider, YCoordinate=number_slider, ZCoordinate=number_slider)
gh_cpython = GH_CPython(input=Button())  # -> length, height, ret; inputs input: list
#   port input: [required] - [type = int] - [default = None] Descripe your input here * bullet point. * bullet point
#   port length: indicate your output description here. refers to a new line.
# ---------- gh_cpython: Python ----------
import pandas as pd

file = r"C:\Users\mkreidler\Desktop\FCCH LENGTH HEIGHT RETURN.xlsx"
df = pd.read_excel(file)

print(df)

length = df.Length.tolist()
height = df.Height.tolist()
ret = df.Return.tolist()
# ---------- end gh_cpython ----------
pt_2 = ConstructPoint(XCoordinate=gh_cpython.length, YCoordinate=gh_cpython.ret, ZCoordinate=gh_cpython.height)
number_slider_2 = Slider(0.25, range=0..1)
box = Box2Pt(PointA=pt, PointB=pt_2, Plane=PlaneXY(0, 0, 0))
path = DataPath("{0;2}")
pgroups = PointGroups(Points=pt_2, Distance=Slider(0.125, range=0..1))  # -> Groups, Indices
sph = Sphere(Base=pt_2, Radius=number_slider_2)
branch = TreeBranch(Tree=pgroups.Indices, Path=path, MaintainPaths=True)
item = ListItem(List=box, Index=branch, Wrap=True)
panel = Panel(pgroups.Groups)
avr = Average(Input=pgroups.Groups)
panel_2 = Panel(avr)
sph_2 = Sphere(Base=avr, Radius=number_slider_2)
