# Grasshopper definition box.gh (Grasshopper 0.9.76)

vector_xyz = VectorXYZ(XComponent=Slider(14, range=0..100), YComponent=Slider(7, range=0..10), ZComponent=Slider(12, range=0..100))  # -> Vector, Length
point = Point(<point referenced from the Rhino model>)
curve = Curve(<curve referenced from the Rhino model>)
move = Move(Geometry=point, Motion=vector_xyz.Vector)  # -> Geometry, Transform
divide_curve = DivideCurve(Curve=curve, Count=Slider(4, range=0..10), Kinks=False)  # -> Points, Tangents, Parameters
brep = Brep(<brep referenced from the Rhino model>)
box_2pt = Box2Pt(PointA=point, PointB=move.Geometry, Plane=PlaneXY(0, 0, 0))
point_2 = Point(<point referenced from the Rhino model>)
brep_edges = BrepEdges(Brep=box_2pt)  # -> Naked, Interior, NonManifold
vector_2pt = Vector2Pt(PointA=point_2, PointB=divide_curve.Points, Unitize=False)  # -> Vector, Length
curve_2 = Curve(brep_edges.Interior)
move_2 = Move(Geometry=brep, Motion=vector_2pt.Vector)  # -> Geometry, Transform
pipe = Pipe(Curve=brep_edges.Interior, Radius=Slider(0.24, range=0..1), Caps=1)
