# Grasshopper definition cloud maker from points and circles.gh (Grasshopper 1.0.7)

# ---- group: Cloud Maker
number_slider = Slider(17, range=0..100)
pt = Point([<point referenced from the Rhino model> x1456])
voronoi = Voronoi(Points=pt, Radius=number_slider, BruteForceOverride=False)
python = GhPythonScript(curves=voronoi)  # -> out, lines, arcs, circles; inputs curves: list of Curve
# ---------- python: Python ----------
import rhinoscriptsyntax as rs
import Rhino

arcs = []
lines = []
circles = []

for c in curves:
    if c.IsCircle():
        print "circle"
        circles.append(c)
    else:
        parts = c.Explode()
        for p in parts:
            if type(p) == Rhino.Geometry.LineCurve:
                print "line"
                line = p
                lines.append(line)
            if type(p) == Rhino.Geometry.ArcCurve:
                print "arc"
                arc = p
                arcs.append(p)
    

#Rhino.Geometry.PolyCurve.IsCircle
#Rhino.Geometry.PolyCurve.Explode()
# ---------- end python ----------
crv = Curve(python.arcs)
join = JoinCurves(Curves=crv, Preserve=False)
python_2 = GhPythonScript(radius=number_slider, curves=join)  # -> out, arcs; inputs curves: list of Curve
# ---------- python_2: Python ----------
import rhinoscriptsyntax as rs
import math as m
import Rhino 


circle = 2*m.pi*radius
print circle

arcs = []

for c in curves:
    length = c.GetLength()
    if length < circle:
        print "Too small"
    else:
        arcs.append(c)
# ---------- end python_2 ----------
crv_2 = Curve([python_2.arcs, python.circles])
