# Grasshopper definition compare dots by proximity and layer -- bid vs. style 35 wacker -- ckd tree closest neighbor and scipy.gh (Grasshopper 1.0.7)
# plug-ins: Human, GH_CPython

xy = XYPlane(Origin=Point(0, 0, 0))
id_all_dots = Guid([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])
button = Button()
python = GhPythonScript(guids=id_all_dots, run=Toggle(True))  # -> out, points, texts, objs; inputs guids: list
# ---------- python: Python ----------
import rhinoscriptsyntax as rs
import datetime
import Rhino


points = []
texts = []
objs = []

if run == True:
    for guid in guids:
        #Rhino.Geometry.TextDot.Point
        obj = Rhino.RhinoDoc.ActiveDoc.Objects.Find(guid)
        point = obj.Geometry.Point
        name = obj.Geometry.Text
        points.append(point)
        texts.append(name)
        objs.append(obj)
# ---------- end python ----------
objatts = ObjectAttributes(ObjectOrAttributes=python.objs)  # -> Name, LayerName, LayerFullPath, Color, MaterialName, LinetypeName, GroupIndices, PlotWeight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
panel = Panel(python.texts)
panel_2 = Panel(python.points)
gh_cpython = GH_CPython(points=python.points, guids=id_all_dots, names=python.texts, layers=objatts.LayerName)  # -> output; inputs points: list, guids: list, names: list, layers: list
#   port points: [required] - [type = int] - [default = None] Descripe your input here * bullet point. * bullet point
#   port output: indicate your output description here. refers to a new line.
# ---------- gh_cpython: Python ----------
import numpy as np
from scipy import spatial
import pandas as pd


class Block:
    def __init__(self):
        self.guid = None
        self.point = None
        self.order = None
        self.name = None
        self.layer = None

blocks = []

for i,guid in enumerate(guids):
    b = Block()
    b.guid = guid
    b.point = points[i]
    b.x = b.point[0]
    b.y = b.point[1]
    b.z = b.point[2]
    b.order = i
    b.name = names[i]
    b.layer = layers[i]
    blocks.append(b)
    

df = pd.DataFrame([vars(x) for x in blocks])

coords = [[x,y] for x,y,z in df.point.tolist()]
indices = [i for i in df.order.tolist()]


#Create some coordinates and indices
#It is assumed that the coordinates are unique (only one entry per hydrant)
#Coords=np.random.rand(1000*2).reshape(1000,2)
#Coords*=100
#Indices=np.arange(1000) #Indices 

def get_indices_of_nearest_neighbours(Coords,Indices):
  tree=spatial.cKDTree(Coords)
  #k=4 because the first entry is the nearest neighbour 
  # of a point with itself
  res=tree.query(Coords, k=2)[1][:,1:]
  return res

#result = get_indices_of_nearest_neighbours(coords, indices)

def get_pairs(coords, radius):
    tree = spatial.cKDTree(coords)
    result = tree.query_pairs(radius)
    return result

result = get_pairs(coords, 4)


class Match:
    def __init__(self):
        self.kramer = None
        self.bid = None
        self.distance = None
        self.k_id = None
        self.b_id = None

matches = []
for r in result:
    first = r[0]
    second = r[1]
    fl = df.loc[df["order"]==first, "layer"].values[0]
    sl = df.loc[df["order"]==second, "layer"].values[0]
    fg = df.loc[df["order"]==first, "guid"].values[0]
    sg = df.loc[df["order"]==second, "guid"].values[0]
    a = df.loc[df["order"]==first, "point"].values[0]
    b = df.loc[df["order"]==second, "point"].values[0]
    fn = df.loc[df["order"]==first, "name"].values[0]
    sn = df.loc[df["order"]==second, "name"].values[0]

    layers = [fl, sl]
    guids = [fg, sg]
    distance = spatial.distance.euclidean(a,b)

    if ("Kramer" in layers) and ("Bid" in layers):
        m = Match()
        if fl == "Kramer":
            m.k_id = fg
            m.b_id = sg
            m.kramer = fn
            m.bid = sn
        else:
            m.k_id = sg
            m.b_id = fg
            m.kramer = sn
            m.bid = fn
        m.distance = distance
        matches.append(m)


data = pd.DataFrame([vars(m) for m in matches])
save = r"C:\Users\mkreidler\Desktop\Test Setting Folder\kramerVbid.xlsx"
data.to_excel(save)
# ---------- end gh_cpython ----------
prox = Proximity2D(
    Points=python.points,
    Plane=xy,
    Group=Slider(1, range=0..1),
    MinRadius=Slider(0, range=0..100),
    MaxRadius=Slider(4, range=0..10))  # -> Links, Topology
item = ListItem(List=id_all_dots, Index=prox.Topology, Wrap=True)
panel_3 = Panel(prox.Links)
python_2 = GhPythonScript(links=item)  # -> out, a; inputs links: tree
# ---------- python_2: Python ----------
import rhinoscriptsyntax as rs

print links
# ---------- end python_2 ----------
