# Grasshopper definition curve.contains point.gh (Grasshopper 1.0.7)

crv = Curve([<curve referenced from the Rhino model> x34])
id = Guid([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])
python = GhPythonScript(guids=id, curves=crv, run=Button())  # -> out, a; inputs guids: list, curves: list of Curve
# ---------- python: Python ----------
import rhinoscriptsyntax as rs
import datetime
import Rhino

if True == True:
    start = datetime.datetime.now()
    for guid in guids:
        Rhino.Geometry.TextDot.Point
        obj = Rhino.RhinoDoc.ActiveDoc.Objects.Find(guid)
        point = obj.Geometry.Point
        
        for curve in curves:
            plane = Rhino.Geometry.Plane.WorldXY
            tolerance = Rhino.RhinoDoc.ActiveDoc.ModelRelativeTolerance
            result = curve.Contains(point, plane, tolerance)
            #print result
            #Rhino.Geometry.Curve.Contains(
    end = datetime.datetime.now()
    a = end - start


    print a
# ---------- end python ----------
panel = Panel(python.out)
panel_2 = Panel(python.a)
