# Grasshopper definition curveFromFlatTilesCalculator (2).gh (Grasshopper 0.9.76)
# plug-ins: Python Interpreter

number_slider = Slider(48, range=0..100)
number_slider_2 = Slider(1, range=0..10)
blockwidth = Slider(12, range=0..100)
crv_arc = Curve(<curve referenced from the Rhino model>)

python_geometrycalc = PythonScript(arc=crv_arc, width=blockwidth, length=number_slider, space=number_slider_2)  # -> out, result; inputs arc: Curve
# ---------- python_geometrycalc: Python ----------
import math

#define variables
R = arc.Radius   #constant
L = length      #input
W = width      #constant
S = space       #can be input


#solve for A
A = math.asin((.5*L)/R)

#solve for C
C = math.asin((.5*S)/R)

#Solve for E
E = math.radians(90) - A - C

#Solve for X
X = math.cos(E)*W


#Get Result
result = S - (2 * X)
print result
# ---------- end python_geometrycalc ----------

python = PythonScript(arc=crv_arc, BlockLength=number_slider, MortarSpacing=number_slider_2, BlockWidth=blockwidth)  # -> out, lines, center, deviation, blockQty; inputs arc: Curve
# ---------- python: Python ----------
import rhinoscriptsyntax as rs
import math

#get arc center
center = rs.coerce3dpoint(rs.ArcCenterPoint(arc))

#get arc len
arcLen = rs.CurveLength(arc)
arcLength = arcLen

#see how many blocks fit
block = BlockLength + MortarSpacing

#get arc radius
radius = rs.ArcRadius(arc)

blockQty = arcLen/block
wholeBlocks = int(blockQty)
remainder = blockQty % wholeBlocks
leftover = blockQty - wholeBlocks


#get deviation
longleg = math.sqrt(radius**2 - (BlockLength/2)**2)
deviation = radius - longleg
print deviation

def addBlockLines(arc, arcLen, block, space):
    dist = space #start is 0, first block after space
    points = []
    lines = []
    while dist < arcLen:
        ###start point
        st = arc.PointAt(dist)
        start = rs.AddPoint(st)
        points.append(start)
        dist += block
        if dist >= arcLen: break
        
        ###end point
        ed = arc.PointAt(dist)
        end = rs.AddPoint(ed)
        points.append(end)
        dist += space
        
        ###create line
        if start and end:
            line = rs.AddLine(start, end)
            lines.append(line)
    return lines  ##return points if you want

lines = addBlockLines(arc, arcLen, BlockLength, MortarSpacing)
# ---------- end python ----------
python_2 = PythonScript(arc=crv_arc)  # -> out, result; inputs arc: Curve
# ---------- python_2: Python ----------
length = arc.GetLength()
result = str(length)
print result
# ---------- end python_2 ----------
python_offset = PythonScript(curve=python.lines, distance=blockwidth, center=python.center)  # -> out, flatten(a)
# ---------- python_offset: Python ----------
import rhinoscriptsyntax as rs

a = rs.OffsetCurve(curve, center, distance)
# ---------- end python_offset ----------
python_3 = PythonScript(lines=python_offset.a)  # -> out, distance; inputs lines: list of Curve
# ---------- python_3: Python ----------
import rhinoscriptsyntax as rs

a = rs.CurveEndPoint(lines[0])
b = rs.CurveStartPoint(lines[1])

distance = rs.Distance(a, b)
print distance
# ---------- end python_3 ----------
end = EndPoints(Curve=python.lines)  # -> Start, End
end_2 = EndPoints(Curve=python_offset.a)  # -> Start, End
ln = Line(StartPoint=end.Start, EndPoint=end_2.Start)
ln_2 = Line(StartPoint=end.End, EndPoint=end_2.End)

distance_between_blocks_calculated = Panel(python_geometrycalc.result)

deviation = Panel(python.deviation)
block_quantity = Panel(python.blockQty)
arc_length = Panel(python_2.result)
distance_between_blocks = Panel(python_3.distance)

join = JoinCurves(Curves=[python_offset.a, ln_2, ln, python.lines], Preserve=False)  # -> flatten(Curves)
