# Grasshopper definition curveFromFlatTilesCalculator.gh (Grasshopper 0.9.76)
# plug-ins: Python Interpreter

crv = Curve(<curve referenced from the Rhino model>)
python_getarccenter = PythonScript(arc=crv)  # -> out, a; inputs arc: Curve
# ---------- python_getarccenter: Python ----------
import rhinoscriptsyntax as rs


a = rs.ArcCenterPoint(arc)
# ---------- end python_getarccenter ----------
python_getarclength = PythonScript(arc=crv, chord=Slider(12, range=0..12))  # -> out, arcLen; inputs arc: Curve
# ---------- python_getarclength: Python ----------
import math
import rhinoscriptsyntax as rs

radius = rs.ArcRadius(arc)
print radius

###calculate arc length
def getAngle(radius, chord, degree=True):
    leg = .5 * chord
    theta = math.asin(leg/radius)
    if degree:
        theta = radToDegree(theta)
    return theta * 2

def circumference(radius):
    circumference = 2 * math.pi * radius
    return circumference


def radToDegree(radian):
    degree = (radian *180)/math.pi
    return degree

def getArcLength(radius, chord):
    angle = getAngle(radius, chord)
    circum = circumference(radius)
    ratioOfCircle = angle/360
    arcLength = ratioOfCircle * circum
    return arcLength




arcLen = getArcLength(radius, chord)
print arcLen
# ---------- end python_getarclength ----------
divide = DivideCurve(Curve=crv, Count=Slider(64, range=0..100), Kinks=False)  # -> Points, Tangents, Parameters
python_arccenter = PythonScript(curve=crv)  # -> out, center; inputs curve: Curve
# ---------- python_arccenter: Python ----------
import rhinoscriptsyntax as rs

center = rs.coerce3dpoint(rs.ArcCenterPoint(curve))
# ---------- end python_arccenter ----------
panel = Panel(python_getarclength.arcLen)
python_lines = PythonScript(points=divide.Points)  # -> out, lines; inputs points: list of Point3d
# ---------- python_lines: Python ----------
import rhinoscriptsyntax as rs

lines = []

count = 0 
for num in range(len(points)-1):
    line = rs.AddLine(points[count], points[count + 1])
    lines.append(line)
    count += 1
# ---------- end python_lines ----------

number_slider = Slider(46, range=0..100)
number_slider_2 = Slider(1, range=0..10)
blockwidth = Slider(12, range=0..100)
crv_arc = Curve(<curve referenced from the Rhino model>)

arrpolar = PolarArray(Plane=PlaneXY(0, 0, 0), Count=Slider(7, range=0..10), Angle=6.283185307)  # -> Geometry, Transform
python_offset = PythonScript(curve=python_lines.lines, dir=python_arccenter.center, dist=Slider(12, range=0..100))  # -> out, flatten(offset); inputs curve: Curve
# ---------- python_offset: Python ----------
import rhinoscriptsyntax as rs



offset = rs.OffsetCurve(curve, dir, dist)
# ---------- end python_offset ----------
python_geometrycalc = PythonScript(arc=crv_arc, width=blockwidth, length=number_slider, space=number_slider_2)  # -> out, result; inputs arc: Curve
# ---------- python_geometrycalc: Python ----------
import math

#define variables
R = arc.Radius   #constant
L = length      #input
W = width      #constant
S = space       #can be input


#solve for A
A = math.asin((.5*L)/R)

#solve for C
C = math.asin((.5*S)/R)

#Solve for E
E = math.radians(90) - A - C

#Solve for X
X = math.cos(E)*W


#Get Result
result = S - (2 * X)
print result
# ---------- end python_geometrycalc ----------

python = PythonScript(arc=crv_arc, BlockLength=number_slider, MortarSpacing=number_slider_2, BlockWidth=blockwidth)  # -> out, lines, center, deviation, blockQty; inputs arc: Curve
# ---------- python: Python ----------
import rhinoscriptsyntax as rs
import math

#get arc center
center = rs.coerce3dpoint(rs.ArcCenterPoint(arc))

#get arc len
arcLen = rs.CurveLength(arc)
arcLength = arcLen

#see how many blocks fit
block = BlockLength + MortarSpacing

#get arc radius
radius = rs.ArcRadius(arc)

blockQty = arcLen/block
wholeBlocks = int(blockQty)
remainder = blockQty % wholeBlocks
leftover = blockQty - wholeBlocks


#get deviation
longleg = math.sqrt(radius**2 - (BlockLength/2)**2)
deviation = radius - longleg
print deviation

def addBlockLines(arc, arcLen, block, space):
    dist = space #start is 0, first block after space
    points = []
    lines = []
    while dist < arcLen:
        ###start point
        st = arc.PointAt(dist)
        start = rs.AddPoint(st)
        points.append(start)
        dist += block
        if dist >= arcLen: break
        
        ###end point
        ed = arc.PointAt(dist)
        end = rs.AddPoint(ed)
        points.append(end)
        dist += space
        
        ###create line
        if start and end:
            line = rs.AddLine(start, end)
            lines.append(line)
    return lines  ##return points if you want

lines = addBlockLines(arc, arcLen, BlockLength, MortarSpacing)
# ---------- end python ----------
python_2 = PythonScript(arc=crv_arc)  # -> out, result; inputs arc: Curve
# ---------- python_2: Python ----------
length = arc.GetLength()
result = str(length)
print result
# ---------- end python_2 ----------
python_offset_2 = PythonScript(curve=python.lines, distance=blockwidth, center=python.center)  # -> out, flatten(a)
# ---------- python_offset_2: Python ----------
import rhinoscriptsyntax as rs

a = rs.OffsetCurve(curve, center, distance)
# ---------- end python_offset_2 ----------
python_3 = PythonScript(lines=python_offset_2.a)  # -> out, distance; inputs lines: list of Curve
# ---------- python_3: Python ----------
import rhinoscriptsyntax as rs

a = rs.CurveEndPoint(lines[0])
b = rs.CurveStartPoint(lines[1])

distance = rs.Distance(a, b)
print distance
# ---------- end python_3 ----------
end = EndPoints(Curve=python.lines)  # -> Start, End
end_2 = EndPoints(Curve=python_offset_2.a)  # -> Start, End
ln = Line(StartPoint=end.Start, EndPoint=end_2.Start)
ln_2 = Line(StartPoint=end.End, EndPoint=end_2.End)

python_4 = PythonScript(line=python_lines.lines, offset=python_offset.offset)  # -> out, result, flatten(box)
# ---------- python_4: Python ----------
import rhinoscriptsyntax as rs


a_start = rs.CurveStartPoint(line)
b_start = rs.CurveEndPoint(line)

a_end = rs.CurveStartPoint(offset)
b_end = rs.CurveEndPoint(offset)


a = rs.AddLine(a_start, a_end)
b = rs.AddLine(b_start, b_end)

result = [a,b]


curves = [line, offset, a, b]
box = rs.JoinCurves(curves)
# ---------- end python_4 ----------
distance_between_blocks_calculated = Panel(python_geometrycalc.result)

deviation = Panel(python.deviation)
block_quantity = Panel(python.blockQty)
arc_length = Panel(python_2.result)
distance_between_blocks = Panel(python_3.distance)

crv_2 = Curve(python_4.box)
dom = ConstructDomain(DomainStart=Slider(5, range=0..10), DomainEnd=Slider(60, range=0..100))
join = JoinCurves(Curves=[python_offset_2.a, ln_2, ln, python.lines], Preserve=False)  # -> flatten(Curves)
