# Grasshopper definition customcomponent.gh (Grasshopper 0.9.76)

number_slider = Slider(10, range=0..100)
surface = Surface(<surface referenced from the Rhino model>)
divide_domain² = DivideDomain²(Domain=surface, UCount=number_slider, VCount=number_slider)
isotrim = Isotrim(Surface=surface, Domain=divide_domain²)
deconstruct_brep = DeconstructBrep(Brep=isotrim)  # -> Faces, Edges, Vertices
value_list = ValueList({"Zero": 0, "One": 1, "Two": 2, "Three": 3}, selected="Zero")
value_list_2 = ValueList({"Zero": 0, "One": 1, "Two": 2, "Three": 3}, selected="Zero")
value_list_3 = ValueList({"Zero": 0, "One": 1, "Two": 2, "Three": 3}, selected="Zero")
value_list_4 = ValueList({"Zero": 0, "One": 1, "Two": 2, "Three": 3}, selected="Zero")
