# Grasshopper definition cylinder_from_tangent_circle.gh (Grasshopper 0.9.76)
# plug-ins: Human

number_slider = Slider(250, range=0..1000)
pln = Plane(Plane(origin=(-0.724192048, 1.169179074, -0.9979637376), x=(0.9999652285, -0.007935952002, 0.002561743295), y=(-0.008339176391, -0.9516138866, 0.3071831197)))
deplane = DeconstructPlane(Plane=pln)  # -> Origin, XAxis, YAxis, ZAxis
neg = Negative(Value=number_slider)
multiplication = Multiplication(A=deplane.ZAxis, B=Slider(12, range=0..100))
cir = Circle(Plane=pln, Radius=number_slider)
multiplication_2 = Multiplication(A=neg, B=deplane.YAxis)
addition = Addition(A=multiplication_2, B=multiplication)
neg_2 = Negative(Value=deplane.ZAxis)
move = Move(Geometry=cir, Motion=addition)  # -> Geometry, Transform
multiplication_3 = Multiplication(A=neg_2, B=Slider(45, range=0..100))
extr = Extrude(Base=move.Geometry, Direction=multiplication_3)
bake = BakeGeometry(Bake=Button(), Geometry=extr)
