# Grasshopper definition datatreecurves.gh (Grasshopper 0.9.76)

line = Line([Line((-15, 12, 0), (-6, -12, 0)), Line((-2, -5, 0), (-8, 24, 0)), Line((-1, 28, 0), (2, -5, 0)), Line((6, 14, 0), (6, -8, 0))])
divide = DivideCurve(Curve=line, Count=10, Kinks=False)  # -> Points, Tangents, Parameters
line_2 = LineSDL(Start=divide.Points, Direction=Vector(0, 0, 1), Length=1)
divide_2 = DivideCurve(Curve=line_2, Count=10, Kinks=False)  # -> Points, Tangents, Parameters
circle = Circle([{Plane=Plane(origin=(20, 31, 0), x=(0.7682212796, -0.6401843997, 0), y=(0.6401843997, 0.7682212796, 0)), Radius=15.62049935}, {Plane=Plane(origin=(55, 19, 0), x=(0.8320502943, -0.5547001962, 0), y=(0.5547001962, 0.8320502943, 0)), Radius=7.211102551}, {Plane=Plane(origin=(53, 35, 0), x=(0.8, -0.6, 0), y=(0.6, 0.8, 0)), Radius=5}])
viewer = ParamViewer(divide_2.Points)
vb = VBScript(DT=divide_2.Points, C=circle)  # -> out, diagram; inputs DT: tree
# ---------- vb: VB ----------
    If (DT Is Nothing) Then Return
    If (DT.BranchCount = 0) Then Return

    Dim builder As New Grasshopper.Kernel.Data.GH_TreeBuilder()
    For Each path As GH_Path In DT.Paths
      builder.AddPathRecursive(path)
    Next

    Dim allpaths As List(Of GH_Path) = builder.AllPaths
    If (allpaths Is Nothing) OrElse (allpaths.Count = 0) Then Return

    Dim args As New GH_GraphicTreeDisplayArgs()
    args.radius = C.Radius
    args.origin = New PointF(Convert.ToSingle(C.Center.X), Convert.ToSingle(C.Center.Y))

    Dim tree As New GH_GraphicBranch()
    tree.GrowTree(allpaths)
    tree.SolveLeafAngles(tree_angle, tree_spread, leaf_angle, args)
    tree.Distribute_Phylogenetic(1.0 / args.maxPathLength)

    Dim curves As New List(Of Curve)
    AppendTreeToDiagram(tree, args, curves)
    diagram = curves
# ---------- vb: VB additional code ----------
  Private Shared tree_angle As Single = 0.5 * Math.PI
  Private Shared tree_spread As Single = 0.75 * Math.PI
  Private Shared leaf_angle As Single = (10 / 180.0F) * Math.PI

  Private Sub AppendTreeToDiagram(branch As GH_GraphicBranch, args As GH_GraphicTreeDisplayArgs, list As List(Of Curve))
    If (branch.Twigs IsNot Nothing) Then
      For Each twig As GH_GraphicBranch In branch.Twigs
        Rhino.RhinoApp.WriteLine("Tree twig recursed")
        AppendTreeToDiagram(twig, args, list)
      Next
    End If

    If (branch.IsRoot) Then Return
    If (branch.Length < 0.001F) Then Return
    If (branch.IsLeaf) Then
      Dim p0 As PointF = args.RadialCrd(branch.Angle, branch.Offset)
      Dim p1 As PointF = args.RadialCrd(branch.Angle, branch.Offset + branch.Length)
      list.Add(New LineCurve(New Point3d(p0.X, p0.Y, 0.0), New Point3d(p1.X, p1.Y, 0.0)))
      Rhino.RhinoApp.WriteLine("Tree line added")
    Else
      For Each twig As GH_GraphicBranch In branch.Twigs
        Dim p0, p1, p2, p3 As PointF
        SolveBezier(branch, twig, args, p0, p1, p2, p3)
        Dim pa As New Point3d(p0.X, p0.Y, 0.0)
        Dim pb As New Point3d(p1.X, p1.Y, 0.0)
        Dim pc As New Point3d(p2.X, p2.Y, 0.0)
        Dim pd As New Point3d(p3.X, p3.Y, 0.0)

        list.Add(Curve.CreateControlPointCurve(New Point3d(){pa, pb, pc, pd}, 3))
        Rhino.RhinoApp.WriteLine("Tree bezier added")
      Next
    End If
  End Sub

  Private Sub SolveBezier(ByVal twig As GH_GraphicBranch, _
    ByVal nextTwig As GH_GraphicBranch, _
    ByVal e As GH_GraphicTreeDisplayArgs, _
    <Out()> ByRef P0 As PointF, _
    <Out()> ByRef P1 As PointF, _
    <Out()> ByRef P2 As PointF, _
    <Out()> ByRef P3 As PointF)
    Dim A0 As Single = twig.Angle
    Dim A1 As Single = nextTwig.Angle

    Dim O0 As Single = twig.Offset
    Dim O3 As Single = nextTwig.Offset

    Dim O1 As Single = O0 + 0.55F * (O3 - O0)
    Dim O2 As Single = O0 + 0.45F * (O3 - O0)

    P0 = e.RadialCrd(A0, O0)
    P1 = e.RadialCrd(A0, O1)
    P2 = e.RadialCrd(A1, O2)
    P3 = e.RadialCrd(A1, O3)
  End Sub
# ---------- end vb ----------
