# Grasshopper definition dot comparison in scope or not FCCH scipy.gh (Grasshopper 1.0.7)
# plug-ins: Human, GH_CPython

number_slider = Slider(1, range=0..1)
number_slider_2 = Slider(0, range=0..100)
number_slider_3 = Slider(4, range=0..10)
xy = XYPlane(Origin=Point(0, 0, 0))
named_dots = Guid([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])
button = Button()
toggle = BooleanToggle(True)
rp_dots = Guid([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])
python = GhPythonScript(guids=named_dots, run=toggle)  # -> out, points, texts, objs; inputs guids: list
# ---------- python: Python ----------
import rhinoscriptsyntax as rs
import datetime
import Rhino


points = []
texts = []
objs = []

if run == True:
    for guid in guids:
        #Rhino.Geometry.TextDot.Point
        obj = Rhino.RhinoDoc.ActiveDoc.Objects.Find(guid)
        point = obj.Geometry.Point
        name = obj.Geometry.Text
        points.append(point)
        texts.append(name)
        objs.append(obj)
# ---------- end python ----------
objatts = ObjectAttributes(ObjectOrAttributes=python.objs)  # -> Name, LayerName, LayerFullPath, Color, MaterialName, LinetypeName, GroupIndices, PlotWeight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
python_2 = GhPythonScript(guids=rp_dots, run=toggle)  # -> out, points, texts, objs; inputs guids: list; same code as python
objatts_2 = ObjectAttributes(ObjectOrAttributes=python_2.objs)  # -> Name, LayerName, LayerFullPath, Color, MaterialName, LinetypeName, GroupIndices, PlotWeight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
number_slider_4 = Slider(7.5, range=1..12)
panel = Panel(python_2.texts)
gh_cpython = GH_CPython(
    apt=python_2.points,
    aguid=rp_dots,
    aname=python_2.texts,
    alayer=objatts_2.LayerName,
    bpt=python.points,
    bguid=named_dots,
    bname=python.texts,
    blayer=objatts.LayerName,
    radius=number_slider_4)  # -> x, y, z, xd, yd, zd, xa, ya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; inputs apt: list, aguid: list, aname: list, alayer: list, bpt: list, bguid: list, bname: list, blayer: list, radius: list
#   port apt: [required] - [type = int] - [default = None] Descripe your input here * bullet point. * bullet point
#   port x: indicate your output description here. refers to a new line.
# ---------- gh_cpython: Python ----------
import numpy as np
from scipy import spatial
import pandas as pd


class Block:
    def __init__(self):
        self.guid = None
        self.point = None
        self.order = None
        self.name = None
        self.layer = None

ablocks = []
bblocks = []

for i,guid in enumerate(aguid):
    b = Block()
    b.guid = guid
    b.point = apt[i]
    b.x = b.point[0]
    b.y = b.point[1]
    b.z = b.point[2]
    b.order = i
    b.name = aname[i]
    b.layer = alayer[i]
    ablocks.append(b)
    

adf = pd.DataFrame([vars(x) for x in ablocks])

for i,guid in enumerate(bguid):
    b = Block()
    b.guid = guid
    b.point = bpt[i]
    b.x = b.point[0]
    b.y = b.point[1]
    b.z = b.point[2]
    b.order = i
    b.name = bname[i]
    b.layer = blayer[i]
    bblocks.append(b)
    

bdf = pd.DataFrame([vars(x) for x in bblocks])

A = [[x,y] for x,y,z in adf.point.tolist()]
B = [[x,y] for x,y,z in bdf.point.tolist()]





atree = spatial.cKDTree(A)
btree = spatial.cKDTree(B)


result = btree.query_ball_tree(atree, radius)
opp_result = atree.query_ball_tree(btree, radius)
adf["res"] = opp_result
#result = [x for x in result if len(result)> 0]

bdf["res"] = result

#links = adf.loc[adf["res"].str.len() != 0, :]





def first(x):
    if len(x)>0:
        return x[0]
    else:
        return None

bdf.res = bdf.res.apply(first)
adf.res = adf.res.apply(first)

adds = adf.loc[adf["res"].isnull(),:]

links = bdf.loc[bdf["res"].notnull(),:]

dels = bdf.loc[bdf["res"].isnull(),:]



x = links.x.tolist()
y = links.y.tolist()
z = links.z.tolist()


xd = dels.x.tolist()
yd = dels.y.tolist()
zd = dels.z.tolist()

xa = adds.x.tolist()
ya = adds.y.tolist()
za = adds.z.tolist()

#save = r"C:\Users\mkreidler\Desktop\fcch.xlsx"
#adf.to_excel(save)
#print("done")

confirmed = links.guid.tolist()
added = adds.guid.tolist()
deleted = dels.guid.tolist()
# ---------- end gh_cpython ----------
pt_delete = ConstructPoint(XCoordinate=gh_cpython.xd, YCoordinate=gh_cpython.yd, ZCoordinate=gh_cpython.zd)
pt_match = ConstructPoint(XCoordinate=gh_cpython.x, YCoordinate=gh_cpython.y, ZCoordinate=gh_cpython.z)
Z = UnitZ(Factor=1)
Z_2 = UnitZ(Factor=1)
python_change_object_layer = GhPythonScript(confirmed=gh_cpython.confirmed, added=gh_cpython.added, deleted=gh_cpython.deleted, run=Button(), copy=Toggle(False))  # -> out, a; inputs confirmed: list, added: list, deleted: list
# ---------- python_change_object_layer: Python ----------
import rhinoscriptsyntax as rs
import scriptcontext as sc
import Rhino
import datetime

sc.doc = Rhino.RhinoDoc.ActiveDoc

confirmed = [x.replace("'","") for x in confirmed]
added = [x.replace("'","") for x in added]
deleted = [x.replace("'","") for x in deleted]


def layer_deleted(guids, date_deleted=datetime.date.today().strftime("%B %d, %Y")):
    if "Deleted" not in rs.LayerNames():
        rs.AddLayer(name="Deleted")
    del_layer = str("Deleted::{}".format(date_deleted))
    if  del_layer not in  rs.LayerNames():
        rs.AddLayer(del_layer)
    rs.EnableRedraw(False)
    for g in guids:
        rs.ObjectLayer(g, layer=del_layer)
    rs.EnableRedraw(True)


def add_to_layer(guids, phase, sub=None, copy=False):
    layer = None
    if sub == None:
       layer = phase
    else:
        layer = "{}::{}".format(phase, sub)
    if layer not in rs.LayerNames():
        rs.AddLayer(layer)
    rs.EnableRedraw(False)
    if copy == False:
        for g in guids:
            rs.ObjectLayer(g, layer=layer)
    else:
        for g in guids:
            copy = rs.CopyObject(g)
            rs.ObjectLayer(copy, layer=layer)
    rs.EnableRedraw(True)


if run == True:
    add_to_layer(confirmed, "Base", sub="Presurvey")
    add_to_layer(added, "Base", sub="WJE add after survey 1", copy=copy)
    layer_deleted(deleted)

sc.doc = ghdoc
# ---------- end python_change_object_layer ----------
pt_add = ConstructPoint(XCoordinate=gh_cpython.xa, YCoordinate=gh_cpython.ya, ZCoordinate=gh_cpython.za)
Z_3 = UnitZ(Factor=1)
circle = CircleCNR(Center=pt_match, Normal=Z_2, Radius=number_slider_4)
circle_2 = CircleCNR(Center=pt_delete, Normal=Z, Radius=number_slider_4)
circle_3 = CircleCNR(Center=pt_add, Normal=Z_3, Radius=number_slider_4)
srf = Surface(circle)
srf_2 = Surface(circle_2)
srf_3 = Surface(circle_3)
preview = CustomPreview(Geometry=srf, Material=ColourSwatch(SwatchColor=RGB(114, 141, 186)))
preview_2 = CustomPreview(Geometry=srf_3, Material=ColourSwatch(SwatchColor=RGB(37, 176, 81)))
preview_3 = CustomPreview(Geometry=srf_2, Material=ColourSwatch(SwatchColor=RGB(255, 13, 13)))
