# Grasshopper definition excel to rhinio via gh.gh (Grasshopper 1.0.7)
# plug-ins: GH_CPython

gh_cpython = GH_CPython(input=Toggle(False))  # -> guid, name, phase, priority, bid; inputs input: list
#   port input: [required] - [type = int] - [default = None] Descripe your input here * bullet point. * bullet point
#   port guid: indicate your output description here. refers to a new line.
# ---------- gh_cpython: Python ----------
import pandas as pd


file = r"V:\Projects\35 East Wacker - 2020\TerraCotta\_Preliminary_Models\_archive\group data.xlsx"

df = pd.read_excel(file)

guid = df.guid.tolist()
guid = [x.replace("'", "") for x in guid]
name = df.name.tolist()
phase = df.phase.tolist()
priority = df.priority.tolist()
bid = df.bid.tolist()
# ---------- end gh_cpython ----------
toggle = BooleanToggle(True)
python = GhPythonScript(
    guid=gh_cpython.guid,
    name=gh_cpython.name,
    phase=gh_cpython.phase,
    priority=gh_cpython.priority,
    bid=gh_cpython.bid,
    bake=Button())  # -> out, ptx, pty, ptz, name, phase, priority, bid; inputs guid: list, name: list, phase: list, priority: list, bid: list
# ---------- python: Python ----------
import rhinoscriptsyntax as rs
import Rhino
import uuid
import scriptcontext as sc

points = []
ptx = []
pty = []
ptz = []

name = [n.replace("'", "").strip() for n in name]
phase = [x.replace("'", "").strip() for x in phase]
priority = [x.replace("'", "").strip() for x in priority]
bid = [x.replace("'", "").strip() for x in bid]

sc.doc = Rhino.RhinoDoc.ActiveDoc

rs.EnableRedraw(False)
for g in guid:
    id = g.replace("'","")
    point = rs.TextObjectPoint(id)
    points.append(point)
    ptx.append(point[0])
    pty.append(point[1])
    ptz.append(point[2])
rs.EnableRedraw(True)




if bake == True:
    
    for i, p in enumerate(points):
        point = p
        text = name[i]
        dot = rs.AddTextDot(text, point)
        rs.SetUserText(dot, "priority", priority[i])
        rs.SetUserText(dot, "phase", phase[i])
        rs.SetUserText(dot, "bid", bid[i])
        rs.SetUserText(dot, "name", name[i])
        if phase[i] not in rs.LayerNames():
            rs.AddLayer(phase[i])
            print "added"
            print rs.LayerNames()
            print phase[i]
            print phase[i] in rs.LayerNames()

        rs.ObjectLayer(dot, layer=phase[i])


sc.doc = ghdoc
# ---------- end python ----------
