# Grasshopper definition find blocks instances without dots above them.gh (Grasshopper 0.9.76)
# plug-ins: Python Interpreter

id_blocks = Guid([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])
id_dots = Guid([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])
python = PythonScript(dots=id_dots, blocks=id_blocks)  # -> out, dot_pts, block_pts, remainder; inputs dots: list, blocks: list
# ---------- python: Python ----------
import scriptcontext as sc
import rhinoscriptsyntax as rs
import Rhino

dot_pts = []
block_pts = []

sc.doc = Rhino.RhinoDoc.ActiveDoc

for d in dots:
    pt = rs.TextDotPoint(d)
    dot_pts.append(pt)
    

for b in blocks:
    pt = rs.BlockInstanceInsertPoint(b)
    block_pts.append(pt)


remainder = set(block_pts) - set(dot_pts) 


sc.doc = ghdoc
# ---------- end python ----------
sph = Sphere(Base=python.remainder, Radius=Slider(28, range=0..1000))
