# Grasshopper definition fuzzy grouping x y coordinates.gh (Grasshopper 1.0.7)
# plug-ins: GH_CPython

id_block_dots = Guid([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])
id_block_dots_2 = Guid([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])
id_block_dots_3 = Guid([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])
fuzzy_threshold = Slider(24, range=0..100)
python = GhPythonScript(dots=id_block_dots)  # -> points, names, layers; inputs dots: list
# ---------- python: Python ----------
import scriptcontext as sc
import rhinoscriptsyntax as rs
import Rhino

points = []
names = []
layers = []

sc.doc = Rhino.RhinoDoc.ActiveDoc

for y in dots:
    #pt = rs.BlockInstanceInsertPoint(y)
    #pt = rs.TextObjectText(y)
    pt = rs.TextDotPoint(y)
    points.append(pt)
    #name = rs.BlockInstanceName(y)
    name = rs.TextDotText(y)
    names.append(name)
    layer = rs.ObjectLayer(y)
    layers.append(layer)
    

sc.doc = ghdoc

points
names
layers
# ---------- end python ----------
python_2 = GhPythonScript(dots=id_block_dots_2)  # -> points, names, layers; inputs dots: list; same code as python
python_3 = GhPythonScript(dots=id_block_dots_3)  # -> points, names, layers; inputs dots: list; same code as python
gh_cpython = GH_CPython(guids=id_block_dots, points=python.points, names=python.names, base=Slider(15, range=0..100))  # -> x, y, z, r, g, b; inputs guids: list, points: list, names: list, base: list
#   port guids: [required] - [type = int] - [default = None] Descripe your input here * bullet point. * bullet point
#   port x: indicate your output description here. refers to a new line.
# ---------- gh_cpython: Python ----------
import pandas as pd
import random


class Block():
    def __init__(self):
        self.guid = None
        self.name = None
        self.point = None
        #self.layer = None
        #self.zones = None
        self.x = None
        self.y = None
        self.z = None
        #self.floor = None
        #self.swing_drop = None
        #self.elevation = None
        #self.priority = None
        #self.phase = None

# make an empty list to populate with block objects
blocks = []
# connect gh wires to python block classes
for i, z in enumerate(guids):
    b = Block()
    b.guid = guids[i]
    b.point = points[i]
    b.name = names[i]
    b.x,b.y,b.z = points[i]



# populate list of blocks
    blocks.append(b)

# turn the above list to a pandas dataframe
df = pd.DataFrame([vars(f) for f in blocks])





def round_ten(x):
    return round(x,-1)

def myround(x):
    return base * round(x/base)

df["fuzzy_x"] = df.x.apply(myround)

x = df.x.tolist()
y = df.y.tolist()
z = df.z.tolist()

def random_color(x):
    random.seed(x)
    r = random.randint(0,255)
    g = random.randint(0,255) 
    b = random.randint(0,255)
    return [r,g,b]

df["color"]=df.fuzzy_x.apply(random_color)
colors = df.color.tolist()
r = [r for r,g,b in colors]
g = [g for r,g,b in colors]
b = [b for r,g,b in colors]
# ---------- end gh_cpython ----------
gh_cpython_2 = GH_CPython(
    guids=id_block_dots_3,
    points=python_3.points,
    names=python_3.names,
    base=Slider(25, range=0..100),
    selection=Slider(150, range=0..301))  # -> x, y, z, options; inputs guids: list, points: list, names: list, base: list, selection: list
#   port guids: [required] - [type = int] - [default = None] Descripe your input here * bullet point. * bullet point
#   port x: indicate your output description here. refers to a new line.
# ---------- gh_cpython_2: Python ----------
import pandas as pd

class Block():
    def __init__(self):
        self.guid = None
        self.name = None
        self.point = None
        #self.layer = None
        #self.zones = None
        self.x = None
        self.y = None
        self.z = None
        #self.floor = None
        #self.swing_drop = None
        #self.elevation = None
        #self.priority = None
        #self.phase = None

# make an empty list to populate with block objects
blocks = []
# connect gh wires to python block classes
for i, z in enumerate(guids):
    b = Block()
    b.guid = guids[i]
    b.point = points[i]
    b.name = names[i]
    b.x,b.y,b.z = points[i]



# populate list of blocks
    blocks.append(b)

# turn the above list to a pandas dataframe
df = pd.DataFrame([vars(f) for f in blocks])





def round_ten(x):
    return round(x,-1)

def myround(x):
    return base * round(x/base)

df["fuzzy_x"] = df.x.apply(myround)




options = sorted(list(set(df.fuzzy_x.tolist())))

number = options[selection]

x = df.loc[df.fuzzy_x == number, "x"].tolist()
y = df.loc[df.fuzzy_x == number, "y"].tolist()
z = df.loc[df.fuzzy_x == number, "z"].tolist()

x = [float(i) for i in x]
y = [float(i) for i in y]
z = [float(i) for i in z]
# ---------- end gh_cpython_2 ----------
gh_cpython_3 = GH_CPython(guids=id_block_dots_2, points=python_2.points, names=python_2.names, base=fuzzy_threshold)  # -> x, y, z, r, g, b; inputs guids: list, points: list, names: list, base: list
#   port guids: [required] - [type = int] - [default = None] Descripe your input here * bullet point. * bullet point
#   port x: indicate your output description here. refers to a new line.
# ---------- gh_cpython_3: Python ----------
import pandas as pd
import random


class Block():
    def __init__(self):
        self.guid = None
        self.name = None
        self.point = None
        #self.layer = None
        #self.zones = None
        self.x = None
        self.y = None
        self.z = None
        #self.floor = None
        #self.swing_drop = None
        #self.elevation = None
        #self.priority = None
        #self.phase = None

# make an empty list to populate with block objects
blocks = []
# connect gh wires to python block classes
for i, z in enumerate(guids):
    b = Block()
    b.guid = guids[i]
    b.point = points[i]
    b.name = names[i]
    b.x,b.y,b.z = points[i]



# populate list of blocks
    blocks.append(b)

# turn the above list to a pandas dataframe
df = pd.DataFrame([vars(f) for f in blocks])





def round_ten(x):
    return round(x,-1)

def myround(x):
    return base * round(x/base)

df["fuzzy_y"] = df.y.apply(myround)

x = df.x.tolist()
y = df.y.tolist()
z = df.z.tolist()

def random_color(x):
    random.seed(x)
    r = random.randint(0,255)
    g = random.randint(0,255) 
    b = random.randint(0,255)
    return [r,g,b]

df["color"]=df.fuzzy_y.apply(random_color)
colors = df.color.tolist()
r = [r for r,g,b in colors]
g = [g for r,g,b in colors]
b = [b for r,g,b in colors]
# ---------- end gh_cpython_3 ----------
lng = ListLength(List=gh_cpython_2.options)
rgb = ColourRGB(Alpha=255, Red=gh_cpython.r, Green=gh_cpython.g, Blue=gh_cpython.b)
rgb_2 = ColourRGB(Alpha=255, Red=gh_cpython_3.r, Green=gh_cpython_3.g, Blue=gh_cpython_3.b)
pt = ConstructPoint(XCoordinate=gh_cpython.x, YCoordinate=gh_cpython.y, ZCoordinate=gh_cpython.z)
pt_2 = ConstructPoint(XCoordinate=gh_cpython_3.x, YCoordinate=gh_cpython_3.y, ZCoordinate=gh_cpython_3.z)
pt_3 = ConstructPoint(XCoordinate=gh_cpython_2.x, YCoordinate=gh_cpython_2.y, ZCoordinate=gh_cpython_2.z)
sph = Sphere(Base=pt, Radius=Slider(10, range=0..100))
sph_2 = Sphere(Base=pt_2, Radius=Slider(10, range=0..100))
sph_3 = Sphere(Base=pt_3, Radius=Slider(10, range=0..100))
preview_x_vertical_grouping = CustomPreview(Geometry=sph, Material=rgb)
preview_y_horizontal_grouping = CustomPreview(Geometry=sph_2, Material=rgb_2)
