# Grasshopper definition header redo.gh (Grasshopper 1.0.7)

python = GhPythonScript(height=Slider(16, range=0..100), length=Slider(40, range=0..100), top="12,12,12", bottom="15,12,12")  # -> out, a, b, c, d, e
# ---------- python: Python ----------
import rhinoscriptsyntax as rs
import Rhino.Geometry as rg



origin = rg.Point3d(0,0,0)


a = origin
b = a + rg.Vector3d(0,height,0)

c = rg.Line(a,b)




def plot_pt(len_list, start):
    len_list = len_list.split(",")
    len_list = [float(x) for x in len_list]
    
    points = []
    
    for i, length in enumerate(len_list):
        total = sum(len_list[0:i+1])
        print total
        pt = start + rg.Vector3d(total, 0, 0)
        points.append(pt)
    return points


d = plot_pt(top, b)
e = plot_pt(bottom, a)

def make_lines(t, b):
    length = len(t)
# ---------- end python ----------
