# Grasshopper definition header_maker.gh (Grasshopper 0.9.76)
# plug-ins: Python Interpreter

python_script = PythonScript()  # -> out, a
# ---------- python_script: Python ----------
nums = [

.375,
.25,
.25,
0


]

s = sum(nums)
l = len(nums)
a = s/l

print a
# ---------- end python_script ----------
negative = Negative(Value=Slider(19.375, range=0..100))
curve = Curve(<curve referenced from the Rhino model>)
python_script_2 = PythonScript(space=Slider(0.375, range=0..1))  # -> out, top_spaces, bottom_spaces
# ---------- python_script_2: Python ----------
top = [
        0,
        7.75,
        14.375,
        14.375,
        14.375,
        14.375,
        14.25
]

bottom = [
        0,
        17.25,
        12.75,
        12.75,
        12.75,
        12.75,
        12.5
]

top_spaces = []
dist = 0
for i, num in enumerate(top):
    if i == 0:
        top_spaces.append(num)
        dist = num
        
    elif i == 1:
        dist += num
        top_spaces.append(dist)
        
    else:
        dist += space
        top_spaces.append(dist)
        dist += num
        top_spaces.append(dist)

print top_spaces

bottom_spaces = []
dist = 0
for i, num in enumerate(bottom):
    if i == 0:
        bottom_spaces.append(num)
        dist = num
        
    elif i == 1:
        dist += num
        bottom_spaces.append(dist)
        
    else:
        dist += space
        bottom_spaces.append(dist)
        dist += num
        bottom_spaces.append(dist)

print bottom_spaces
# ---------- end python_script_2 ----------
offset = Offset(Curve=curve, Distance=negative, Plane=PlaneXY(0, 0, 0), Corners=1)
evaluate_curve = EvaluateCurve(Curve=curve, Parameter=python_script_2.bottom_spaces)  # -> Point, Tangent, Angle
evaluate_curve_2 = EvaluateCurve(Curve=offset, Parameter=python_script_2.top_spaces)  # -> Point, Tangent, Angle
line = Line(StartPoint=evaluate_curve_2.Point, EndPoint=evaluate_curve.Point)
unit_x = UnitX(Factor=Slider(200, range=0..1000))
unit_z = UnitZ(Factor=Slider(8.625, range=0..10))
python_script_3 = PythonScript(t=evaluate_curve_2.Point, b=evaluate_curve.Point)  # -> out, a; inputs t: list of Point3d, b: list of Point3d
# ---------- python_script_3: Python ----------
import Rhino
import Rhino.Geometry as rg

points = []

def block(i, t, b):
    return [t[i],t[i+1],b[i+1],b[i],t[i]]

for i in range(0,11,2):
    #print i
    points.append(block(i,t,b))


lines = []
for p in points:
    L1 = rg.Line(p[0],p[1])
    L2 = rg.Line(p[1],p[2])
    L3 = rg.Line(p[2],p[3])
    L4 = rg.Line(p[3],p[4])
    L5 = rg.Line(p[4],p[0])
    
    line = [L1,L2,L3,L4,L5]


    pl = rg.Polyline([p[0],p[1],p[2],p[3],p[4],p[0]])
    lines.append(pl)

a = lines
# ---------- end python_script_3 ----------
curve_2 = Curve(<curve referenced from the Rhino model>)
extrude = Extrude(Base=curve_2, Direction=unit_x)
extrude_2 = Extrude(Base=python_script_3.a, Direction=unit_z)
cap_holes = CapHoles(Brep=extrude_2)
cap_holes_2 = CapHoles(Brep=extrude)
solid_intersection = SolidIntersection(BrepsA=cap_holes, BrepsB=cap_holes_2)
