# Grasshopper definition k_mean2.ghx (Grasshopper 1.0.7)

# K-Means: K-Means Algorthims are a automated way of grouping data. For now my implementation only works on points but other types should work in theory. The VB script is also woefully un-optimzed which I hope to revisit.
# 
# Check out the K-Means Page on wikipedia @
# http://en.wikipedia.org/wiki/K-means_clustering
# 
# And the general page on data clustering @
# http://en.wikipedia.org/wiki/Cluster_analysis
example_1 = Panel("A single set")
example_2 = Panel("Muiltiple Data Trees")
box = Box2Pt(PointA="0,0,0", PointB="10,10,10", Plane=PlaneXY(0, 0, 0))
slider = Slider(30, range=0..30)
random = Random(Range=Domain(0, 1), Number="500", Seed="8593", Integers=False)
random_2 = Random(Range=Domain(0, 1), Number="500", Seed="12457", Integers=False)
random_3 = Random(Range=Domain(0, 1), Number="500", Seed="65830", Integers=False)
random_4 = Random(Range=Domain(0, 1), Number="500", Seed=2, Integers=False)
example_1_2 = Panel("A single set")
random_5 = Random(Range=Domain(0, 1), Number="500", Seed=2)
number_slider = Slider(25, range=0..50)
random_6 = Random(Range=Domain(0, 1), Number="500", Seed="12457")
pop3d = Populate3D(Region=box, Count=Slider(6000, range=0..10000), Seed=1)
panel = Panel("100")
pt = PointXYZ(XComponent=random_5, YComponent=random_6, ZComponent=0)
pt_2 = PointXYZ(XComponent=random_3, YComponent=random, ZComponent=0)
pt_3 = PointXYZ(XComponent=random_4, YComponent=random_2, ZComponent=0)
slider_2 = Slider(8, range=0..30)
path_mapper = PathMapper(pt_2, source="{A;B}", target="{A;1}")
c_script = CSharpScript(points=pop3d, groupsNumber=slider, precision="0.000001", seed=number_slider)  # -> out, G; inputs points: list of Point3d, groupsNumber: Int32, precision: Double, seed: Int32
# ---------- c_script: C# ----------
    //Code by Dieter Toews
    //https://www.grasshopper3d.com/forum/topics/kmeans-1
    //Rewritten in January 2019 by Laurent Delrieu

    //***************** Initialize K-Means Algorithm ****************************
    Print("--------Initializing " + groupsNumber + " groupings-------");
    Component.Message ="K-Means Clustering";

    List<List<int>> groupings = new List<List<int>>();
    List<Point3d> oldCentroids = new  List<Point3d> ();
    List<Point3d> newCentroids = new  List<Point3d> ();
    for (int i = 0; i < groupsNumber; i++)
    {
      groupings.Add(new List<int>());
      newCentroids.Add(Point3d.Origin);
      oldCentroids.Add(Point3d.Origin);
      Print("creating grouping " + i);
    }
    //randomly assign points from the input list (intialze the k-mean groups)
    Print("--------Initializing group assignments (random)-------");
    Random r = new Random(seed);
    DataTree<Point3d> groupingsTree = new DataTree<Point3d>();
    for (int j = 0 ; j < points.Count; j++)
    {
      int groupNum = RandomNumber(r, groupsNumber - 1, 0);
      groupings[groupNum].Add(j);
      Print("Adding index value " + groupings[groupNum][groupings[groupNum].Count - 1] + " to group " + groupNum + ".");
    }
    //***************** Do K-Means Algorithm ************************************
    Print("--------Entering main k-means loop--------");
    bool isStillMoving = true;
    //Number of while counting
    int k = 0;
    double minDist, dist;
    Point3d XYZ = Point3d.Origin;
    Point3d pt = Point3d.Origin;

    while ( isStillMoving)
    {
      isStillMoving = false;
      //find new centroids
      Print(".....finding new centroids");
      for (int i = 0; i < groupsNumber; i++)
      {
        oldCentroids[i] = newCentroids[i];
        for (int j = 0; j < groupings[i].Count; j++)
        {
          XYZ = XYZ + points[groupings[i][j]];
        }
        XYZ = XYZ / ((double) groupings[i].Count + 1);

        Point3d newCentroid = XYZ;
        newCentroids[i] = newCentroid;
        Print("New centroid for group " + i + " is " + newCentroids[i].ToString());
        groupings[i].Clear();
        dist = newCentroid.DistanceTo(oldCentroids[i]);

        if (dist > precision)
        {
          Print("need to do more work");
          isStillMoving = true;
        }
      }
      //create new groupings
      Print(".....creating new groupings");
      for (int j = 0; j < points.Count; j++)
      {
        pt = points[j];
        minDist = pt.DistanceTo(newCentroids[0]);
        int groupNum = 0;
        for (int i = 0; i < groupsNumber; i++)
        {
          dist = pt.DistanceTo(newCentroids[i]);
          if( minDist >= dist )
          {
            groupNum = i;
            minDist = dist;
          }
        }
        groupings[groupNum].Add(j);
        if ( isStillMoving == false)
        {
          groupingsTree.Add(pt, new GH_Path(groupNum));
        }
      }
      if (isStillMoving == false)
      {
        Print("***************all groups setled exiting loop********************");
        Print("***************total loop count is " + k + "************************");
      }
      //a hard limit on the number of loops to execute....
      if(k > 1000)
      {
        isStillMoving = false;
      }
      k += 1;
    }//End while
    G = groupingsTree;
# ---------- c_script: C# additional code ----------
  public int RandomNumber(Random r, int MaxNumber, int MinNumber)
  {
    //if passed incorrect arguments, swap them
    //can also throw exception or return 0
    if (MinNumber > MaxNumber)
    {
      int t = MinNumber;
      MinNumber = MaxNumber;
      MaxNumber = t;
    }
    return r.Next(MinNumber, MaxNumber);
  }
# ---------- end c_script ----------
vb = VBScript(P=pop3d, N=slider, D="0.000001", seed=number_slider)  # -> out, G; inputs P: tree of Point3d, N: tree
# ---------- vb: VB ----------
    'your code goes here…
    Dim t As Integer = 0
    Dim i As Integer = 0
    Dim j As Integer = 0
    Dim k As Integer = 0
    Dim numGroups As Integer
    Dim groupNum As Integer
    Dim X As Double
    Dim Y As Double
    Dim Z As Double
    Dim minDist As Double
    Dim dist As Double
    'Dim cluster As Integer
    'initialize random number generator
    'Dim r As New Random(System.DateTime.Now.Millisecond)
    Dim r As New Random(seed)
    Dim goupings As New List(Of List(Of Integer))
    Dim oldCentroids As New List(Of Point3d)
    Dim newCentroids As New List(Of Point3d)
    Dim pathList As New List(Of GH_Path)
    Dim newCentroid As Point3d
    Dim pt As Point3d
    Dim isStillMoving As Boolean
    Dim groupingsTree As New DataTree(Of Point3d)
    Dim inputpts As New List(Of Point3d)

    For t = 0 To P.BranchCount - 1

      'this mess dose data matching for inputs P and N
      'this if is ture is the input branches are equal
      If N.BranchCount >= P.BranchCount Then
        'check to see if, in the case the branches are equal, that there is only one item in each branch of N
        If N.Branch(t).Count = 1 Then
          numGroups = N.Branch(t)(0)
          'I don't know what to do if the above statment isn't true so let's exit the program
        Else
          Print("Error: data missmatch between inputs P and N, Please reformat inputs")
          Exit Sub
        End If
        'here we check if it is a simple list...
      Else If N.Branch(0).Count = P.BranchCount
        numGroups = N.Branch(0)(t)
        'here we check if it is a simple list but is shorter or longer than the tree P
      Else If N.Branch(0).Count < P.BranchCount Then
        If t <= N.Branch(0).Count - 1 Then
          numGroups = N.Branch(0)(t)
        Else
          numGroups = N.Branch(0)(N.Branch(0).Count - 1)
        End If
        'if all else fails exit the program!
      Else
        Print("Error: data missmatch between inputs P and N, Please reformat inputs")
        Exit Sub
      End If

      inputpts = P.Branch(t)
      print("--------Accessing Branch " & t & "--------")
      '***************** Initialize K-Means Algorithm ****************************
      print("--------Initializing " & numGroups & " groupings-------")


      For i = 0 To numGroups - 1
        'Dim pt As Point3d
        'Dim group As New List(Of Integer)
        Dim tempPath As New GH_Path
        goupings.Add(New List(Of Integer))
        newCentroids.add(pt)
        oldCentroids.Add(pt)

        tempPath.FromString(t & ";" & i)
        pathList.Add(tempPath)
        print("creating grouping " & i)
      Next
      'radomly assign points from the input list (intialze the k-mean groups)
      print("--------Initializing group assinments (random)-------")
      For j = 0 To inputpts.Count - 1
        groupNum = RandomNumber(r, numGroups - 1)
        goupings(groupNum).Add(j)
        print("Adding index value " & goupings(groupNum)(goupings(groupNum).Count - 1) & " to group " & groupNum & ".")
      Next

      '***************** Do K-Means Algorithm ************************************
      print("--------entering main k-means loop--------")
      isStillMoving = True
      Do While isStillMoving
        isStillMoving = False


        'find new centroids
        print(".....finding new centroids")
        For i = 0 To numGroups - 1
          oldCentroids(i) = newCentroids(i)
          For j = 0 To goupings(i).Count - 1
            pt = inputpts(goupings(i)(j))
            X = X + pt.X
            Y = Y + pt.Y
            Z = Z + pt.Z
          Next
          X = X / (j + 1)
          Y = Y / (j + 1)
          Z = Z / (j + 1)
          newCentroid.X = X
          newCentroid.Y = Y
          newCentroid.Z = Z
          newCentroids(i) = newCentroid
          print("new centroid for group " & i & " is " & newCentroids(i).ToString)
          goupings(i).Clear
          dist = newCentroid.DistanceTo(oldCentroids(i))
          'print("dist = " & dist)
          If dist > D Then
            print("need to do more work")
            isStillMoving = True
          End If
        Next

        'create new groupings
        print(".....creating new groupings")
        For j = 0 To inputpts.Count - 1
          pt = inputpts(j)
          minDist = pt.DistanceTo(newCentroids(0))
          For i = 0 To numGroups - 1
            dist = pt.DistanceTo(newCentroids(i))
            If minDist >= dist Then
              groupNum = i
              minDist = dist
              'print(minDist)
            End If

          Next
          'Print("Adding index value " & j & " to group " & groupNum & ".")
          goupings(groupNum).Add(j)
          If isStillMoving = False Then
            groupingsTree.Add(pt, pathList(groupNum))
          End If
        Next

        If isStillMoving = False Then
          print("***************all groups setled exiting loop********************")
          print("***************total loop count is " & k & "************************")
        End If

        'a hard limit on the number of loops to execute....
        If k > 1000 Then
          isStillMoving = False
        End If

        k = k + 1
      Loop
      goupings.Clear
      newCentroids.Clear
      oldCentroids.Clear
      pathList.Clear
    Next
    G = groupingsTree
# ---------- vb: VB additional code ----------
  '<Custom additional code>
  'function taken from http://www.freevbcode.com/ShowCode.Asp?ID=4451 (and slightly modified)
  Public Function RandomNumber(ByVal r As Random, ByVal MaxNumber As Integer, Optional ByVal MinNumber As Integer = 0) As Integer

    'if passed incorrect arguments, swap them
    'can also throw exception or return 0

    If MinNumber > MaxNumber Then
      Dim t As Integer = MinNumber
      MinNumber = MaxNumber
      MaxNumber = t
    End If

    Return r.Next(MinNumber, MaxNumber)

  End Function
# ---------- end vb ----------
vb_2 = VBScript(P=pt, N=slider_2, D="0.000001")  # -> out, G; inputs P: tree of Point3d, N: tree
# ---------- vb_2: VB ----------
    
    'your code goes here…
    Dim t As Integer = 0
    Dim i As Integer = 0
    Dim j As Integer = 0
    Dim k As Integer = 0
    Dim numGroups As Integer
    Dim groupNum As Integer
    Dim X As Double
    Dim Y As Double
    Dim Z As Double
    Dim minDist As Double
    Dim dist As Double
    'Dim cluster As Integer
    'initialize random number generator
    Dim r As New Random(System.DateTime.Now.Millisecond)
    Dim goupings As New List(Of List(Of Integer))
    Dim oldCentroids As New List(Of Point3d)
    Dim newCentroids As New List(Of Point3d)
    Dim pathList As New List(Of GH_Path)
    Dim newCentroid As Point3d
    Dim pt As Point3d
    Dim isStillMoving As Boolean
    Dim groupingsTree As New DataTree(Of Point3d)
    Dim inputpts As New List(Of Point3d)

    For t = 0 To P.BranchCount - 1

      'this mess dose data matching for inputs P and N
      'this if is ture is the input branches are equal
      If N.BranchCount >= P.BranchCount Then
        'check to see if, in the case the branches are equal, that there is only one item in each branch of N
        If N.Branch(t).Count = 1 Then
          numGroups = N.Branch(t)(0)
          'I don't know what to do if the above statment isn't true so let's exit the program
        Else
          Print("Error: data missmatch between inputs P and N, Please reformat inputs")
          Exit Sub
        End If
        'here we check if it is a simple list...
      Else If N.Branch(0).Count = P.BranchCount
        numGroups = N.Branch(0)(t)
        'here we check if it is a simple list but is shorter or longer than the tree P
      Else If N.Branch(0).Count < P.BranchCount Then
        If t <= N.Branch(0).Count - 1 Then
          numGroups = N.Branch(0)(t)
        Else
          numGroups = N.Branch(0)(N.Branch(0).Count - 1)
        End If
        'if all else fails exit the program!
      Else
        Print("Error: data missmatch between inputs P and N, Please reformat inputs")
        Exit Sub
      End If

      inputpts = P.Branch(t)
      print("--------Accessing Branch " & t & "--------")
      '***************** Initialize K-Means Algorithm ****************************
      print("--------Initializing " & numGroups & " groupings-------")


      For i = 0 To numGroups - 1
        'Dim pt As Point3d
        'Dim group As New List(Of Integer)
        Dim tempPath As New GH_Path
        goupings.Add(New List(Of Integer))
        newCentroids.add(pt)
        oldCentroids.Add(pt)

        tempPath.FromString(t & ";" & i)
        pathList.Add(tempPath)
        print("creating grouping " & i)
      Next
      'radomly assign points from the input list (intialze the k-mean groups)
      print("--------Initializing group assinments (random)-------")
      For j = 0 To inputpts.Count - 1
        groupNum = RandomNumber(r, numGroups - 1)
        goupings(groupNum).Add(j)
        print("Adding index value " & goupings(groupNum)(goupings(groupNum).Count - 1) & " to group " & groupNum & ".")
      Next

      '***************** Do K-Means Algorithm ************************************
      print("--------entering main k-means loop--------")
      isStillMoving = True
      Do While isStillMoving
        isStillMoving = False


        'find new centroids
        print(".....finding new centroids")
        For i = 0 To numGroups - 1
          oldCentroids(i) = newCentroids(i)
          For j = 0 To goupings(i).Count - 1
            pt = inputpts(goupings(i)(j))
            X = X + pt.X
            Y = Y + pt.Y
            Z = Z + pt.Z
          Next
          X = X / (j + 1)
          Y = Y / (j + 1)
          Z = Z / (j + 1)
          newCentroid.X = X
          newCentroid.Y = Y
          newCentroid.Z = Z
          newCentroids(i) = newCentroid
          print("new centroid for group " & i & " is " & newCentroids(i).ToString)
          goupings(i).Clear
          dist = newCentroid.DistanceTo(oldCentroids(i))
          'print("dist = " & dist)
          If dist > D Then
            print("need to do more work")
            isStillMoving = True
          End If
        Next

        'create new groupings
        print(".....creating new groupings")
        For j = 0 To inputpts.Count - 1
          pt = inputpts(j)
          minDist = pt.DistanceTo(newCentroids(0))
          For i = 0 To numGroups - 1
            dist = pt.DistanceTo(newCentroids(i))
            If minDist >= dist Then
              groupNum = i
              minDist = dist
              'print(minDist)
            End If

          Next
          'Print("Adding index value " & j & " to group " & groupNum & ".")
          goupings(groupNum).Add(j)
          If isStillMoving = False Then
            groupingsTree.Add(pt, pathList(groupNum))
          End If
        Next

        If isStillMoving = False Then
          print("***************all groups setled exiting loop********************")
          print("***************total loop count is " & k & "************************")
        End If

        'a hard limit on the number of loops to execute....
        If k > 1000 Then
          isStillMoving = False
        End If

        k = k + 1
      Loop
      goupings.Clear
      newCentroids.Clear
      oldCentroids.Clear
      pathList.Clear
    Next
    G = groupingsTree
# ---------- vb_2: VB additional code ----------
  '<Custom additional code> 
  'function taken from http://www.freevbcode.com/ShowCode.Asp?ID=4451 (and slightly modified)
Public Function RandomNumber(ByVal r As Random, ByVal MaxNumber As Integer, Optional ByVal MinNumber As Integer = 0) As Integer

  'if passed incorrect arguments, swap them
  'can also throw exception or return 0

  If MinNumber > MaxNumber Then
    Dim t As Integer = MinNumber
    MinNumber = MaxNumber
    MaxNumber = t
  End If

  Return r.Next(MinNumber, MaxNumber)

End Function
# ---------- end vb_2 ----------
unim = UnifyMesh()  # -> Result, Count
viewer = ParamViewer(vb.G)
unim_2 = UnifyMesh()  # -> Result, Count
move = Move(Geometry=unim_2.Result, Motion=Vector(15, -1, 0))  # -> Geometry, Transform
merge = Merge(Data1=path_mapper, Data2=pt_3)
preview = CustomPreview(
    Geometry=unim.Result,
    Material={diffuse=RGB(221, 160, 221), emission=RGB(66, 48, 66), shine=0.5, specular=RGB(255, 255, 255), transparency=0})
preview_2 = CustomPreview(
    Geometry=move.Geometry,
    Material={diffuse=RGB(221, 160, 221), emission=RGB(66, 48, 66), shine=0.5, specular=RGB(255, 255, 255), transparency=0})
viewer_2 = ParamViewer(vb_2.G)
vb_3 = VBScript(P=merge, N=graft([slider_2, Slider(6, range=0..30), Slider(9, range=0..30)]), D="0.000001")  # -> out, G; inputs P: tree of Point3d, N: tree; same code as vb_2
hull = ConvexHull(Points=vb_2.G, Plane=PlaneXY(0, 0, 0))  # -> Hull, HullZ, Indices
panel_2 = Panel(c_script.out)
panel_3 = Panel(vb_2.out)
hull_2 = ConvexHull(Points=vb_3.G, Plane=PlaneXY(0, 0, 0))  # -> Hull, HullZ, Indices
viewer_3 = ParamViewer(vb_3.G)
panel_4 = Panel(vb_3.out)
lolcat = RandomLolCat()
