# Grasshopper definition kgroo.gh (Grasshopper 0.9.76)
# plug-ins: Weaverbird, Kangaroo2 Components

mesh_plane = MeshPlane(Boundary={Plane=PlaneXY(0, 0, 0), Size=Domain2(u=-10..10, v=-10..10)}, WidthCount=10, HeightCount=10)  # -> Mesh, Area
deconstruct_mesh = DeconstructMesh(Mesh=mesh_plane.Mesh)  # -> Vertices, Faces, Colours, Normals
unit_z = UnitZ(Factor=1)
weaverbird_s_mesh_edges = WeaverbirdsMeshEdges(MeshOrPolylines=mesh_plane.Mesh)
meshcorners = MeshCorners(Mesh=mesh_plane.Mesh, Angle=2.35619449)
load = Load(Point=deconstruct_mesh.Vertices, ForceVector=unit_z)
length = Length(Curve=weaverbird_s_mesh_edges)
anchor = Anchor(Point=meshcorners, Strength=10000)
multiplication = Multiplication(A=length, B=Slider(0.604, range=0..1))
show = Show(G=mesh_plane.Mesh)
length_line = LengthLine(Line=weaverbird_s_mesh_edges, Length=multiplication, Strength=10)
grab = Grab(On=True, Strength=1, Range=3)  # -> Grab, Anchors
merge = Merge(Data1=length_line, Data2=anchor, Data3=load, Data4=show, Data5=grab.Grab)
button = Button()
solver = Solver(GoalObjects=merge, Reset=button, Threshold=1e-15, Tolerance=0.01, On=True)  # -> I, V, O
bouncysolver = BouncySolver(
    GoalObjects=merge,
    Reset=button,
    Threshold=1e-15,
    Tolerance=0.01,
    Damping=0.99,
    Iterations=Slider(3, range=0..100),
    On=True)  # -> I, V, O
