# Grasshopper definition line tracer.gh (Grasshopper 0.9.76)
# plug-ins: Python Interpreter

crv = Curve(<curve referenced from the Rhino model>)
explode = Explode(Curve=crv, Recursive=True)  # -> Segments, Vertices
python = PythonScript()  # -> Out, A
cullpt = CullDuplicates(Points=explode.Vertices, Tolerance=0.1, CullMode=3)  # -> Points, Indices, Valence
python_2 = PythonScript(pts=cullpt.Points, max=Slider(0, range=0..2), sel=simplify(Slider(47, range=0..220)))  # -> out, first, rest, v, keep_points, selected; inputs pts: list of Point3d, sel: Int32
# ---------- python_2: Python ----------
import Rhino



for pt in pts:
    x,y,z = pt
    #print pt
    

selected = pts[sel]
rest = pts[1:]

#Rhino.Geometry.Vector3d()

def vec_move(center, pts):
    x,y,z = center
    vectors = []
    keep_points = []
    for p in pts:
        dx, dy, dz = p
        nx = dx - x
        ny = dy - y
        nz = dz - z
        
        vec = Rhino.Geometry.Vector3d(nx, ny, nz)
        vectors.append(vec)
        
        if vec[0] < max:
            keep_points.append(p)
            
    
        
        
    return vectors, keep_points

v, keep_points = vec_move(selected, rest)
print v
# ---------- end python_2 ----------
vec = Vector(python_2.v)
Y = UnitY(Factor=1)
line = LineSDL(Start=Point(0, 0, 0), Direction=python_2.v, Length=1)
vec2pt = Vector2Pt(PointA=python_2.first, PointB=python_2.rest, Unitize=False)  # -> Vector, Length
circle = CircleCNR(Center=python_2.selected, Normal=Y, Radius=1)
pt = Point(python_2.keep_points)
X = UnitX(Factor=1)
Z = UnitZ(Factor=1)
Y_2 = UnitY(Factor=1)
ln = Line(StartPoint=python_2.selected, EndPoint=python_2.keep_points)
angle = Angle(VectorA=vec2pt.Vector, VectorB=Z)  # -> Angle, Reflex
ln_2 = Line(StartPoint=python_2.first, EndPoint=python_2.rest)
graph = QuickGraph(angle.Angle)
