# Grasshopper definition make auto setting tag with two lines of text from dot and attribute.gh (Grasshopper 1.0.7)
# plug-ins: Human, EleFront

id = Guid([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])
getatt = GetElefrontAttributes(Geometry=id)
getuv = GetUserValue(Geometry=getatt, Key="bid")
python = GhPythonScript(dots=id)  # -> ptx, pty, ptz, texts, objs, rcpoint; inputs dots: list
# ---------- python: Python ----------
import rhinoscriptsyntax as rs
import Rhino

texts = []
ptx = []
pty = []
ptz = []
objs = []
rcpoint = []
bid = []


for d in dots:
    obj = Rhino.RhinoDoc.ActiveDoc.Objects.Find(d)
    objs.append(obj)
    point = obj.Geometry.Point
    rcpoint.append(point)
    text = obj.Geometry.Text
    ptx.append(point.X)
    pty.append(point.Y)
    ptz.append(point.Z)
    texts.append(text)
    #bid.append(rs.GetUserText(d, key="bid"))
    print point
# ---------- end python ----------
objatts = ObjectAttributes(ObjectOrAttributes=python.objs)  # -> Name, LayerName, LayerFullPath, Color, MaterialName, LinetypeName, GroupIndices, PlotWeight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
pt = Point(python.rcpoint)
vec = VectorXYZ(XComponent=0, YComponent=Slider(1.08, range=0..10), ZComponent=0)  # -> Vector, Length
neg = Negative(Value=vec.Vector)

# ---- group: Auto Setting Tag
number_slider = Slider(1.268, range=0..10)
pt_2 = Point(pt)
python_2 = GhPythonScript(points=pt_2, width=Slider(6.897, range=0..14), height=Slider(5.1331, range=0..10), side=Slider(1.261, range=0..2))  # -> out, a; inputs points: list of Point3d
# ---------- python_2: Python ----------
import rhinoscriptsyntax as rs
import Rhino

def make_tag(point, w, h, side):
    """origin is bottom left,
    direction is counterclockwise"""
    
    hw = w/2
    hh = h/2
    
    x,y,z = point
    origin = x-hw, y-hh, z
    x,y,z = origin
    pt1 = x-side,y+hh,z
    pt2 = x,y+h,z
    pt3 = x+w,y+h,z
    pt4 = x+w+side,y+hh,z
    pt5 = x+w,y,z
    
    pt_coords = [origin, pt1, pt2, pt3, pt4, pt5, origin]
    pts = [Rhino.Geometry.Point3d(x,y,z) for x,y,z in pt_coords]
    pl = Rhino.Geometry.Polyline(pts)


    return pl

a = []

for p in points:
    tag = make_tag(p, width, height, side)
    a.append(tag)
# ---------- end python_2 ----------
rgb = ColourRGB(Alpha=255, Red=0, Green=0, Blue=0)
srf = Surface(python_2.a)
crv = Curve(python_2.a)
preview = CustomPreview(Geometry=srf, Material=objatts.PlotColor)
previewlw = CustomPreviewLineweights(Geometry=crv, Shader=rgb, Thickness=Slider(2, range=0..10), Absolute=False)

# ----
multiplication = Multiplication(A=number_slider, B=0.8)
move = Move(Geometry=pt_2, Motion=vec.Vector)  # -> Geometry, Transform
move_2 = Move(Geometry=pt_2, Motion=neg)  # -> Geometry, Transform

# ---- group: Auto Setting Tag (continued)
tag = TextTag3D(Location=move.Geometry, Text=python.texts, Size=number_slider, Justification=5)

# ----
tag_2 = TextTag3D(Location=move_2.Geometry, Text=getuv, Size=multiplication, Justification=5)
