# Grasshopper definition mortarIndents.gh (Grasshopper 0.9.76)

crv = Curve(<curve referenced from the Rhino model>)
vec = VectorXYZ(XComponent=0, YComponent=0, ZComponent=Slider(6, range=0..10))  # -> Vector, Length
extr = Extrude(Base=crv, Direction=vec.Vector)
neg = Negative(Value=Slider(1.25, range=0..10))
offset = Offset(Curve=crv, Distance=neg, Plane=PlaneXY(0, 0, 0), Corners=1)
cap = CapHoles(Brep=extr)
vec_2 = VectorXYZ(XComponent=0, YComponent=0, ZComponent=Slider(1, range=0..100))  # -> Vector, Length
move = Move(Geometry=offset, Motion=vec_2.Vector)  # -> Geometry, Transform
neg_2 = Negative(Value=Slider(0.289, range=0..1))
offset_2 = Offset(Curve=move.Geometry, Distance=neg_2, Plane=PlaneXY(0, 0, 0), Corners=1)
crv_2 = Curve(flatten([offset, offset_2]))
loft = Loft(Curves=crv_2, Options={Adjust=False, Closed=False, LoftEnds=0, LoftSimp=0, LoftType=0, Rebuild=10, Refit=0.01})
cap_2 = CapHoles(Brep=loft)
volume = Volume(Geometry=cap_2)  # -> Volume, Centroid
