# Grasshopper definition name blocks by area with dot.gh (Grasshopper 1.0.7)
# plug-ins: EleFront

crv = Curve([<curve referenced from the Rhino model> x39])
area = Area(Geometry=crv)  # -> Area, Centroid
python = GhPythonScript(area=area.Area, center=area.Centroid, region=crv)  # -> out, result; inputs area: list, center: list, region: list
# ---------- python: Python ----------
import rhinoscriptsyntax as rs

rounded_areas = [round(x, 3) for x in area]
unique_areas = list(set(rounded_areas))

prefix = ["N" for x in area]

suffix = [str(unique_areas.index(x)+1) for x in rounded_areas]

result = zip(prefix, suffix)
result = ["".join(x) for x in result]
# ---------- end python ----------
textdot = DefineTextDot(Text=python.result, Location=area.Centroid, Font="Arial", Size=14)
