# Grasshopper definition new2by4.gh (Grasshopper 0.9.76)
# plug-ins: Python Interpreter

number_slider = Slider(14, range=0..100)
cone = Cone(Base=PlaneXY(0, 0, 0), Radius=0.5, Length=1)  # -> Cone, Tip
curve = Curve(<curve referenced from the Rhino model>)
curve_2 = Curve(<curve referenced from the Rhino model>)
point = Point(<point referenced from the Rhino model>)
point_2 = Point(<point referenced from the Rhino model>)
divide_curve = DivideCurve(Curve=curve_2, Count=number_slider, Kinks=False)  # -> Points, Tangents, Parameters
divide_curve_2 = DivideCurve(Curve=curve, Count=number_slider, Kinks=False)  # -> Points, Tangents, Parameters
line = Line(StartPoint=point_2, EndPoint=point)
flipboard_python = PythonScript(switch=Toggle(True))  # -> out, a; inputs switch: Boolean
# ---------- flipboard_python: Python ----------
values = [1.5, 3.5]

if switch == True:
    values = list(reversed(values))
print switch
print values
a = values
# ---------- end flipboard_python ----------
pt_start = Point(<point referenced from the Rhino model>)
pt_end = Point(<point referenced from the Rhino model>)
line_2 = Line(StartPoint=divide_curve_2.Points, EndPoint=divide_curve.Points)
line_3 = Line()
python_script = PythonScript(start=pt_start, end=pt_end, dimensions=flipboard_python.a)  # -> out, plane, box_pt; inputs start: Point3d, end: Point3d, dimensions: list
# ---------- python_script: Python ----------
import rhinoscriptsyntax as rs
import Rhino
import Rhino.Geometry as rg

width = dimensions[0]
height = dimensions[1]

altitude = rg.Point3d(start.X, start.Y, start.Z + 1)
x_vector = rg.Vector3d(end - start) 
y_vector = rg.Vector3d(altitude - start) 

plane = rg.Plane(start, x_vector, y_vector)


move_z = plane.ZAxis * width
move_y = plane.YAxis * height

translation = move_z + move_y

xform = rg.Transform.Translation(translation)

box_pt = end
box_pt.Transform(xform)
# ---------- end python_script ----------
deconstruct_plane = DeconstructPlane(Plane=python_script.plane)  # -> Origin, XAxis, YAxis, ZAxis
box_2pt = Box2Pt(PointA=pt_start, PointB=python_script.box_pt, Plane=python_script.plane)
multiplication = Multiplication(A=deconstruct_plane.ZAxis, B=Slider(1, range=0..1))
multiplication_2 = Multiplication(A=deconstruct_plane.YAxis, B=Slider(1.34, range=0..10))
negative = Negative(Value=multiplication_2)
negative_2 = Negative(Value=multiplication)
addition = Addition(A=negative, B=negative_2)
move = Move(Geometry=box_2pt, Motion=addition)  # -> Geometry, Transform
