# Grasshopper definition new2by4_basedOnCenter.gh (Grasshopper 0.9.76)
# plug-ins: Python Interpreter

number_slider = Slider(73, range=0..100)
curve = Curve(<curve referenced from the Rhino model>)
curve_2 = Curve(<curve referenced from the Rhino model>)
divide_curve = DivideCurve(Curve=curve, Count=number_slider, Kinks=False)  # -> Points, Tangents, Parameters
divide_curve_2 = DivideCurve(Curve=curve_2, Count=number_slider, Kinks=False)  # -> Points, Tangents, Parameters
flip = BooleanToggle(False)
python_script = PythonScript(
    start=divide_curve.Points,
    end=divide_curve_2.Points,
    flip=flip,
    shift_z=Slider(0, range=-0.5..0.5),
    shift_y=Slider(0, range=-0.5..0.5))  # -> out, plane, a, b; inputs start: Point3d, end: Point3d, flip: Boolean
# ---------- python_script: Python ----------
import rhinoscriptsyntax as rs
import Rhino
import Rhino.Geometry as rg



values = [1.5, 3.5]

if flip == True:
    values = list(reversed(values))

width = values[0]
height = values[1]



altitude = rg.Point3d(start.X, start.Y, start.Z + 1)
x_vector = rg.Vector3d(end - start) 
y_vector = rg.Vector3d(altitude - start) 

plane = rg.Plane(start, x_vector, y_vector)


move_z = plane.ZAxis * .5 * width
z2 = plane.ZAxis * shift_z * width
move_y = plane.YAxis * .5 * height
y2 = plane.YAxis * shift_y * height
xform = rg.Transform.Translation((move_z * -1) + (move_y * -1) + z2 + y2)
xform_rev = rg.Transform.Translation(move_z + move_y + z2 + y2)

a = start
a.Transform(xform)


b = end
b.Transform(xform_rev)
# ---------- end python_script ----------
box_2pt = Box2Pt(PointA=python_script.a, PointB=python_script.b, Plane=python_script.plane)
