# Grasshopper definition new2by4_basedOnCenter_architecture.gh (Grasshopper 0.9.76)
# plug-ins: Python Interpreter, Human, PTComponentLibrary

unit_z = UnitZ(Factor=Slider(68, range=0..100))
curve = Curve(<curve referenced from the Rhino model>)
move = Move(Geometry=curve, Motion=unit_z)  # -> Geometry, Transform
explode = Explode(Curve=move.Geometry, Recursive=True)  # -> Segments, Vertices
number_slider = Slider(4.1, range=0..10)
point = Point([<point referenced from the Rhino model> x10])
extend_curve = ExtendCurve(Curve=explode.Segments, Type=0, Start=number_slider, End=number_slider)
divide_length = DivideLength(Curve=move.Geometry, Distance=Slider(16, range=0..100), RoundUp=False, RoundDn=False)
flip = BooleanToggle(False)
python_script = PythonScript(points=point, seed=Slider(573, range=0..1000))  # -> out, colors, R, G, B; inputs points: list of Point3d
# ---------- python_script: Python ----------
import rhinoscriptsyntax as rs
import random
import time
import Rhino

random.seed(seed)

def rand_color():
    r = lambda: random.randint(0,255)
    color = [r(),r(),r()]
    return color

colors = [rand_color() for x in points]
R = [r for r, g, b in colors]
G = [g for r, g, b in colors]
B = [b for r, g, b in colors]
# ---------- end python_script ----------
divide_length_2 = DivideLength(Curve=curve, Distance=Slider(16, range=0..100), RoundUp=False, RoundDn=False)
python_script_2 = PythonScript(radius=Slider(3.4, range=0..10), points=point)  # -> out, a, names, lines, couple; inputs points: list of Point3d
# ---------- python_script_2: Python ----------
import Rhino
import Rhino.Geometry as rg


circles = [rg.Circle(x, radius) for x in points]

a = circles

names = ["Joe", "Gail", "Sallie", "Gemma", "Rochelle", "Frank", "George"]


length = len(points)


lines = [rg.Line(x, points[4]) for e, x in enumerate(points) if e != 4]

pairs = zip(points, names)

for p in pairs: print p
print length
print len(pairs)


start = [x for x, y in pairs if "Gail" in y]
end = [x for x, y in pairs if "George" in y]

couple = rg.Line(start[0], end[0])
# ---------- end python_script_2 ----------
colour_rgb = ColourRGB(Alpha=Slider(255, range=0..1000), Red=python_script.R, Green=python_script.G, Blue=python_script.B)
line = Line(StartPoint=divide_length, EndPoint=divide_length_2)
end_points = EndPoints(Curve=[extend_curve, line])  # -> Start, End
python_script_3 = PythonScript(
    start=end_points.Start,
    end=end_points.End,
    flip=flip,
    shift_z=Slider(0, range=-0.5..0.5),
    shift_y=Slider(0, range=-0.5..0.5))  # -> out, plane, a, b; inputs start: Point3d, end: Point3d, flip: Boolean
# ---------- python_script_3: Python ----------
import rhinoscriptsyntax as rs
import Rhino
import Rhino.Geometry as rg



values = [1.5, 3.5]

if flip == True:
    values = list(reversed(values))

width = values[0]
height = values[1]


if start.X == end.X and start.Y == end.Y:
    altitude = rg.Point3d(start.X, start.Y + 1, start.Z)
else:
    altitude = rg.Point3d(start.X, start.Y, start.Z + 1)



x_vector = rg.Vector3d(end - start) 
y_vector = rg.Vector3d(altitude - start) 

plane = rg.Plane(start, x_vector, y_vector)


move_z = plane.ZAxis * .5 * width
z2 = plane.ZAxis * shift_z * width
move_y = plane.YAxis * .5 * height
y2 = plane.YAxis * shift_y * height
xform = rg.Transform.Translation((move_z * -1) + (move_y * -1) + z2 + y2)
xform_rev = rg.Transform.Translation(move_z + move_y + z2 + y2)

a = start
a.Transform(xform)


b = end
b.Transform(xform_rev)
# ---------- end python_script_3 ----------
justifiedtext3d = JustifiedText3d(
    Location=point,
    Text=python_script_2.names,
    Size=1,
    Color=colour_rgb,
    HorizontalAlignment=1,
    VerticalAlginment=1,
    Font="51",
    UseMeshes=False,
    Bake=False)
box_2pt = Box2Pt(PointA=python_script_3.a, PointB=python_script_3.b, Plane=python_script_3.plane)
vector_xyz = VectorXYZ(XComponent=Slider(37, range=0..100), YComponent=Slider(10, range=0..10), ZComponent=Slider(17, range=0..100))  # -> Vector, Length
number_slider_2 = Slider(0.74, range=0..10)
point_2 = Point(<point referenced from the Rhino model>)
move_2 = Move(Geometry=point_2, Motion=vector_xyz.Vector)  # -> Geometry, Transform
box_2pt_2 = Box2Pt(PointA=point_2, PointB=move_2.Geometry, Plane=PlaneXY(0, 0, 0))
flip_2 = BooleanToggle(True)
brep_edges = BrepEdges(Brep=box_2pt_2)  # -> Naked, Interior, NonManifold
explode_2 = Explode(Curve=brep_edges.Interior, Recursive=True)  # -> Segments, Vertices
extend_curve_2 = ExtendCurve(Curve=explode_2.Segments, Type=0, Start=number_slider_2, End=number_slider_2)
end_points_2 = EndPoints(Curve=extend_curve_2)  # -> Start, End
python_script_4 = PythonScript(
    start=end_points_2.Start,
    end=end_points_2.End,
    flip=flip_2,
    shift_z=Slider(0, range=-0.5..0.5),
    shift_y=Slider(0, range=-0.5..0.5))  # -> out, plane, a, b; inputs start: Point3d, end: Point3d, flip: Boolean; same code as python_script_3
curve_2 = Curve(brep_edges.Interior)
box_2pt_3 = Box2Pt(PointA=python_script_4.a, PointB=python_script_4.b, Plane=python_script_4.plane)
pipe = Pipe(Curve=brep_edges.Interior, Radius=Slider(0.24, range=0..1), Caps=1)
