# Grasshopper definition numpy_pandas_working.gh (Grasshopper 0.9.76)
# plug-ins: Python Interpreter, GH_CPython

pt = Point([<point referenced from the Rhino model> x30])
python = PythonScript(points=pt)  # -> out, x_val; inputs points: list of Point3d
# ---------- python: Python ----------
import rhinoscriptsyntax as rs

x_val = []

for pt in points:
    x,y,z = pt
    print x
    x_val.append(x)
# ---------- end python ----------
gh_cpython = GH_CPython(input=Slider(5, range=0..10), x=python.x_val)  # -> output; inputs input: list, x: list
# ---------- gh_cpython: Python ----------
# -*- coding: utf-8 -*-
""" 
Python Script
Created on  Tuesday May 2018 09:21:27 
@author:  mkreidler 

[desc]
Description of the plugin Here
Write here any thing... 
[/desc]

ARGUMENTS:
----------
<inp> 
    _input :[required] - [type = int] - [default = None] 
    Descripe your input here 
        * bullet point.
        * bullet point
</inp>

<inp> 
    x :[required] - [type = int] - [default = None] 
    Descripe your input here 
        * bullet point.
        * bullet point
</inp>


<inp>
    Other inputs go here ...
</inp>

RETURN:
----------
    <out>
        output_ : indicate your output description here. \n refers to a new line.
    </out>

"""

import pint
import pandas as pd
import numpy as np
import matplotlib.pyplot as plt

print("Hello")

print(x)

a = [12,34,54]
b = ["Walrus", "chipper", "manta"]

data = [a,b,a*2]

df = pd.DataFrame(data)

print(df)

output_ = df
# ---------- end gh_cpython ----------
panel = Panel(python.x_val)
panel_2 = Panel(gh_cpython)
