# Grasshopper definition nut generator.gh (Grasshopper 0.9.76)
# plug-ins: Python Interpreter

width_of_nut = Slider(1.625, range=0..10)
id_of_nut = Slider(1, range=0..2)
number_slider = Slider(6, range=0..10)
division = Division(A=id_of_nut, B=2)
python = PythonScript(nutWidth=width_of_nut, sides=number_slider)  # -> out, a
# ---------- python: Python ----------
import math as m

adjacentSide = nutWidth/2
angle = 360/(sides*2)

myCos = m.cos(m.radians(angle))


a = 1/(myCos/adjacentSide)
# ---------- end python ----------
pt = Point(<point referenced from the Rhino model>)
cir = Circle(Plane=pt, Radius=python.a)
cir_2 = Circle(Plane=pt, Radius=division)
divide = DivideCurve(Curve=cir, Count=number_slider, Kinks=False)  # -> Points, Tangents, Parameters
python_2 = PythonScript(x=pt)  # -> out, a; inputs x: Point3d
# ---------- python_2: Python ----------
import rhinoscriptsyntax as rs


magnitude = 63/64


a = rs.coerce3dpoint([x[0],x[1],x[2]+magnitude])


print a
# ---------- end python_2 ----------
python_3 = PythonScript(lines=divide.Points)  # -> out, a; inputs lines: list of Point3d
# ---------- python_3: Python ----------
import rhinoscriptsyntax as rs

count = 0 
a = []


for step in range(len(lines)-1) :

    p = rs.AddLine(lines[count],lines[count+1])
    print count
    count += 1
    a.append(p)
    
    if count == len(lines)-1:
        p = rs.AddLine(lines[count],lines[0])
        print count
        a.append(p)
# ---------- end python_3 ----------
vec2pt = Vector2Pt(PointA=pt, PointB=python_2.a, Unitize=False)  # -> Vector, Length
join = JoinCurves(Curves=python_3.a, Preserve=False)
extr = Extrude(Base=cir_2, Direction=vec2pt.Vector)
python_4 = PythonScript()  # -> out, a
# ---------- python_4: Python ----------
import math as m

a = m.pi/10
# ---------- end python_4 ----------
extr_2 = Extrude(Base=join, Direction=vec2pt.Vector)
cap = CapHoles(Brep=extr_2)
cap_2 = CapHoles(Brep=extr)
series = Series(Start=0, Step=python_4.a, Count=Slider(177, range=0..300))
sdiff = SolidDifference(BrepsA=cap, BrepsB=cap_2)
python_5 = PythonScript(height=vec2pt.Vector)  # -> out, a
# ---------- python_5: Python ----------
numTurns = 8 

circleSect = 4 

a = height/(numTurns * circleSect)
# ---------- end python_5 ----------
cos = Cosine(Value=series)
number_slider_2 = Slider(0.508, range=0..10)
sin = Sine(Value=series)
contour = Contour(Shape=cap_2, Point=pt, Direction=vec2pt.Vector, Distance=python_5.a)  # -> flatten(Contours)
multiplication = Multiplication(A=series, B=Slider(0.02, range=0..0.04))
multiplication_2 = Multiplication(A=sin, B=number_slider_2)
multiplication_3 = Multiplication(A=cos, B=number_slider_2)
pt_2 = ConstructPoint(XCoordinate=multiplication_3, YCoordinate=multiplication_2, ZCoordinate=multiplication)
divide_2 = DivideCurve(Curve=contour, Count=Slider(4, range=0..10), Kinks=False)  # -> Points, Tangents, Parameters
python_6 = PythonScript()  # -> out, a
# ---------- python_6: Python ----------
import rhinoscriptsyntax as rs

rs.Command("_spiral")
# ---------- end python_6 ----------
intcrv = Interpolate(Vertices=pt_2, Degree=3, Periodic=False, KnotStyle=1)  # -> Curve, Length, Domain
