# Grasshopper definition old paradise street solver.gh (Grasshopper 1.0.7)

# ---- group: Controls
wall_thickness = Slider(0.538, range=0..1)
curve_amplitude = Slider(1.671, range=0..10)
depth = Slider(1.563, range=0..10)
square_size = Slider(13.5, range=0..100)

# ---- group: Machine
pt = ConstructPoint(XCoordinate=square_size, YCoordinate=square_size, ZCoordinate=0)
rec_2pt = Rectangle2Pt(Plane=PlaneXY(0, 0, 0), PointA=Point(0, 0, 0), PointB=pt, Radius=0)  # -> Rectangle, Length
neg = Negative(Value=wall_thickness)
division = Division(A=wall_thickness, B=2)
offset = OffsetCurve(Curve=rec_2pt.Rectangle, Distance=neg, Plane=PlaneXY(0, 0, 0), Corners=1)
tweencrv = TweenCurve(CurveA=rec_2pt.Rectangle, CurveB=offset, Factor=0.5, BlendType=0)
neg_2 = Negative(Value=division)
explode = Explode(Curve=tweencrv, Recursive=True)  # -> Segments, Vertices
python = GhPythonScript(edges=explode.Segments)  # -> out, a, line_midpt, edge1; inputs edges: list of Curve
# ---------- python: Python ----------
import rhinoscriptsyntax as rs
import Rhino

mids = []



for i,e in enumerate(edges):
    if i % 2 == 0:
        print e
        start = rs.CurveStartPoint(e)
        end = rs.CurveEndPoint(e)
        x1,y1,z1 = start
        x2, y2, z2 = end
        x3,y3,z3 = [(x2+x1)/2,(y2+y1)/2,(z2+z1)/2]
        midpoint = Rhino.Geometry.Point3d(x3,y3,z3)
        
        mids.append(midpoint)
    if i == 1:
        edge1=e

line = Rhino.Geometry.Line(mids[0],mids[1])
a = line
# ---------- end python ----------
offset_2 = OffsetCurve(Curve=python.a, Distance=neg_2, Plane=PlaneXY(0, 0, 0), Corners=1)
offset_3 = OffsetCurve(Curve=python.a, Distance=division, Plane=PlaneXY(0, 0, 0), Corners=1)
end = EndPoints(Curve=python.a)  # -> Start, End
end_2 = EndPoints(Curve=python.edge1)  # -> Start, End
leaf_bottom = PointOnCurve(python.a, parameter=0.431)
end_3 = EndPoints(Curve=offset_3)  # -> Start, End
end_4 = EndPoints(Curve=offset_2)  # -> Start, End
ln = Line(StartPoint=end_3.End, EndPoint=end_4.End)
ln_2 = Line(StartPoint=end_3.Start, EndPoint=end_4.Start)
join = JoinCurves(Curves=[offset_3, ln_2, ln, offset_2], Preserve=False)
rdiff = RegionDifference(CurvesA=offset, CurvesB=join)
Z = UnitZ(Factor=1)
rad = Radians(Degrees=Slider(90, range=0..100))
rad_2 = Radians(Degrees=Slider(180, range=0..1000))
rad_3 = Radians(Degrees=Slider(180, range=0..1000))
item = ListItem(List=rdiff, Index=Slider(1, range=0..100), Wrap=True)
rdiff_2 = RegionDifference(CurvesA=rec_2pt.Rectangle, CurvesB=rdiff)
unknown = Slider(6, range=0..10)
crv = Curve(rec_2pt.Rectangle)
crv_2 = Curve(rdiff)
Z_2 = UnitZ(Factor=unknown)
Z_3 = UnitZ(Factor=depth)
extr = Extrude(Base=crv, Direction=Z_3)
extr_2 = Extrude(Base=crv_2, Direction=Z_3)
cap = CapHoles(Brep=extr)
cap_2 = CapHoles(Brep=extr_2)
extr_3 = Extrude(Base=rdiff_2, Direction=Z_2)
yz = YZPlane(Origin=leaf_bottom)
sdiff = SolidDifference(BrepsA=cap, BrepsB=cap_2)
yz_2 = YZPlane(Origin=leaf_bottom)

# ---- group: Controls / Leaf Bottom
curvepoint = PointOnCurve(python.a, parameter=0.341)

# ---- group: Controls / Leaf Top
curvepoint_2 = PointOnCurve(python.edge1, parameter=0.553)

# ---- group: Machine (continued)
ln_3 = Line(StartPoint=end_2.End, EndPoint=curvepoint)
end_5 = EndPoints(Curve=ln_3)  # -> Start, End
curvepoint_3 = PointOnCurve(ln_3, parameter=0.5)
ln_4 = Line(StartPoint=curvepoint_2, EndPoint=end.Start)
pt_2 = Point(end_5.End)
vec2pt = Vector2Pt(PointA=end_5.Start, PointB=pt_2, Unitize=False)  # -> Vector, Length
end_6 = EndPoints(Curve=ln_4)  # -> Start, End
curvepoint_4 = PointOnCurve(ln_4, parameter=0.5)
vrot = Rotate(Vector=vec2pt.Vector, Axis=Z, Angle=rad)
vrot_2 = Rotate(Vector=curvepoint_4, Axis=Z, Angle=rad)
amp = Amplitude(Vector=vrot, Amplitude=curve_amplitude)
vrot_3 = Rotate(Vector=vrot, Axis=Z, Angle=rad_2)
amp_2 = Amplitude(Vector=vrot_2, Amplitude=curve_amplitude)
move = Move(Geometry=curvepoint_3, Motion=amp)  # -> Geometry, Transform
amp_3 = Amplitude(Vector=vrot_3, Amplitude=curve_amplitude)
move_2 = Move(Geometry=curvepoint_4, Motion=amp_2)  # -> Geometry, Transform
move_3 = Move(Geometry=curvepoint_3, Motion=amp_3)  # -> Geometry, Transform
arc = Arc3Pt(PointA=end_6.Start, PointB=move_2.Geometry, PointC=end_6.End)  # -> Arc, Plane, Radius
xy = XYPlane(Origin=curvepoint_4)
arc_2 = Arc3Pt(PointA=end_5.Start, PointB=move_3.Geometry, PointC=pt_2)  # -> Arc, Plane, Radius
arc_3 = Arc3Pt(PointA=end_5.Start, PointB=move.Geometry, PointC=pt_2)  # -> Arc, Plane, Radius
join_2 = JoinCurves(Curves=[arc_2.Arc, arc_3.Arc], Preserve=False)
rotate = Rotate(Geometry=arc.Arc, Angle=rad_3, Plane=xy)  # -> Geometry, Transform
offset_4 = OffsetCurve(Curve=join_2, Distance=neg_2, Plane=PlaneXY(0, 0, 0), Corners=1)
offset_5 = OffsetCurve(Curve=join_2, Distance=division, Plane=PlaneXY(0, 0, 0), Corners=1)
join_3 = JoinCurves(Curves=[rotate.Geometry, arc.Arc], Preserve=False)
offset_6 = OffsetCurve(Curve=join_3, Distance=division, Plane=PlaneXY(0, 0, 0), Corners=1)
offset_7 = OffsetCurve(Curve=join_3, Distance=neg_2, Plane=PlaneXY(0, 0, 0), Corners=1)
rint = RegionIntersection(CurvesA=rec_2pt.Rectangle, CurvesB=offset_5)
rint_2 = RegionIntersection(CurvesA=item, CurvesB=offset_5)
rint_3 = RegionIntersection(CurvesA=item, CurvesB=offset_4)
rint_4 = RegionIntersection(CurvesA=item, CurvesB=offset_6)
extr_4 = Extrude(Base=rint_3, Direction=Z_3)
extr_5 = Extrude(Base=rint_2, Direction=Z_3)
offset_8 = OffsetCurve(Curve=ln_3, Distance=division, Plane=PlaneXY(0, 0, 0), Corners=1)
offset_9 = OffsetCurve(Curve=ln_3, Distance=neg_2, Plane=PlaneXY(0, 0, 0), Corners=1)
cap_3 = CapHoles(Brep=extr_4)
cap_4 = CapHoles(Brep=extr_5)
extr_6 = Extrude(Base=offset_7, Direction=Z_3)
extr_7 = Extrude(Base=rint_4, Direction=Z_3)
end_7 = EndPoints(Curve=offset_9)  # -> Start, End
end_8 = EndPoints(Curve=offset_8)  # -> Start, End
cap_5 = CapHoles(Brep=extr_6)
cap_6 = CapHoles(Brep=extr_7)
ln_5 = Line(StartPoint=end_8.End, EndPoint=end_7.End)
ln_6 = Line(StartPoint=end_8.Start, EndPoint=end_7.Start)
crv_3 = Curve(ln_4)
offset_10 = OffsetCurve(Curve=crv_3, Distance=division, Plane=PlaneXY(0, 0, 0), Corners=1)
offset_11 = OffsetCurve(Curve=crv_3, Distance=neg_2, Plane=PlaneXY(0, 0, 0), Corners=1)
join_4 = JoinCurves(Curves=[ln_6, ln_5, offset_8, offset_9], Preserve=False)
end_9 = EndPoints(Curve=offset_11)  # -> Start, End
end_10 = EndPoints(Curve=offset_10)  # -> Start, End
rint_5 = RegionIntersection(CurvesA=item, CurvesB=join_4)
rdiff_3 = RegionDifference(CurvesA=rint_2, CurvesB=rint_3)
ln_7 = Line(StartPoint=end_10.Start, EndPoint=end_9.Start)
ln_8 = Line(StartPoint=end_10.End, EndPoint=end_9.End)
join_5 = JoinCurves(Curves=[offset_10, offset_11, ln_7, ln_8], Preserve=False)
extr_8 = Extrude(Base=rint_5, Direction=Z_3)
extr_9 = Extrude(Base=join_5, Direction=Z_3)
cap_7 = CapHoles(Brep=extr_9)
sdiff_2 = SolidDifference(BrepsA=cap_6, BrepsB=cap_5)
extr_10 = Extrude(Base=rdiff_3, Direction=Z_2)
extr_11 = Extrude(Base=rint_5, Direction=Z_2)
sdiff_3 = SolidDifference(BrepsA=cap_4, BrepsB=cap_3)
cap_8 = CapHoles(Brep=extr_8)
sunion = SolidUnion(Breps=[sdiff_2, cap_7])
sunion_2 = SolidUnion(Breps=[sdiff_3, cap_8])
mirror = Mirror(Geometry=sunion, Plane=yz)  # -> Geometry, Transform
mirror_2 = Mirror(Geometry=sunion_2, Plane=yz_2)  # -> Geometry, Transform
brep = Brep(flatten([sdiff, sunion_2, mirror_2.Geometry, mirror.Geometry, sunion]))

# ---- group: Assembly
addition = Addition(A=square_size, B=Slider(0.125, range=0..1))
sunion_3 = SolidUnion(Breps=brep)  # -> flatten(Result)
pt_3 = ConstructPoint(XCoordinate=addition, YCoordinate=addition, ZCoordinate=0)
rec_2pt_2 = Rectangle2Pt(Plane=PlaneXY(0, 0, 0), PointA=Point(0, 0, 0), PointB=pt_3, Radius=0)  # -> Rectangle, Length
arrrec = RectangularArray(Geometry=sunion_3, Cell=rec_2pt_2.Rectangle, XCount=Slider(4, range=0..10), YCount=Slider(2, range=0..10))  # -> Geometry, Transform
