# Grasshopper definition point density - heat map.gh (Grasshopper 1.0.7)
# plug-ins: Heteroptera

pt = Point([Point(-891.973907, -169.220077, -1886.856891), Point(-899.132054, -169.220077, -1965.587516), Point(-929.014527, -169.220077, -1866.313137), Point(-946.555778, -169.220077, -1866.278101), Point(-1050.987407, -169.220077, -1865.235575), Point(-1068.36315, -169.220077, -1865.344622)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])
srf = Surface(<surface referenced from the Rhino model>)
crossref = CrossReference(ListA=pt, ListB=pt, CrossMode=1)  # -> ListA, ListB
xz = XZPlane(Origin=Point(0, 0, 0))
voronoi = Voronoi(Points=pt, Boundary=srf, BruteForceOverride=False)
area = Area(Geometry=voronoi)  # -> Area, Centroid
extremums = MinMax(Number=area.Area)  # -> Minimum, Maximum
prox = Proximity2D(
    Points=pt,
    Plane=xz,
    Group=Slider(11, range=0..100),
    MinRadius=Slider(0, range=0..100),
    MaxRadius=Slider(3500, range=2..3500))  # -> Links, Topology
python = GhPythonScript(area=area.Area, denominator=extremums.Maximum, x=Slider(18.62, range=0..30))  # -> r; inputs area: list
# ---------- python: Python ----------
print sum(area)/len(area)

def normalize(number):
    minimum = min(area)
    maximum = max(area)
    delta = maximum - minimum
    ratio = (number - minimum)/(denominator/x)
    
    rgb = ratio * 255
    return rgb

r = []

for ar in area:
    value = normalize(ar)
    r.append(value)
# ---------- end python ----------
sort = SortList(Keys=area.Area)  # -> Keys, ValuesA
len = Length(Curve=prox.Links)
python_tree_to_lists = PythonScript(x=len, y=Toggle(True), adjust=Slider(1, range=1..10))  # -> out, a, z, normalize; inputs x: tree
# ---------- python_tree_to_lists: Python ----------
if y == True:
    
    import rhinoscriptsyntax as rs
     
    import Rhino.Geometry as rg
    from clr import AddReference as addr
    addr("Grasshopper")
     
    from System import Object
    from Grasshopper import DataTree
    from Grasshopper.Kernel.Data import GH_Path
     
     
    def raggedListToDataTree(raggedList):
        rl = raggedList
        result = DataTree[object]()
        for i in range(len(rl)):
            temp = []
            for j in range(len(rl[i])):
                temp.append(rl[i][j])
            #print i, " - ",temp
            path = GH_Path(i)
            result.AddRange(temp, path)
        return result
     
    def dataTreeToList(aTree):
        theList = []
        for i in range(aTree.BranchCount ):
            thisListPart = []
            thisBranch = aTree.Branch(i)
            for j in range(len(thisBranch)):
                thisListPart.append( thisBranch[j] )
            theList.append(thisListPart)
        return theList
    
    # take gh data tree and turn it into lists of lists
    # for python, the tree in this case groups points
    # based on threshold
    
    a = dataTreeToList(x)
    # enumerate the branches, which is telling you 
    # the group number
    
    z = []
    
    
    for length in a:
        #print length
        total =  sum(length)
        z.append(total)
        
    maximum = max(z)
    normalize = [x/(maximum/adjust) for x in z]
# ---------- end python_tree_to_lists ----------
mesh = MeshBrep(
    Brep=voronoi,
    Settings={GridMaxCount=0, GridMinCount=16, JaggedSeams=False, MaxEdgeLength=0, MinEdgeLength=0.0001, MinTolerance=0, Refine=True, RefineAngle=0, RelativeTolerance=0.65, SimplePlanes=True, Tolerance=0})
graph = QuickGraph(sort.Keys, SortOrder=0)
rgb = ColourRGB(Alpha=255, Red=python, Green=Slider(255, range=0..255), Blue=Slider(255, range=0..255))
gradient = Gradient(
    LowerLimit=0,
    UpperLimit=1,
    Parameter=python_tree_to_lists.normalize,
    stops=[0.174: RGB(0, 128, 0), 0.314: RGB(255, 255, 0), 0.903: RGB(222, 9, 9)])
preview = CustomPreview(Geometry=mesh, Material=rgb)
sph = Sphere(Base=pt, Radius=Slider(68, range=0..100))
preview_2 = CustomPreview(Geometry=sph, Material=gradient)
