# Grasshopper definition points from leaders in excel.gh (Grasshopper 1.0.7)
# plug-ins: EleFront, GH_CPython

gh_cpython = GH_CPython(input=Button())  # -> name, guid; inputs input: list
#   port input: [required] - [type = int] - [default = None] Descripe your input here * bullet point. * bullet point
#   port name: indicate your output description here. refers to a new line.
# ---------- gh_cpython: Python ----------
import pandas as pd


file = r"C:\Users\mkreidler\Desktop\Local Data\leader names.xlsx"

df = pd.read_excel(file)

print(df)

name = df.names.tolist()
guid = df.guid.tolist()
# ---------- end gh_cpython ----------
python = GhPythonScript(names=gh_cpython.name, guids=gh_cpython.guid)  # -> out, a, names; inputs names: list, guids: list
# ---------- python: Python ----------
import rhinoscriptsyntax as rs
import Rhino
import scriptcontext as sc

doc = Rhino.RhinoDoc.ActiveDoc

names = [n.replace("'", "") for n in names]

guids = [g.replace("'", "") for g in guids]

sc.doc = doc

points = []

#Rhino.Geometry.Leader.Points3D()

for g in guids:
    #obj = Rhino.RhinoDoc.ActiveDoc.Objects.Find(g)
    obj = rs.coercerhinoobject(g)
    #geo = rs.coercegeometry(g)
    point = Rhino.Geometry.Point3d(0,0,0)
    if obj:
        point =  obj.Geometry.Points3D[0]
    
    points.append(point)

a = points





sc.doc = ghdoc
# ---------- end python ----------
textdot = DefineTextDot(Text=python.names, Location=python.a, Font="Arial", Size=14)
