# Grasshopper definition profileOffsetTests.gh (Grasshopper 0.9.76)

crv = Curve(<curve referenced from the Rhino model>)
topoly = CurveToPolyline(Curve=crv, ToleranceDistance=Slider(0.25, range=0..1), ToleranceAngle=0)  # -> Polyline, Segments
offset = Offset(Curve=topoly.Polyline, Distance=Slider(1.25, range=0..10), Plane=PlaneXY(0, 0, 0), Corners=1)
