# Grasshopper definition quote rx test 2.gh (Grasshopper 1.0.7)
# plug-ins: GH_CPython

guids_a = Guid([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])
guids_c = Guid([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])
guids_b = Guid([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])
generate_report = Button()
python = GhPythonScript(dots=guids_c)  # -> names, points, layers; inputs dots: list
# ---------- python: Python ----------
import scriptcontext as sc
import rhinoscriptsyntax as rs
import Rhino

points = []
names = []
layers = []

sc.doc = Rhino.RhinoDoc.ActiveDoc

for d in dots:
    pt = rs.TextDotPoint(d)
    #pt = rs.BlockInstanceInsertPoint(y)
    #pt = rs.TextObjectText(y)
    points.append(pt)
    name = rs.TextDotText(d)
    #name = rs.BlockInstanceName(y)
    names.append(name)
    layer = rs.ObjectLayer(d)
    layers.append(layer)
    

sc.doc = ghdoc
# ---------- end python ----------
python_2 = GhPythonScript(dots=guids_a)  # -> names, points, layers; inputs dots: list; same code as python
python_3 = GhPythonScript(dots=guids_b)  # -> names, points, layers; inputs dots: list; same code as python
gh_cpython = GH_CPython(names=python.names, points=python.points, layers=python.layers, guids=guids_c, run=generate_report)  # -> a; inputs names: list, points: list, layers: list, guids: list, run: list
#   port names: [required] - [type = int] - [default = None] Descripe your input here * bullet point. * bullet point
#   port a: indicate your output description here. refers to a new line.
# ---------- gh_cpython: Python ----------
import pandas as pd
import os

folder = r"C:\Users\mkreidler\Desktop\dataframes"

class block:
    def __init__(self):
        self.name = None
        self.point = None
        self.layer = None
        self.guid = None


blocks = []

for i,g in enumerate(guids):
    b = block()
    b.name = names[i]
    b.point = points[i]
    b.layer = layers[i]
    b.guid = guids[i]
    blocks.append(b)


df = pd.DataFrame([vars(f) for f in blocks])

df = df[["name","guid"]].groupby("name").count().reset_index()

file_path = os.path.join(folder, "3-CO2.xlsx")


if run==True:
    df.to_excel(file_path)
# ---------- end gh_cpython ----------
gh_cpython_2 = GH_CPython(names=python_2.names, points=python_2.points, layers=python_2.layers, guids=guids_a, run=generate_report)  # -> a; inputs names: list, points: list, layers: list, guids: list, run: list
#   port names: [required] - [type = int] - [default = None] Descripe your input here * bullet point. * bullet point
#   port a: indicate your output description here. refers to a new line.
# ---------- gh_cpython_2: Python ----------
import pandas as pd
import os

folder = r"C:\Users\mkreidler\Desktop\dataframes"

class block:
    def __init__(self):
        self.name = None
        self.point = None
        self.layer = None
        self.guid = None


blocks = []

for i,g in enumerate(guids):
    b = block()
    b.name = names[i]
    b.point = points[i]
    b.layer = layers[i]
    b.guid = guids[i]
    blocks.append(b)


df = pd.DataFrame([vars(f) for f in blocks])

df = df[["name","guid"]].groupby("name").count().reset_index()

file_path = os.path.join(folder, "1-Estimate.xlsx")

if run==True:
    df.to_excel(file_path)
# ---------- end gh_cpython_2 ----------
gh_cpython_3 = GH_CPython(names=python_3.names, points=python_3.points, layers=python_3.layers, guids=guids_b, run=generate_report)  # -> a; inputs names: list, points: list, layers: list, guids: list, run: list
#   port names: [required] - [type = int] - [default = None] Descripe your input here * bullet point. * bullet point
#   port a: indicate your output description here. refers to a new line.
# ---------- gh_cpython_3: Python ----------
import pandas as pd
import os

folder = r"C:\Users\mkreidler\Desktop\dataframes"

class block:
    def __init__(self):
        self.name = None
        self.point = None
        self.layer = None
        self.guid = None


blocks = []

for i,g in enumerate(guids):
    b = block()
    b.name = names[i]
    b.point = points[i]
    b.layer = layers[i]
    b.guid = guids[i]
    blocks.append(b)


df = pd.DataFrame([vars(f) for f in blocks])

df = df[["name","guid"]].groupby("name").count().reset_index()

file_path = os.path.join(folder, "2-Survey.xlsx")


if run==True:
    df.to_excel(file_path)
# ---------- end gh_cpython_3 ----------
gh_cpython_4 = GH_CPython(run=Button())  # -> output; inputs run: list
#   port run: [required] - [type = int] - [default = None] Descripe your input here * bullet point. * bullet point
#   port output: indicate your output description here. refers to a new line.
# ---------- gh_cpython_4: Python ----------
import pandas as pd
import os

folder = r"C:\Users\mkreidler\Desktop\dataframes"
excels = []
dataframes = []
for root, dirs, files in os.walk(folder, topdown = False):
   for name in files:
      excels.append(os.path.join(root, name))
bases = []
for e in excels:
    df = pd.read_excel(e)
    base = os.path.basename(e).replace(".xlsx","")
    #print(base)
    bases.append(base)
    dataframes.append(df)

master = dataframes[0]

for i,df in enumerate(dataframes):
    if i != 0:
        master = master.merge(df, on="name", how="outer", suffixes=tuple([bases[1],bases[-1]])).fillna(0)
    
master = master.rename(index=str, columns={"guid":"guid"+bases[0]})

print(master)
# ---------- end gh_cpython_4 ----------
