# Grasshopper definition ridgecap generator.gh (Grasshopper 0.9.76)

crv = Curve(<curve referenced from the Rhino model>)
pt = Point(<point referenced from the Rhino model>)
crv_2 = Curve(<curve referenced from the Rhino model>)
circlett = CircleTanTan(CurveA=crv_2, CurveB=crv, Point=pt)
pt_rotate_center = Point(<point referenced from the Rhino model>)
pdecon = Deconstruct(Point=pt_rotate_center)  # -> XComponent, YComponent, ZComponent
number_slider = Slider(1, range=0..1)
neg = Negative(Value=Slider(1, range=0..1))
xz = XZPlane(Origin=Point(0, 0, 0))
pt_2 = ConstructPoint(XCoordinate=pdecon.XComponent, YCoordinate=neg, ZCoordinate=pdecon.ZComponent)
crv_3 = Curve(<curve referenced from the Rhino model>)
crv_rotate_leg = Curve(<curve referenced from the Rhino model>)
ln = Line(StartPoint=pt_rotate_center, EndPoint=pt_2)
addition = Addition()
neg_2 = Negative(Value=number_slider)
rad = Radians(Degrees=Slider(302, range=0..360))
number_slider_2 = Slider(0.5, range=0..1)
offset = Offset(Curve=crv_3, Distance=number_slider, Plane=xz, Corners=1)
offset_2 = Offset(Curve=crv_3, Distance=neg_2, Plane=xz, Corners=1)
rotax = RotateAxis(Geometry=crv_rotate_leg, Angle=rad, Axis=ln)  # -> Geometry, Transform
neg_3 = Negative(Value=number_slider_2)
offset_3 = Offset(Curve=rotax.Geometry, Distance=neg_3, Plane=xz, Corners=1)
offset_4 = Offset(Curve=rotax.Geometry, Distance=number_slider_2, Plane=xz, Corners=1)
end = EndPoints(Curve=offset_4)  # -> Start, End
Y = UnitY(Factor=1)
circle = CircleCNR(Center=end.End, Normal=Y, Radius=Slider(1, range=0..1))
pt_3 = Point(<point referenced from the Rhino model>)
circlett_2 = CircleTanTan(CurveA=offset_2, CurveB=offset_3, Point=pt_3)
