# Grasshopper definition rooftile_cylinder_finder.gh (Grasshopper 0.9.76)

crv = Curve(<curve referenced from the Rhino model>)
cp = ControlPoints(Curve=crv)  # -> Points, Weights, Knots
Y = UnitY(Factor=1)
mesh = Mesh(<mesh referenced from the Rhino model>)
multiplication = Multiplication(A=Slider(49, range=0..100), B=Y)
fcircle = CircleFit(Points=cp.Points)  # -> Circle, Radius, Deviation
neg = Negative(Value=Slider(23, range=0..100))
panel = Panel(fcircle.Radius)
extr = Extrude(Base=fcircle.Circle, Direction=multiplication)
vec = VectorXYZ(XComponent=0, YComponent=neg, ZComponent=0)  # -> Vector, Length
move = Move(Geometry=extr, Motion=vec.Vector)  # -> Geometry, Transform
