# Grasshopper definition rotatingVectorOnCurve.gh (Grasshopper 0.9.76)
# plug-ins: Python Interpreter

crv = Curve(<curve referenced from the Rhino model>)
divide = DivideCurve(Curve=crv, Count=Slider(331, range=0..1000), Kinks=False)  # -> Points, Tangents, Parameters
vec = Vector(Vector(0, 6.861803395, 0))
vec_2 = VectorXYZ(XComponent=0, YComponent=0, ZComponent=Slider(1, range=0..1))  # -> Vector, Length
python = PythonScript(points=divide.Points, vector=vec, length=Slider(1.2, range=0..10), axis=vec_2.Vector, angle=Slider(0.1979, range=0..1))  # -> out, a; inputs points: list of Point3d, vector: Vector3d, axis: Vector3d
# ---------- python: Python ----------
import rhinoscriptsyntax as rs
import Rhino.Geometry as rg
import Rhino

a = [] 
for point in points:
    vector.Rotate(angle, axis)
    v2 = rg.Vector3d.Negate(vector)
    line = rg.Line(point, vector, length)
    l2 = rg.Line(point, v2 , length)
    a.append(line)
    a.append(l2)
# ---------- end python ----------
