# Grasshopper definition shelf_side_parametric.gh (Grasshopper 0.9.76)

height_overall = Slider(46.2, range=0..100)
thickness_lumber = Slider(1.5, range=0..10)
width_lumber = Slider(3.3, range=0..10)
width_overall = Slider(28, range=0..100)
multiplication = Multiplication(A=width_lumber, B=2)
multiplication_2 = Multiplication(A=Slider(5.7, range=0..10), B=2)
division = Division(A=width_overall, B=2)
addition = Addition(A=multiplication, B=multiplication_2)
vector_xyz = VectorXYZ(XComponent=0, YComponent=0, ZComponent=thickness_lumber)  # -> Vector, Length
vector_xyz_2 = VectorXYZ(XComponent=width_lumber, YComponent=0, ZComponent=0)  # -> Vector, Length
xy_plane = XYPlane(Origin=Point(0, 0, 0))
vector_xyz_3 = VectorXYZ(XComponent=0, YComponent=height_overall, ZComponent=0)  # -> Vector, Length
yz_plane = YZPlane(Origin=Point(0, 0, 0))
xz_plane = XZPlane(Origin=Point(0, 0, 0))
negative = Negative(Value=width_lumber)
move = Move(Geometry=xz_plane, Motion=vector_xyz_3.Vector)  # -> Geometry, Transform
move_2 = Move(Geometry=xy_plane, Motion=vector_xyz.Vector)  # -> Geometry, Transform
vector_xyz_4 = VectorXYZ(XComponent=0, YComponent=negative, ZComponent=0)  # -> Vector, Length
srf_top = PlaneSurface(Plane=move_2.Geometry, XSize=Domain(-1000, 1000), YSize=Domain(-1000, 1000))
srf_left = PlaneSurface(Plane=yz_plane, XSize=Domain(-1000, 1000), YSize=Domain(-1000, 1000))
move_3 = Move(Geometry=srf_left, Motion=vector_xyz_2.Vector)  # -> Geometry, Transform
srf_front = PlaneSurface(Plane=xz_plane, XSize=Domain(-1000, 1000), YSize=Domain(-1000, 1000))
srf_back = PlaneSurface(Plane=move.Geometry, XSize=Domain(-1000, 1000), YSize=Domain(-1000, 1000))
move_4 = Move(Geometry=srf_back, Motion=vector_xyz_4.Vector)  # -> Geometry, Transform
srf_bottom = PlaneSurface(Plane=xy_plane, XSize=Domain(-1000, 1000), YSize=Domain(-1000, 1000))
srf_right = Surface(move_3.Geometry)
division_2 = Division(A=addition, B=2)
negative_2 = Negative(Value=addition)
negative_3 = Negative(Value=division_2)
vector_xyz_5 = VectorXYZ(XComponent=0, YComponent=negative_2, ZComponent=0)  # -> Vector, Length
vector_xyz_6 = VectorXYZ(XComponent=0, YComponent=negative_3, ZComponent=0)  # -> Vector, Length
construct_point = ConstructPoint(XCoordinate=division, YCoordinate=0, ZCoordinate=0)
boundary_volume = BoundaryVolume(Boundaries=[srf_bottom, srf_back, srf_top, srf_front, srf_left, srf_right])
yz_plane_2 = YZPlane(Origin=construct_point)
mirror = Mirror(Geometry=srf_right, Plane=yz_plane_2)  # -> Geometry, Transform
boundary_volume_2 = BoundaryVolume(Boundaries=[srf_bottom, srf_top, srf_back, move_4.Geometry, mirror.Geometry, srf_right])
move_5 = Move(Geometry=boundary_volume_2, Motion=[vector_xyz_6.Vector, vector_xyz_5.Vector])  # -> Geometry, Transform
mirror_2 = Mirror(Geometry=boundary_volume, Plane=yz_plane_2)  # -> Geometry, Transform
