# Grasshopper definition shelf_side_parametric2.gh (Grasshopper 0.9.76)

thickness_lumber = Slider(1.5, range=0..10)
width_lumber = Slider(3, range=0..10)
height_overall = Slider(32.68, range=0..100)
width_overall = Slider(21, range=0..100)
clear_shelf_opening = Slider(9.7, range=0..10)
region_union = RegionUnion()
cluster = Cluster(
    z_component=thickness_lumber,
    x_component=width_lumber,
    y_component=height_overall,
    A=width_overall,
    value=width_lumber,
    A_2=width_lumber,
    A_3=clear_shelf_opening)  # -> solid_2, geometry_2, solid, geometry
brep = Brep([cluster.solid_2, cluster.geometry_2, cluster.solid, cluster.geometry])

# ==== cluster Cluster
z_component = ClusterInput()
y_component = ClusterInput()
x_component = ClusterInput()
value = ClusterInput()
A = ClusterInput()
A_2 = ClusterInput()
A_3 = ClusterInput()
xy_plane = XYPlane(Origin=Point(0, 0, 0))
vector_xyz = VectorXYZ(XComponent=0, YComponent=0, ZComponent=z_component)  # -> Vector, Length
yz_plane = YZPlane(Origin=Point(0, 0, 0))
vector_xyz_2 = VectorXYZ(XComponent=x_component, YComponent=0, ZComponent=0)  # -> Vector, Length
xz_plane = XZPlane(Origin=Point(0, 0, 0))
vector_xyz_3 = VectorXYZ(XComponent=0, YComponent=y_component, ZComponent=0)  # -> Vector, Length
multiplication = Multiplication(A=A_2, B=2)
multiplication_2 = Multiplication(A=A_3, B=2)
division = Division(A=A, B=2)
addition = Addition(A=multiplication, B=multiplication_2)
negative = Negative(Value=value)
vector_xyz_4 = VectorXYZ(XComponent=0, YComponent=negative, ZComponent=0)  # -> Vector, Length
move = Move(Geometry=xy_plane, Motion=vector_xyz.Vector)  # -> Geometry, Transform
move_2 = Move(Geometry=xz_plane, Motion=vector_xyz_3.Vector)  # -> Geometry, Transform
srf_bottom = PlaneSurface(Plane=xy_plane, XSize=Domain(-1000, 1000), YSize=Domain(-1000, 1000))
srf_top = PlaneSurface(Plane=move.Geometry, XSize=Domain(-1000, 1000), YSize=Domain(-1000, 1000))
srf_left = PlaneSurface(Plane=yz_plane, XSize=Domain(-1000, 1000), YSize=Domain(-1000, 1000))
move_3 = Move(Geometry=srf_left, Motion=vector_xyz_2.Vector)  # -> Geometry, Transform
srf_front = PlaneSurface(Plane=xz_plane, XSize=Domain(-1000, 1000), YSize=Domain(-1000, 1000))
srf_back = PlaneSurface(Plane=move_2.Geometry, XSize=Domain(-1000, 1000), YSize=Domain(-1000, 1000))
move_4 = Move(Geometry=srf_back, Motion=vector_xyz_4.Vector)  # -> Geometry, Transform
srf_right = Surface(move_3.Geometry)
division_2 = Division(A=addition, B=2)
construct_point = ConstructPoint(XCoordinate=division, YCoordinate=0, ZCoordinate=0)
negative_2 = Negative(Value=addition)
negative_3 = Negative(Value=division_2)
vector_xyz_5 = VectorXYZ(XComponent=0, YComponent=negative_2, ZComponent=0)  # -> Vector, Length
vector_xyz_6 = VectorXYZ(XComponent=0, YComponent=negative_3, ZComponent=0)  # -> Vector, Length
yz_plane_2 = YZPlane(Origin=construct_point)
mirror = Mirror(Geometry=srf_right, Plane=yz_plane_2)  # -> Geometry, Transform
boundary_volume = BoundaryVolume(Boundaries=[srf_bottom, srf_top, srf_back, move_4.Geometry, mirror.Geometry, srf_right])
solid = ClusterOutput(boundary_volume)
boundary_volume_2 = BoundaryVolume(Boundaries=[srf_bottom, srf_back, srf_top, srf_front, srf_left, srf_right])
solid_2 = ClusterOutput(boundary_volume_2)
move_5 = Move(Geometry=boundary_volume, Motion=[vector_xyz_6.Vector, vector_xyz_5.Vector])  # -> Geometry, Transform
geometry = ClusterOutput(move_5.Geometry)
mirror_2 = Mirror(Geometry=boundary_volume_2, Plane=yz_plane_2)  # -> Geometry, Transform
geometry_2 = ClusterOutput(mirror_2.Geometry)
