# Grasshopper definition sine curve between points.gh (Grasshopper 0.9.76)

pt = Point(<point referenced from the Rhino model>)
cos = Cosine(Value=pt)
sin = Sine(Value=pt)
pt_2 = Point(<point referenced from the Rhino model>)
tag = TextTag3D(Location=pt, Text="Hello", Size=Slider(0.59, range=0..1), Justification=5)
ln = Line(StartPoint=pt_2, EndPoint=pt)
circle = CircleCNR(Center=[pt_2, pt], Normal=Vector(0, 0, 1), Radius=Slider(2.55, range=0..10))
pt_3 = Point([<point referenced from the Rhino model> x5])
intcrv_t = InterpolateT(Vertices=pt_3, Degree=3, TangentStart=Vector(0, 0, 0), TangentEnd=Vector(0, 0, 0), KnotStyle=1)  # -> Curve, Length, Domain
pt_4 = Point(<point referenced from the Rhino model>)
pt_5 = Point(<point referenced from the Rhino model>)
number_slider = Slider(39, range=0..100)
ln_2 = Line(StartPoint=pt_4, EndPoint=pt_5)
pi = Pi(Factor=Slider(2, range=0..10))
range = Range(Domain=Domain(0, 1), Steps=number_slider)
pt_6 = Point(<point referenced from the Rhino model>)
pt_7 = Point(<point referenced from the Rhino model>)
divide = DivideCurve(Curve=ln_2, Count=number_slider, Kinks=False)  # -> Points, Tangents, Parameters
Z = UnitZ(Factor=1)
cluster = Cluster(A=pt_6, B=pt_7)
range_2 = Range(Domain=pi, Steps=number_slider)
xprod = CrossProduct(VectorA=divide.Tangents, VectorB=Z, Unitize=False)  # -> Vector, Length
intcrv = Interpolate(Vertices=cluster, Degree=3, Periodic=False, KnotStyle=1)  # -> Curve, Length, Domain
sin_2 = Sine(Value=range_2)
multiplication = Multiplication(A=Slider(0.2, range=0..10), B=sin_2)
amp = Amplitude(Vector=xprod.Vector, Amplitude=multiplication)
move = Move(Geometry=divide.Points, Motion=amp)  # -> Geometry, Transform
intcrv_2 = Interpolate(Vertices=move.Geometry, Degree=3, Periodic=False, KnotStyle=1)  # -> Curve, Length, Domain

# ==== cluster Cluster
A = ClusterInput()
B = ClusterInput()
number_slider = Slider(39, range=0..100)
ln = Line(StartPoint=A, EndPoint=B)
pi = Pi(Factor=Slider(2, range=0..10))
range = Range(Domain=Domain(0, 1), Steps=number_slider)
divide = DivideCurve(Curve=ln, Count=number_slider, Kinks=False)  # -> Points, Tangents, Parameters
Z = UnitZ(Factor=1)
range_2 = Range(Domain=pi, Steps=number_slider)
xprod = CrossProduct(VectorA=divide.Tangents, VectorB=Z, Unitize=False)  # -> Vector, Length
sin = Sine(Value=range_2)
multiplication = Multiplication(A=Slider(0.2, range=0..10), B=sin)
amp = Amplitude(Vector=xprod.Vector, Amplitude=multiplication)
move = Move(Geometry=divide.Points, Motion=amp)  # -> Geometry, Transform
G = ClusterOutput(move.Geometry)
