# Grasshopper definition sphereWedge.gh (Grasshopper 0.9.76)
# plug-ins: Python Interpreter

pt = Point(<point referenced from the Rhino model>)
pt_2 = Point(Point(0, 0, 0))
rad = Radians(Degrees=Slider(20, range=0..100))
Z = UnitZ(Factor=1)
panel = Panel(rad)
ln = Line(StartPoint=pt_2, EndPoint=pt)
multiplication = Multiplication(A=Slider(12, range=0..100), B=Slider(35, range=0..100))
rot3d = Rotate3D(Geometry=ln, Angle=rad, Center=pt_2, Axis=Z)  # -> Geometry, Transform
Z_2 = UnitZ(Factor=1)
sph = Sphere(Base=PlaneXY(0, 0, 0), Radius=multiplication)
multiplication_2 = Multiplication(A=Z_2, B=Slider(574, range=0..1000))
neg = Negative(Value=multiplication_2)
extr = Extrude(Base=[rot3d.Geometry, ln], Direction=neg)
offset = Offset(Surface=sph, Distance=Slider(3.5, range=0..10), Retrim=True)
sdiff = SolidDifference(BrepsA=sph, BrepsB=offset)
extr_2 = Extrude(Base=[rot3d.Geometry, ln], Direction=multiplication_2)
number_slider = Slider(2640, range=0..10000)
pt_3 = Point(<point referenced from the Rhino model>)
xy = XYPlane(Origin=pt_3)
planesrf = PlaneSurface(Plane=xy, XSize=number_slider, YSize=number_slider)
join = BrepJoin(Breps=[extr_2, extr])  # -> Breps, Closed
split = SplitBrep(Brep=sph, Cutter=planesrf)
item = ListItem(List=split, Index=Slider(1, range=0..100), Wrap=True)
split_2 = SplitBrep(Brep=item, Cutter=join.Breps)
item_2 = ListItem(List=split_2, Index=Slider(1, range=0..100), Wrap=True)
offset_2 = Offset(Surface=item_2, Distance=Slider(5.5, range=0..10), Retrim=True)
edges = BrepEdges(Brep=offset_2)  # -> Naked, Interior, NonManifold
edges_2 = BrepEdges(Brep=item_2)  # -> Naked, Interior, NonManifold
join_2 = JoinCurves(Curves=edges.Naked, Preserve=False)
join_3 = JoinCurves(Curves=edges_2.Naked, Preserve=False)
loft = Loft(
    Curves=[join_2, join_3],
    Options={Adjust=False, Closed=False, LoftEnds=0, LoftSimp=0, LoftType=0, Rebuild=10, Refit=0.01})
join_4 = BrepJoin(Breps=[loft, item_2, offset_2])  # -> flatten(Breps), Closed
python = PythonScript(breps=join_4.Breps)  # -> out, a; inputs breps: list of Brep
# ---------- python: Python ----------
import rhinoscriptsyntax as rs
import Rhino
import Rhino.Geometry as rg


#rg.Brep.CreateSolid(breps, Rhino.RhinoDoc.ModelAbsoluteTolerance)
# ---------- end python ----------
