# Grasshopper definition spiral divide line rake.gh (Grasshopper 0.9.76)

division = Division(A=Slider(1, range=0..1), B=Slider(9, range=0..10))
bottom_crv = Curve(<curve referenced from the Rhino model>)
top_crv = Curve(<curve referenced from the Rhino model>)
crv = Curve(<curve referenced from the Rhino model>)
crv_2 = Curve(<curve referenced from the Rhino model>)
tweencrv = TweenCurve(CurveA=top_crv, CurveB=bottom_crv, Factor=0.5, BlendType=0)
divlength = DivideLength(Curve=crv, Length=division)  # -> Points, Tangents, Parameters
divlength_2 = DivideLength(Curve=crv_2, Length=division)  # -> Points, Tangents, Parameters
divide = DivideCurve(Curve=tweencrv, Count=Slider(119, range=0..1000), Kinks=False)  # -> Points, Tangents, Parameters
ln = Line(StartPoint=divlength_2.Points, EndPoint=divlength.Points)
crv_cp = CurveClosestPoint(Point=divide.Points, Curve=bottom_crv)  # -> Point, Parameter, Distance
crv_cp_2 = CurveClosestPoint(Point=divide.Points, Curve=top_crv)  # -> Point, Parameter, Distance
ln_2 = Line(StartPoint=crv_cp_2.Point, EndPoint=divide.Points)
ln_3 = Line(StartPoint=divide.Points, EndPoint=crv_cp.Point)
ln_4 = Line(StartPoint=crv_cp_2.Point, EndPoint=crv_cp.Point)
