# Grasshopper definition survey studies with points 171 m cleanup 2.gh (Grasshopper 0.9.76)
# plug-ins: Python Interpreter

id = Guid([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])
python = PythonScript(x=id)  # -> out, a; inputs x: list
# ---------- python: Python ----------
import scriptcontext as sc
import rhinoscriptsyntax as rs
import Rhino

points = []

sc.doc = Rhino.RhinoDoc.ActiveDoc

for y in x:
    pt = rs.BlockInstanceInsertPoint(y)
    points.append(pt)
    

sc.doc = ghdoc

a = points
# ---------- end python ----------
id_2 = Guid()
xy = XYPlane(Origin=Point(0, 0, 0))
pgroups = PointGroups(Points=python.a, Distance=Slider(24, range=0..100))  # -> Groups, Indices
voronoi = Voronoi(Points=pgroups.Groups, Plane=xy, BruteForceOverride=False)
python_tree_to_lists = PythonScript(x=pgroups.Groups, indices=pgroups.Indices, block_guid=id)  # -> out, a; inputs x: tree, indices: tree
# ---------- python_tree_to_lists: Python ----------
import rhinoscriptsyntax as rs
 
import Rhino.Geometry as rg
from clr import AddReference as addr
addr("Grasshopper")
 
from System import Object
from Grasshopper import DataTree
from Grasshopper.Kernel.Data import GH_Path
 
 
def raggedListToDataTree(raggedList):
    rl = raggedList
    result = DataTree[object]()
    for i in range(len(rl)):
        temp = []
        for j in range(len(rl[i])):
            temp.append(rl[i][j])
        #print i, " - ",temp
        path = GH_Path(i)
        result.AddRange(temp, path)
    return result
 
def dataTreeToList(aTree):
    theList = []
    for i in range(aTree.BranchCount ):
        thisListPart = []
        thisBranch = aTree.Branch(i)
        for j in range(len(thisBranch)):
            thisListPart.append( thisBranch[j] )
        theList.append(thisListPart)
    return theList

# take gh data tree and turn it into lists of lists
# for python, the tree in this case groups points
# based on threshold

a = dataTreeToList(x)
# enumerate the branches, which is telling you 
# the group number
for i, b in enumerate(a):
    i += 1
    for c in b:
        print "Group {},{}".format(i, c)
# ---------- end python_tree_to_lists ----------
item = ListItem(List=id, Index=pgroups.Indices, Wrap=True)
index = ItemIndex(List=id, Item=pgroups.Indices)
python_tree_to_lists_2 = PythonScript(x=index)  # -> out, a; inputs x: tree
# ---------- python_tree_to_lists_2: Python ----------
import rhinoscriptsyntax as rs
 
import Rhino.Geometry as rg
from clr import AddReference as addr
addr("Grasshopper")
 
from System import Object
from Grasshopper import DataTree
from Grasshopper.Kernel.Data import GH_Path
 
 
def raggedListToDataTree(raggedList):
    rl = raggedList
    result = DataTree[object]()
    for i in range(len(rl)):
        temp = []
        for j in range(len(rl[i])):
            temp.append(rl[i][j])
        #print i, " - ",temp
        path = GH_Path(i)
        result.AddRange(temp, path)
    return result
 
def dataTreeToList(aTree):
    theList = []
    for i in range(aTree.BranchCount ):
        thisListPart = []
        thisBranch = aTree.Branch(i)
        for j in range(len(thisBranch)):
            thisListPart.append( thisBranch[j] )
        theList.append(thisListPart)
    return theList

# take gh data tree and turn it into lists of lists
# for python, the tree in this case groups points
# based on threshold

a = dataTreeToList(x)
# enumerate the branches, which is telling you 
# the group number

b = []

for i, b in enumerate(a):
    i += 1
    for c in b:
        #print "Group {},{}".format(i, c)
        if i == 1:
            b.append(c)
            print c
# ---------- end python_tree_to_lists_2 ----------
