# Grasshopper definition survey studies with points 171 m cleanup 3.gh (Grasshopper 0.9.76)
# plug-ins: Python Interpreter

id = Guid([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])
python = PythonScript(x=id)  # -> out, a; inputs x: list
# ---------- python: Python ----------
import scriptcontext as sc
import rhinoscriptsyntax as rs
import Rhino

points = []

sc.doc = Rhino.RhinoDoc.ActiveDoc

for y in x:
    pt = rs.BlockInstanceInsertPoint(y)
    points.append(pt)
    

sc.doc = ghdoc

a = points
# ---------- end python ----------
pgroups = PointGroups(Points=python.a, Distance=Slider(24, range=0..100))  # -> simplify(Groups), Indices
id_2 = Guid([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])
panel = Panel(pgroups.Groups)
python_2 = PythonScript(x=pgroups.Groups)  # -> out, a; inputs x: tree
# ---------- python_2: Python ----------
import rhinoscriptsyntax as rs


# written by Giulio Piacentino, giulio@mcneel.com
def tree_to_list(input, retrieve_base = lambda x: x[0]):
    """Returns a list representation of a Grasshopper DataTree"""
    def extend_at(path, index, simple_input, rest_list):
        target = path[index]
        if len(rest_list) <= target: rest_list.extend([None]*(target-len(rest_list)+1))
        if index == path.Length - 1:
            rest_list[target] = list(simple_input)
        else:
            if rest_list[target] is None: rest_list[target] = []
            extend_at(path, index+1, simple_input, rest_list[target])
    all = []
    for i in range(input.BranchCount):
        path = input.Path(i)
        extend_at(path, 0, input.Branch(path), all)
    return retrieve_base(all)
    

a = tree_to_list(x)


for lst in a:
    print len(a)
# ---------- end python_2 ----------
python_3 = PythonScript(x=id_2)  # -> out, a; inputs x: list; same code as python
id_3 = Guid([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])
del = DelaunayMesh(Points=pgroups.Groups, Plane=PlaneXY(0, 0, 0))
python_4 = PythonScript(x=id_3)  # -> out, a; inputs x: list; same code as python
lng = ListLength(List=pgroups.Groups)
xy = XYPlane(Origin=Point(0, 0, 0))
pgroups_2 = PointGroups(Points=python_3.a, Distance=Slider(24, range=0..100))  # -> Groups, Indices
demesh = DeconstructMesh(Mesh=del)  # -> Vertices, Faces, Colours, Normals
panel_2 = Panel(lng)
medges = MeshEdges(Mesh=del)  # -> NakedEdges, InteriorEdges, NonManifoldEdges
pgroups_3 = PointGroups(Points=python_4.a, Distance=Slider(24, range=0..100))  # -> Groups, Indices
panel_3 = Panel(demesh.Vertices)
voronoi = Voronoi(Points=pgroups_2.Groups, Plane=xy, BruteForceOverride=False)
viewer = ParamViewer(pgroups.Groups)
index = ItemIndex(List=id_3, Item=pgroups_3.Indices)
python_tree_to_lists = PythonScript(x=pgroups_2.Groups, indices=pgroups_2.Indices, block_guid=id_2)  # -> out, a; inputs x: tree, indices: tree
# ---------- python_tree_to_lists: Python ----------
import rhinoscriptsyntax as rs
 
import Rhino.Geometry as rg
from clr import AddReference as addr
addr("Grasshopper")
 
from System import Object
from Grasshopper import DataTree
from Grasshopper.Kernel.Data import GH_Path
 
 
def raggedListToDataTree(raggedList):
    rl = raggedList
    result = DataTree[object]()
    for i in range(len(rl)):
        temp = []
        for j in range(len(rl[i])):
            temp.append(rl[i][j])
        #print i, " - ",temp
        path = GH_Path(i)
        result.AddRange(temp, path)
    return result
 
def dataTreeToList(aTree):
    theList = []
    for i in range(aTree.BranchCount ):
        thisListPart = []
        thisBranch = aTree.Branch(i)
        for j in range(len(thisBranch)):
            thisListPart.append( thisBranch[j] )
        theList.append(thisListPart)
    return theList

# take gh data tree and turn it into lists of lists
# for python, the tree in this case groups points
# based on threshold

a = dataTreeToList(x)
# enumerate the branches, which is telling you 
# the group number
for i, b in enumerate(a):
    i += 1
    for c in b:
        print "Group {},{}".format(i, c)
# ---------- end python_tree_to_lists ----------
cull = CullPattern(List=lng, CullPattern=[False, False, True, True])
item = ListItem(List=id_2, Index=pgroups_2.Indices, Wrap=True)
index_2 = ItemIndex(List=id_2, Item=pgroups_2.Indices)
python_tree_to_lists_2 = PythonScript(x=index_2)  # -> out, a; inputs x: tree
# ---------- python_tree_to_lists_2: Python ----------
import rhinoscriptsyntax as rs
 
import Rhino.Geometry as rg
from clr import AddReference as addr
addr("Grasshopper")
 
from System import Object
from Grasshopper import DataTree
from Grasshopper.Kernel.Data import GH_Path
 
 
def raggedListToDataTree(raggedList):
    rl = raggedList
    result = DataTree[object]()
    for i in range(len(rl)):
        temp = []
        for j in range(len(rl[i])):
            temp.append(rl[i][j])
        #print i, " - ",temp
        path = GH_Path(i)
        result.AddRange(temp, path)
    return result
 
def dataTreeToList(aTree):
    theList = []
    for i in range(aTree.BranchCount ):
        thisListPart = []
        thisBranch = aTree.Branch(i)
        for j in range(len(thisBranch)):
            thisListPart.append( thisBranch[j] )
        theList.append(thisListPart)
    return theList

# take gh data tree and turn it into lists of lists
# for python, the tree in this case groups points
# based on threshold

a = dataTreeToList(x)
# enumerate the branches, which is telling you 
# the group number

b = []

for i, b in enumerate(a):
    i += 1
    for c in b:
        #print "Group {},{}".format(i, c)
        if i == 1:
            b.append(c)
            print c
# ---------- end python_tree_to_lists_2 ----------
python_tree_to_lists_3 = PythonScript(x=index_2)  # -> out, a; inputs x: tree; same code as python_tree_to_lists_2
