# Grasshopper definition survey studies with points 171 m.gh (Grasshopper 0.9.76)
# plug-ins: Python Interpreter

id = Guid([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])
python = PythonScript(x=id)  # -> out, a; inputs x: list
# ---------- python: Python ----------
import scriptcontext as sc
import rhinoscriptsyntax as rs
import Rhino

points = []

sc.doc = Rhino.RhinoDoc.ActiveDoc

for y in x:
    pt = rs.BlockInstanceInsertPoint(y)
    points.append(pt)
    

sc.doc = ghdoc

a = points
# ---------- end python ----------
qt = QuadTree(Points=python.a, Plane=PlaneXY(0, 0, 0), Square=False, Group=5)  # -> Quads, Points
prox = Proximity2D(Points=python.a, Plane=PlaneXY(0, 0, 0), Group=5)  # -> Links, Topology
pt = Point(python.a)
pt_2 = Point(python.a)
tstat = TreeStatistics()  # -> Paths, Length, Count
series = Series(Start=0, Step=1, Count=tstat.Count)
lng = ListLength()  # -> flatten(Length)
vorgroup = VoronoiGroups(Boundary={Plane=PlaneXY(0, 0, 0), Size=Domain2(u=-10..10, v=-10..10)})  # -> Diagram1, Diagram2
sort = SortList(Keys=lng, ValuesA=series)  # -> Keys, ValuesA
panel = Panel(pt)
pgroups = PointGroups(Points=pt_2, Distance=Slider(23, range=0..1000))  # -> Groups, Indices
panel_2 = Panel(pgroups.Groups)
item = ListItem(List=tstat.Paths, Index=sort.ValuesA, Wrap=True)
tstat_2 = TreeStatistics(Tree=pgroups.Groups)  # -> Paths, Length, Count
xy = XYPlane(Origin=Point(0, 0, 0))
pgroups_2 = PointGroups(Points=pt, Distance=Slider(1, range=0..100))  # -> Groups, Indices
branch = TreeBranch(Path=item, MaintainPaths=False)
xz = XZPlane(Origin=Point(0, 0, 0))
python__find_double_points = PythonScript(x=tstat_2.Length)  # -> out, a
# ---------- python__find_double_points: Python ----------
a = []

if x == 2:
    a.append(x)
# ---------- end python__find_double_points ----------
voronoi = Voronoi(Points=pgroups.Groups, Plane=xy, BruteForceOverride=False)
Y = UnitY(Factor=1)
python__find_loner_points = PythonScript(x=tstat_2.Length)  # -> out, a
# ---------- python__find_loner_points: Python ----------
a = []

if x == 1:
    a.append(x)
# ---------- end python__find_loner_points ----------
sort_2 = SortList(Keys=tstat_2.Length)  # -> Keys, ValuesA
del = DelaunayMesh(Points=pgroups.Groups, Plane=xy)
cull_doubles = CullPattern(List=pgroups.Groups, CullPattern=python__find_double_points.a)
cull_loners = CullPattern(List=pgroups.Groups, CullPattern=python__find_loner_points.a)
panel_4 = Panel(sort_2.Keys)
python_2 = PythonScript(x=tstat_2.Length)  # -> out, a
# ---------- python_2: Python ----------
a = []

if x > 2:
    a.append(x)
# ---------- end python_2 ----------
cullpt = CullDuplicates(Points=pt, Tolerance=Slider(6.053, range=0..10), CullMode=3)  # -> Points, Indices, Valence
cull_i = CullIndex(List=pt, Indices=cullpt.Indices, Wrap=True)
circle = CircleCNR(Center=cull_i, Normal=Y, Radius=Slider(100, range=0..100))
circle_2 = CircleCNR(Center=cull_i, Normal=Y, Radius=Slider(8, range=0..10))
lng_2 = ListLength(List=circle)
lng_3 = ListLength(List=circle_2)
cull = CullPattern(List=pgroups.Groups, CullPattern=python_2.a)
null = NullItem(Item=cull)  # -> NullFlags, InvalidFlags, Description
xy_2 = XYPlane(Origin=cull_doubles)
xz_2 = XZPlane(Origin=cull_doubles)
panel_5 = Panel(lng_2)
panel_6 = Panel(lng_3)
Y_2 = UnitY(Factor=1)
Z = UnitZ(Factor=1)
panel_7 = Panel(cull)
dispatch = Dispatch(List=xy_2, DispatchPattern=[True, False])  # -> ListA, ListB
X = UnitX(Factor=1)
hull = ConvexHull(Points=cull, Plane=xy)  # -> Hull, HullZ, Indices
vec2pt = Vector2Pt(PointA=dispatch.ListA, PointB=dispatch.ListB, Unitize=False)  # -> Vector, Length
dist = Distance(PointA=dispatch.ListA, PointB=dispatch.ListB)
pt_3 = Point(dispatch.ListA)
pt_4 = Point(dispatch.ListB)
panel_8 = Panel(hull.Hull)
X_2 = UnitX(Factor=1)
Y_3 = UnitY(Factor=1)
Z_2 = UnitZ(Factor=1)
addition = Addition(A=pt_3, B=pt_4)
division = Division(A=addition, B=2)
pl = ConstructPlane(Origin=division, XAxis=vec2pt.Vector, YAxis=X_2)
division_2 = Division(A=dist, B=2)
circle_3 = CircleCNR(Center=cull_loners, Normal=X, Radius=Slider(8, range=0..10))
ellipse = Ellipse(Plane=pl, Radius1=dist, Radius2=division_2)  # -> Ellipse, Focus1, Focus2
