# Grasshopper definition survey studies with points.gh (Grasshopper 0.9.76)
# plug-ins: Python Interpreter

pt = Point([<point referenced from the Rhino model> x323])
pt_2 = Point([<point referenced from the Rhino model> x323])
tstat = TreeStatistics()  # -> Paths, Length, Count
series = Series(Start=0, Step=1, Count=tstat.Count)
lng = ListLength()  # -> flatten(Length)
sort = SortList(Keys=lng, ValuesA=series)  # -> Keys, ValuesA
panel = Panel(pt)
pgroups = PointGroups(Points=pt_2, Distance=Slider(20, range=0..1000))  # -> Groups, Indices
item = ListItem(List=tstat.Paths, Index=sort.ValuesA, Wrap=True)
tstat_2 = TreeStatistics(Tree=pgroups.Groups)  # -> Paths, Length, Count
pgroups_2 = PointGroups(Points=pt, Distance=Slider(1, range=0..100))  # -> Groups, Indices
panel_2 = Panel(pgroups.Groups)
branch = TreeBranch(Path=item, MaintainPaths=False)
python__find_double_points = PythonScript(x=tstat_2.Length)  # -> out, a
# ---------- python__find_double_points: Python ----------
a = []

if x == 2:
    a.append(x)
# ---------- end python__find_double_points ----------
Y = UnitY(Factor=1)
python__find_loner_points = PythonScript(x=tstat_2.Length)  # -> out, a
# ---------- python__find_loner_points: Python ----------
a = []

if x == 1:
    a.append(x)
# ---------- end python__find_loner_points ----------
xz = XZPlane(Origin=Point(0, 0, 0))
sort_2 = SortList(Keys=tstat_2.Length)  # -> Keys, ValuesA
del = DelaunayMesh(Points=pgroups.Groups, Plane=xz)
voronoi = Voronoi(Points=pgroups.Groups, BruteForceOverride=False)
cull_doubles = CullPattern(List=pgroups.Groups, CullPattern=python__find_double_points.a)
cull_loners = CullPattern(List=pgroups.Groups, CullPattern=python__find_loner_points.a)
panel_3 = Panel(sort_2.Keys)
python = PythonScript(x=tstat_2.Length)  # -> out, a
# ---------- python: Python ----------
a = []

if x > 2:
    a.append(x)
# ---------- end python ----------
cull = CullPattern(List=pgroups.Groups, CullPattern=python.a)
null = NullItem(Item=cull)  # -> NullFlags, InvalidFlags, Description
cullpt = CullDuplicates(Points=pt, Tolerance=Slider(6.053, range=0..10), CullMode=3)  # -> Points, Indices, Valence
cull_i = CullIndex(List=pt, Indices=cullpt.Indices, Wrap=True)
circle = CircleCNR(Center=cull_i, Normal=Y, Radius=Slider(100, range=0..100))
circle_2 = CircleCNR(Center=cull_i, Normal=Y, Radius=Slider(8, range=0..10))
lng_2 = ListLength(List=circle)
lng_3 = ListLength(List=circle_2)
panel_4 = Panel(lng_2)
panel_5 = Panel(lng_3)
Y_2 = UnitY(Factor=1)
xz_2 = XZPlane(Origin=cull_doubles)
panel_6 = Panel(cull)
dispatch = Dispatch(List=xz_2, DispatchPattern=[True, False])  # -> ListA, ListB
hull = ConvexHull(Points=cull, Plane=xz)  # -> Hull, HullZ, Indices
vec2pt = Vector2Pt(PointA=dispatch.ListA, PointB=dispatch.ListB, Unitize=False)  # -> Vector, Length
dist = Distance(PointA=dispatch.ListA, PointB=dispatch.ListB)
pt_3 = Point(dispatch.ListA)
pt_4 = Point(dispatch.ListB)
panel_7 = Panel(hull.Hull)
Z = UnitZ(Factor=1)
addition = Addition(A=pt_3, B=pt_4)
division = Division(A=addition, B=2)
pl = ConstructPlane(Origin=division, XAxis=vec2pt.Vector, YAxis=Z)
division_2 = Division(A=dist, B=2)
ellipse = Ellipse(Plane=pl, Radius1=dist, Radius2=division_2)  # -> Ellipse, Focus1, Focus2
circle_3 = CircleCNR(Center=cull_loners, Normal=Y_2, Radius=Slider(10, range=0..10))
