# Grasshopper definition test1_orienting agi.gh (Grasshopper 0.9.76)

vec = VectorXYZ(XComponent=0, YComponent=0, ZComponent=Slider(15.25, range=0..100))  # -> Vector, Length
crv = Curve(<curve referenced from the Rhino model>)
extr = Extrude(Base=crv, Direction=vec.Vector)
crv_2 = Curve(<curve referenced from the Rhino model>)
cap = CapHoles(Brep=extr)
offset = Offset(
    Curve=crv_2,
    Distance=[Slider(0.33, range=0..1), Slider(2.5, range=0..10), Slider(2.12, range=0..10)],
    Plane=PlaneXY(0, 0, 0),
    Corners=1)
repeat = RepeatData(Data=offset, Length=Slider(8, range=0..10))
explode = Explode(Curve=repeat, Recursive=True)  # -> Segments, Vertices
