# Grasshopper definition traceryenginefail.gh (Grasshopper 0.9.76)

pt = Point(<point referenced from the Rhino model>)
crv = Curve(<curve referenced from the Rhino model>)
crv_2 = Curve(<curve referenced from the Rhino model>)
pl = ConstructPlane(Origin=pt, XAxis=Vector(0, 9.797331858, 0), YAxis=Vector(0, 0, 263.8442579))
crv_3 = Curve(<curve referenced from the Rhino model>)
mirror = Mirror(Geometry=crv_2, Plane=pl)  # -> Geometry, Transform
contour = Contour(Point=Point(0, 0, 0), Direction=Vector(0, 0, 1))
