# Grasshopper definition truncated cone for roof hip.gh (Grasshopper 0.9.76)

Z = UnitZ(Factor=1)
Z_2 = UnitZ(Factor=1)
pt = Point(<point referenced from the Rhino model>)
Z_3 = UnitZ(Factor=Slider(19.655, range=0..100))
move = Move(Geometry=pt, Motion=Z_3)  # -> Geometry, Transform
circle = CircleCNR(Center=move.Geometry, Normal=Z_2, Radius=Slider(2.641, range=0..10))
circle_2 = CircleCNR(Center=pt, Normal=Z, Radius=Slider(4, range=0..10))
loft = Loft(
    Curves=[circle_2, circle],
    Options={Adjust=False, Closed=False, LoftEnds=0, LoftSimp=0, LoftType=0, Rebuild=10, Refit=0.01})
