# Grasshopper definition twoByFourGenerator.gh (Grasshopper 0.9.76)
# plug-ins: Python Interpreter

crv = Curve(<curve referenced from the Rhino model>)
explode = Explode(Curve=crv, Recursive=True)  # -> Segments, Vertices
number_slider = Slider(0.75, range=0..1)
python = PythonScript(lines=explode.Segments, ext_length=Slider(2, range=0..10))  # -> out, even, odd; inputs lines: list of Curve, ext_length: Int32
# ---------- python: Python ----------
import rhinoscriptsyntax as rs
import Rhino.Geometry as rg
import Rhino
doc = Rhino.RhinoDoc.ActiveDoc


even = []
odd = []

count = 1
for line in lines:
    print str(line)
    print
    if count % 2 == 0:
        even.append(line)
        
    else:
        odd.append(line)
    count += 1
# ---------- end python ----------
neg = Negative(Value=number_slider)
ext = ExtendCurve(Curve=python.even, Type=Slider(1, range=0..1), Start=neg, End=neg)
ext_2 = ExtendCurve(Curve=python.odd, Type=Slider(1, range=0..1), Start=number_slider, End=number_slider)
python_2 = PythonScript(x=ext, y=ext_2)  # -> out, a; inputs x: Curve, y: Curve
# ---------- python_2: Python ----------
a = []
a.append(x)
a.append(y)
# ---------- end python_2 ----------
end = EndPoints(Curve=python_2.a)  # -> Start, End
python_3 = PythonScript(start=end.Start, end=end.End)  # -> out, result; inputs start: Point3d, end: Point3d
# ---------- python_3: Python ----------
import rhinoscriptsyntax as rs
import Rhino.Geometry as rg
import Rhino
doc = Rhino.RhinoDoc.ActiveDoc




###PARAMETRIC 2X4 GARBAGE BAG HOLDER###

class Lumber():
    """Linear board class"""
    
    def __init__(self, name, width, height, start, end):
        self.name = name
        self.width = width
        self.height = height
        self.start = rs.coerce3dpoint(start)
        self.end = rs.coerce3dpoint(end)
        self.cross_sectional_area = self.get_cross_section_area()
        self.length = self.get_length()
        self.volume = self.get_volume()
        self.length_vector = self.get_length_vector()
        self.start_plane = self.get_start_plane()
        self.end_plane = self.get_end_plane()
        self.start_corners = self.get_start_corners()
        self.end_corners = self.get_end_corners()
        self.corners = self.add_corners(self.start_corners, self.end_corners)


    def get_cross_section_area(self):
        area = self.height * self.width
        return area


    def get_length(self):
        distance = rs.Distance(self.start, self.end)
        return distance


    def get_volume(self):
        volume = self.cross_sectional_area * self.length
        return volume


    def get_length_vector(self):
        end_vec = rg.Vector3d(self.end)
        start_vec = rg.Vector3d(self.start)
        len_from_origin = end_vec - start_vec
        return len_from_origin
        
    def get_start_plane(self):
        plane = rg.Plane(self.start, self.length_vector)
        return plane
    
    def get_end_plane(self):
       plane = rg.Plane(self.end, self.length_vector)
       return plane


    def get_start_corners(self):
        plane = self.start_plane
        width = self.width * .5
        neg_width = width * -1
        height = self.height * .5
        neg_height = height * -1
        point1 = plane.PointAt(neg_width, neg_height)
        point2 = plane.PointAt(width, neg_height)
        point3 = plane.PointAt(width, height)
        point4 = plane.PointAt(neg_width, height)
        point_list = [point1, point2, point3, point4]
        return point_list


    def get_end_corners(self):
        plane = self.end_plane
        width = self.width * .5
        neg_width = width * -1
        height = self.height * .5
        neg_height = height * -1
        point1 = plane.PointAt(neg_width, neg_height)
        point2 = plane.PointAt(width, neg_height)
        point3 = plane.PointAt(width, height)
        point4 = plane.PointAt(neg_width, height)
        point_list = [point1, point2, point3, point4]
        return point_list



    def add_corners(self, point_list_start, point_list_end):
        corners = []
        for point in point_list_start:
            pt_obj = rs.AddPoint(point)
            corners.append(pt_obj)
        for point in point_list_end:
            pt_obj = rs.AddPoint(point)
            corners.append(pt_obj)
            
        return corners
        
    def get_box(self):
        box = rs.AddBox(self.corners)
        return box
        

two_by_four = Lumber("2 x 4", 1.5, 3.5, start, end)

print two_by_four.__dict__
result = two_by_four.get_box()
# ---------- end python_3 ----------
