# Grasshopper definition wallPlumb.gh (Grasshopper 0.9.76)
# plug-ins: Python Interpreter

srf = Surface([<surface referenced from the Rhino model> x17])
python = PythonScript(brep=srf)  # -> out, a; inputs brep: list of Surface
# ---------- python: Python ----------
import rhinoscriptsyntax as rs
import Rhino
import Rhino.Geometry as rg


def get_normal(plane):
    centroid = rs.SurfaceAreaCentroid(plane)
    normal = rs.SurfaceNormal(plane, (0,0))
    return normal
    


surfaces = brep

normals = [get_normal(x) for x in surfaces]

a = normals
# ---------- end python ----------
panel = Panel(python.a)
xy = XYPlane(Origin=Point(0, 0, 0))
angle = Angle(VectorA=panel, VectorB=xy)  # -> Angle, Reflex
angles_between_vertical_and_plane_normal = Panel(angle.Angle)
python_2 = PythonScript(angle=angle.Angle)  # -> out, a, average; inputs angle: list
# ---------- python_2: Python ----------
"""    


-----x----
|       /
|      /
|     /
|    /  46'
|   /
|a /
| /
|/

S = O/H
O = sin(x)*H
"""
import math

#list of deviations at top in inches
a = [math.sin(math.radians(b))*46*12 for b in angle]

average = sum(a)/len(a)
# ---------- end python_2 ----------
average_deviation_in_inches = Panel(python_2.average)
panel_2 = Panel(python_2.a)
