# Grasshopper definition zone solver 3 working _ fcch.gh (Grasshopper 1.0.7)
# plug-ins: Human, GH_CPython

id_blocks = Guid([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])
crv_zones = Curve([<curve referenced from the Rhino model> x57])

panel = Panel(id_blocks)
panel_2 = Panel(crv_zones)
objatts = ObjectAttributes(ObjectOrAttributes=crv_zones)  # -> Name, LayerName, LayerFullPath, Color, MaterialName, LinetypeName, GroupIndices, PlotWeight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
python = GhPythonScript(x=id_blocks)  # -> out, a, b, c; inputs x: list
# ---------- python: Python ----------
import scriptcontext as sc
import rhinoscriptsyntax as rs
import Rhino

points = []
names = []
layers = []

sc.doc = Rhino.RhinoDoc.ActiveDoc

for y in x:
    pt = rs.BlockInstanceInsertPoint(y)
    #pt = rs.TextObjectText(y)
    points.append(pt)
    name = rs.BlockInstanceName(y)
    names.append(name)
    layer = rs.ObjectLayer(y)
    layers.append(layer)
    

sc.doc = ghdoc

a = points
b = names
c = layers
# ---------- end python ----------
panel_3 = Panel(objatts.Name)
panel_4 = Panel(python.c)
panel_5 = Panel(python.b)
panel_6 = Panel(python.a)
incurve = PointInCurve(Point=python.a, Curve=crv_zones)  # -> Relationship, Point
python_2 = GhPythonScript(
    block_guid=id_blocks,
    block_name=python.b,
    block_pt=python.a,
    block_layer=python.c,
    zone_guid=crv_zones,
    zone_pt=crv_zones,
    zone_name=objatts.Name,
    zone_crv=crv_zones)  # -> out, a; inputs block_guid: list, block_name: list, block_pt: list, block_layer: list, zone_guid: list, zone_pt: list, zone_name: list, zone_crv: list
# ---------- python_2: Python ----------
import scriptcontext as sc
import rhinoscriptsyntax as rs
import Rhino



class block:
    
    def __init__(self):
        self.point = None
        self.layer = None
        self.name = None
        self.drop = None
        self.floor = None
        self.guid = None
        self.zones = []


class zone:
    
    def __init__(self):
        self.name = None
        self.guid = None
        self.curve = None




def point_in_zone(point, zone):
    result = True if rs.PointInPlanarClosedCurve(point, zone.curve) == 1 else False
    return result

def point_zones(point, zones):
    matches = [x.name for x in zones if point_in_zone(point, x) is True]
    #print "Point in {}".format(matches)
    return matches

def load_zones(file):
    
    with open(file, "r") as f:
        content = f.readlines()
        content = [x.strip() for x in content] 
        return content


blocks = []

for i,id in enumerate(block_guid):
    b = block()
    b.guid = id
    b.name = block_name[i]
    b.point = block_pt[i]
    b.layer = block_layer[i]
    blocks.append(b)

zones = []

for i, id in enumerate(zone_guid):
    z = zone()
    z.name = zone_name[i] 
    z.guid = id
    z.curve = zone_crv[i]
    zones.append(z)

#sc.doc = Rhino.RhinoDoc.ActiveDoc
block_zones = []

for b in blocks:
    for z in zones:
        test = rs.PointInPlanarClosedCurve(b.point, z.curve)
        if test > 0:
            #print test
            b.zones.append(z.name)
            print "{} in {}".format(b.name, z.name)
        #print b.point

#sc.doc = ghdoc

for b in blocks:
    block_zones.append(str(b.zones))


a = block_zones
# ---------- end python_2 ----------
panel_7 = Panel(incurve.Relationship)
show_report_and_barcodes = Button()
show_barcodes = Button()
generate_report_only = Button()
show_report = Button()
gh_cpython = GH_CPython(
    block_zones=python_2.a,
    block_name=python.b,
    block_pt=python.a,
    block_layer=python.c,
    block_guid=id_blocks,
    report=generate_report_only,
    open_report=show_report,
    show_barcodes=show_barcodes,
    show_bc_rpt=show_report_and_barcodes,
    show_static=Toggle(False))  # -> bumper, x, y, z, survey_num; inputs block_zones: list, block_name: list, block_pt: list, block_layer: list, block_guid: list, group: list, id: list, report: list, open_report: list, show_barcodes: list, show_bc_rpt: list, show_static: list
#   port block_zones: [required] - [type = int] - [default = None] Descripe your input here * bullet point. * bullet point
# ---------- gh_cpython: Python ----------
import pandas as pd
import re
import datetime
import os
from reportlab.pdfgen import canvas
import qrcode
import uuid
from natsort import natsorted, ns

class Block():
    def __init__(self):
        self.guid = None
        self.name = None
        self.point = None
        self.layer = None
        self.zones = None
        self.x = None
        self.y = None
        self.z = None
        self.floor = None
        self.swing_drop = None
        self.elevation = None
        self.priority = None
        self.phase = None
        

def find_floor(x):
    pat = r"floor\s*(\d*)"
    result = re.search(pat, str(x), flags=re.IGNORECASE)
    if result:
        return int(result.group(1))    

def find_phase(x):
    if "BASE" in x.upper():
        return 0
    else:
        pat = r"CO\s*(\d*)"
        result = re.search(pat, str(x), flags=re.IGNORECASE)
        if result:
            return int(result.group(1)) 

def find_priority(x):
    pat = r"priority\s*(\d*)"
    result = re.search(pat, str(x), flags=re.IGNORECASE)
    if result:
        return int(result.group(1))   

def find_elevation(x):
    pat = r"([a-zA-Z\s]*)\s*ELEVATION"
    result = re.search(pat, str(x), flags=re.IGNORECASE)
    if result:
        return result.group(1)

def get_drop(x):
    pat = r"drop\s*([a-z]*\d*)"
    match = re.search(pat, str(x), flags=re.IGNORECASE)

    if match:
        # print("Found Match")
        return match.group(1)
    else:
        # print("Not Found")
        return None

class Group():
    def __init__(self):
        self.group = None
        self.guid = None

#def sort_drops(x):
    #drop_sort = {   "W1":1,"W2":2,"W3":3, "W4":4, "W5":5, "W6":6, "S1":7, "S2":8, "S3":9, "S4":10
             #}
    #return drop_sort[x]



def gen_report():

    blocks = []

    for i, z in enumerate(block_zones):
        b = Block()
        b.guid = block_guid[i]
        b.name = block_name[i]
        b.point = block_pt[i]
        b.layer = block_layer[i]
        b.phase = find_phase(b.layer)
        b.zones = z
        b.x = b.point[0]
        b.y = b.point[1]
        b.z = b.point[2]
        b.floor = find_floor(str(z))
        b.elevation = find_elevation(str(z))
        b.swing_drop = get_drop(str(z))
        b.priority = find_priority(str(z))

        blocks.append(b)

    df = pd.DataFrame([vars(f) for f in blocks])

    #print(df)
    #df.to_excel(r"C:\Users\mkreidler\Desktop\test.xlsx")

    groups = []


    #for i, g in enumerate(group):
       # gr = Group()
       # gr.group = g
       # gr.guid = id[i]
       # groups.append(gr)

    #group_df = pd.DataFrame([vars(f) for f in groups])

    #print(group_df)

   # merge = df.merge(group_df, on="guid", how="outer")
    
    merge = df

    def nat_sort(x):
        unordered = merge.swing_drop.tolist()
        reordered = natsorted(unordered,alg=ns.IGNORECASE)
        return reordered.index(x)


    merge["drop_sort"] = merge.swing_drop.apply(nat_sort)
    
    merge = merge.sort_values(["elevation", "drop_sort", "floor", "y", "x"], ascending=[True, True, False,False,True])


    merge.reset_index(inplace = True, drop=True )
    merge["new_order"] = merge.index + 1

    merge["survey_name"] = merge.swing_drop +"-"+ merge.floor.map(str) +"-"+ merge.name + "[" +merge.new_order.map(str) +"]"
    bumper = merge["survey_name"].tolist()
    points = merge["point"].tolist()
    #if report == True:
    merge.to_excel(path)

    #if open_report == True:
    #merge.to_excel(path)
    #os.startfile(path)

    print(path)
    return path



###############################################################

def make_barcodes(path):

    data = pd.read_excel(path)
    stuff = data.survey_name.tolist()
    df = pd.DataFrame({'stuff': stuff})
    df["num"] = df.index + 1
    df["c"] = df.num % 3
    df.c = df.c.replace(0, 3)
    df["page"] = ((df.num + 23) // 24)
    df["r"] = (((df.num - 1) // 3) + 1) % 8
    df.r = df.r.replace(0, 8)

    # FILE LOCATIONS
    logo_path = r"C:\Users\mkreidler\Desktop\pdf print barcodes\BVTC-Logo-BLACK-horizontal.png"
    pdf_suffix = r"C:\Users\mkreidler\Desktop\pdf print barcodes\\" ##actually this is a prefix
    dt = str(datetime.datetime.now()).replace(":", "_")
    ext = ".pdf"
    pdf_path = f"{pdf_suffix}{dt}{ext}"

    # MAKE CANVAS
    c = canvas.Canvas(pdf_path)
    c.setPageSize((612, 792))
    last_page = None

    # SPLIT INTO PAGES, COLUMNS, ROWS
    for index, row in df.iterrows():
        page = row["page"]
        if page != last_page:
            if last_page == None:
                last_page = page

            else:
                c.showPage()
                last_page = page

        col = row["c"]
        _row = row["r"]
        i = row["stuff"]
        code = f"{i}"
        print(f"page {page} row {_row} column {col} info {i}")

        # DRAW QR
        def draw_qr(data, base=r"C:\Users\mkreidler\Desktop\pdf print barcodes\\"):
            # draw QR
            dt = str(datetime.datetime.now()).replace(":", "_")
            random = uuid.uuid4()
            img_path = f"{base}{dt}{random}.png" ##can't write file paths with certain characters, removing 'i' variable here

            qr = qrcode.QRCode()
            qr.add_data(data)
            img = qr.make_image().save(img_path)
            return img_path


        # DRAW 1 TAG
        def draw_tag(x_num, y_num, code):
            flip_y = {1: 8,
                      2: 7,
                      3: 6,
                      4: 5,
                      5: 4,
                      6: 3,
                      7: 2,
                      8: 1}

            y_num = flip_y[y_num]

            qr = draw_qr(code)
            x_increment = 204
            y_increment = 99

            x = x_increment * (x_num - 1)
            y = y_increment * (y_num - 1)

            c.drawString(102.5491 + x, 33.7174 + y, code)
            c.drawInlineImage(qr, 0 + x, 0 + y, width=99, height=99)
            os.remove(qr)
            c.drawInlineImage(logo_path, 102.5491 + x, 71.2396 + y, width=84.2926,
                              height=14.0488)  # replace maroon with bnw later


        draw_tag(col, _row, code)
    

    # SAVE DOCUMENT
    c.save()
    print()
    print("Done!")
    return pdf_path




#############################


def print_bumpers():

    blocks = []

    for i, z in enumerate(block_zones):
        b = Block()
        b.guid = block_guid[i]
        b.name = block_name[i]
        b.point = block_pt[i]
        b.layer = block_layer[i]
        b.phase = find_phase(b.layer)
        b.zones = z
        b.x = b.point[0]
        b.y = b.point[1]
        b.z = b.point[2]
        b.floor = find_floor(str(z))
        b.elevation = find_elevation(str(z))
        b.swing_drop = get_drop(str(z))
        b.priority = find_priority(str(z))

        blocks.append(b)

    df = pd.DataFrame([vars(f) for f in blocks])

    #print(df)
    #df.to_excel(r"C:\Users\mkreidler\Desktop\test.xlsx")

    groups = []


   

    def nat_sort(x):
        unordered = merge.swing_drop.tolist()
        reordered = natsorted(unordered,alg=ns.IGNORECASE)
        return reordered.index(x)


    merge["drop_sort"] = merge.swing_drop.apply(nat_sort)
    
    merge = merge.sort_values(["elevation", "drop_sort", "floor", "y", "x"], ascending=[True, True, False,False,True])

    #print(group_df)

    #merge = df.merge(group_df, on="guid", how="outer")

    
    #merge["drop_sort"] = merge.swing_drop.apply(sort_drops)

    #merge = merge.sort_values(["elevation", "swing_drop", "floor", "y", "x", "group"], ascending=[True, True, False,False,True,True])


    merge.reset_index(inplace = True, drop=True )
    merge["new_order"] = merge.index + 1

    merge["survey_name"] = merge.swing_drop +"-"+ merge.floor.map(str) +"-"+ merge.name + "[" +merge.new_order.map(str) +"]"
    bumper = str(merge["survey_name"].tolist())
    survey = merge["new_order"].tolist()
    x = merge["x"].tolist()
    y = merge["y"].tolist()
    z = merge["z"].tolist()
    return bumper, x,y,z,survey
    
########################################





folder = r"V:\Field Survey\Moynihan Station Phase II\Moynihan Phase II CO17 + CO19\Deliverables\Setting Reports\\"
path = folder + "ProjectReport_" + str(datetime.datetime.now()).replace(":","_") + ".xlsx"

if show_barcodes == True:
    rpt = gen_report()
    #os.startfile(rpt) ###don't show report if you press barcode button
    barcodes = make_barcodes(path)
    os.startfile(barcodes)

if open_report == True:
    rpt = gen_report()
    os.startfile(rpt) # open report after pressing button

if report == True:
    gen_report() # make report, do not open

if show_bc_rpt == True:
    rpt = gen_report()
    os.startfile(rpt) 
    barcodes = make_barcodes(path)
    os.startfile(barcodes)

if show_static == True:
    bumper = print_bumpers()[0]
    print (bumper)
    x = print_bumpers()[1]
    y = print_bumpers()[2]
    z = print_bumpers()[3]
    survey_num = print_bumpers()[4]
# ---------- end gh_cpython ----------
