# Grasshopper definition zone solver.gh (Grasshopper 1.0.7)
# plug-ins: Human, GH_CPython

# ---- group: Select by Survey Scope by saved GUID
id_hatches_blocks_etc = Guid([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])
selectobjs = CSharpScript(run=Button(), ID=id_hatches_blocks_etc)  # -> out, A; inputs run: Boolean, ID: Guid
# ---------- selectobjs: C# ----------
    if(run){
      doc.Objects.Select(ID);
    }
# ---------- end selectobjs ----------

# ---- group: Select by layer or guid
geo = Geometry(<curve referenced from the Rhino model>)
id = Guid(geo)
objsbylayer = ObjectsByLayer(Layer="Default")  # -> RhinoObjects, ObjectAttributes; disabled
selectobjs_2 = CSharpScript(run=Button(), O=objsbylayer.RhinoObjects)  # -> out, A; inputs run: Boolean
# ---------- selectobjs_2: C# ----------
    if(run){
      Rhino.DocObjects.RhinoObject rhObj = O as Rhino.DocObjects.RhinoObject;
      doc.Objects.Select(rhObj.Id);
    }
# ---------- end selectobjs_2 ----------
selectobjs_3 = CSharpScript(run=Button(), ID=id)  # -> out, A; inputs run: Boolean, ID: Guid; same code as selectobjs

# ---- group: Blocks in Zone ---> To Excel
id_blocks = Guid([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])
crv_zones = Curve([<curve referenced from the Rhino model> x38])
panel = Panel(id_blocks)
panel_2 = Panel(crv_zones)
objatts = ObjectAttributes(ObjectOrAttributes=crv_zones)  # -> Name, LayerName, LayerFullPath, Color, MaterialName, LinetypeName, GroupIndices, PlotWeight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
python = GhPythonScript(x=id_blocks)  # -> out, a, b, c; inputs x: list
# ---------- python: Python ----------
import scriptcontext as sc
import rhinoscriptsyntax as rs
import Rhino

points = []
names = []
layers = []

sc.doc = Rhino.RhinoDoc.ActiveDoc

for y in x:
    pt = rs.BlockInstanceInsertPoint(y)
    #pt = rs.TextObjectText(y)
    points.append(pt)
    name = rs.BlockInstanceName(y)
    names.append(name)
    layer = rs.ObjectLayer(y)
    layers.append(layer)
    

sc.doc = ghdoc

a = points
b = names
c = layers
# ---------- end python ----------
panel_3 = Panel(objatts.Name)
panel_4 = Panel(python.c)
panel_5 = Panel(python.b)
panel_6 = Panel(python.a)
incurve = PointInCurve(Point=python.a, Curve=crv_zones)  # -> Relationship, Point
python_2 = GhPythonScript(
    block_guid=id_blocks,
    block_name=python.b,
    block_pt=python.a,
    block_layer=python.c,
    zone_guid=crv_zones,
    zone_pt=crv_zones,
    zone_name=objatts.Name,
    zone_crv=crv_zones)  # -> out, a; inputs block_guid: list, block_name: list, block_pt: list, block_layer: list, zone_guid: list, zone_pt: list, zone_name: list, zone_crv: list
# ---------- python_2: Python ----------
import scriptcontext as sc
import rhinoscriptsyntax as rs
import Rhino



class block:
    
    def __init__(self):
        self.point = None
        self.layer = None
        self.name = None
        self.drop = None
        self.floor = None
        self.guid = None
        self.zones = []


class zone:
    
    def __init__(self):
        self.name = None
        self.guid = None
        self.curve = None




def point_in_zone(point, zone):
    result = True if rs.PointInPlanarClosedCurve(point, zone.curve) == 1 else False
    return result

def point_zones(point, zones):
    matches = [x.name for x in zones if point_in_zone(point, x) is True]
    #print "Point in {}".format(matches)
    return matches

def load_zones(file):
    
    with open(file, "r") as f:
        content = f.readlines()
        content = [x.strip() for x in content] 
        return content


blocks = []

for i,id in enumerate(block_guid):
    b = block()
    b.guid = id
    b.name = block_name[i]
    b.point = block_pt[i]
    b.layer = block_layer[i]
    blocks.append(b)

zones = []

for i, id in enumerate(zone_guid):
    z = zone()
    z.name = zone_name[i] 
    z.guid = id
    z.curve = zone_crv[i]
    zones.append(z)

#sc.doc = Rhino.RhinoDoc.ActiveDoc
block_zones = []

for b in blocks:
    for z in zones:
        test = rs.PointInPlanarClosedCurve(b.point, z.curve)
        if test > 0:
            #print test
            b.zones.append(z.name)
            print "{} in {}".format(b.name, z.name)
        #print b.point

#sc.doc = ghdoc

for b in blocks:
    block_zones.append(str(b.zones))


a = block_zones
# ---------- end python_2 ----------
panel_7 = Panel(incurve.Relationship)
button_generate_then_open_report = Button()
button_generate_report = Button()

# ---- group: Block Adjacency Clustering
number_slider = Slider(22, range=0..100)
python_3 = PythonScript(x=id_blocks)  # -> out, a; inputs x: list
# ---------- python_3: Python ----------
import scriptcontext as sc
import rhinoscriptsyntax as rs
import Rhino

points = []

sc.doc = Rhino.RhinoDoc.ActiveDoc

for y in x:
    pt = rs.BlockInstanceInsertPoint(y)
    points.append(pt)
    

sc.doc = ghdoc

a = points
# ---------- end python_3 ----------
pgroups = PointGroups(Points=python_3.a, Distance=number_slider)  # -> simplify(Groups), Indices
item = ListItem(List=id_blocks, Index=pgroups.Indices, Wrap=True)
tstat = TreeStatistics(Tree=pgroups.Groups)  # -> Paths, Length, Count
division = Division(A=number_slider, B=2)
python_tree_to_lists = PythonScript(x=item, y=Toggle(True))  # -> out, a, group, id; inputs x: tree
# ---------- python_tree_to_lists: Python ----------
if y == True:
    
    import rhinoscriptsyntax as rs
     
    import Rhino.Geometry as rg
    from clr import AddReference as addr
    addr("Grasshopper")
     
    from System import Object
    from Grasshopper import DataTree
    from Grasshopper.Kernel.Data import GH_Path
     
     
    def raggedListToDataTree(raggedList):
        rl = raggedList
        result = DataTree[object]()
        for i in range(len(rl)):
            temp = []
            for j in range(len(rl[i])):
                temp.append(rl[i][j])
            #print i, " - ",temp
            path = GH_Path(i)
            result.AddRange(temp, path)
        return result
     
    def dataTreeToList(aTree):
        theList = []
        for i in range(aTree.BranchCount ):
            thisListPart = []
            thisBranch = aTree.Branch(i)
            for j in range(len(thisBranch)):
                thisListPart.append( thisBranch[j] )
            theList.append(thisListPart)
        return theList
    
    # take gh data tree and turn it into lists of lists
    # for python, the tree in this case groups points
    # based on threshold
    
    a = dataTreeToList(x)
    # enumerate the branches, which is telling you 
    # the group number
    
    b = []
    
    group = []
    id = []
    
    print "group, guid"
    for i, b in enumerate(a):
        i += 1
        for c in b:
            print "{},{}".format(i, c)
            group.append(i)
            id.append(str(c))
# ---------- end python_tree_to_lists ----------
random = Random(Range=Domain(0, 255), Number=tstat.Count, Seed=52)
random_2 = Random(Range=Domain(0, 255), Number=tstat.Count, Seed=785)
random_3 = Random(Range=Domain(0, 255), Number=tstat.Count, Seed=563)
viewer = ParamViewer(pgroups.Groups)
int = Integer(random)
int_2 = Integer(random_3)
int_3 = Integer(random_2)
panel_8 = Panel(python_tree_to_lists.a)
rgb = ColourRGB(Alpha=255, Red=int, Green=int_3, Blue=int_2)  # -> graft(Colour)
sph = Sphere(Base=pgroups.Groups, Radius=division)
preview = CustomPreview(Geometry=sph, Shader=rgb)

# ---- group: Blocks in Zone ---> To Excel (continued)
gh_cpython = GH_CPython(
    block_zones=python_2.a,
    block_name=python.b,
    block_pt=python.a,
    block_layer=python.c,
    block_guid=id_blocks,
    group=python_tree_to_lists.group,
    id=python_tree_to_lists.id,
    report=button_generate_report,
    open_report=button_generate_then_open_report)  # -> output; inputs block_zones: list, block_name: list, block_pt: list, block_layer: list, block_guid: list, group: list, id: list, report: list, open_report: list
#   port block_zones: [required] - [type = int] - [default = None] Descripe your input here * bullet point. * bullet point
#   port output: indicate your output description here. refers to a new line.
# ---------- gh_cpython: Python ----------
import pandas as pd
import re
import datetime
import os

class Block():
    def __init__(self):
        self.guid = None
        self.name = None
        self.point = None
        self.layer = None
        self.zones = None
        self.x = None
        self.y = None
        self.z = None
        self.floor = None
        self.swing_drop = None
        self.elevation = None
        self.priority = None
        self.phase = None
        

blocks = []


def find_floor(x):
    pat = r"floor\s*(\d*)"
    result = re.search(pat, str(x), flags=re.IGNORECASE)
    if result:
        return int(result.group(1))    

def find_phase(x):
    if "BASE" in x.upper():
        return 0
    else:
        pat = r"CO\s*(\d*)"
        result = re.search(pat, str(x), flags=re.IGNORECASE)
        if result:
            return int(result.group(1)) 

def find_priority(x):
    pat = r"priority\s*(\d*)"
    result = re.search(pat, str(x), flags=re.IGNORECASE)
    if result:
        return int(result.group(1))   

def find_elevation(x):
    pat = r"([a-zA-Z\s]*)\s*ELEVATION"
    result = re.search(pat, str(x), flags=re.IGNORECASE)
    if result:
        return result.group(1)

def get_drop(x):
    pat = r"drop\s*([a-z]*\d*)"
    match = re.search(pat, str(x), flags=re.IGNORECASE)

    if match:
        # print("Found Match")
        return match.group(1)
    else:
        # print("Not Found")
        return None

for i, z in enumerate(block_zones):
    b = Block()
    b.guid = block_guid[i]
    b.name = block_name[i]
    b.point = block_pt[i]
    b.layer = block_layer[i]
    b.phase = find_phase(b.layer)
    b.zones = z
    b.x = b.point[0]
    b.y = b.point[1]
    b.z = b.point[2]
    b.floor = find_floor(str(z))
    b.elevation = find_elevation(str(z))
    b.swing_drop = get_drop(str(z))
    b.priority = find_priority(str(z))

    blocks.append(b)

df = pd.DataFrame([vars(f) for f in blocks])

#print(df)
#df.to_excel(r"C:\Users\mkreidler\Desktop\test.xlsx")

groups = []
class Group():
    def __init__(self):
        self.group = None
        self.guid = None

for i, g in enumerate(group):
    gr = Group()
    gr.group = g
    gr.guid = id[i]
    groups.append(gr)

group_df = pd.DataFrame([vars(f) for f in groups])

#print(group_df)

merge = df.merge(group_df, on="guid", how="outer")

folder = r"V:\Projects\35 East Wacker\Field Work\BVTC Survey #2\\"

path = folder + "ProjectReport_" + str(datetime.datetime.now()).replace(":","_") + ".xlsx"

if report == True:
    merge.to_excel(path)

if open_report == True:
    merge.to_excel(path)
    os.startfile(path)

print(path)
# ---------- end gh_cpython ----------
